# Grasshopper definition acute_crease_angle_checker.gh (Grasshopper 1.0.7)

# This script checks all the concave creases (edges) of a brep to ensure they are at least 90 degrees.
brep = Brep(<brep referenced from the Rhino model>)

# ---- group: Filter only line like curve
edges = BrepEdges(Brep=brep)  # -> Naked, Interior, NonManifold
line = Line(edges.Interior)
clean = CleanTree(RemoveNulls=True, RemoveInvalid=True, RemoveEmpty=False, Tree=line)

# ---- group: Tangential Circle for evaluation
sample_distance = Slider(1, range=0..10)
eval = EvaluateCurve(Curve=clean, Parameter=0.5)  # -> Point, Tangent, Angle
circle = CircleCNR(Center=eval.Point, Normal=eval.Tangent, Radius=sample_distance)

# ----
bcx = BrepCurve(Brep=brep, Curve=circle)  # -> Curves, Points
pt = Point(graft(eval.Point))
item = ListItem(List=bcx.Points, Index=0, Wrap=True)  # -> Item, Item1

# ---- group: Only include concave edges
vec2pt = Vector2Pt(PointA=item.Item, PointB=item.Item1, Unitize=False)  # -> Vector, Length
brep_cp = BrepClosestPoint(Point=item.Item, Brep=brep)  # -> Point, Normal, Distance
dprod = DotProduct(VectorA=vec2pt.Vector, VectorB=brep_cp.Normal, Unitize=False)
vdis = VectorDisplay(Anchor=brep_cp.Point, Vector=vec2pt.Vector)
larger = LargerThan(FirstNumber=dprod, SecondNumber=Slider(0, range=0..100))  # -> LargerThan, OrEqualTo

# ---- group: Only include angle < 90
vec2pt_2 = Vector2Pt(PointA=pt, PointB=item.Item, Unitize=False)  # -> Vector, Length
vec2pt_3 = Vector2Pt(PointA=pt, PointB=item.Item1, Unitize=False)  # -> Vector, Length
angle = Angle(VectorA=vec2pt_2.Vector, VectorB=vec2pt_3.Vector)  # -> Angle, Reflex
deg = Degrees(Radians=angle.Angle)
smaller = SmallerThan(FirstNumber=deg, SecondNumber=Slider(89.9999, range=0..100))  # -> SmallerThan, OrEqualTo

# ----
number_slider = Slider(10, range=0..10)
amp = Amplitude(Vector=vec2pt_2.Vector, Amplitude=number_slider)
amp_2 = Amplitude(Vector=vec2pt_3.Vector, Amplitude=number_slider)
move = Move(Geometry=pt, Motion=amp)  # -> Geometry, Transform
move_2 = Move(Geometry=pt, Motion=amp_2)  # -> Geometry, Transform

pt_2 = Point(flatten(pt))
pt_3 = Point(flatten(move.Geometry))
pt_4 = Point(flatten(move_2.Geometry))
and = GateAnd(A=smaller.SmallerThan, B=larger.LargerThan)
cull = CullPattern(List=flatten(pt_2), CullPattern=flatten(and))
angledim = AngularDimension(Center=pt_2, PointA=pt_3, PointB=pt_4, Reflex=False, Text="{0:0.0}°", Size=Slider(4.4, range=0..10))
panel = Panel(cull)
