# Grasshopper definition beam_endcut.gh (Grasshopper 1.0.7)

# ----
# Beam's Frame
number_slider = Slider(0, range=0..100)
vector_xyz = VectorXYZ(XComponent=Slider(4, range=-10..10), YComponent=Slider(0, range=-10..10), ZComponent=Slider(0, range=-10..10))  # -> Vector, Length
construct_point = ConstructPoint(XCoordinate=number_slider, YCoordinate=Slider(100, range=0..100), ZCoordinate=Slider(31, range=0..100))
plane_normal = PlaneNormal(Origin=construct_point, ZAxis=vector_xyz.Vector)

# ----
# Reload Python Modules (if Module Code is Changed)
python_module_to_reload = Panel("""compas
compas_fab
roslibpy
integral_timber_joints""")
# Development Tools
reload = Button()
py = PythonScript(reload_module_button=reload, module_names=python_module_to_reload)  # inputs module_names: list
# ---------- py: Python ----------
import compas_ghpython
from compas_ghpython import unload_modules
if reload_module_button:
    for module in module_names:
        unload_modules(module)
# ---------- end py ----------

vector_xyz_2 = VectorXYZ(XComponent=Slider(10, range=-10..10), YComponent=Slider(-7, range=-10..10), ZComponent=Slider(8, range=-10..10))  # -> Vector, Length
construct_point_2 = ConstructPoint(XCoordinate=Slider(25, range=0..100), YCoordinate=Slider(9, range=0..100), ZCoordinate=Slider(0, range=0..100))
plane_normal_2 = PlaneNormal(Origin=construct_point_2, ZAxis=vector_xyz_2.Vector)

# ----
# Cutting Frame in WCF (will be auto converted to beam OCF)
number_slider_2 = Slider(25, range=0..100)
vector_xyz_3 = VectorXYZ(XComponent=Slider(-3, range=-10..10), YComponent=Slider(-5, range=-10..10), ZComponent=Slider(8, range=-10..10))  # -> Vector, Length
construct_point_3 = ConstructPoint(XCoordinate=number_slider_2, YCoordinate=Slider(0, range=0..100), ZCoordinate=Slider(0, range=0..100))
plane_normal_3 = PlaneNormal(Origin=construct_point_3, ZAxis=vector_xyz_3.Vector)

# ----
# Check Path and Environment
compas_version = GhPythonScript()  # -> out, compas_version, compas_fab_version, compas_path, compas_fab_path, compas_env_name, python_directory
# ---------- compas_version: Python ----------
__author__ = "leungp"
__version__ = "2020.04.20"

import rhinoscriptsyntax as rs
import compas
import compas_fab
compas_version  = compas.__version__
compas_fab_version = compas_fab.__version__
import os
compas_path = os.path.abspath(compas.__file__)
compas_fab_path = os.path.abspath(compas_fab.__file__)

import compas_bootstrapper
compas_env_name = compas_bootstrapper.ENVIRONMENT_NAME
python_directory = compas_bootstrapper.PYTHON_DIRECTORY
# ---------- end compas_version ----------
compas_environment_name = Panel(compas_version.compas_env_name)
compas_version_2 = Panel(compas_version.compas_version)
compas_fab_version = Panel(compas_version.compas_fab_version)
compas_path = Panel(compas_version.compas_path)
compas_fab_path = Panel(compas_version.compas_fab_path)
python_directory = Panel(compas_version.python_directory)

# ----
# Beam's Frame
number_slider_3 = Slider(300, range=0..300)
vector_xyz_4 = VectorXYZ(XComponent=Slider(5, range=-10..10), YComponent=Slider(0, range=-10..10), ZComponent=Slider(0, range=-10..10))  # -> Vector, Length
construct_point_4 = ConstructPoint(XCoordinate=number_slider_3, YCoordinate=Slider(0, range=0..100), ZCoordinate=Slider(31, range=0..100))
plane_normal_4 = PlaneNormal(Origin=construct_point_4, ZAxis=vector_xyz_4.Vector)

beam = GhPythonScript(
    plane=plane_normal,
    length=Slider(1000, range=0..1000),
    width=Slider(100, range=0..200),
    height=Slider(111, range=0..200),
    name="b1")  # -> out, beam, assembly; inputs plane: Plane
# ---------- beam: Python ----------
from compas_rhino.geometry import RhinoMesh, RhinoPlane

from integral_timber_joints.assembly import Assembly
from integral_timber_joints.geometry import Beam

frame = RhinoPlane.from_geometry(plane).to_compas()

beam = Beam(frame, length, width, height, name)

assembly = Assembly()
assembly.add_beam(beam)
assembly.get_beam_mesh_in_wcf(name, True)
# ---------- end beam ----------
beam_2 = GhPythonScript(
    plane=plane_normal_4,
    length=Slider(1000, range=0..1000),
    width=Slider(100, range=0..200),
    height=Slider(111, range=0..200),
    name="b1")  # -> out, beam, assembly; inputs plane: Plane; same code as beam
beamcut_plane = GhPythonScript(assembly=beam.assembly, beam_id="b1", cut_planes=[plane_normal_3, plane_normal_2])  # -> out, assembly_out, boolean_geometry; inputs cut_planes: list of Plane
# ---------- beamcut_plane: Python ----------
from integral_timber_joints.geometry import Beam, Beamcut_plane 
from compas_rhino.geometry import RhinoPlane
from compas.geometry import Plane
from compas_ghpython.utilities import draw_mesh

from copy import deepcopy

assembly_out = deepcopy(assembly)
assembly_out.remove_all_beam_cuts(beam_id)

for cut_plane in cut_planes:
    compas_frame = RhinoPlane.from_geometry(cut_plane).to_compas()
    cutplane_wcf = Plane(compas_frame.point, compas_frame.normal)
    assembly_out.add_ocf_beam_cut_from_wcf_plane(beam_id, cutplane_wcf)

assembly_out.get_beam_mesh_in_wcf(beam_id)

beam = assembly_out.beam(beam_id)
boolean_geometry = []
for cut in assembly_out.beam_cuts(beam_id):
    for shape in cut.get_feature_shapes(beam):
        boolean_geometry.append(draw_mesh(* shape.to_vertices_and_faces()))
# ---------- end beamcut_plane ----------

# ----
# Four Corner Tetra Cut
toggle = BooleanToggle(True)
dist_y = Slider(43, range=0..100)
dist_x = Slider(335, range=0..500)
dist_z = Slider(16, range=0..100)
beamcutfourcorners = GhPythonScript(assembly=beam_2.assembly, beam_id="b1", on_beam_start=toggle, dist_x=dist_x, dist_y=dist_y, dist_z=dist_z)  # -> out, assembly_out, boolean_geometry; inputs on_beam_start: Boolean
# ---------- beamcutfourcorners: Python ----------
from integral_timber_joints.geometry import Beam, BeamcutFourCorners 
from compas_rhino.geometry import RhinoPlane
from compas.geometry import Plane
from compas_ghpython.utilities import draw_mesh

from copy import deepcopy

assembly_out = deepcopy(assembly)
assembly_out.remove_all_beam_cuts(beam_id)

# Create beamcut
beamcut = BeamcutFourCorners(on_beam_start, dist_x, dist_y, dist_z)


assembly_out.add_beam_cut(beam_id, beamcut)
assembly_out.get_beam_mesh_in_wcf(beam_id)
beam = assembly_out.beam(beam_id)
boolean_geometry = []

for cut in assembly_out.beam_cuts(beam_id):
    for shape in cut.get_feature_shapes(beam):
        boolean_geometry.append(draw_mesh(* shape.to_vertices_and_faces()))
# ---------- end beamcutfourcorners ----------
panel = Panel(beamcutfourcorners.boolean_geometry)
demesh = DeconstructMesh(Mesh=beamcutfourcorners.boolean_geometry)  # -> Vertices, Faces, Colours, Normals
basic_assembly_preview = GhPythonScript(assembly=beamcutfourcorners.assembly_out, beam_ids="b1")  # -> out, beam_mesh_prev; inputs beam_ids: list
# ---------- basic_assembly_preview: Python ----------
from compas_ghpython.utilities import draw_mesh

beam_mesh_prev = []

for beam_id in beam_ids:
    beam = assembly.beam(beam_id)
    beam_mesh_prev.append(draw_mesh(* assembly.get_beam_mesh_in_wcf(beam_id).to_vertices_and_faces()))
# ---------- end basic_assembly_preview ----------
custom_preview = CustomPreview(Geometry=basic_assembly_preview.beam_mesh_prev, Material=ColourSwatch(SwatchColor=RGBA(102, 255, 0, 148)))

panel_2 = Panel(beamcut_plane.boolean_geometry)
basic_assembly_preview_2 = GhPythonScript(assembly=beamcut_plane.assembly_out, beam_ids="b1")  # -> out, beam_mesh_prev; inputs beam_ids: list; same code as basic_assembly_preview
demesh_2 = DeconstructMesh(Mesh=beamcut_plane.boolean_geometry)  # -> Vertices, Faces, Colours, Normals
custom_preview_2 = CustomPreview(Geometry=basic_assembly_preview_2.beam_mesh_prev, Material=ColourSwatch(SwatchColor=RGBA(102, 255, 0, 148)))
