# Grasshopper definition beam_from_brep_algorithm.gh (Grasshopper 1.0.7)

brep = Brep(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)
geo = Geometry(<brep referenced from the Rhino model>)
id = Guid(geo)
debrep = DeconstructBrep(Brep=brep)  # -> Faces, Edges, Vertices
end = EndPoints(Curve=debrep.Edges)  # -> Start, End
vec2pt = Vector2Pt(PointA=end.Start, PointB=end.End, Unitize=True)  # -> Vector, Length
python = GhPythonScript(guid=geo)  # -> out, vector_x, vector_y
# ---------- python: Python ----------
import rhinoscriptsyntax as rs
import Rhino as rh
import scriptcontext as sc

from compas.geometry import dot_vectors, cross_vectors, allclose, close, subtract_vectors, length_vector

def caliper(vector, points):
    values = [dot_vectors(vector, point) for point in points]
    return (max(values) - min(values))

def best_aligned_vector(vectors, guide_vector):
    alignment = [dot_vectors(guide_vector, v) for v in vectors]
    return vectors[alignment.index(max(alignment))]

def unitize_vectors(vectors, non_zero=1e-7):
    results = []
    for vector in vectors:
        length = length_vector(vector)
        if length > non_zero:
            results.append([value / length for value in vector])
    return results

print (guid)
brep = rs.coercebrep(guid)

vertices = [[coor for coor in vertex.Location] for vertex in brep.Vertices]
#print (vertices)

edge_vectors = [subtract_vectors([_ for _ in edge.PointAtStart], [_ for _ in edge.PointAtEnd]) for edge in brep.Edges]
edge_vectors = unitize_vectors(edge_vectors) # Unitize

face_normals = [[_ for _ in face.NormalAt(face.Domain(0).Mid,face.Domain(1).Mid)] for face in brep.Faces]
#print (face_normals)


    
points = vertices
vectors = face_normals

bounding_widths = [caliper(vector, points) for vector in vectors]
beam_z_size = min(bounding_widths)
vector_z_candidates = [vector for vector, widths in zip(vectors, bounding_widths) if close(widths, beam_z_size)]
vector_z = best_aligned_vector(vector_z_candidates, [0.01,0.1,1])


# Prepare vector_y candidates
vector_y_candidates = [cross_vectors(vector_z, vector) for vector in face_normals] # edge_vectors + face_normals
vector_y_candidates = unitize_vectors(vector_y_candidates) # Unitize

bounding_widths = [caliper(vector, points) for vector in vector_y_candidates]
beam_y_size = min(bounding_widths)
vector_y_candidates = [vector for vector, widths in zip(vector_y_candidates, bounding_widths) if close(widths, beam_y_size)]
vector_y = best_aligned_vector(vector_y_candidates, [0,1,0])

vector_x = cross_vectors(vector_y, vector_z)

print vector_x, vector_y, vector_z

vector_x = rh.Geometry.Point3d(* vector_x)
vector_y = rh.Geometry.Point3d(* vector_y)
# ---------- end python ----------
panel = Panel(vec2pt.Vector)
evalsrf = EvaluateSurface(Surface=reparameterize(debrep.Faces), Point=Point(0.5, 0.5, 0))  # -> Point, flatten(Normal), UDirection, VDirection, Frame
pt = Point(flatten(debrep.Vertices))

vec = Vector(graft(evalsrf.Normal))
vertices = Vector(pt)
dprod = DotProduct(VectorA=vec, VectorB=vertices, Unitize=False)
sort = SortList(Keys=dprod)  # -> Keys, ValuesA
item = ListItem(List=sort.Keys, Index=0, Wrap=True)
item_2 = ListItem(List=sort.Keys, Index=-1, Wrap=True)
subtraction = Subtraction(A=item_2, B=item)

panel_2 = Panel(evalsrf.Normal)
avr = Average(Input=pt)
pl = ConstructPlane(Origin=avr, XAxis=python.vector_x, YAxis=python.vector_y)
number_slider = Slider(3, range=0..10)

sort_2 = SortList(Keys=flatten(subtraction), ValuesA=flatten(vec))  # -> Keys, ValuesA
item_3 = ListItem(List=sort_2.Keys, Index=number_slider, Wrap=True)
item_4 = ListItem(List=sort_2.ValuesA, Index=number_slider, Wrap=True)
amp = Amplitude(Vector=item_4, Amplitude=item_3)

shortest_vector_z = Vector(item_4)
vec_2 = Vector(vec)
xprod = CrossProduct(VectorA=shortest_vector_z, VectorB=vec_2, Unitize=False)  # -> flatten(Vector), flatten(Length)
larger = LargerThan(FirstNumber=xprod.Length, SecondNumber=1e-05)  # -> LargerThan, OrEqualTo
cull = CullPattern(List=xprod.Vector, CullPattern=larger.LargerThan)  # -> graft(List)
unit = UnitVector(Vector=cull)

unit_2 = UnitVector(Vector=shortest_vector_z)

vertices_2 = Vector(pt)
dprod_2 = DotProduct(VectorA=unit, VectorB=vertices_2, Unitize=False)
sort_3 = SortList(Keys=dprod_2)  # -> Keys, ValuesA
item_5 = ListItem(List=sort_3.Keys, Index=-1, Wrap=True)
item_6 = ListItem(List=sort_3.Keys, Index=0, Wrap=True)
subtraction_2 = Subtraction(A=item_5, B=item_6)

panel_3 = Panel(subtraction_2)

sort_4 = SortList(Keys=flatten(subtraction_2), ValuesA=flatten(unit))  # -> Keys, ValuesA
item_7 = ListItem(List=sort_4.Keys, Index=0, Wrap=True)
item_8 = ListItem(List=sort_4.ValuesA, Index=0, Wrap=True)
amp_2 = Amplitude(Vector=item_8, Amplitude=item_7)

panel_4 = Panel(sort_2.ValuesA)
panel_5 = Panel(item_8)
pl_2 = ConstructPlane(Origin=avr, XAxis=amp, YAxis=amp_2)
vdis = VectorDisplay(Anchor=avr, Vector=amp_2)
dom = ConstructDomain(DomainStart=expr("-x/2", amp), DomainEnd=expr("x/2", amp))
dom_2 = ConstructDomain(DomainStart=expr("-x/2", amp_2), DomainEnd=expr("x/2", amp_2))
vdis_2 = VectorDisplay(Anchor=avr, Vector=amp)
rectangle = Rectangle(Plane=pl_2, XSize=dom, YSize=dom_2, Radius=0)  # -> Rectangle, Length
