# Grasshopper definition custom_polyline_visualizer.gh (Grasshopper 1.0.7)

# ----
# Reload Python Modules (if Module Code is Changed)
python_module_to_reload = Panel("""compas
compas_fab
roslibpy
integral_timber_joints""")
# Development Tools
reload = Button()
py = PythonScript(reload_module_button=reload, module_names=python_module_to_reload)  # inputs module_names: list
# ---------- py: Python ----------
import compas_ghpython
from compas_ghpython import unload_modules
if reload_module_button:
    for module in module_names:
        unload_modules(module)
# ---------- end py ----------

# ----
# Check Path and Environment
compas_version = GhPythonScript()  # -> out, compas_version, compas_fab_version, compas_path, compas_fab_path, compas_env_name, python_directory
# ---------- compas_version: Python ----------
__author__ = "leungp"
__version__ = "2020.04.20"

import rhinoscriptsyntax as rs
import compas
import compas_fab
compas_version  = compas.__version__
compas_fab_version = compas_fab.__version__
import os
compas_path = os.path.abspath(compas.__file__)
compas_fab_path = os.path.abspath(compas_fab.__file__)

import compas_bootstrapper
compas_env_name = compas_bootstrapper.ENVIRONMENT_NAME
python_directory = compas_bootstrapper.PYTHON_DIRECTORY
# ---------- end compas_version ----------
compas_environment_name = Panel(compas_version.compas_env_name)
compas_version_2 = Panel(compas_version.compas_version)
compas_fab_version = Panel(compas_version.compas_fab_version)
compas_path = Panel(compas_version.compas_path)
compas_fab_path = Panel(compas_version.compas_fab_path)
python_directory = Panel(compas_version.python_directory)

panel = Panel("C:\Users\leungp\Documents\GitHub\integral_timber_joints\external\itj_design_study\211010_CantiBox\joints\left\")
file_number = Slider(13, range=0..35)
int = Integer(file_number)
test_with_3d_base_plane = BooleanToggle(False)  # disabled

number_slider = Slider(0, range=0..1)  # disabled
number_slider_2 = Slider(0.4, range=0..1)  # disabled
number_slider_3 = Slider(0, range=0..1)  # disabled
# Auto Create Planar Lap Joints on Intersecting beams
number_slider_4 = Slider(0.7, range=0..1)  # disabled
number_slider_5 = Slider(0, range=0..1)  # disabled
number_slider_6 = Slider(0.1, range=0..1)  # disabled
vec = VectorXYZ(XComponent=number_slider_2, YComponent=number_slider, ZComponent=number_slider_5)  # -> Vector, Length; disabled
vec_2 = VectorXYZ(XComponent=number_slider_4, YComponent=number_slider_3, ZComponent=number_slider_6)  # -> Vector, Length; disabled
pl = ConstructPlane(Origin=Point(0, 0, 0), XAxis=vec_2.Vector, YAxis=vec.Vector)  # disabled

has_screw = BooleanToggle(False)  # disabled
concat = Concatenate(FragmentA=panel, FragmentB=int, FragmentC=".txt")
file = ReadFile(File=concat, PerLineParse=True)
split = TextSplit(Text=file, Separators="'")
item = ListItem(List=split, Index=0, Wrap=True)  # -> Item, Item1, Item2
split_2 = TextSplit(Text=item.Item, Separators="], [")
xy = XYPlane(Origin=Point(0, 0, 0))  # disabled
num = Number(split_2)
clean = CleanTree(RemoveNulls=True, RemoveInvalid=True, RemoveEmpty=True, Tree=flatten(num))
filter = StreamFilter(Gate=test_with_3d_base_plane, Stream0=xy, Stream1=pl)  # disabled

# ----
# beam_move
number_slider_7 = Slider(0, range=0..100)  # disabled
number_slider_8 = Slider(-50, range=-100..100)  # disabled
number_slider_9 = Slider(-1000, range=-1000..1000)  # disabled
number_slider_10 = Slider(2000, range=0..3000)  # disabled
number_slider_11 = Slider(100, range=0..100)  # disabled
number_slider_12 = Slider(100, range=0..1000)  # disabled
pt = ConstructPoint(XCoordinate=number_slider_9, YCoordinate=number_slider_8, ZCoordinate=0)  # disabled
panel_2 = Panel("b1")  # disabled
xy_2 = XYPlane(Origin=pt)  # disabled
rotate = Rotate(Geometry=xy_2, Angle=degrees(number_slider_7), Plane=PlaneXY(0, 0, 0))  # -> Geometry, Transform; disabled
orient = Orient(Geometry=rotate.Geometry, Source=PlaneXY(0, 0, 0), Target=filter)  # -> Geometry, Transform; disabled
beam = GhPythonScript(plane=orient.Geometry, length=number_slider_10, width=number_slider_11, height=number_slider_12, name=panel_2)  # -> out, beam, assembly; inputs plane: Plane; disabled
# ---------- beam: Python ----------
from compas_rhino.geometry import RhinoMesh, RhinoPlane

from integral_timber_joints.geometry import Beam
from integral_timber_joints.assembly import Assembly

frame = RhinoPlane.from_geometry(plane).to_compas()

beam = Beam(frame, length, width, height, name)

assembly = Assembly()
assembly.add_beam(beam)
assembly.get_beam_mesh_in_wcf(name, True)
# ---------- end beam ----------

# ----
# beam_stay
number_slider_13 = Slider(-50, range=-100..100)  # disabled
number_slider_14 = Slider(90, range=10..170)  # disabled
number_slider_15 = Slider(-1000, range=-1000..1000)  # disabled
number_slider_16 = Slider(2000, range=0..2000)  # disabled
number_slider_17 = Slider(100, range=0..100)  # disabled
number_slider_18 = Slider(100, range=0..1000)  # disabled
panel_3 = Panel("b2")  # disabled
pt_2 = ConstructPoint(XCoordinate=number_slider_15, YCoordinate=number_slider_13, ZCoordinate=0)  # disabled
xy_3 = XYPlane(Origin=pt_2)  # disabled
rotate_2 = Rotate(Geometry=xy_3, Angle=degrees(number_slider_14), Plane=PlaneXY(0, 0, 0))  # -> Geometry, Transform; disabled
orient_2 = Orient(Geometry=rotate_2.Geometry, Source=PlaneXY(0, 0, 0), Target=filter)  # -> Geometry, Transform; disabled
beam_2 = GhPythonScript(plane=orient_2.Geometry, length=number_slider_16, width=number_slider_17, height=number_slider_18, name=panel_3)  # -> out, beam, assembly; inputs plane: Plane; disabled; same code as beam

beam_length_simulation = Slider(400, range=0..1000)
item_2 = ListItem(List=clean, Index=0, Wrap=True)  # -> Item, Item1, Item2, Item3, Item4, Item5, Item6, Item7, Item8
pln = Plane(filter)  # disabled
number_slider_19 = Slider(150, range=0..150)  # disabled
panel_4 = Panel(item.Item1)
pt_3 = ConstructPoint(XCoordinate=item_2.Item, YCoordinate=item_2.Item1, ZCoordinate=item_2.Item2)
vec_3 = VectorXYZ(XComponent=item_2.Item6, YComponent=item_2.Item7, ZComponent=item_2.Item8)  # -> Vector, Length
vec_4 = VectorXYZ(XComponent=item_2.Item3, YComponent=item_2.Item4, ZComponent=item_2.Item5)  # -> Vector, Length
jointpolylinelap = GhPythonScript(beam1=beam.beam, beam2=beam_2.beam, has_screw=has_screw, polyline_string=panel_4)  # -> out, assembly, beam1_negative_mesh, beam2_negative_mesh, beam1_polyline_mid, polyline_interior_angles; inputs has_screw: Boolean; disabled
# ---------- jointpolylinelap: Python ----------
from compas_ghpython import unload_modules
unload_modules('integral_timber_joints')
from compas.datastructures import Mesh
from integral_timber_joints.assembly import Assembly
from integral_timber_joints.geometry import JointHalfLap, JointPolylineLap
from integral_timber_joints.assembly.beam_assembly_method import BeamAssemblyMethod

assembly = Assembly()
assembly.add_beam(beam1)
assembly.add_beam(beam2)

joint1, joint2, screw_line = JointPolylineLap.from_beam_beam_intersection(beam1, beam2)
if polyline_string is not None and polyline_string != "":
    joint1.set_parameter('param_string', polyline_string)
    joint2.set_parameter('param_string', polyline_string)
assembly.add_joint_pair(joint1, joint2, beam1.name, beam2.name)

if has_screw:
    assembly.set_beam_attribute(beam2.name, 'assembly_method', BeamAssemblyMethod.SCREWED_WITH_GRIPPER)

joint_id = beam1.name, beam2.name

#assembly.get_beam_mesh_in_wcf(beam1.name, True)
#assembly.get_beam_mesh_in_wcf(beam2.name, True)

from compas_ghpython.artists import MeshArtist

shapes = assembly.get_beam_negative_shapes(beam1.name)
beam1_negative_mesh = [MeshArtist(Mesh.from_shape(shape)).draw() for shape in shapes]
shapes = assembly.get_beam_negative_shapes(beam2.name)
beam2_negative_mesh = [MeshArtist(Mesh.from_shape(shape)).draw() for shape in shapes]

print assembly.sequence
#screw = assembly.get_screw_of_joint((beam1.name, beam2.name))

# * Get Negative mesh for debugging
print joint1.get_joint_center_at_solid_side(beam1)
print joint2.get_joint_center_at_solid_side(beam2)

# * Get Polyline for debugging
from compas_ghpython.artists import PolylineArtist
from compas.geometry import Polyline

beam1_polyline_mid = [Polyline(joint1._polyline_at_mid(i)) for i in range (4)]
print (beam1_polyline_mid)
beam1_polyline_mid = [PolylineArtist(pl).draw()[0] for pl in beam1_polyline_mid]
print (beam1_polyline_mid)

polyline_interior_angles = joint1.get_polyline_interior_angles()
print (polyline_interior_angles)
polyline_interior_angles = [item for sublist in polyline_interior_angles for item in sublist]
print (joint1.check_polyline_interior_angle())
# ---------- end jointpolylinelap ----------
angle = Angle(VectorA=vec_4.Vector, VectorB=vec_3.Vector)  # -> Angle, Reflex
scale = Scale(Geometry=pt_3, Center=Point(0, 0, 0), Factor=1000)  # -> Geometry, Transform
multiplication = Multiplication(A=beam_length_simulation, B=-2)
amp = Amplitude(Vector=vec_3.Vector, Amplitude=beam_length_simulation)
amp_2 = Amplitude(Vector=vec_4.Vector, Amplitude=beam_length_simulation)

bnd = Bounds(Numbers=jointpolylinelap.polyline_interior_angles)  # disabled
polyline_interior_angles_range = Panel(bnd)  # disabled

deg = Degrees(Radians=angle.Angle)
move = Move(Geometry=scale.Geometry, Motion=amp_2)  # -> Geometry, Transform
amp_3 = Amplitude(Vector=vec_4.Vector, Amplitude=multiplication)
joint_angle = Panel(deg)
move_2 = Move(Geometry=scale.Geometry, Motion=amp)  # -> Geometry, Transform
amp_4 = Amplitude(Vector=vec_3.Vector, Amplitude=multiplication)
xprod = CrossProduct(VectorA=amp_2, VectorB=amp, Unitize=False)  # -> Vector, Length
pl_2 = ConstructPlane(Origin=move.Geometry, XAxis=amp_3, YAxis=xprod.Vector)
pl_3 = ConstructPlane(Origin=move_2.Geometry, XAxis=amp_4, YAxis=xprod.Vector)

# ----
# beam_stay negative
swatch = ColourSwatch(SwatchColor=RGBA(0, 61, 89, 48))  # disabled
faceb = FaceBoundaries(Mesh=jointpolylinelap.beam2_negative_mesh)  # disabled
facen = FaceNormals(Mesh=jointpolylinelap.beam2_negative_mesh)  # -> Centers, Normals; disabled
area = Area(Geometry=flatten(faceb))  # -> Area, Centroid; disabled
amp_5 = Amplitude(Vector=facen.Normals, Amplitude=20)  # disabled
vdis = VectorDisplay(Anchor=facen.Centers, Vector=amp_5)  # disabled
bnd_2 = Bounds(Numbers=area.Area)  # disabled
mesh_face_area = Panel(bnd_2)  # disabled
preview = CustomPreview(Geometry=jointpolylinelap.beam2_negative_mesh, Material=swatch)  # disabled

number_slider_20 = Slider(150, range=0..150)  # disabled
deplane = DeconstructPlane(Plane=pln)  # -> Origin, XAxis, YAxis, ZAxis; disabled
amp_6 = Amplitude(Vector=deplane.ZAxis, Amplitude=number_slider_19)  # disabled
move_3 = Move(Geometry=jointpolylinelap.beam1_polyline_mid, Motion=amp_6)  # -> Geometry, Transform; disabled
crv = Curve(move_3.Geometry)  # disabled
explode = Explode(Curve=crv, Recursive=True)  # -> Segments, Vertices; disabled
shift = ShiftList(List=explode.Segments, Shift=1, Wrap=False)  # disabled
shift_2 = ShiftList(List=explode.Segments, Shift=-1, Wrap=False)  # disabled
end = EndPoints(Curve=shift)  # -> Start, End; disabled
end_2 = EndPoints(Curve=shift_2)  # -> Start, End; disabled
vec2pt = Vector2Pt(PointA=end_2.Start, PointB=end_2.End, Unitize=False)  # -> Vector, Length; disabled
vec2pt_2 = Vector2Pt(PointA=end.Start, PointB=end.End, Unitize=False)  # -> Vector, Length; disabled
angledim = AngularDimension(Center=end_2.End, PointA=end_2.Start, PointB=end.End, Reflex=False, Text="{0:0.0}°", Size=3)  # disabled
pt_4 = ConstructPoint(XCoordinate=0, YCoordinate=-50, ZCoordinate=-50)
orient_3 = Orient(Geometry=pt_4, Source=PlaneXY(0, 0, 0), Target=pl_2)  # -> Geometry, Transform
orient_4 = Orient(Geometry=pt_4, Source=PlaneXY(0, 0, 0), Target=pl_3)  # -> Geometry, Transform
rev = Reverse(Vector=deplane.ZAxis)  # disabled
amp_7 = Amplitude(Vector=rev, Amplitude=number_slider_20)  # disabled

# ----
# beam_move negative
swatch_2 = ColourSwatch(SwatchColor=RGBA(39, 89, 0, 61))  # disabled
move_4 = Move(Geometry=jointpolylinelap.beam1_negative_mesh, Motion=amp_7)  # -> Geometry, Transform; disabled
faceb_2 = FaceBoundaries(Mesh=move_4.Geometry)  # disabled
facen_2 = FaceNormals(Mesh=move_4.Geometry)  # -> Centers, Normals; disabled
area_2 = Area(Geometry=flatten(faceb_2))  # -> Area, Centroid; disabled
amp_8 = Amplitude(Vector=facen_2.Normals, Amplitude=20)  # disabled
bnd_3 = Bounds(Numbers=area_2.Area)  # disabled
mesh_face_area_2 = Panel(bnd_3)  # disabled
vdis_2 = VectorDisplay(Anchor=facen_2.Centers, Vector=amp_8)  # disabled
preview_2 = CustomPreview(Geometry=move_4.Geometry, Material=swatch_2)  # disabled

pl_origin = PlaneOrigin(Base=pl_2, Origin=orient_3.Geometry)
pl_origin_2 = PlaneOrigin(Base=pl_3, Origin=orient_4.Geometry)
multiplication_2 = Multiplication(A=beam_length_simulation, B=2)

beam_3 = GhPythonScript(plane=pl_origin, length=multiplication_2, width=Slider(100, range=0..100), height=Slider(100, range=0..1000), name="b1")  # -> out, beam, assembly; inputs plane: Plane; same code as beam

beam_4 = GhPythonScript(
    plane=pl_origin_2,
    length=multiplication_2,
    width=Slider(100, range=0..100),
    height=Slider(100, range=0..1000),
    name="b2")  # -> out, beam, assembly; inputs plane: Plane; same code as beam

# ----
# beam_stay
toggle = BooleanToggle(True)  # disabled
panel_5 = Panel("b2")  # disabled
assembly_preview = AssemblyPreview(assembly=jointpolylinelap.assembly, beam_ids=panel_5, update_cache=toggle)  # disabled
swatch_3 = ColourSwatch(SwatchColor=RGBA(0, 151, 207, 232))  # disabled
preview_3 = CustomPreview(Geometry=assembly_preview, Material=swatch_3)  # disabled

# ----
# beam_move
toggle_2 = BooleanToggle(True)  # disabled
panel_6 = Panel("b1")  # disabled
assembly_preview_2 = AssemblyPreview(assembly=jointpolylinelap.assembly, beam_ids=panel_6, update_cache=toggle_2)  # disabled
move_5 = Move(Geometry=assembly_preview_2, Motion=amp_7)  # -> Geometry, Transform; disabled
swatch_4 = ColourSwatch(SwatchColor=RGBA(140, 255, 0, 232))  # disabled
preview_4 = CustomPreview(Geometry=move_5.Geometry, Material=swatch_4)  # disabled

amp_9 = Amplitude(Vector=xprod.Vector, Amplitude=Slider(150, range=0..150))
faceb_3 = FaceBoundaries(Mesh=move_5.Geometry)  # disabled
rev_2 = Reverse(Vector=amp_9)
jointpolylinelap_2 = GhPythonScript(beam1=beam_3.beam, beam2=beam_4.beam, polyline_string=panel_4)  # -> out, assembly, beam1_negative_mesh, beam2_negative_mesh, beam1_polyline_mid, polyline_interior_angles; inputs has_screw: Boolean; same code as jointpolylinelap
assembly_preview_3 = AssemblyPreview(assembly=beam_3.assembly)
assembly_preview_4 = AssemblyPreview(assembly=beam_4.assembly)
boundary = BoundarySurfaces(Edges=faceb_3)  # disabled

# ----
# beam_move negative
swatch_5 = ColourSwatch(SwatchColor=RGBA(39, 89, 0, 61))
move_6 = Move(Geometry=jointpolylinelap_2.beam1_negative_mesh, Motion=rev_2)  # -> Geometry, Transform
tri = Triangulate(Mesh=move_6.Geometry)  # -> Mesh, Count
faceb_4 = FaceBoundaries(Mesh=tri.Mesh)
facen_3 = FaceNormals(Mesh=move_6.Geometry)  # -> Centers, Normals
area_3 = Area(Geometry=flatten(faceb_4))  # -> Area, Centroid
amp_10 = Amplitude(Vector=facen_3.Normals, Amplitude=20)
bnd_4 = Bounds(Numbers=area_3.Area)
mesh_face_area_3 = Panel(bnd_4)
preview_5 = CustomPreview(Geometry=move_6.Geometry, Material=swatch_5)
vdis_3 = VectorDisplay(Anchor=facen_3.Centers, Vector=amp_10)

join = BrepJoin(Breps=boundary)  # -> Breps, Closed; disabled

# ----
# beam_move
panel_7 = Panel("b1")
assembly_preview_5 = AssemblyPreview(assembly=jointpolylinelap_2.assembly, beam_ids=panel_7, update_cache=True)

number_slider_21 = Slider(370, range=0..500)  # disabled
number_slider_22 = Slider(500, range=0..500)  # disabled

# ----
# Polyline Properities
explode_2 = Explode(Curve=jointpolylinelap_2.beam1_polyline_mid, Recursive=True)  # -> Segments, Vertices
lng = ListLength(List=explode_2.Vertices)  # -> flatten(Length)
len = Length(Curve=explode_2.Segments)
polyline_number_count = Panel(lng)
polyline_segment_length = Panel(len)
polyline_vertice = Panel(explode_2.Vertices)

geo = Geometry(jointpolylinelap_2.beam2_negative_mesh)

# ----
# beam_stay negative
tri_2 = Triangulate(Mesh=geo)  # -> Mesh, Count
faceb_5 = FaceBoundaries(Mesh=tri_2.Mesh)
facen_4 = FaceNormals(Mesh=geo)  # -> Centers, Normals
area_4 = Area(Geometry=flatten(faceb_5))  # -> Area, Centroid
amp_11 = Amplitude(Vector=facen_4.Normals, Amplitude=20)
bnd_5 = Bounds(Numbers=area_4.Area)
mesh_face_area_4 = Panel(bnd_5)
preview_6 = CustomPreview(Geometry=geo, Material=ColourSwatch(SwatchColor=RGBA(39, 89, 0, 61)))
vdis_4 = VectorDisplay(Anchor=facen_4.Centers, Vector=amp_11)

amp_12 = Amplitude(Vector=rev, Amplitude=number_slider_21)  # disabled
amp_13 = Amplitude(Vector=rev, Amplitude=number_slider_22)  # disabled
swatch_6 = ColourSwatch(SwatchColor=RGBA(140, 255, 0, 101))  # disabled
move_7 = Move(Geometry=assembly_preview_2, Motion=amp_13)  # -> Geometry, Transform; disabled
move_8 = Move(Geometry=assembly_preview, Motion=amp_12)  # -> Geometry, Transform; disabled
swatch_7 = ColourSwatch(SwatchColor=RGBA(0, 151, 207, 116))  # disabled
preview_7 = CustomPreview(Geometry=move_7.Geometry, Material=swatch_6)  # disabled
preview_8 = CustomPreview(Geometry=move_8.Geometry, Material=swatch_7)  # disabled
move_9 = Move(Geometry=assembly_preview_5, Motion=rev_2)  # -> Geometry, Transform
move_10 = Move(Geometry=jointpolylinelap_2.beam1_negative_mesh, Motion=rev_2)  # -> Geometry, Transform
preview_9 = CustomPreview(Geometry=move_9.Geometry, Material=ColourSwatch(SwatchColor=RGBA(140, 255, 0, 101)))

# ----
# beam_stay
panel_8 = Panel("b2")
assembly_preview_6 = AssemblyPreview(assembly=jointpolylinelap_2.assembly, beam_ids=panel_8, update_cache=True)
preview_10 = CustomPreview(Geometry=assembly_preview_6, Material=ColourSwatch(SwatchColor=RGBA(0, 151, 207, 232)))

preview_11 = CustomPreview(Geometry=move_10.Geometry, Material=ColourSwatch(SwatchColor=RGBA(140, 255, 0, 101)))

# ==== cluster AssemblyPreview
beam_ids = ClusterInput()
update_cache = ClusterInput()
assembly = ClusterInput()
basic_assembly_preview = GhPythonScript(assembly=assembly, beam_ids=beam_ids, update_cache=update_cache)  # -> out, beam_mesh_prev; inputs beam_ids: list
# ---------- basic_assembly_preview: Python ----------
from compas_ghpython.artists import MeshArtist

beam_mesh_prev = []
if beam_ids == []:
    beam_ids = assembly.beam_ids()

for beam_id in beam_ids:
    beam = assembly.beam(beam_id)
    mesh = assembly.get_beam_mesh_in_wcf(beam_id, not update_cache)
    beam_mesh_prev.append(MeshArtist(mesh).draw())
# ---------- end basic_assembly_preview ----------
beam_mesh_prev = ClusterOutput(basic_assembly_preview.beam_mesh_prev)
