# Grasshopper definition joint_polyline.gh (Grasshopper 1.0.7)

crv = Curve([<curve referenced from the Rhino model> x4])
crv_2 = Curve([<curve referenced from the Rhino model> x4])
number_slider = Slider(100, range=0..100)
number_slider_2 = Slider(0.5, range=0..1)
shift = ShiftList(List=crv_2, Shift=1, Wrap=True)
crv_3 = Curve(shift)
shift_2 = ShiftList(List=crv, Shift=1, Wrap=True)
crv_4 = Curve(shift_2)
panel = Panel("""1
3""")
panel_2 = Panel("""0
2""")
subtraction = Subtraction(A=number_slider_2, B=1)
panel_3 = Panel("""1
3""")
panel_4 = Panel("""0
2""")
multiplication = Multiplication(A=number_slider, B=number_slider_2)
multiplication_2 = Multiplication(A=number_slider, B=subtraction)
item = ListItem(List=crv_2, Index="0", Wrap=True)
item_2 = ListItem(List=crv, Index="0", Wrap=True)
item_3 = ListItem(List=crv_2, Index="2", Wrap=True)
item_4 = ListItem(List=crv_2, Index=panel, Wrap=True)
item_5 = ListItem(List=crv, Index="2", Wrap=True)
item_6 = ListItem(List=crv, Index=panel_2, Wrap=True)
item_7 = ListItem(List=crv_3, Index="0", Wrap=True)
item_8 = ListItem(List=crv_4, Index="0", Wrap=True)
item_9 = ListItem(List=crv_3, Index="2", Wrap=True)
item_10 = ListItem(List=crv_3, Index=panel_3, Wrap=True)
item_11 = ListItem(List=crv_4, Index="2", Wrap=True)
item_12 = ListItem(List=crv_4, Index=panel_4, Wrap=True)
Z = UnitZ(Factor=multiplication)
Z_2 = UnitZ(Factor=multiplication_2)
join = JoinCurves(Curves=flatten([item, item_2]), Preserve=False)
join_2 = JoinCurves(Curves=flatten([item_3, item_5]), Preserve=False)
join_3 = JoinCurves(Curves=flatten([item_7, item_8]), Preserve=False)
join_4 = JoinCurves(Curves=flatten([item_4, item_6]), Preserve=False)
join_5 = JoinCurves(Curves=flatten([item_9, item_11]), Preserve=False)
join_6 = JoinCurves(Curves=flatten([item_10, item_12]), Preserve=False)
extr = Extrude(Base=join, Direction=Z)
extr_2 = Extrude(Base=join_2, Direction=Z)
extr_3 = Extrude(Base=join_4, Direction=Z_2)
extr_4 = Extrude(Base=join_3, Direction=Z_2)
extr_5 = Extrude(Base=join_5, Direction=Z_2)
extr_6 = Extrude(Base=join_6, Direction=Z)
cap = CapHoles(Brep=extr_2)
cap_2 = CapHoles(Brep=extr)
cap_3 = CapHoles(Brep=extr_3)
cap_4 = CapHoles(Brep=extr_5)
cap_5 = CapHoles(Brep=extr_4)
cap_6 = CapHoles(Brep=extr_6)
sunion = SolidUnion(Breps=[cap_2, cap, cap_3])
sunion_2 = SolidUnion(Breps=[cap_5, cap_4, cap_6])
