# Grasshopper definition joint_polyline_encoder.gh (Grasshopper 1.0.7)

toggle = BooleanToggle(True)

# ----
# Reload Python Modules (if Module Code is Changed)
python_module_to_reload = Panel("""compas
compas_fab
roslibpy
integral_timber_joints""")
# Development Tools
reload = Button()
py = PythonScript(reload_module_button=reload, module_names=python_module_to_reload)  # inputs module_names: list
# ---------- py: Python ----------
import compas_ghpython
from compas_ghpython import unload_modules
if reload_module_button:
    for module in module_names:
        unload_modules(module)
# ---------- end py ----------

# ----
# Check Path and Environment
compas_version = GhPythonScript()  # -> out, compas_version, compas_fab_version, compas_path, compas_fab_path, compas_env_name, python_directory
# ---------- compas_version: Python ----------
__author__ = "leungp"
__version__ = "2020.04.20"

import rhinoscriptsyntax as rs
import compas
import compas_fab
compas_version  = compas.__version__
compas_fab_version = compas_fab.__version__
import os
compas_path = os.path.abspath(compas.__file__)
compas_fab_path = os.path.abspath(compas_fab.__file__)

import compas_bootstrapper
compas_env_name = compas_bootstrapper.ENVIRONMENT_NAME
python_directory = compas_bootstrapper.PYTHON_DIRECTORY
# ---------- end compas_version ----------
compas_environment_name = Panel(compas_version.compas_env_name)
compas_version_2 = Panel(compas_version.compas_version)
compas_fab_version = Panel(compas_version.compas_fab_version)
compas_path = Panel(compas_version.compas_path)
compas_fab_path = Panel(compas_version.compas_fab_path)
python_directory = Panel(compas_version.python_directory)

four_curves_bottom_left_top_right = Curve([<curve referenced from the Rhino model> x4])
four_curves_bottom_left_top_right_2 = Curve([<curve referenced from the Rhino model> x4])
four_curves_bottom_left_top_right_3 = Curve([<curve referenced from the Rhino model> x4])
four_curves_bottom_left_top_right_4 = Curve([<curve referenced from the Rhino model> x4])
four_curves_bottom_left_top_right_5 = Curve([<curve referenced from the Rhino model> x4])
four_curves_bottom_left_top_right_6 = Curve([<curve referenced from the Rhino model> x4])
four_curves_bottom_left_top_right_7 = Curve([<curve referenced from the Rhino model> x4])
four_curves_bottom_left_top_right_8 = Curve([<curve referenced from the Rhino model> x4])
four_curves_bottom_left_top_right_9 = Curve([<curve referenced from the Rhino model> x4])
four_curves_bottom_left_top_right_10 = Curve([<curve referenced from the Rhino model> x4])
four_curves_bottom_left_top_right_11 = Curve([<curve referenced from the Rhino model> x4])
four_curves_bottom_left_top_right_12 = Curve([<curve referenced from the Rhino model> x4])
four_curves_bottom_left_top_right_13 = Curve([<curve referenced from the Rhino model> x4])

# ----
# Auto Create Planar Lap Joints on Intersecting beams
number_slider = Slider(0.7, range=0..1)
vec = VectorXYZ(XComponent=Slider(0.4, range=0..1), YComponent=Slider(0, range=0..1), ZComponent=Slider(0, range=0..1))  # -> Vector, Length
vec_2 = VectorXYZ(XComponent=number_slider, YComponent=Slider(0, range=0..1), ZComponent=Slider(0.1, range=0..1))  # -> Vector, Length
pl = ConstructPlane(Origin=Point(0, 0, 0), XAxis=vec_2.Vector, YAxis=vec.Vector)

test_with_3d_base_plane = BooleanToggle(False)
has_screw = BooleanToggle(True)
depth_mm = Slider(50, range=0..100)
xy = XYPlane(Origin=Point(0, 0, 0))
encode_polylines_python = GhPythonScript(four_curves=four_curves_bottom_left_top_right, depth=depth_mm)  # -> out, encoded_string; inputs four_curves: list of Polyline
# ---------- encode_polylines_python: Python ----------
import Rhino as rc

def close(x,y):
    return abs(x-y) < 1e-6
    
def encode():
    # Check input to be four curves
    if len(four_curves) != 4:
        print ("Error: Number of input curves must be 4")
        return
        
#    if not all([hasattr(crv,'ToPolyline') for crv in four_curves]):
#        print ("Error: Input Curves cannot be converted to Polyline")
#    polylines = [crv.ToPolyline() for crv in four_curves]

    polylines = four_curves
    
    # Normalize polylines to 0-1 range
    all_x = []
    all_y = []
    for polyline in polylines:
        for point in polyline.Item:
            all_x.append(point.X)
            all_y.append(point.Y)
            if abs(point.Z) > 1e-8:
                print ("Warning: Input curve Z is not zero: %s" % point.Z)
    x_min = min(all_x)
    x_range = max(all_x) -min(all_x)
    y_min = min(all_y)
    y_range = max(all_y) -min(all_y)
    print("Info: Input X Min = %4.2f, Range = %4.2f, Y Min = %4.2f, Range = %4.2f"% (x_min, x_range, y_min, y_range))
    
    normal_polylines = []
    for i, polyline in enumerate(polylines):
        pl = rc.Geometry.Polyline(polyline.Count)
        for point in polyline.Item:
            x = round((point.X - x_min) / x_range, 6)
            y = round((point.Y - y_min) / y_range, 6)
            # Choose U and V coordinate 
            if i == 0:
                pl.Add(rc.Geometry.Point3d(y,x,0))
            elif i == 1:
                pl.Add(rc.Geometry.Point3d(x,1-y,0))
            elif i == 2:
                pl.Add(rc.Geometry.Point3d(1-y,1-x,0))
            elif i == 3:
                pl.Add(rc.Geometry.Point3d(1-x,y,0))
        normal_polylines.append(pl)
    
    # Automatic flip polylines and check their start end
    for i, polyline in enumerate(normal_polylines):
        if polyline.Item[0].X == 1.0:
            polyline.Reverse()
        n = polyline.Count - 1
        if not close(polyline.Item[0].X, 0.0) or not close(polyline.Item[0].Y, 0.0):
            print ("Error: Line %i did not start at corner" % i )
        if not close(polyline.Item[n].X, 1.0) or not close(polyline.Item[n].Y, 0.0):
            print ("Error: Line %i did not end at corner" % i )
#        print("Line %i" % i)
#        for point in polyline.Item:
#            print ("Point U=%1.3f V=%1.3f" % (point.X, point.Y))
            
    string="["
    string += ("%1.3f" % (depth)).rstrip("0")
    string +=",["
    for i, polyline in enumerate(normal_polylines):
        string +="["
        for point in polyline.Item:
            # print ("Point U=%1.3f V=%1.3f" % (point.X, point.Y))
            string += "["
            string += ("%1.3f" % (point.X)).rstrip("0")
            string += ","
            string += ("%1.3f" % (point.Y)).rstrip("0")
            string += "],"
            
        string += "],"
    string += "]]"
    string = string.replace(",]", "]")
    a = eval(string)
    return string
    
encoded_string = encode()
# ---------- end encode_polylines_python ----------
result = Panel(encode_polylines_python.encoded_string)
filter = StreamFilter(Gate=test_with_3d_base_plane, Stream0=xy, Stream1=pl)

# ----
# beam_move
number_slider_2 = Slider(0, range=0..100)
pt = ConstructPoint(XCoordinate=Slider(-1000, range=-1000..1000), YCoordinate=Slider(-50, range=-100..100), ZCoordinate=0)
xy_2 = XYPlane(Origin=pt)
rotate = Rotate(Geometry=xy_2, Angle=degrees(number_slider_2), Plane=PlaneXY(0, 0, 0))  # -> Geometry, Transform
orient = Orient(Geometry=rotate.Geometry, Source=PlaneXY(0, 0, 0), Target=filter)  # -> Geometry, Transform
beam = GhPythonScript(
    plane=orient.Geometry,
    length=Slider(2000, range=0..3000),
    width=Slider(100, range=0..100),
    height=Slider(100, range=0..1000),
    name="b1")  # -> out, beam, assembly; inputs plane: Plane
# ---------- beam: Python ----------
from compas_rhino.geometry import RhinoMesh, RhinoPlane

from integral_timber_joints.geometry import Beam
from integral_timber_joints.assembly import Assembly

frame = RhinoPlane.from_geometry(plane).to_compas()

beam = Beam(frame, length, width, height, name)

assembly = Assembly()
assembly.add_beam(beam)
assembly.get_beam_mesh_in_wcf(name, True)
# ---------- end beam ----------

# ----
# beam_stay
number_slider_3 = Slider(-50, range=-100..100)
pt_2 = ConstructPoint(XCoordinate=Slider(-1000, range=-1000..1000), YCoordinate=number_slider_3, ZCoordinate=0)
xy_3 = XYPlane(Origin=pt_2)
rotate_2 = Rotate(Geometry=xy_3, Angle=degrees(Slider(67, range=10..170)), Plane=PlaneXY(0, 0, 0))  # -> Geometry, Transform
orient_2 = Orient(Geometry=rotate_2.Geometry, Source=PlaneXY(0, 0, 0), Target=filter)  # -> Geometry, Transform
beam_2 = GhPythonScript(
    plane=orient_2.Geometry,
    length=Slider(2000, range=0..2000),
    width=Slider(100, range=0..100),
    height=Slider(100, range=0..1000),
    name="b2")  # -> out, beam, assembly; inputs plane: Plane; same code as beam

pln = Plane(filter)
encode_report = Panel(encode_polylines_python.out)
jointpolylinelap = GhPythonScript(beam1=beam.beam, beam2=beam_2.beam, has_screw=has_screw, polyline_string=result)  # -> out, assembly, beam1_negative_mesh, beam2_negative_mesh, beam1_polyline_mid, polyline_interior_angles; inputs has_screw: Boolean
# ---------- jointpolylinelap: Python ----------
from compas_ghpython import unload_modules
unload_modules('integral_timber_joints')
from compas.datastructures import Mesh
from integral_timber_joints.assembly import Assembly
from integral_timber_joints.geometry import JointHalfLap, JointPolylineLap
from integral_timber_joints.assembly.beam_assembly_method import BeamAssemblyMethod

assembly = Assembly()
assembly.add_beam(beam1)
assembly.add_beam(beam2)

joint1, joint2, screw_line = JointPolylineLap.from_beam_beam_intersection(beam1, beam2)
if polyline_string is not None and polyline_string != "":
    joint1.set_parameter('param_string', polyline_string)
    joint2.set_parameter('param_string', polyline_string)
assembly.add_joint_pair(joint1, joint2, beam1.name, beam2.name)

if has_screw:
    assembly.set_beam_attribute(beam2.name, 'assembly_method', BeamAssemblyMethod.SCREWED_WITH_GRIPPER)

joint_id = beam1.name, beam2.name

#assembly.get_beam_mesh_in_wcf(beam1.name, True)
#assembly.get_beam_mesh_in_wcf(beam2.name, True)

from compas_ghpython.artists import MeshArtist

shapes = assembly.get_beam_negative_shapes(beam1.name)
beam1_negative_mesh = [MeshArtist(Mesh.from_shape(shape)).draw() for shape in shapes]
shapes = assembly.get_beam_negative_shapes(beam2.name)
beam2_negative_mesh = [MeshArtist(Mesh.from_shape(shape)).draw() for shape in shapes]

print assembly.sequence
#screw = assembly.get_screw_of_joint((beam1.name, beam2.name))

# * Get Negative mesh for debugging
print joint1.get_joint_center_at_solid_side(beam1)
print joint2.get_joint_center_at_solid_side(beam2)

# * Get Polyline for debugging
from compas_ghpython.artists import PolylineArtist
from compas.geometry import Polyline

beam1_polyline_mid = [Polyline(joint1._polyline_at_mid(i)) for i in range (4)]
print (beam1_polyline_mid)
beam1_polyline_mid = [PolylineArtist(pl).draw()[0] for pl in beam1_polyline_mid]
print (beam1_polyline_mid)

polyline_interior_angles = joint1.get_polyline_interior_angles()
print (polyline_interior_angles)
polyline_interior_angles = [item for sublist in polyline_interior_angles for item in sublist]
print (joint1.check_polyline_interior_angle())
# ---------- end jointpolylinelap ----------

bnd = Bounds(Numbers=jointpolylinelap.polyline_interior_angles)
polyline_interior_angles_range = Panel(bnd)

# ----
# beam_stay negative
swatch = ColourSwatch(SwatchColor=RGBA(0, 61, 89, 48))
faceb = FaceBoundaries(Mesh=jointpolylinelap.beam2_negative_mesh)
facen = FaceNormals(Mesh=jointpolylinelap.beam2_negative_mesh)  # -> Centers, Normals
area = Area(Geometry=flatten(faceb))  # -> Area, Centroid
amp = Amplitude(Vector=facen.Normals, Amplitude=20)
vdis = VectorDisplay(Anchor=facen.Centers, Vector=amp)
bnd_2 = Bounds(Numbers=area.Area)
mesh_face_area = Panel(bnd_2)
preview = CustomPreview(Geometry=jointpolylinelap.beam2_negative_mesh, Material=swatch)

deplane = DeconstructPlane(Plane=pln)  # -> Origin, XAxis, YAxis, ZAxis
amp_2 = Amplitude(Vector=deplane.ZAxis, Amplitude=Slider(150, range=0..150))
move = Move(Geometry=jointpolylinelap.beam1_polyline_mid, Motion=amp_2)  # -> Geometry, Transform
crv = Curve(move.Geometry)
explode = Explode(Curve=crv, Recursive=True)  # -> Segments, Vertices
shift = ShiftList(List=explode.Segments, Shift=1, Wrap=False)
shift_2 = ShiftList(List=explode.Segments, Shift=-1, Wrap=False)
end = EndPoints(Curve=shift)  # -> Start, End
end_2 = EndPoints(Curve=shift_2)  # -> Start, End
vec2pt = Vector2Pt(PointA=end_2.Start, PointB=end_2.End, Unitize=False)  # -> Vector, Length
vec2pt_2 = Vector2Pt(PointA=end.Start, PointB=end.End, Unitize=False)  # -> Vector, Length
angledim = AngularDimension(Center=end_2.End, PointA=end_2.Start, PointB=end.End, Reflex=False, Text="{0:0.0}°", Size=3)
panel = Panel("[50.,[[[0.,0.],[0.,0.2],[1.,0.2],[1.,0.],],[[0.,0.],[1.,0.],],[[0.,0.],[0.,0.2],[1.,0.2],[1.,0.],],[[0.,0.],[1.,0.],],]]")
panel_2 = Panel("[50.,[[[0.,0.],[0.2,0.],[0.2,0.2],[0.8,0.2],[0.8,0.],[1.,0.],],[[0.,0.],[0.,0.2],[1.,0.2],[1.,0.],],[[0.,0.],[0.2,0.],[0.2,0.2],[0.8,0.2],[0.8,0.],[1.,0.],],[[0.,0.],[0.,0.2],[1.,0.2],[1.,0.],],]]")
panel_3 = Panel("[50.,[[[0.,0.],[0.038,0.192],[1.,0.],],[[0.,0.],[1.,0.],],[[0.,0.],[0.963,0.193],[1.,0.],],[[0.,0.],[0.193,0.037],[0.808,0.038],[1.,0.],],]]")
panel_4 = Panel("[50.,[[[0.,0.],[1.,0.],],[[0.,0.],[0.5,0.2],[1.,0.],],[[0.,0.],[1.,0.],],[[0.,0.],[0.5,0.2],[1.,0.],],]]")
panel_5 = Panel("[50.,[[[0.,0.],[0.2,0.2],[0.8,0.2],[1.,0.],],[[0.,0.],[1.,0.],],[[0.,0.],[0.2,0.2],[0.8,0.2],[1.,0.],],[[0.,0.],[1.,0.],],]]")
rev = Reverse(Vector=deplane.ZAxis)
amp_3 = Amplitude(Vector=rev, Amplitude=Slider(150, range=0..150))

# ----
# beam_move negative
swatch_2 = ColourSwatch(SwatchColor=RGBA(39, 89, 0, 61))
move_2 = Move(Geometry=jointpolylinelap.beam1_negative_mesh, Motion=amp_3)  # -> Geometry, Transform
faceb_2 = FaceBoundaries(Mesh=move_2.Geometry)
facen_2 = FaceNormals(Mesh=move_2.Geometry)  # -> Centers, Normals
area_2 = Area(Geometry=flatten(faceb_2))  # -> Area, Centroid
amp_4 = Amplitude(Vector=facen_2.Normals, Amplitude=20)
bnd_3 = Bounds(Numbers=area_2.Area)
mesh_face_area_2 = Panel(bnd_3)
vdis_2 = VectorDisplay(Anchor=facen_2.Centers, Vector=amp_4)
preview_2 = CustomPreview(Geometry=move_2.Geometry, Material=swatch_2)

# ----
# beam_stay
toggle_2 = BooleanToggle(True)
assembly_preview = AssemblyPreview(assembly=jointpolylinelap.assembly, beam_ids="b2", update_cache=toggle_2)
preview_3 = CustomPreview(Geometry=assembly_preview, Material=ColourSwatch(SwatchColor=RGBA(0, 151, 207, 232)))

# ----
# beam_move
toggle_3 = BooleanToggle(True)
assembly_preview_2 = AssemblyPreview(assembly=jointpolylinelap.assembly, beam_ids="b1", update_cache=toggle_3)
move_3 = Move(Geometry=assembly_preview_2, Motion=amp_3)  # -> Geometry, Transform
preview_4 = CustomPreview(Geometry=move_3.Geometry, Material=ColourSwatch(SwatchColor=RGBA(140, 255, 0, 232)))

faceb_3 = FaceBoundaries(Mesh=move_3.Geometry)
boundary = BoundarySurfaces(Edges=faceb_3)
join = BrepJoin(Breps=boundary)  # -> Breps, Closed
amp_5 = Amplitude(Vector=rev, Amplitude=Slider(370, range=0..500))
amp_6 = Amplitude(Vector=rev, Amplitude=Slider(500, range=0..500))
move_4 = Move(Geometry=assembly_preview_2, Motion=amp_6)  # -> Geometry, Transform
move_5 = Move(Geometry=assembly_preview, Motion=amp_5)  # -> Geometry, Transform
preview_5 = CustomPreview(Geometry=move_4.Geometry, Material=ColourSwatch(SwatchColor=RGBA(140, 255, 0, 101)))
preview_6 = CustomPreview(Geometry=move_5.Geometry, Material=ColourSwatch(SwatchColor=RGBA(0, 151, 207, 116)))

# ==== cluster AssemblyPreview
beam_ids = ClusterInput()
update_cache = ClusterInput()
assembly = ClusterInput()
basic_assembly_preview = GhPythonScript(assembly=assembly, beam_ids=beam_ids, update_cache=update_cache)  # -> out, beam_mesh_prev; inputs beam_ids: list
# ---------- basic_assembly_preview: Python ----------
from compas_ghpython.artists import MeshArtist

beam_mesh_prev = []
if beam_ids == []:
    beam_ids = assembly.beam_ids()

for beam_id in beam_ids:
    beam = assembly.beam(beam_id)
    mesh = assembly.get_beam_mesh_in_wcf(beam_id, not update_cache)
    beam_mesh_prev.append(MeshArtist(mesh).draw())
# ---------- end basic_assembly_preview ----------
beam_mesh_prev = ClusterOutput(basic_assembly_preview.beam_mesh_prev)
