# Grasshopper definition visualize_mesh.gh (Grasshopper 1.0.7)

panel = Panel("([[18966.442562499782, 9060.0063476533724, 1744.0677388505171], [18966.442562499782, 9063.7068729487273, 1725.1156357340176], [18966.442562499786, 9160.0106517019649, 1760.7617519018088], [18966.442562499786, 9160.0051471299521, 1781.0364743339333], [18966.442562499782, 9060.0106577385923, 1764.344377660319]], [[4, 3, 2], [0, 2, 1], [2, 0, 4]])")
panel_2 = Panel("([[18966.442562499786, 9160.0063476533724, 1659.3773202785742], [18966.442562499782, 9063.8066481759852, 1662.7839932098275], [18966.442562499782, 9060.0029914332572, 1642.68601581449], [18966.442562499782, 9060.0051784611733, 1622.4032325928285], [18966.442562499786, 9160.0088885845635, 1639.1045307925742]], [[0, 4, 1], [4, 2, 1], [2, 4, 3]])")
python = GhPythonScript(str=panel)  # -> out, a
# ---------- python: Python ----------
__author__ = "leungp"
__version__ = "2021.10.05"

import rhinoscriptsyntax as rs
from ast import literal_eval

from compas_ghpython.utilities import draw_mesh
v,f = literal_eval(str)
a = draw_mesh(v,f)
# ---------- end python ----------
python_2 = GhPythonScript(str=panel_2)  # -> out, a; same code as python
