# Grasshopper definition Assembly Design with Diagonals.gh (Grasshopper 1.0.7)
# plug-ins: Human

# ----
# Reload Python Modules (if Module Code is Changed)
python_module_to_reload = Panel("""compas
compas_fab
roslibpy
integral_timber_joints""")
# Development Tools
reload = Button()
py = PythonScript(reload_module_button=reload, module_names=python_module_to_reload)  # inputs module_names: list
# ---------- py: Python ----------
import compas_ghpython
from compas_ghpython import unload_modules
if reload_module_button:
    for module in module_names:
        unload_modules(module)
# ---------- end py ----------

# ----
# Check Path and Environment
compas_version = GhPythonScript()  # -> out, compas_version, compas_fab_version, compas_path, compas_fab_path, compas_env_name, python_directory
# ---------- compas_version: Python ----------
__author__ = "leungp"
__version__ = "2020.04.20"

import rhinoscriptsyntax as rs
import compas
import compas_fab
compas_version  = compas.__version__
compas_fab_version = compas_fab.__version__
import os
compas_path = os.path.abspath(compas.__file__)
compas_fab_path = os.path.abspath(compas_fab.__file__)

import compas_bootstrapper
compas_env_name = compas_bootstrapper.ENVIRONMENT_NAME
python_directory = compas_bootstrapper.PYTHON_DIRECTORY
# ---------- end compas_version ----------
compas_environment_name = Panel(compas_version.compas_env_name)
compas_version_2 = Panel(compas_version.compas_version)
compas_fab_version = Panel(compas_version.compas_fab_version)
compas_path = Panel(compas_version.compas_path)
compas_fab_path = Panel(compas_version.compas_fab_path)
python_directory = Panel(compas_version.python_directory)

# ----
# Update Beam Position
enable_interactive_selection_disable_to = BooleanToggle(False)  # "Enable Interactive Selection (disable to resume normal Rhino function)"
# What happens: WARNING: Overwrites previously defined Assembly files
# Creates one Assembly object containing all selected Beams. Beam direction auto detect from input geometry. No Sequence is defined, no joints are defined.
new_assembly_from_something = Button()
# Create Assembly Geometry
geo_from = ValueList({"Brep Input": 0, "Line Input": 1}, selected="Line Input")

# ----
# Load assembly file
reload_assembly_from_disk = Button()
# Interactive Edit
# - Joint , Sequence, Direction Design
auto_json_path = GhPythonScript()  # -> json_path
# ---------- auto_json_path: Python ----------
from Rhino.RhinoDoc import ActiveDoc
import os
json_path = os.path.splitext(ActiveDoc.Path)[0] + "_assembly.json"
# ---------- end auto_json_path ----------
file_path = FilePath(auto_json_path)

lap_joint_auto_direction = Button()
# Assembly Sequence
flip_all_lap_joints_to_previous_beams = Button()
flip_one_lap_joint = Button()

automatic_sequence_bottom_to_top = Button()
move_earlier = Button()
# Assembly Direction
move_later = Button()

# ----
# Select Joint Directions
update_beam_position_from_rhino = Button()
selobj = ObjectsBySelection(Reset=update_beam_position_from_rhino, LiveMode=False)

or = GateOr(A=new_assembly_from_something, B=update_beam_position_from_rhino)

# ----
# Assembly from Brep
structure_layer = GeometryPipeline(
    GroupByLayer=False,
    GroupByType=False,
    IncludeHidden=True,
    IncludeLocked=True,
    LayerFilter="Structure",
    NameFilter="*",
    SublayerFiltering=True,
    TypeFilter=1073741848)
mesh_brep = MeshBrep(
    Brep=structure_layer,
    Settings={GridMaxCount=0, GridMinCount=16, JaggedSeams=False, MaxEdgeLength=0, MinEdgeLength=0.0001, MinTolerance=0, Refine=True, RefineAngle=0, RelativeTolerance=0.65, SimplePlanes=True, Tolerance=0})
and = GateAnd(A=or, B=invert(geo_from))
auto_beam_frame_long_short_edge = AutoBeamFrameLongShortEdge(brep=structure_layer)
new_assembly = GhPythonScript(activate=and, beam_meshes=mesh_brep, guids=structure_layer, orientation_planes=auto_beam_frame_long_short_edge)  # -> out, assembly; inputs beam_meshes: list of Mesh, guids: list of Guid, orientation_planes: list
# ---------- new_assembly: Python ----------
if activate:
    
    from compas_rhino.geometry import RhinoMesh, RhinoPlane
    from integral_timber_joints.assembly import Assembly
    from integral_timber_joints.geometry import Beam
    
    # Assert List length of beam_mesh, guid, orientation_plane are same
    assert len(beam_meshes) == len(guids)
    assert len(beam_meshes) == len(orientation_planes)
    
    # Create Assmebly object, the main object.
    assembly = Assembly()
    
    # create Beam Elements and add it to Assembly
    for index, (beam_mesh, guid, orientation_plane) in enumerate(zip(beam_meshes, guids, orientation_planes)):
        
        # Convert input to compas mesh
        compas_mesh = RhinoMesh.from_geometry(beam_mesh).to_compas()
        compas_frame = RhinoPlane.from_geometry(orientation_plane).to_compas()
        # Beam class method
        beam = Beam.from_mesh(compas_mesh, compas_frame)
        
        # Create key/identifier of the beam. The number do not represent sequence
        beam.name ='b%s'% index 
        
        # Guid of the Rhino object is tracked for later interactive selection design process
        beam.guid = guid.__str__()
        
        # Add beam to assembly
        assembly.add_beam(beam)
        print ("%s : Guid(%s)" % (beam, beam.guid))
# ---------- end new_assembly ----------

# ----
# Assembly from Lines
structure_layer_2 = GeometryPipeline(
    GroupByLayer=False,
    GroupByType=False,
    IncludeHidden=True,
    IncludeLocked=True,
    LayerFilter="Structure",
    NameFilter="*",
    SublayerFiltering=True,
    TypeFilter=4)
number_slider = Slider(100, range=0..100)
number_slider_2 = Slider(100, range=0..100)
xy = XYPlane(Origin=Point(0, 0, 0))
auto_flip_z = AutoFlipZ(line=structure_layer_2, pln=xy)  # -> line_4, vector
planes_from_line_and_guide_plane = PlanesFromLineAndGuidePlane(line=auto_flip_z.line_4, height=number_slider_2, width=number_slider, pln=xy)  # -> plane, length, name
and_2 = GateAnd(A=or, B=geo_from)
beam = GhPythonScript(
    plane=planes_from_line_and_guide_plane.plane,
    length=planes_from_line_and_guide_plane.length,
    width=number_slider,
    height=number_slider_2,
    name=planes_from_line_and_guide_plane.name)  # -> out, beam; inputs plane: Plane
# ---------- beam: Python ----------
from compas_rhino.geometry import RhinoMesh, RhinoPlane

from integral_timber_joints.geometry import Beam
from integral_timber_joints.assembly import Assembly

frame = RhinoPlane.from_geometry(plane).to_compas()
beam = Beam(frame, length, width, height, name)
# ---------- end beam ----------
new_assembly_2 = GhPythonScript(activate=and_2, beams=beam.beam)  # -> out, assembly; inputs beams: list
# ---------- new_assembly_2: Python ----------
if activate:
    
    from integral_timber_joints.assembly import Assembly

    # Create Assmebly object, the main object.
    assembly = Assembly()
    
    # create Beam Elements and add it to Assembly
    for beam in beams:
        assembly.add_beam(beam)
# ---------- end new_assembly_2 ----------

filter = StreamFilter(Gate=geo_from, Stream0=new_assembly.assembly, Stream1=new_assembly_2.assembly)

# ----
# Save new Assembly
assembly_json_path = GhPythonScript()  # -> json_path; same code as auto_json_path
json_pickle = GhPythonScript(stuff=filter, json_output_path=assembly_json_path, output=new_assembly_from_something)  # -> update_trigger; inputs output: Boolean
# ---------- json_pickle: Python ----------
if output:
    import jsonpickle
    jsonpickle.set_preferred_backend('json')
    jsonpickle.set_encoder_options('json')
    
    with open(json_output_path, 'w') as f:
        f.write(jsonpickle.encode(stuff, keys=True, make_refs=False))

    update_trigger = True
else:
    update_trigger = False
# ---------- end json_pickle ----------

or_2 = GateOr(A=json_pickle, B=reload_assembly_from_disk)

json_unpickle = GhPythonScript(json_path=file_path, enable=True, reload=or_2)  # -> warn_col, warn_msg, data; inputs enable: Boolean
# ---------- json_unpickle: Python ----------
import jsonpickle
import os

import scriptcontext as sc

if enable:
    # Retriving the previously loaded asssembly
    key = 'assembly_%s' % str(ghenv.Component.InstanceGuid)
    previous_data = sc.sticky.get(key, None)

    if previous_data is None or reload:
        exist = os.path.exists(json_path)
        if exist:
            f = open(json_path, 'r')
            json_str = f.read()
            data = jsonpickle.decode(json_str, keys=True)
            f.close()
            warn_col = "lime"    
            warn_msg = "Assembly File loaded with %s Beams" % (len(list(data.beams())))
            sc.sticky[key] = (data, warn_col, warn_msg)
        else:
            warn_col = "orange"    
            warn_msg = "Assembly File not created yet"
            sc.sticky[key] = (None, warn_col, warn_msg)
    # Avoid output of the data if reload is false (Button Down)
    if reload:
        data = None
    else:
        data = previous_data[0]
        warn_col = previous_data[1]
        warn_msg = previous_data[2]
# ---------- end json_unpickle ----------
legend = Legend(Colour=json_unpickle.warn_col, Tags=json_unpickle.warn_msg, LegendType=1)
update_meshes = GhPythonScript(assembly=json_unpickle.data, force=False)  # -> out, assembly_out; inputs force: Boolean
# ---------- update_meshes: Python ----------
__author__ = "leungp"
__version__ = "2020.02.19"

from compas_ghpython.helpers import mesh_draw

assembly_out = assembly

for beam_id in assembly.beam_ids():
    if force or assembly.beam(beam_id).cached_mesh is None:
        assembly.update_beam_mesh_with_joints(beam_id)
# ---------- end update_meshes ----------

update_beam_pos = GhPythonScript(
    assembly=update_meshes.assembly_out,
    updated_assembly=filter,
    selected_guids=selobj,
    activate_update=update_beam_position_from_rhino)  # -> out, assembly_out; inputs selected_guids: list of Guid, activate_update: Boolean
# ---------- update_beam_pos: Python ----------
from compas_ghpython.helpers import mesh_draw

from integral_timber_joints.geometry import Joint_halflap_from_beam_beam_intersection

assembly_out = assembly


# Interactively change joint definition
if activate_update:
    selected_guids = [guid.__str__() for guid in selected_guids]
    for guid in selected_guids:
        for beam in assembly_out.beams():
            # Find beam in assembly
            if beam.guid == guid:
                # Find beam in updated_assembly
                for updated_beam in updated_assembly.beams():
                    if updated_beam.guid == guid:
                        # Update Beam Position and geometry
                        beam.frame = updated_beam.frame
                        beam.length = updated_beam.length
                        beam.width = updated_beam.width
                        beam.height = updated_beam.width
                        beam.cached_mesh = None         
                        # Update all connected joints
                        for bid_1, bid_2 in assembly_out.get_joint_ids_of_beam(beam.name):
                            beam1 = assembly_out.beam(bid_1)
                            beam2 = assembly_out.beam(bid_2)
                            joint1, joint2 = Joint_halflap_from_beam_beam_intersection(beam1, beam2)
                            assembly_out.add_joint_pair(joint1, joint2, bid_1, bid_2)
                            beam1.cached_mesh = None 
                            beam2.cached_mesh = None 
#    if beam_id is not None:
#        beams_to_update = [beam_id]
#        # Loop though neighbous and swap joint
#        for neighbour_id in assembly.get_already_built_neighbors(beam_id):
##            beam1 = assembly_out.beam(beam_id)
##            beam2 = assembly_out.beam(neighbour_id)
#            
#            assembly_out.joint((beam_id , neighbour_id)).swap_faceid_to_opposite_face()
#            assembly_out.joint((neighbour_id , beam_id)).swap_faceid_to_opposite_face()
#            
##            assembly_out.add_joint_pair(joint1, joint2, beam_id, neighbour_id)
#            beams_to_update.append(neighbour_id)
#        # Update Mesh           
#        for beam_id in beams_to_update:         
#            assembly_out.update_beam_mesh_with_joints(beam_id)
# ---------- end update_beam_pos ----------

# ----
# Clickable Joint Preview
# Not Selected Joint
# Selected Joint
intersection_joint_selector = GhPythonScript(assembly=update_meshes.assembly_out)  # -> out, joint_breps, joint_ids, assembly_out
# ---------- intersection_joint_selector: Python ----------
from Rhino.Geometry.Brep import CreateBooleanIntersection
from Rhino.RhinoDoc import ActiveDoc
import rhinoscriptsyntax as rs

import System
import Rhino
from Rhino.Geometry.Brep import TryConvertBrep
from ghpythonlib.components import SolidIntersection

from compas_ghpython import draw_frame
from Rhino.Geometry.Transform import PlaneToPlane
from Rhino.Geometry import Plane


assembly_out = assembly

joint_breps = []
joint_ids = []
beam_ids = list(assembly.beam_ids())

# Loop thorugh the list in an Strict Lower triangle 
# Computational cost O(n^2)/2
for i, bid_i in enumerate(beam_ids):
    for j, bid_j in enumerate(beam_ids[:i]):
        
        joint_id = (bid_i, bid_j)
        
        # Intersect BRep and allow for selection
#        i_guid = assembly.beam(bid_i).guid
#        j_guid = assembly.beam(bid_j).guid
#        i_brep = ActiveDoc.Objects.FindId(System.Guid(i_guid))
#        j_brep = ActiveDoc.Objects.FindId(System.Guid(j_guid))
#        
#        if type(i_brep)==Rhino.DocObjects.ExtrusionObject:
#            i_brep = TryConvertBrep(i_brep.ExtrusionGeometry)
#        if type(j_brep)==Rhino.DocObjects.ExtrusionObject:
#            j_brep = TryConvertBrep(j_brep.ExtrusionGeometry)
            
        # Recreate BrepBox of beam
        def beam_brep(beam_id):
            frame = draw_frame(assembly.beam(beam_id).frame)
            length = assembly.beam(beam_id).length
            height = assembly.beam(beam_id).height
            width = assembly.beam(beam_id).width
            pt0 = Rhino.Geometry.Point3d(0, 0, 0)
            pt1 = Rhino.Geometry.Point3d(length, height, width)
            box = Rhino.Geometry.BoundingBox(pt0, pt1)
            brep = box.ToBrep()
            T = PlaneToPlane(Plane.WorldXY, frame)
            brep.Transform(T)
            return brep
            
            
        i_brep = beam_brep(bid_i)
        j_brep = beam_brep(bid_j)
        
        # Brep Intersection
        boolean_result = SolidIntersection(i_brep, j_brep)
        
        # If result is not empty, send to output.
        if boolean_result is None:
            print ("Joint(%s-%s) : None" % joint_id)
            continue
        
        if type(boolean_result) is not list :
            print ("Joint(%s-%s) : One Result" % joint_id)
            joint_breps.append(boolean_result)
            joint_ids.append(joint_id)
        else:
            print ("Joint(%s-%s) : len(%s)" % (bid_i, bid_j , len(boolean_result)))
            for result in boolean_result:
                joint_breps.append(result)
                joint_ids.append(joint_id)
# ---------- end intersection_joint_selector ----------
clickable_mesh = ClickableMesh(Enable=enable_interactive_selection_disable_to, Meshes=intersection_joint_selector.joint_breps)  # -> SelectedMeshes, SelectedIndices, MouseLine
all_intersecting_joints = Data(intersection_joint_selector.joint_ids)
stream_filter = StreamFilter(Gate=enable_interactive_selection_disable_to, Stream1=clickable_mesh.SelectedIndices)
cull_index = CullIndex(List=intersection_joint_selector.joint_breps, Indices=clickable_mesh.SelectedMeshes, Wrap=True)
list_item = ListItem(List=intersection_joint_selector.joint_ids, Index=stream_filter, Wrap=True)
list_item_2 = ListItem(List=intersection_joint_selector.joint_breps, Index=stream_filter, Wrap=True)
selected_joint_id = Panel(list_item)
selected_joint_id_2 = Data(list_item)
custom_preview = CustomPreview(Geometry=cull_index, Material=ColourSwatch(SwatchColor=RGBA(209, 206, 0, 36)))
custom_preview_2 = CustomPreview(Geometry=list_item_2, Material=ColourSwatch(SwatchColor=RGBA(147, 21, 158, 215)))

# ----
# Check joint angles
show_angle_check_for_cl3_clamp = BooleanToggle(False)
change_joint_type = GhPythonScript(
    enable=show_angle_check_for_cl3_clamp,
    all_joints_id=all_intersecting_joints,
    assembly=update_beam_pos.assembly_out,
    warning_min="24.99",
    warning_max="155.01")  # -> out, angles, okays, tag_location, tag_text, tag_size; inputs all_joints_id: list
# ---------- change_joint_type: Python ----------
from compas_ghpython.helpers import mesh_draw
from compas_ghpython.utilities import draw_frame

from integral_timber_joints.geometry import Joint_halflap
from integral_timber_joints.geometry import Joint_halflap_from_beam_beam_intersection

assembly_out = assembly
angles = []
okays = []
tag_location = []
tag_text = []
tag_size = []


size_factor = 0.4

# Interactively change joint definition
if enable:
    if all_joints_id is not None:
        for bid_1 , bid_2 in all_joints_id:
            beam1 = assembly_out.beam(bid_1)
            beam2 = assembly_out.beam(bid_2)
            
            joint1, joint2 = Joint_halflap_from_beam_beam_intersection(beam1, beam2)
            
            # Output for angles and check
            angles.append(joint1.angle)
            
            okays.append(joint1.angle > warning_min and joint1.angle < warning_max)
            
            # Output for text tag location

            face_frame = joint1.get_clamp_frames(beam1)[0]
            face_frame.yaxis = face_frame.yaxis * -1.0
            
            tag_text.append("%.1f\N{DEGREE SIGN}" % joint1.angle)
            tag_location.append(draw_frame(face_frame))
            tag_size.append(joint1.width * size_factor)
            
            face_frame = joint2.get_clamp_frames(beam2)[0]
            face_frame.yaxis = face_frame.yaxis * -1.0
            
            tag_text.append("%.1f\N{DEGREE SIGN}" % joint2.angle)
            tag_location.append(draw_frame(face_frame))
            tag_size.append(joint2.width * size_factor)
# ---------- end change_joint_type ----------
filter_2 = StreamFilter(Gate=show_angle_check_for_cl3_clamp, Stream1=intersection_joint_selector.joint_breps)
joint_breps = Geometry(filter_2)
volume = Volume(Geometry=joint_breps)  # -> Volume, Centroid
cull = CullPattern(List=joint_breps, CullPattern=invert(change_joint_type.okays))
cull_2 = CullPattern(List=joint_breps, CullPattern=change_joint_type.okays)
custom_preview_3 = CustomPreview(Geometry=cull_2, Material=ColourSwatch(SwatchColor=RGB(47, 156, 0)))
custom_preview_4 = CustomPreview(Geometry=cull, Material=ColourSwatch(SwatchColor=RGB(156, 0, 0)))
font = Panel("DejaVu Sans Mono")
justifiedtext3d = JustifiedText3d(
    Location=change_joint_type.tag_location,
    Text=change_joint_type.tag_text,
    Size=change_joint_type.tag_size,
    Color=ColourSwatch(SwatchColor=RGB(0, 0, 0)),
    HorizontalAlignment=1,
    VerticalAlginment=1,
    Font=font,
    UseMeshes=False,
    Bake=False)

# ----
# Export to Lines
assembly_center_lines = GhPythonScript(assembly=update_meshes.assembly_out)  # -> out, center_lines
# ---------- assembly_center_lines: Python ----------
from Rhino.Geometry import Line, Point3d

center_lines = []
for beam in assembly.beams():
    center_line = beam.get_center_line()
    center_lines.append(Line(
        Point3d(center_line.start[0], center_line.start[1], center_line.start[2]), 
        Point3d(center_line.end[0], center_line.end[1], center_line.end[2])
        ))
# ---------- end assembly_center_lines ----------

# ----
# Save Edits
save_assembly_to_disk = Button()
assembly_json_path_2 = GhPythonScript()  # -> json_path; same code as auto_json_path

# ----
# Design Method 1 # Infer Assembly Directions
# from JointGeo and Sequence
number_slider_3 = Slider(5, range=0..10)

change_joint_type_2 = GhPythonScript(
    all_joints_id=all_intersecting_joints,
    assembly=update_beam_pos.assembly_out,
    activate_autolapjoint=lap_joint_auto_direction)  # -> out, assembly_out; inputs all_joints_id: list, activate_autolapjoint: Boolean
# ---------- change_joint_type_2: Python ----------
from compas_ghpython.helpers import mesh_draw

from integral_timber_joints.geometry import Joint_halflap
from integral_timber_joints.geometry import Joint_halflap_from_beam_beam_intersection

assembly_out = assembly
beam_meshes = []

# Interactively change joint definition
if activate_autolapjoint:
    if all_joints_id is not None:
        for bid_1 , bid_2 in all_joints_id:
            beam1 = assembly_out.beam(bid_1)
            beam2 = assembly_out.beam(bid_2)
            
            joint1, joint2 = Joint_halflap_from_beam_beam_intersection(beam1, beam2)
#            print ("joint1 : %s" % joint1)
#            print ("joint2 : %s" % joint2)
            
            assembly_out.add_joint_pair(joint1, joint2, bid_1, bid_2)
    
#    for beam_id in assembly_out.sequence:
#        print assembly_out.beam(beam_id)
#        for joint in assembly.get_joints_of_beam(beam_id):
#            print ("Joint : %s" % joint)
        
    for beam_id in assembly_out.sequence:
        assembly_out.update_beam_mesh_with_joints(beam_id, skip_if_cached=True)
# ---------- end change_joint_type_2 ----------
change_joint_type_3 = GhPythonScript(selected_joint_id=selected_joint_id_2, assembly=change_joint_type_2.assembly_out, activate_flip=flip_one_lap_joint)  # -> out, assembly_out; inputs activate_flip: Boolean
# ---------- change_joint_type_3: Python ----------
from compas_ghpython.helpers import mesh_draw

assembly_out = assembly

joint_id = selected_joint_id

# Interactively change joint definition
if activate_flip:
    if joint_id is not None:
        bid_1 , bid_2 = joint_id
        assembly_out.joint((bid_1 , bid_2)).swap_faceid_to_opposite_face()
        assembly_out.joint((bid_2 , bid_1)).swap_faceid_to_opposite_face()
        # Update Mesh           
        assembly_out.update_beam_mesh_with_joints(bid_1)
        assembly_out.update_beam_mesh_with_joints(bid_2)
# ---------- end change_joint_type_3 ----------

# ----
# Clickable Beam
ghpython_script = GhPythonScript(assembly=change_joint_type_2.assembly_out, enable=True)  # -> out, beam_meshes, beam_ids
# ---------- ghpython_script: Python ----------
from compas_ghpython.helpers import mesh_draw

beam_meshes = []
beam_ids = []
if enable:
    for beam_id in assembly.beam_ids():
        assembly.update_beam_mesh_with_joints(beam_id, skip_if_cached = True)
        beam = assembly.beam(beam_id)
        beam_meshes.append(mesh_draw(beam.cached_mesh))
        beam_ids.append(beam_id)
# ---------- end ghpython_script ----------
clickable_mesh_2 = ClickableMesh(Enable=enable_interactive_selection_disable_to, Meshes=ghpython_script.beam_meshes)  # -> SelectedMeshes, SelectedIndices, MouseLine
list_item_3 = ListItem(List=ghpython_script.beam_ids, Index=clickable_mesh_2.SelectedIndices, Wrap=True)
selected_beam_name = Panel(list_item_3)
selected_beam_id = Text(selected_beam_name)

change_joint_type_4 = GhPythonScript(
    selected_beam_id=selected_beam_id,
    assembly=change_joint_type_3.assembly_out,
    activate_flip=flip_all_lap_joints_to_previous_beams)  # -> out, assembly_out; inputs activate_flip: Boolean
# ---------- change_joint_type_4: Python ----------
from compas_ghpython.helpers import mesh_draw

from integral_timber_joints.geometry import Joint_90lap
from integral_timber_joints.geometry import Joint_90lap_from_beam_beam_intersection

assembly_out = assembly
beam_id = selected_beam_id

# Interactively change joint definition
if activate_flip:
    if beam_id is not None:
        beams_to_update = [beam_id]
        # Loop though neighbous and swap joint
        for neighbour_id in assembly.get_already_built_neighbors(beam_id):
#            beam1 = assembly_out.beam(beam_id)
#            beam2 = assembly_out.beam(neighbour_id)
            
            assembly_out.joint((beam_id , neighbour_id)).swap_faceid_to_opposite_face()
            assembly_out.joint((neighbour_id , beam_id)).swap_faceid_to_opposite_face()
            
#            assembly_out.add_joint_pair(joint1, joint2, beam_id, neighbour_id)
            beams_to_update.append(neighbour_id)
        # Update Mesh           
        for beam_id in beams_to_update:         
            assembly_out.update_beam_mesh_with_joints(beam_id)
# ---------- end change_joint_type_4 ----------

seq_auto_bottom_up = GhPythonScript(assembly=change_joint_type_4.assembly_out, activate=automatic_sequence_bottom_to_top)  # -> out, assembly_out
# ---------- seq_auto_bottom_up: Python ----------
assembly_out = assembly

if activate:
    center_points = []
    for beam in assembly.beams():
        center_point = beam.get_center_point()
        center_points.append((center_point.z, beam))
        
    center_points.sort(key=lambda tup: tup[0])
    
    assembly.sequence = []
    i = 0
    for center_point_z, beam in center_points:
       assembly.sequence.append(beam.name)
       print ("Seq[%s] Beam[%s] Center Point z=%s " % (i, beam.name, center_point_z))
       i += 1
# ---------- end seq_auto_bottom_up ----------
seq_auto_bottom_up_2 = GhPythonScript(
    assembly=seq_auto_bottom_up.assembly_out,
    selected_beam_id=selected_beam_id,
    activate_earlier=move_earlier,
    activate_later=move_later)  # -> out, assembly_out
# ---------- seq_auto_bottom_up_2: Python ----------
assembly_out = assembly
sequence = assembly.sequence
if activate_earlier or activate_later:
    i = sequence.index(selected_beam_id)
    print i
    
    if activate_earlier and i > 0:
        sequence[i-1], sequence[i] = sequence[i], sequence[i-1] 
    if activate_later and i < len(sequence) - 1:
        sequence[i+1], sequence[i] = sequence[i], sequence[i+1]
# ---------- end seq_auto_bottom_up_2 ----------

infer_assembly_dir = GhPythonScript(
    assembly=seq_auto_bottom_up_2.assembly_out,
    downward_placement_amount_if_no_joint=Slider(50, range=0..100),
    beam_in_jaw_position_gap_offset=number_slider_3)  # -> out, assembly_out
# ---------- infer_assembly_dir: Python ----------
__author__ = "leungp"
__version__ = "2020.02.26"

import rhinoscriptsyntax as rs

from compas.geometry import Vector

assembly_out = assembly

assembly_vector_if_no_joint = Vector(0, 0, -downward_placement_amount_if_no_joint)


#assembly_out.compute_assembly_direction_from_joints_and_sequence(
#    assembly_vector_if_no_joint, 
#    beam_in_jaw_position_gap_offset
#    )
         

def compute_assembly_direction_from_joints_and_sequence(self, assembly_vector_if_no_joint, beam_in_jaw_position_gap_offset):
    """Computes the assembly of all beams based on the assembly sequence and the joints the beam

    Based on the assembly sequence of the beams. We can deduce the assembly direction
    from the joints that are to be clamped to the already-assembled beams.

    """
    from compas.geometry import Vector
    from compas.geometry import Translation
    
    def assembly_direction_contradict(vectors):
        for i, vector_i in enumerate(vectors):
            for j, vector_j in enumerate(list(vectors)[i+1:]):
                if vector_i.dot(vector_j) < 0: return True
        return False  
    
    for beam_id in self.sequence:
        
        beam = self.beam(beam_id)
        print ("> %s" % beam)
        # Compute assembly_wcf_final.
        # It is equal to beam.frame, because the beam is modelled in its final position
        self.set_beam_attribute(beam_id, 'assembly_wcf_final', beam.frame.copy())

        # Compute assembly_wcf_inclamp
        # We are going to check all the joint pairs.
        # Vector is computed from averaging the assembly direction of the joint
        # Vector length is computed from the combined height of pairs of joint.
        # The maximum length value is taken if there are multiple joints.
        assembly_direction_wcf = []
        assembly_vector_length = 0.0
        for _, neighbout_beam_id in self.get_joints_of_beam_connected_to_already_built(beam_id):
            print ("neighbout_beam_id: %s" % neighbout_beam_id)
            joint_on_this_beam = self.joint((beam_id, neighbout_beam_id))
            joint_on_this_neighbor = self.joint((neighbout_beam_id, beam_id))
            
            assembly_direction_wcf.append(joint_on_this_beam.get_assembly_direction(beam).unitized())
            assembly_vector_length = max(joint_on_this_neighbor.height + joint_on_this_beam.height, assembly_vector_length)

        if len(assembly_direction_wcf) == 0:
            # No Neighbouring joint case
            # Handles no_clamp (perhaps) grounded beams v.s. typical clamp installed beams
            assembly_vector_wcf = assembly_vector_if_no_joint
            print("Assembly Direction of Beam (%s) using downward movement %s (ref to wcf)." % (beam.name, assembly_direction_wcf))
        else:
            # Test if the list of assembly_direction_wcf contradicts eachother
            contradict = assembly_direction_contradict(assembly_direction_wcf)
            if contradict :
                # No Solution Case
                print("WARNING: Beam (%s) Assembly direction is blocked by joints." % (beam_id))
                assembly_vector_wcf = None
            else:
                # Solution exist Case
                assembly_vector_wcf = Vector.sum_vectors(assembly_direction_wcf).unitized().scaled(assembly_vector_length + beam_in_jaw_position_gap_offset)
                print("Assembly Direction of Beam (%s) computed from Joints to be %s (ref to wcf)." % (beam_id, assembly_direction_wcf))

        self.set_beam_attribute(beam_id, 'assembly_vector_final', assembly_vector_wcf)
        
        # Compute the assembly_wcf_inclamp by moving back along the assembly_direction_wcf.
        if assembly_vector_wcf is None:
            self.set_beam_attribute(beam_id, 'assembly_wcf_inclamp', None)
            print ('assembly_wcf_inclamp set to None')
            
        else:
            wcf_clamp_transform = Translation.from_vector(assembly_vector_wcf.scaled(-1.0))
            self.set_beam_attribute(beam_id, 'assembly_wcf_inclamp', beam.frame.transformed(wcf_clamp_transform))
            
compute_assembly_direction_from_joints_and_sequence(assembly, assembly_vector_if_no_joint, beam_in_jaw_position_gap_offset)
# ---------- end infer_assembly_dir ----------
panel = Panel(infer_assembly_dir.out)

json_pickle_2 = GhPythonScript(stuff=infer_assembly_dir.assembly_out, json_output_path=assembly_json_path_2, output=save_assembly_to_disk)  # inputs output: Boolean
# ---------- json_pickle_2: Python ----------
if output:
    import jsonpickle
    jsonpickle.set_preferred_backend('json')
    jsonpickle.set_encoder_options('json')
    
    with open(json_output_path, 'w') as f:
        f.write(jsonpickle.encode(stuff, keys=True, make_refs=False))
# ---------- end json_pickle_2 ----------

# ----
# Assembly Sequence Preview
# Previous Beams
# Selected Beam in moved-out position
basic_assembly_preview = GhPythonScript(assembly=infer_assembly_dir.assembly_out, selected_beam_id=selected_beam_id, enable=True)  # -> out, beam_mesh_prev, beam_mesh_curr, assembly_wcf_inclamp_none
# ---------- basic_assembly_preview: Python ----------
from compas_ghpython.helpers import mesh_draw

beam_mesh_prev = []
beam_mesh_curr = None

# Loop using assembly sequence until we reach the selected_beam_id
if enable:
    for beam_id in assembly.sequence:
        beam = assembly.beam(beam_id)
        # The selected beam
        if beam_id == selected_beam_id:
            # Draw beam at assembly_wcf_inclamp
            T = assembly.get_beam_transformaion_to(beam_id, "assembly_wcf_inclamp")
            if T is None:
                assembly_wcf_inclamp_none = True
                beam_mesh_curr = mesh_draw(beam.cached_mesh)
            else:
                assembly_wcf_inclamp_none = False
                beam_mesh_curr = mesh_draw(beam.cached_mesh.transformed(T))
            break
            
        # Before reaching the selected beam
        beam_mesh_prev.append(mesh_draw(beam.cached_mesh))
# ---------- end basic_assembly_preview ----------
stream_filter_2 = StreamFilter(
    Gate=basic_assembly_preview.assembly_wcf_inclamp_none,
    Stream0=ColourSwatch(SwatchColor=RGBA(97, 209, 27, 181)),
    Stream1=ColourSwatch(SwatchColor=RGBA(209, 27, 27, 181)))
custom_preview_5 = CustomPreview(Geometry=basic_assembly_preview.beam_mesh_curr, Material=stream_filter_2)
custom_preview_6 = CustomPreview(Geometry=basic_assembly_preview.beam_mesh_prev, Material=ColourSwatch(SwatchColor=RGBA(219, 219, 219, 103)))

# ----
# Beam Preview on Perspective VP
# Other Beams
# Selected Beam
ghpython_script_2 = GhPythonScript(assembly=change_joint_type_4.assembly_out, enable=True)  # -> out, beam_meshes, beam_ids; same code as ghpython_script
selected_beam_id_2 = Text(clickable_mesh_2.SelectedIndices)
cull_index_2 = CullIndex(List=ghpython_script_2.beam_meshes, Indices=selected_beam_id_2, Wrap=True)
list_item_4 = ListItem(List=ghpython_script_2.beam_meshes, Index=selected_beam_id_2, Wrap=True)
custom_preview_7 = CustomPreview(Geometry=list_item_4, Material=ColourSwatch(SwatchColor=RGBA(27, 170, 209, 181)))
custom_preview_8 = CustomPreview(Geometry=cull_index_2, Material=ColourSwatch(SwatchColor=RGBA(219, 219, 219, 103)))

# ----
# Beam Name Tag on Beam Start
beam_name_tag = GhPythonScript(assembly=seq_auto_bottom_up_2.assembly_out, activate=True, faces=[2, 4])  # -> out, tag_location, tag_text, tag_size, assembly_out; inputs faces: list
# ---------- beam_name_tag: Python ----------
from compas_ghpython.utilities import draw_frame

assembly_out = assembly
tag_location = []
tag_text = []
tag_size = []

padding_factor = 0.2
size_factor = 0.6

if activate:
    if faces is None: faces = [1]
    for face_id in faces:
        for i, beam_id in enumerate(assembly.sequence):
            beam = assembly.beam(beam_id)
            face_frame = beam.reference_side_wcf(face_id)
            
            # Padding
            beam_size_min = min(beam.height, beam.width)
            padding = beam_size_min * padding_factor
            padded_location_origin = face_frame.to_world_coordinates([padding, padding , 0])
            face_frame.point = padded_location_origin
            tag_location.append(draw_frame(face_frame))
            
            # Test and Size
            tag_text.append(".%s." % (i))
            tag_size.append(beam_size_min * size_factor)
# ---------- end beam_name_tag ----------
font_2 = Panel("DejaVu Sans Mono")
justifiedtext3d_2 = JustifiedText3d(
    Location=beam_name_tag.tag_location,
    Text=beam_name_tag.tag_text,
    Size=beam_name_tag.tag_size,
    HorizontalAlignment=0,
    VerticalAlginment=0,
    Font=font_2,
    UseMeshes=False,
    Bake=False)

# ==== cluster AutoBeamFrameLongShortEdge
brep = ClusterInput()

brep_2 = Brep(graft(brep))
edges = BrepEdges(Brep=brep_2)  # -> Naked, Interior, NonManifold
end = EndPoints(Curve=edges.Interior)  # -> Start, End
vec2pt = Vector2Pt(PointA=end.Start, PointB=end.End, Unitize=False)  # -> Vector, Length
pl = PlaneNormal(Origin=end.Start, ZAxis=vec2pt.Vector)
bbox = BoundingBox(Content=brep_2, Plane=pl)  # -> Box, Box_2

# ----
# Measure edge lengths
item = ListItem(List=bbox.Box, Index=0, Wrap=True)
pshift = ShiftPaths(Data=item, Offset=-1)
debox = DeconstructBox(Box=pshift)  # -> Plane, X, Y, Z
dedomain = DeconstructDomain(Domain=debox.Z)  # -> Start, End
subtraction = Subtraction(A=dedomain.Start, B=dedomain.End)
abs = Absolute(Value=subtraction)

# ----
# Use longest and shortest edge as X
sort = SortList(Keys=abs, ValuesB=edges.Interior)  # -> Keys, ValuesB
item_2 = ListItem(List=sort.ValuesB, Index=-1, Wrap=True)
item_3 = ListItem(List=sort.ValuesB, Index=0, Wrap=True)
end_2 = EndPoints(Curve=item_2)  # -> Start, End
end_3 = EndPoints(Curve=item_3)  # -> Start, End
vec2pt_2 = Vector2Pt(PointA=end_2.Start, PointB=end_2.End, Unitize=False)  # -> Vector, Length
vec2pt_3 = Vector2Pt(PointA=end_3.Start, PointB=end_3.End, Unitize=False)  # -> Vector, Length
pl_2 = ConstructPlane(Origin=end_2.Start, XAxis=vec2pt_2.Vector, YAxis=vec2pt_3.Vector)

pshift_2 = ShiftPaths(Data=pl_2, Offset=-2)
D = ClusterOutput(pshift_2)

# ==== cluster AutoFlipZ
pln = ClusterInput()
line = ClusterInput()
pln_2 = Plane(pln)
deplane = DeconstructPlane(Plane=pln_2)  # -> Origin, XAxis, YAxis, ZAxis
line_2 = Line(line)
line_3 = LineSDL(Start=Point(0, 0, 0), Direction=deplane.ZAxis, Length=1)
flip = FlipCurve(Curve=line_2, Guide=line_3)  # -> Curve, Flag
end = EndPoints(Curve=flip.Curve)  # -> Start, End
vec2pt = Vector2Pt(PointA=end.Start, PointB=end.End, Unitize=False)  # -> Vector, Length
line_4 = ClusterOutput(flip.Curve)
vector = ClusterOutput(vec2pt.Vector)

# ==== cluster PlanesFromLineAndGuidePlane
height = ClusterInput()
pln = ClusterInput()
width = ClusterInput()
pln_2 = Plane(pln)
height_2 = Number(height)
width_2 = Number(width)
line = ClusterInput()
line_2 = Line(line)
end = EndPoints(Curve=line_2)  # -> Start, End
vec2pt = Vector2Pt(PointA=end.Start, PointB=end.End, Unitize=False)  # -> Vector, Length
deplane = DeconstructPlane(Plane=pln_2)  # -> Origin, XAxis, YAxis, ZAxis
angle = Angle(VectorA=vec2pt.Vector, VectorB=deplane.ZAxis)  # -> Angle, Reflex
end_2 = EndPoints(Curve=line_2)  # -> Start, End
len = Length(Curve=line_2)
guide_vector_vertical = Vector(deplane.XAxis)
guide_vector_angled = Vector(deplane.ZAxis)
# Sort out Beams parallel to given plane Z
larger = LargerThan(FirstNumber=angle.Angle, SecondNumber="0.01")  # -> LargerThan, OrEqualTo
merge = Merge(Data1=guide_vector_vertical, Data2=guide_vector_angled)
item = ListItem(List=merge, Index=graft(larger.LargerThan), Wrap=True)  # -> flatten(Item)
xprod = CrossProduct(VectorA=vec2pt.Vector, VectorB=item, Unitize=False)  # -> Vector, Length
pl = ConstructPlane(Origin=end_2.Start, XAxis=vec2pt.Vector, YAxis=xprod.Vector)
division = Division(A=height_2, B=2)
division_2 = Division(A=width_2, B=2)

neg = Negative(Value=division)
neg_2 = Negative(Value=division_2)
deplane_2 = DeconstructPlane(Plane=pl)  # -> Origin, XAxis, YAxis, ZAxis
amp = Amplitude(Vector=deplane_2.YAxis, Amplitude=neg)
amp_2 = Amplitude(Vector=deplane_2.ZAxis, Amplitude=neg_2)
addition = Addition(A=amp, B=amp_2)
move = Move(Geometry=pl, Motion=addition)  # -> Geometry, Transform

length = ClusterOutput(len)
plane = ClusterOutput(move.Geometry)

lng = ListLength(List=pl)
series = Series(Start=0, Step=1, Count=lng)
int = Integer(series)
concat = Concatenate(FragmentA="b", FragmentB=int)

name = ClusterOutput(concat)
