# Grasshopper definition Process Design with Diagonals.gh (Grasshopper 1.0.7)
# plug-ins: Human

# ----
# Reload Python Modules (if Module Code is Changed)
python_module_to_reload = Panel("""compas
compas_fab
roslibpy
integral_timber_joints""")
# Development Tools
reload = Button()
py = PythonScript(reload_module_button=reload, module_names=python_module_to_reload)  # inputs module_names: list
# ---------- py: Python ----------
import compas_ghpython
from compas_ghpython import unload_modules
if reload_module_button:
    for module in module_names:
        unload_modules(module)
# ---------- end py ----------

# ----
# Check Path and Environment
compas_version = GhPythonScript()  # -> out, compas_version, compas_fab_version, compas_path, compas_fab_path, compas_env_name, python_directory
# ---------- compas_version: Python ----------
__author__ = "leungp"
__version__ = "2020.04.20"

import rhinoscriptsyntax as rs
import compas
import compas_fab
compas_version  = compas.__version__
compas_fab_version = compas_fab.__version__
import os
compas_path = os.path.abspath(compas.__file__)
compas_fab_path = os.path.abspath(compas_fab.__file__)

import compas_bootstrapper
compas_env_name = compas_bootstrapper.ENVIRONMENT_NAME
python_directory = compas_bootstrapper.PYTHON_DIRECTORY
# ---------- end compas_version ----------
compas_environment_name = Panel(compas_version.compas_env_name)
compas_version_2 = Panel(compas_version.compas_version)
compas_fab_version = Panel(compas_version.compas_fab_version)
compas_path = Panel(compas_version.compas_path)
compas_fab_path = Panel(compas_version.compas_fab_path)
python_directory = Panel(compas_version.python_directory)

# ----
# Gripper Orientation
# (vector_grasp)
button = Button()
button_2 = Button()
button_3 = Button()
button_4 = Button()
button_5 = Button()
button_6 = Button()
interactive_vec_button = GhPythonScript(x_pos=button, x_neg=button_2, y_pos=button_3, y_neg=button_4, z_pos=button_5, z_neg=button_6)  # -> output
# ---------- interactive_vec_button: Python ----------
from Rhino.Geometry import Vector3d

if x_pos: output = Vector3d(1,0,0)
if x_neg: output = Vector3d(-1,0,0)
if y_pos: output = Vector3d(0,1,0)
if y_neg: output = Vector3d(0,-1,0)
if z_pos: output = Vector3d(0,0,1)
if z_neg: output = Vector3d(0,0,-1)
# ---------- end interactive_vec_button ----------

# ----
# Grasp Position
move_towards_end = Button()
move_towards_start = Button()
reset_to_middle = Button()

# ----
# Clamp Orientation
# vector_jawapproach
button_7 = Button()
button_8 = Button()
button_9 = Button()
button_10 = Button()
button_11 = Button()
button_12 = Button()
interactive_vec_button_2 = GhPythonScript(x_pos=button_8, x_neg=button_7, y_pos=button_10, y_neg=button_9, z_pos=button_12, z_neg=button_11)  # -> output; same code as interactive_vec_button

# ----
# Gripper Type
long_gripper_pg1 = Button()
short_gripper_pg2 = Button()

reload_process_from_disk = Button()
enable_interactive_selection_disable_to = BooleanToggle(True)  # "Enable Interactive Selection (disable to resume normal Rhino function)"
update_tools_definiations_only = BooleanToggle(False)

# ----
# Load Clamps
tool_definition_file_location = Panel("tools/CL3.json")
tool_definition_file_location_2 = Panel("tools/CL3M.json")
load_tool = LoadTool(filename=tool_definition_file_location)  # -> warn_col, warn_msg, tool_2
load_tool_2 = LoadTool(filename=tool_definition_file_location_2)  # -> warn_col, warn_msg, tool_2
legend = Legend(Colour=load_tool.warn_col, Tags=load_tool.warn_msg, LegendType=2)
legend_2 = Legend(Colour=load_tool_2.warn_col, Tags=load_tool_2.warn_msg, LegendType=2)

# ----
# Load Grippers
tool_definition_file_location_3 = Panel("tools/PG1000.json")
tool_definition_file_location_4 = Panel("tools/PG500.json")
load_tool_3 = LoadTool(filename=tool_definition_file_location_3)  # -> warn_col, warn_msg, tool_2
load_tool_4 = LoadTool(filename=tool_definition_file_location_4)  # -> warn_col, warn_msg, tool_2
legend_3 = Legend(Colour=load_tool_3.warn_col, Tags=load_tool_3.warn_msg, LegendType=2)
legend_4 = Legend(Colour=load_tool_4.warn_col, Tags=load_tool_4.warn_msg, LegendType=2)

# ----
# Pickup Station
pickup_station_corner = Point(<point referenced from the Rhino model>)
lift_off_vector = Slider(50, range=0..100)
pickup_station_collision_mesh = Geometry([<brep referenced from the Rhino model> x3])
xy_plane = XYPlane(Origin=pickup_station_corner)
mjoin = MeshJoin(Meshes=pickup_station_collision_mesh)
unit_z = UnitZ(Factor=lift_off_vector)
pickup_station = GhPythonScript(alignment_frame=xy_plane, pickup_retract_vector=unit_z, collision_mesh=mjoin)  # -> out, pickup_station; inputs collision_mesh: Mesh
# ---------- pickup_station: Python ----------
from integral_timber_joints.tools import PickupStation
from compas_rhino.geometry import RhinoPlane, RhinoVector, RhinoMesh

alignment_frame = RhinoPlane.from_geometry(alignment_frame).to_compas()
pickup_retract_vector = RhinoVector.from_geometry(pickup_retract_vector).to_compas()
pickup_station = PickupStation(alignment_frame, pickup_retract_vector)
pickup_station.collision_mesh = RhinoMesh.from_geometry(collision_mesh).to_compas()
# ---------- end pickup_station ----------

# ----
# Create Process from Assembly + Tools
# Load assembly file
auto_json_path = GhPythonScript()  # -> json_path
# ---------- auto_json_path: Python ----------
from Rhino.RhinoDoc import ActiveDoc
import os
json_path = os.path.splitext(ActiveDoc.Path)[0] + "_assembly.json"
# ---------- end auto_json_path ----------
file_path = FilePath(auto_json_path)
json_unpickle = GhPythonScript(json_path=file_path, enable=True)  # -> warn_col, warn_msg, data; inputs enable: Boolean
# ---------- json_unpickle: Python ----------
import jsonpickle
import os
import datetime

if enable:
    exist = os.path.exists(json_path)
    if exist:
        f = open(json_path, 'r')
        json_str = f.read()
        data = jsonpickle.decode(json_str, keys=True)
        f.close()
        c_time = datetime.datetime.fromtimestamp(os.path.getmtime(json_path))

        warn_col = "lime"    
        warn_msg = "Assembly File loaded with %s Beams.\n File Modified on %s." % (len(list(data.beams())), c_time)
    else:
        warn_col = "orange"    
        warn_msg = "Assembly File not created yet"
# ---------- end json_unpickle ----------
legend_5 = Legend(Colour=json_unpickle.warn_col, Tags=json_unpickle.warn_msg, LegendType=1)

tool_definition_file_location_5 = Panel("tools/TC1.json")
tool_definition_file_location_6 = Panel("tools/ROB_WRIST.json")
load_mesh = LoadTool(filename=tool_definition_file_location_6)  # -> warn_col, warn_msg, tool_2
load_tool_5 = LoadTool(filename=tool_definition_file_location_5)  # -> warn_col, warn_msg, tool_2
legend_6 = Legend(Colour=load_mesh.warn_col, Tags=load_mesh.warn_msg, LegendType=2)
legend_7 = Legend(Colour=load_tool_5.warn_col, Tags=load_tool_5.warn_msg, LegendType=2)

flip_all_lap_joints_to_previous_beams = Button()
panel = Panel(auto_json_path)
panel_2 = Panel("_prepathplan.json")  # disabled
long_gripper_type = Panel("PG1000")
short_gripper_type = Panel("PG500")
filter = StreamFilter(Gate=long_gripper_pg1, Stream1=long_gripper_type)
filter_2 = StreamFilter(Gate=short_gripper_pg2, Stream1=short_gripper_type)
button_13 = Button()  # disabled
merge = Merge(Data1=filter, Data2=filter_2)

unique_tool_id = Panel("g2")
unique_tool_id_2 = Panel("g1")
pt = Point(<point referenced from the Rhino model>)
pt_2 = Point(<point referenced from the Rhino model>)
pl = ConstructPlane(Origin=pt, XAxis=Vector(-2.098851206, 0, 0), YAxis=Vector(0, 1, 0))
pl_2 = ConstructPlane(Origin=pt_2, XAxis=Vector(-2.098851206, 0, 0), YAxis=Vector(0, 1, 0))
clamp_instance = GhPythonScript(robot_model=load_tool_4.tool_2, clamp_id=unique_tool_id, storage_location_by_tcp=pl)  # -> out, robot_model_out, visual; inputs storage_location_by_tcp: Plane
# ---------- clamp_instance: Python ----------
from compas_rhino.geometry import RhinoPlane

# Deep copy should be performed before editing
robot_model_out = robot_model.copy()

# Set the instance properity
robot_model_out.set_current_frame_from_tcp(RhinoPlane.from_geometry(storage_location_by_tcp).to_compas())
robot_model_out.tool_storage_frame = robot_model_out.current_frame
robot_model_out.name = clamp_id

# Preview
from compas_ghpython.helpers import mesh_draw
from copy import deepcopy
visual = [mesh_draw(mesh) for mesh in deepcopy(robot_model_out).draw_visuals()]
# ---------- end clamp_instance ----------
clamp_instance_2 = GhPythonScript(robot_model=load_tool_3.tool_2, clamp_id=unique_tool_id_2, storage_location_by_tcp=pl_2)  # -> out, robot_model_out, visual; inputs storage_location_by_tcp: Plane; same code as clamp_instance
merge_2 = Merge(Data1=clamp_instance_2.robot_model_out, Data2=clamp_instance.robot_model_out)

bake_with_sequencename = Button()
environment_layer = GeometryPipeline(
    GroupByLayer=False,
    GroupByType=False,
    IncludeHidden=True,
    IncludeLocked=True,
    LayerFilter="Environment",
    NameFilter="*",
    SublayerFiltering=True,
    TypeFilter=1073741848)
bake_with_beamname = Button()
joint_clamp_matching = Panel("Joint_90lap,CL1")
mesh_brep = MeshBrep(
    Brep=environment_layer,
    Settings={GridMaxCount=0, GridMinCount=16, JaggedSeams=False, MaxEdgeLength=0, MinEdgeLength=0.0001, MinTolerance=0, Refine=True, RefineAngle=0, RelativeTolerance=0.65, SimplePlanes=True, Tolerance=0})
font = Panel("DejaVu Sans Mono")
show_collision = BooleanToggle(False)

# ----
# Save Edits
save_process_to_disk = Button()
process_path = GhPythonScript()  # -> path
# ---------- process_path: Python ----------
from Rhino.RhinoDoc import ActiveDoc
import os
path = os.path.splitext(ActiveDoc.Path)[0] + "_process.json"
print path
# ---------- end process_path ----------

# ----
# Load Proecss file
process_path_2 = GhPythonScript()  # -> path; same code as process_path
file_path_2 = FilePath(process_path_2)

json_unpickle_2 = GhPythonScript(path=file_path_2, enable=True, reload=reload_process_from_disk)  # -> warn_col, warn_msg, data; inputs enable: Boolean
# ---------- json_unpickle_2: Python ----------
import jsonpickle
import os
import datetime
if enable and not reload:
    exist = os.path.exists(path)
    if exist:
        with open(path, 'r') as f:
            data = jsonpickle.decode(f.read(), keys=True)
        c_time = datetime.datetime.fromtimestamp(os.path.getmtime(path))
        warn_col = "lime"
        warn_msg = "Process File loaded with %s Beams, %s Clamps, %s Grippers.\n File Modified on %s." % (len(list(data.assembly.beams())), len(list(data.clamps)), len(list(data.grippers)), c_time)
    else:
        warn_col = "orange"    
        warn_msg = "Process File not created yet"
# ---------- end json_unpickle_2 ----------
legend_8 = Legend(Colour=json_unpickle_2.warn_col, Tags=json_unpickle_2.warn_msg, LegendType=2)

process = Data(json_unpickle_2.data)

change_joint_type = GhPythonScript(process=process, activate_flip=flip_all_lap_joints_to_previous_beams)  # -> out, assembly_out; inputs activate_flip: Boolean
# ---------- change_joint_type: Python ----------
from compas_ghpython.helpers import mesh_draw

from integral_timber_joints.geometry import Joint_90lap
from integral_timber_joints.geometry import Joint_90lap_from_beam_beam_intersection

assembly_out = assembly
beam_id = selected_beam_id

# Interactively change joint definition
if activate_flip:
    if beam_id is not None:
        beams_to_update = [beam_id]
        # Loop though neighbous and swap joint
        for neighbour_id in assembly.get_already_built_neighbors(beam_id):
#            beam1 = assembly_out.beam(beam_id)
#            beam2 = assembly_out.beam(neighbour_id)
            
            assembly_out.joint((beam_id , neighbour_id)).swap_faceid_to_opposite_face()
            assembly_out.joint((neighbour_id , beam_id)).swap_faceid_to_opposite_face()
            
#            assembly_out.add_joint_pair(joint1, joint2, beam_id, neighbour_id)
            beams_to_update.append(neighbour_id)
        # Update Mesh           
        for beam_id in beams_to_update:         
            assembly_out.update_beam_mesh_with_joints(beam_id)
# ---------- end change_joint_type ----------

show_tools_in_storage = BooleanToggle(False)
process_tools_in_storage = GhPythonScript(process=process, enable=show_tools_in_storage)  # -> out, tool_meshes; inputs enable: Boolean
# ---------- process_tools_in_storage: Python ----------
import itertools
from Rhino.Geometry import Mesh as RhinoMesh
from compas_ghpython.helpers import mesh_draw

tool_meshes = []
if enable:
    for tool in itertools.chain(process.clamps + process.grippers):
        # Set Tool state
        tool = tool.copy()
        tool.current_frame = tool.tool_storage_frame
        
        # Set State
        if hasattr(tool,"gripper_jaw_limits"):
            limits = tool.gripper_jaw_limits
            tool.gripper_jaw_position = limits[0]
            
        if hasattr(tool,"clamp_jaw_limits"):
            limits = tool.clamp_jaw_limits
            tool.clamp_jaw_position = limits[0]
        
        # Draw Rhino Mesh
        joinedMesh = RhinoMesh()
        meshes = [joinedMesh.Append(mesh_draw(m)) for m in tool.draw_visuals()]
        tool_meshes.append(joinedMesh)
# ---------- end process_tools_in_storage ----------
show_environment_meshes = BooleanToggle(False)
process_environment_meshes = GhPythonScript(process=process, enable=show_environment_meshes)  # -> out, environment_meshes
# ---------- process_environment_meshes: Python ----------
from Rhino.Geometry import Mesh as RhinoMesh
from compas_ghpython.helpers import mesh_draw

environment_meshes = []
if enable:
    for mesh in process.environment_meshes:
        environment_meshes.append(mesh_draw(mesh))
# ---------- end process_environment_meshes ----------

# ----
# Visualize Assembly - Clickable Mesh
# (Perspective Viewport)
ghpython_script = GhPythonScript(process=process, enable=True)  # -> out, beam_meshes, beam_ids
# ---------- ghpython_script: Python ----------
from compas_ghpython.helpers import mesh_draw

assembly = process.assembly
beam_meshes = []
beam_ids = []
if enable:
    for beam_id in assembly.beam_ids():
        beam = assembly.beam(beam_id)
        beam_meshes.append(mesh_draw(beam.cached_mesh))
        beam_ids.append(beam_id)
# ---------- end ghpython_script ----------
clickable_mesh = ClickableMesh(Enable=enable_interactive_selection_disable_to, Meshes=ghpython_script.beam_meshes)  # -> SelectedMeshes, SelectedIndices, MouseLine
cull_index = CullIndex(List=ghpython_script.beam_meshes, Indices=clickable_mesh.SelectedIndices, Wrap=True)
list_item = ListItem(List=ghpython_script.beam_meshes, Index=clickable_mesh.SelectedIndices, Wrap=True)
list_item_2 = ListItem(List=ghpython_script.beam_ids, Index=clickable_mesh.SelectedIndices, Wrap=True)
filter_3 = StreamFilter(Gate=enable_interactive_selection_disable_to, Stream1=list_item_2)
selected_beam_id = Text(filter_3)
custom_preview = CustomPreview(Geometry=list_item, Material=ColourSwatch(SwatchColor=RGBA(27, 170, 209, 181)))
custom_preview_2 = CustomPreview(Geometry=cull_index, Material=ColourSwatch(SwatchColor=RGBA(219, 219, 219, 103)))
selected_beam = Panel(selected_beam_id)

# ----
# Compute Clamp Orientation by Custom Guide
selected_beam_id_2 = Text(selected_beam_id)
change_clamp_orientation = GhPythonScript(process=process, beam_id=selected_beam_id_2, guide_vector=interactive_vec_button_2)  # -> out, process_out; inputs guide_vector: Vector3d
# ---------- change_clamp_orientation: Python ----------
#from compas_ghpython import unload_modules
#unload_modules("integral_timber_joints")

from compas_rhino.geometry import RhinoVector

# Process object by default through the component unmodified.
process_out = process

# Interactive interface - guide_vector is None when UI Buttons are not pressed

if guide_vector is not None and beam_id is not None:

    # Set guide vector according to input
    guide_vector_compas = RhinoVector.from_geometry(guide_vector).to_compas()
    process_out.assembly.set_beam_attribute(beam_id, 'design_guide_vector_jawapproach', guide_vector_compas)
    print("design_guide_vector_jawapproach = %s" % guide_vector_compas)
    
    # Recompute clamp orientation
    clamp_orientations = process_out.search_valid_clamp_orientation_with_guiding_vector(beam_id)
    print("clamp_orientations = %s" % clamp_orientations)

    # Recompute Jaw Approach Vector
    #    assembly_vector_jawapproach = process_out.search_valid_jawapproach_vector_prioritizing_guide_vector(beam_id)
    assembly_vector_jawapproach = process_out.search_valid_jawapproach_vector_prioritizing_beam_side(beam_id)
    
    print("assembly_vector_jawapproach = %s" % assembly_vector_jawapproach)
    
    # Recompute retract positions of clamps
    process.compute_clamp_attachapproach_attachretract_detachapproach(beam_id)
    process.compute_clamp_detachretract(beam_id)
# ---------- end change_clamp_orientation ----------

# ----
# Compute Grasp Face by Custom Guide
selected_beam_id_3 = Text(selected_beam_id)
change_gripper_orientation = GhPythonScript(process=process, beam_id=selected_beam_id_3, guide_vector=interactive_vec_button)  # -> out, process_out
# ---------- change_gripper_orientation: Python ----------
#from compas_ghpython import unload_modules
#unload_modules("integral_timber_joints")

from compas.geometry import Vector

from compas_rhino.geometry import RhinoVector

# Process object by default through the component unmodified.
process_out = process

# Interactive interface - guide_vector is None when UI Buttons are not pressed
# In that case, process should simply pass through unmodified.
if guide_vector is not None and beam_id is not None:
    assembly = process.assembly
    beam = assembly.beam(beam_id)
    
    # Set guide vector according to input
    guide_vector_compas = RhinoVector.from_geometry(guide_vector).to_compas()
    assembly.set_beam_attribute(beam_id, "design_guide_vector_grasp", guide_vector_compas)

    # Recompute best clamp face and update grasp frame
    gripper_grasp_face = process.search_grasp_face_from_guide_vector_dir(beam_id)
    gripper_grasp_dist_from_start = assembly.get_beam_attribute(beam_id, "gripper_grasp_dist_from_start")
    gripper_tcp_in_ocf = beam.grasp_frame_ocf(gripper_grasp_face, gripper_grasp_dist_from_start)

    assembly.set_beam_attribute(beam_id, "gripper_tcp_in_ocf", gripper_tcp_in_ocf)
    
    # Recompute Pickup Alignment at Pickup Station
    process.compute_storage_location_at_corner_aligning_pickup_location(beam_id)
    
    # Recompute approach and retract regarding gripper 
    process.compute_beam_storageapproach_and_finalretract(beam_id)
    process.compute_beam_storageretract(beam_id)
# ---------- end change_gripper_orientation ----------

json_pickle = GhPythonScript(stuff=change_gripper_orientation.process_out, path=process_path, output=save_process_to_disk)  # -> out; inputs output: Boolean
# ---------- json_pickle: Python ----------
import integral_timber_joints
from integral_timber_joints.process import RobotClampAssemblyProcess

if output:
    import jsonpickle
    json_str = jsonpickle.encode(stuff, keys= True)
    print ("out json_str len:" , len(json_str))
    with open(path, 'w') as f:
        f.write(json_str)
# ---------- end json_pickle ----------

# ----
# Select Gripper Type
selected_beam_id_4 = Text(selected_beam_id)
change_clamp_type = GhPythonScript(process=process, beam_id=selected_beam_id_4, gripper_type=merge)  # -> out, process_out
# ---------- change_clamp_type: Python ----------
#from compas_ghpython import unload_modules
#unload_modules("integral_timber_joints")

from compas.geometry import Vector

from compas_rhino.geometry import RhinoVector

# Process object by default through the component unmodified.
process_out = process

# Interactive interface - clamp_type is None when UI Buttons are not pressed
# In that case, process should simply pass through unmodified.
if gripper_type is not None and beam_id is not None:
    assembly = process.assembly
    beam = assembly.beam(beam_id)
    
    # Change clamp type
    assembly.set_beam_attribute(beam_id, "gripper_type", gripper_type)
    
    # Recompute best clamp face and update grasp frame
    gripper_grasp_face = process.search_grasp_face_from_guide_vector_dir(beam_id)
    gripper_grasp_dist_from_start = assembly.get_beam_attribute(beam_id, "gripper_grasp_dist_from_start")
    gripper_tcp_in_ocf = beam.grasp_frame_ocf(gripper_grasp_face, gripper_grasp_dist_from_start)
    assembly.set_beam_attribute(beam_id, "gripper_tcp_in_ocf", gripper_tcp_in_ocf)
    
    # Recompute Pickup Alignment at Pickup Station
    process.compute_storage_location_at_corner_aligning_pickup_location(beam_id)
    
    # Recompute approach and retract regarding gripper 
    process.compute_beam_storageapproach_and_finalretract(beam_id)
    process.compute_beam_storageretract(beam_id)
# ---------- end change_clamp_type ----------

# ----
# Shift Gripper Position
selected_beam_id_5 = Text(selected_beam_id)
change_clamp_type_2 = GhPythonScript(
    process=change_clamp_type.process_out,
    beam_id=selected_beam_id_5,
    shift_start=move_towards_start,
    reset_middle=reset_to_middle,
    shift_end=move_towards_end)  # -> out, process_out
# ---------- change_clamp_type_2: Python ----------
#from compas_ghpython import unload_modules
#unload_modules("integral_timber_joints")

# Process object by default through the component unmodified.
process_out = process

# Interactive interface - clamp_type is None when UI Buttons are not pressed
# In that case, process should simply pass through unmodified.
if (shift_start or reset_middle or shift_end) and beam_id is not None:
    assembly = process.assembly
    beam = assembly.beam(beam_id)
    
    gripper_grasp_face = assembly.get_beam_attribute(beam_id, "gripper_grasp_face")
    gripper_grasp_dist_from_start = assembly.get_beam_attribute(beam_id, "gripper_grasp_dist_from_start")
    
    if shift_start:
        gripper_grasp_dist_from_start -= 50
    if shift_end:
        gripper_grasp_dist_from_start += 50
    if reset_middle:
        gripper_grasp_dist_from_start = beam.length / 2

    # Recompute beam grasp_frame        
    assembly.set_beam_attribute(beam_id, "gripper_grasp_dist_from_start", gripper_grasp_dist_from_start)
    gripper_tcp_in_ocf = beam.grasp_frame_ocf(gripper_grasp_face, gripper_grasp_dist_from_start)
    assembly.set_beam_attribute(beam_id, "gripper_tcp_in_ocf", gripper_tcp_in_ocf)
    
    # Recompute Pickup Alignment at Pickup Station
    process.compute_storage_location_at_corner_aligning_pickup_location(beam_id)
    
    # Recompute approach and retract regarding gripper 
    process.compute_beam_storageapproach_and_finalretract(beam_id)
    process.compute_beam_storageretract(beam_id)
# ---------- end change_clamp_type_2 ----------

# ----
# Update Management
# Trigger Downstream
merge_3 = Merge(
    Data1=change_clamp_orientation.process_out,
    Data2=change_gripper_orientation.process_out,
    Data3=change_clamp_type.process_out,
    Data4=change_clamp_type_2.process_out)
item = ListItem(List=merge_3, Index=0, Wrap=True)

# ----
# Avoid downstream on button down
# pressed state
merge_4 = Merge(
    Data1=button_7,
    Data2=button_8,
    Data3=button_9,
    Data4=button_10,
    Data5=button_11,
    Data6=button_12,
    Data7=button,
    Data8=button_2,
    Data9=button_3,
    Data10=button_4,
    Data11=button_5,
    Data12=button_6,
    Data13=long_gripper_pg1,
    Data14=short_gripper_pg2,
    Data15=move_towards_start,
    Data16=move_towards_end)  # -> flatten(Result)
ma = MassAddition(Input=merge_4)  # -> Result, PartialResults
filter_4 = StreamFilter(Gate=ma.Result, Stream0=item)

# ----
# Visualize Assembly Key Location
# (PerspectiveAlt Viewport)
autoplay_loops = BooleanToggle(False)
process_2 = Data(filter_4)
position_of_clamp = Slider(11, range=0..12)
timer = Timer(TimerInterval=500, Target=cluster)  # disabled
panel_3 = Panel("""0,0
0,1
0,2
0,3
1,3
2,3
3,3
4,3
5,4
6,4
6,5
6,6
6,7""")
cluster = Cluster(bool=invert(autoplay_loops), L=panel_3, override=position_of_clamp)
int = Integer(cluster)
list_item_3 = ListItem(List=panel_3, Index=int, Wrap=True)
split = TextSplit(Text=list_item_3, Separators=",")
selected_beam_id_6 = Text(selected_beam_id)
item_2 = ListItem(List=split, Index=0, Wrap=True)  # -> Item, Item1
int_gripper_pos_index = Integer(item_2.Item)
int_clamp_pos_index = Integer(item_2.Item1)
visualize_beams_grippers = GhPythonScript(
    process=process_2,
    beam_id=selected_beam_id_6,
    previous_beams_color=ColourSwatch(SwatchColor=RGB(153, 142, 142)),
    current_beam_color=ColourSwatch(SwatchColor=RGB(107, 181, 51)),
    current_inclamp_color=ColourSwatch(SwatchColor=RGB(188, 191, 0)),
    gripper_color=ColourSwatch(SwatchColor=RGB(199, 165, 101)))  # -> out, previous_beams, current_beam, gripper; inputs previous_beams_color: Color, current_beam_color: Color
# ---------- visualize_beams_grippers: Python ----------
__author__ = "leungp"
__version__ = "2020.02.19"

from compas_ghpython.helpers import mesh_draw
from compas.geometry import Transformation
from compas.datastructures import meshes_join

from Rhino.Geometry import Mesh as RhinoMesh
assembly = process.assembly

# If user has no selection, assume the last beam is picked.
if beam_id is None: beam_id = assembly.sequence[-1]

##########################
# Previous Beams
##########################

# Collect the previously-assembled beam(s)
previous_beams = []

for this_beam_id in assembly.get_already_built_beams(beam_id):
    beam = assembly.beam(this_beam_id)
    previous_beams.append(mesh_draw(beam.cached_mesh, color = previous_beams_color))

###################################
# Current Beam (Different Location)
###################################

# Select the current beam
beam = assembly.beam(beam_id)

# Translate the beam to various location and display
current_beam = []
current_beam_assembly_wcf_final = mesh_draw(beam.cached_mesh, color = current_beam_color)

def join_meshes(meshes):
    if len(meshes) == 1 : return meshes [0]
    

def draw_beam_at(attribute_name):
    T = assembly.get_beam_transformaion_to(beam_id, attribute_name)
    if T is not None:
        current_beam.append(mesh_draw(beam.cached_mesh.transformed(T), color = current_inclamp_color))
    else: current_beam.append(None)

draw_beam_at('assembly_wcf_storage') # Beam does not go to 'assembly_wcf_storageapproach'
draw_beam_at('assembly_wcf_storage')
draw_beam_at('assembly_wcf_storageretract')
if assembly.get_beam_attribute(beam_id, 'assembly_wcf_inclampapproach') is not None:
    draw_beam_at('assembly_wcf_inclampapproach')
else:
    draw_beam_at('assembly_wcf_inclamp')
draw_beam_at('assembly_wcf_inclamp')
draw_beam_at('assembly_wcf_final')
draw_beam_at('assembly_wcf_final') # Beam does not go to 'assembly_wcf_finalretract'

###################################
# Clamps (multiple clamps)
###################################

clamps = []
# Visualize clamps
for neighbour_id in assembly.get_already_built_neighbors(beam_id):
    joint_id = (neighbour_id, beam_id)
    clamp_wcf_final = assembly.get_joint_attribute(joint_id, 'clamp_wcf_final')
    print (clamp_wcf_final)
    clamp_type = assembly.get_joint_attribute(joint_id, 'clamp_type')
    clamp = process.get_one_clamp_by_type(clamp_type).copy()
    clamp.set_current_frame_from_tcp(clamp_wcf_final)
    clamp.clamp_jaw_position = 120
    clamp.gripper_jaw_position = 0
    clamps.append(clamp)
    print (clamp)
    

###################################
# Gripper (Different Location)
###################################

gripper = []
# Get Gripper and move it to the beam's frame
gripper_type = assembly.get_beam_attribute(beam_id, 'gripper_type')
_gripper = process.get_one_gripper_by_type(gripper_type)

#gripper_tcp_in_ocf = assembly.get_beam_attribute(beam_id, "gripper_tcp_in_ocf")
#gripper_tcp_in_wcf = gripper_tcp_in_ocf.transformed(Transformation.from_frame(beam.frame))

def draw_gripper_at(attribute_name, gripper_open = True, mesh_join_by_rhino = True):
    gripper_t0cp = process.get_gripper_t0cp_for_beam_at(beam_id, attribute_name)
    if gripper_t0cp is not None:
        _gripper.current_frame = gripper_t0cp
        if gripper_open: _gripper.open_gripper()
        else: _gripper.close_gripper()
        # Two different way to join meshes
        if mesh_join_by_rhino:
            joinedMesh = RhinoMesh()
            meshes = [joinedMesh.Append(mesh_draw(m,  color = gripper_color)) for m in _gripper.draw_visuals()]
            gripper.append(joinedMesh)
        else:
            meshes = meshes_join(_gripper.draw_visuals())
            gripper.append(mesh_draw(meshes,  color = gripper_color))
        
    else: gripper.append(None)
    
draw_gripper_at('assembly_wcf_storageapproach', True)
draw_gripper_at('assembly_wcf_storage', True)
draw_gripper_at('assembly_wcf_storageretract', False)
if assembly.get_beam_attribute(beam_id, 'assembly_wcf_inclampapproach') is not None:
    draw_gripper_at('assembly_wcf_inclampapproach', False)
else:
    draw_gripper_at('assembly_wcf_inclamp', False)
draw_gripper_at('assembly_wcf_inclamp', False)
draw_gripper_at('assembly_wcf_final', False)
draw_gripper_at('assembly_wcf_finalretract', True)
# ---------- end visualize_beams_grippers ----------
visualize_clamps = GhPythonScript(
    process=process_2,
    beam_id=selected_beam_id_6,
    position=int_clamp_pos_index,
    clamp_color=ColourSwatch(SwatchColor=RGB(51, 181, 125)),
    toolchanger_color=ColourSwatch(SwatchColor=RGB(181, 155, 51)),
    robot_color=ColourSwatch(SwatchColor=RGB(120, 104, 41)))  # -> out, clamps_mesh, toolchanger_mesh, robot_mesh
# ---------- visualize_clamps: Python ----------
from Rhino.Geometry import Mesh as RhinoMesh
from compas_ghpython.utilities import list_to_ghtree
from compas.geometry import Frame, Transformation
import jsonpickle

from compas_ghpython.helpers import mesh_draw

###################################
# Clamps (multiple clamps)
###################################

assembly = process.assembly

# If user has no selection, assume the last beam is picked.
if beam_id is None: beam_id = assembly.sequence[-1]

joint_ids = assembly.get_joint_ids_of_beam_clamps(beam_id)
clamps = [process.get_clamp_of_joint(joint_id, set_position_to_clamp_wcf_final=False) for joint_id in joint_ids]

toolchanger = process.robot_toolchanger
robot_wrist = process.robot_wrist_collision_mesh

clamps_mesh = []
toolchanger_mesh = []
robot_mesh = []

def draw_clamps_at(attribute_name, gripper_open, clamp_open, robot_attached = False):
    for joint_id , clamp in zip(joint_ids, clamps):
        # Retrive the target location frame
        clamp_t0cp = process.assembly.get_joint_attribute(joint_id, attribute_name)
        if clamp_t0cp is not None:
            # Set Clamp State and draw clamp
            clamp.current_frame = clamp_t0cp
            if gripper_open: clamp.open_gripper()
            else: clamp.close_gripper()
            if clamp_open: clamp.open_clamp()
            else: clamp.close_clamp()
            
            _ = [clamps_mesh.append(mesh_draw(m,  color = clamp_color)) for m in clamp.draw_visuals()]
            
            
            if robot_attached:
                # Set Toolchanger State and draw
                toolchanger_t0cp = toolchanger.set_current_frame_from_tcp(clamp_t0cp)
                _ = [toolchanger_mesh.append(mesh_draw(m,  color = toolchanger_color)) for m in toolchanger.draw_visuals()]
                
                # Robot Wrist is drawn at toolchanger_t0cp
                T = Transformation.from_frame_to_frame(Frame.worldXY(), toolchanger_t0cp)
                robot_mesh.append(mesh_draw(robot_wrist.transformed(T),  color = robot_color)) 

        else: clamps_mesh.append(None)

if position == 0: draw_clamps_at('clamp_wcf_attachapproach1', True, True, robot_attached = True)
if position == 1: draw_clamps_at('clamp_wcf_attachapproach2', True, True, robot_attached = True)
if position == 2: draw_clamps_at('clamp_wcf_final', True, True, robot_attached = True)
if position == 3: draw_clamps_at('clamp_wcf_final', False, True)
if position == 4: draw_clamps_at('clamp_wcf_final', False, False)
if position == 5: draw_clamps_at('clamp_wcf_final', True, True, robot_attached = True)
if position == 6: draw_clamps_at('clamp_wcf_detachretract1', True, True, robot_attached = True)
if position == 7: draw_clamps_at('clamp_wcf_detachretract2', True, True, robot_attached = True)
# ---------- end visualize_clamps ----------
list_item_4 = ListItem(List=visualize_beams_grippers.current_beam, Index=int_gripper_pos_index, Wrap=True)
list_item_5 = ListItem(List=visualize_beams_grippers.gripper, Index=int_gripper_pos_index, Wrap=True)
custom_preview_3 = CustomPreview(Geometry=list_item_4, Material=ColourSwatch(SwatchColor=RGBA(255, 255, 255, 171)))
custom_preview_4 = CustomPreview(Geometry=list_item_5, Material=ColourSwatch(SwatchColor=RGBA(255, 255, 255, 171)))
custom_preview_5 = CustomPreview(Geometry=visualize_clamps.clamps_mesh, Material=ColourSwatch(SwatchColor=RGB(29, 105, 72)))
custom_preview_6 = CustomPreview(Geometry=visualize_beams_grippers.previous_beams, Material=ColourSwatch(SwatchColor=RGBA(219, 219, 219, 103)))

# ----
# Global Checks
clamp_check = GhPythonScript(process=process_2)  # -> out
# ---------- clamp_check: Python ----------
from Rhino.Geometry import Mesh as RhinoMesh
from compas_ghpython.utilities import list_to_ghtree
from compas.geometry import Frame, Transformation
import jsonpickle

from compas_ghpython.helpers import mesh_draw

###################################
# Clamps (multiple clamps)
###################################

assembly = process.assembly

for beam_id in assembly.sequence:

    joint_ids = assembly.get_joint_ids_of_beam_clamps(beam_id)
    clamps = [process.get_clamp_of_joint(joint_id, set_position_to_clamp_wcf_final=False) for joint_id in joint_ids]
    clamp_types = [clamp.type_name for clamp in clamps]
    print ("Beam %s needs %s clamps: %s " % (beam_id, len(clamp_types), clamp_types))
# ---------- end clamp_check ----------
panel_4 = Panel(clamp_check)

# ----
# Bake Breps
beam_brep = GhPythonScript(process=process_2)  # -> out, beam_breps, names, seq_names
# ---------- beam_brep: Python ----------
import Rhino.Geometry as rg
import scriptcontext as sc


def cylinder_from_2pt(pt1, pt2, radius):
    line_vector = rg.Vector3d(pt2-pt1)
    height = line_vector.Length
    cyl = rg.Cylinder(rg.Circle(rg.Plane(pt1, line_vector), radius),height)
    return rg.Brep.CreateFromCylinder(cyl, True, True)

def cmesh2rbox(mesh):
    corners_compas = mesh.vertices_attributes("xyz", None, mesh.vertices())
    corners_rhino = [rg.Point3d(*v) for v in corners_compas]
    swap = corners_rhino[5] 
    corners_rhino[5] = corners_rhino[7] 
    corners_rhino[7] = swap
    box = rg.Brep.CreateFromBox(corners_rhino)
    if box.SolidOrientation == rg.BrepSolidOrientation.Inward:
        box.Flip()
    return box



def beam_brep(assembly, beam_id):
    # Gather the beam uncut geometry
    beam = assembly.beam(beam_id)
    beam_uncut_box = cmesh2rbox(beam.draw_uncut_mesh())
    beam_brep = beam_uncut_box
    
    # Gather features for joints
    beam_features_breps = []
    for joint in assembly.get_joints_of_beam(beam_id):
        negative_mesh = joint.get_feature_mesh(beam)
        beam_features_breps.append(cmesh2rbox(negative_mesh))
    
    #holes = []
    from compas.geometry import Transformation, Frame
    # Gather features for clamps
    joint_ids = assembly.get_joint_ids_of_beam_clamps(beam_id, clamping_this_beam = False)
    for joint_id in joint_ids:
        clamp = process.get_clamp_of_joint(joint_id, set_position_to_clamp_wcf_final=True)
        f = clamp.current_tcf
        for line in clamp.gripper_drill_lines:
            T = Transformation.from_frame_to_frame(Frame.worldXY(), clamp.current_frame)
            line_wcf = line.transformed(T)
            pt1 = rg.Point3d(*list(line_wcf.start))
            pt2 = rg.Point3d(*list(line_wcf.end))
            drill_hole = cylinder_from_2pt(pt1, pt2, 5)
            beam_features_breps.append(drill_hole)
            #holes.append(drill_hole)
            
    # Gather features for grippers
    # Not implemented yet
    
    # perform the boolean operation
    if len(beam_features_breps) > 0:
        tolerance = sc.doc.ModelAbsoluteTolerance
        boolean_result = rg.Brep.CreateBooleanDifference([beam_uncut_box], beam_features_breps, tolerance)
    
    assert len(boolean_result) == 1
    return boolean_result[0]

assembly = process.assembly
beam_breps = [beam_brep(assembly, beam_id) for beam_id in assembly.sequence]
names = [beam_id for beam_id in assembly.sequence]
seq_names = ["S%s"%(num + 1) for (num, beam_id) in enumerate(assembly.sequence)]
# ---------- end beam_brep ----------
geo = Geometry(beam_brep.beam_breps)
createatts = CreateAttributes(Name=beam_brep.names, enableFullPath=False)
bake = BakeGeometry(Bake=bake_with_beamname, Geometry=geo, Attributes=createatts, DeleteOldBakes=False, PreserveTrees=False)

createatts_2 = CreateAttributes(Name=beam_brep.seq_names, enableFullPath=False)
bake_2 = BakeGeometry(Bake=bake_with_sequencename, Geometry=geo, Attributes=createatts_2, DeleteOldBakes=False, PreserveTrees=False)
ghpython_script_2 = GhPythonScript(process=process, activate=True, selected_beam_id=selected_beam_id, faces=[2, 4, 1, 3])  # -> out, tag_location, tag_text, tag_size; inputs faces: list
# ---------- ghpython_script_2: Python ----------
from compas_ghpython.utilities import draw_frame

assembly = process.assembly
tag_location = []
tag_text = []
tag_size = []

padding_factor = 0.2
size_factor = 0.6

if activate:
    if faces is None: faces = [1]
    for face_id in faces:
        for i, beam_id in enumerate(assembly.sequence):
            beam = assembly.beam(beam_id)
            face_frame = beam.reference_side_wcf(face_id)
            
            # Padding
            beam_size_min = min(beam.height, beam.width)
            padding = beam_size_min * padding_factor
            padded_location_origin = face_frame.to_world_coordinates([padding, padding , 0])
            face_frame.point = padded_location_origin
            tag_location.append(draw_frame(face_frame))
            
            # Test and Size
            tag_text.append(".%s." % (i))
            tag_size.append(beam_size_min * size_factor)
            
            # Terminate after reaching the selected beam_id
            if beam_id == selected_beam_id:
                break
# ---------- end ghpython_script_2 ----------
custom_preview_7 = CustomPreview(
    Geometry=[visualize_clamps.toolchanger_mesh, visualize_clamps.robot_mesh],
    Material=ColourSwatch(SwatchColor=RGB(194, 181, 116)))
justifiedtext3d = JustifiedText3d(
    Location=ghpython_script_2.tag_location,
    Text=ghpython_script_2.tag_text,
    Size=ghpython_script_2.tag_size,
    HorizontalAlignment=0,
    VerticalAlginment=0,
    Font=font,
    UseMeshes=False,
    Bake=False)
assembly_step = GhPythonScript(process=process_2, beam_id=selected_beam_id_6)  # -> out, previous_beams, current_beam, clamps, gripper; disabled
# ---------- assembly_step: Python ----------
__author__ = "leungp"
__version__ = "2020.02.19"

from compas_ghpython.helpers import mesh_draw
from compas.geometry import Transformation
from compas.datastructures import meshes_join

from Rhino.Geometry import Mesh as RhinoMesh
assembly = process.assembly

if beam_id is None: beam_id = assembly.sequence[-1]

##########################
# Previous Beams
##########################

# Collect the previously-assembled beam(s)
previous_beams = []
for this_beam_id in assembly.sequence:
    if this_beam_id == beam_id: break
    beam = assembly.beam(this_beam_id)
    previous_beams.append(beam.cached_mesh)

###################################
# Current Beam (Different Location)
###################################

# Select the current beam
beam = assembly.beam(beam_id)

# Translate the beam to various location and display
current_beam = []
current_beam_assembly_wcf_final = beam.cached_mesh

def join_meshes(meshes):
    if len(meshes) == 1 : return meshes [0]
    

def draw_beam_at(attribute_name):
    T = assembly.get_beam_transformaion_to(beam_id, attribute_name)
    if T is not None:
        current_beam.append(beam.cached_mesh.transformed(T))
    else: current_beam.append(None)

draw_beam_at('assembly_wcf_storage') # Beam does not go to 'assembly_wcf_storageapproach'
draw_beam_at('assembly_wcf_storage')
draw_beam_at('assembly_wcf_storageretract')
if assembly.get_beam_attribute(beam_id, 'assembly_wcf_inclampapproach') is not None:
    draw_beam_at('assembly_wcf_inclampapproach')
else:
    draw_beam_at('assembly_wcf_inclamp')
draw_beam_at('assembly_wcf_inclamp')
draw_beam_at('assembly_wcf_final')
draw_beam_at('assembly_wcf_final') # Beam does not go to 'assembly_wcf_finalretract'

###################################
# Clamps (multiple clamps)
###################################

clamps = []
# Visualize clamps
for neighbour_id in assembly.get_already_built_neighbors(beam_id):
    joint_id = (neighbour_id, beam_id)
    clamp_wcf_final = assembly.get_joint_attribute(joint_id, 'clamp_wcf_final')
    print (clamp_wcf_final)
    clamp_type = assembly.get_joint_attribute(joint_id, 'clamp_type')
    clamp = process.get_one_clamp_by_type(clamp_type).copy()
    clamp.set_current_frame_from_tcp(clamp_wcf_final)
    clamp.clamp_jaw_position = 120
    clamp.gripper_jaw_position = 0
    clamps.append(clamp)
    print (clamp)
    

###################################
# Gripper (Different Location)
###################################

gripper = []
# Get Gripper and move it to the beam's frame
gripper_type = assembly.get_beam_attribute(beam_id, 'gripper_type')
_gripper = process.get_one_gripper_by_type(gripper_type)

#gripper_tcp_in_ocf = assembly.get_beam_attribute(beam_id, "gripper_tcp_in_ocf")
#gripper_tcp_in_wcf = gripper_tcp_in_ocf.transformed(Transformation.from_frame(beam.frame))

def draw_gripper_at(attribute_name):
    gripper_t0cp = process.get_gripper_t0cp_for_beam_at(beam_id, attribute_name)
    if gripper_t0cp is not None:
        _gripper.current_frame = gripper_t0cp
        
        meshes = meshes_join(_gripper.draw_visuals())
        gripper.append(meshes)
        
    else: gripper.append(None)
    
draw_gripper_at('assembly_wcf_storageapproach')
draw_gripper_at('assembly_wcf_storage')
draw_gripper_at('assembly_wcf_storageretract')
if assembly.get_beam_attribute(beam_id, 'assembly_wcf_inclampapproach') is not None:
    draw_gripper_at('assembly_wcf_inclampapproach')
else:
    draw_gripper_at('assembly_wcf_inclamp')
draw_gripper_at('assembly_wcf_inclamp')
draw_gripper_at('assembly_wcf_final')
draw_gripper_at('assembly_wcf_finalretract')
# ---------- end assembly_step ----------
assembly_collision_check = GhPythonScript(process=process_2, beam_id=selected_beam_id_6)  # -> out, result, col_mesh_preview
# ---------- assembly_collision_check: Python ----------
from compas_ghpython.helpers import mesh_draw
from compas.geometry import Transformation
from compas.datastructures import meshes_join
import compas
from Rhino.Geometry import Mesh as RhinoMesh
from time import time

assembly = process.assembly

if beam_id is None: beam_id = assembly.sequence[-1]

##################################################################
# Functions to retrive object mesh at the right location
##################################################################

clamp_mesh_cache ={}
clamp_mesh_cache_native ={}
gripper_mesh_cache ={}
gripper_mesh_cache_native ={}
beam_mesh_cache ={}
beam_mesh_cache_native ={}

# Native Geometry Cache


def beam_mesh_at(beam_id, position):
    # Cache retrival
    cache_key = (beam_id, position)
    if cache_key in beam_mesh_cache:
        return beam_mesh_cache[cache_key]
    # Generate mesh at
    beam = assembly.beam(beam_id)
    T = assembly.get_beam_transformaion_to(beam_id, position)
    mesh = beam.cached_mesh.transformed(T)
    # Caching
    beam_mesh_cache[cache_key] = mesh
    return mesh
    
def gripper_mesh_at(beam_id, position, gripper_open = True):
    # Cache retrival
    cache_key = (beam_id, position, gripper_open)
    if cache_key in gripper_mesh_cache:
        return gripper_mesh_cache[cache_key]
    # Generate mesh at
    gripper_type = assembly.get_beam_attribute(beam_id, 'gripper_type')
    gripper = process.get_one_gripper_by_type(gripper_type)
    gripper_t0cp = process.get_gripper_t0cp_for_beam_at(beam_id, position)
    gripper.current_frame = gripper_t0cp
    if gripper_open: gripper.open_gripper() 
    else: gripper.close_gripper()
    mesh = meshes_join(gripper.draw_visuals())
    # Caching
    gripper_mesh_cache[cache_key] = mesh
    return mesh

def clamp_mesh_at(joint_id, position, gripper_open, clamp_open):
    # Cache retrival
    cache_key = (joint_id, position, gripper_open, clamp_open)
    if cache_key in clamp_mesh_cache:
        return clamp_mesh_cache[cache_key]
    # Generate mesh at
    clamp_type = assembly.get_joint_attribute(joint_id, 'clamp_type')
    clamp = process.get_one_clamp_by_type(clamp_type)
    clamp_wcf_final = assembly.get_joint_attribute(joint_id, position)
    clamp.current_frame = clamp_wcf_final
    if gripper_open: clamp.open_gripper() 
    else: clamp.close_gripper()
    if clamp_open: clamp.open_clamp() 
    else: clamp.close_clamp()
    mesh = meshes_join(clamp.draw_visuals())
    # Caching
    clamp_mesh_cache[cache_key] = mesh
    return mesh

def previous_beams(beam_id):
    beams = []
    for earlier_beam_id in assembly.sequence:
        if earlier_beam_id == beam_id: break
        beams.append(assembly.beam(earlier_beam_id))
    return beams

def native_clamp_mesh_at(joint_id, position, gripper_open, clamp_open):
    global stat_native_generation, stat_native_retrival
    # Cache retrival
    cache_key = (joint_id, position, gripper_open, clamp_open)
    if cache_key in clamp_mesh_cache_native:
        return clamp_mesh_cache_native[cache_key]
    # Generate native mesh
    mesh = clamp_mesh_at(*cache_key)
    native_mesh = to_native_mesh(mesh)
    # Caching
    clamp_mesh_cache_native[cache_key] = native_mesh
    return native_mesh

def native_gripper_mesh_at(beam_id, position, gripper_open = True):
    global stat_native_generation, stat_native_retrival
    # Cache retrival
    cache_key = (beam_id, position, gripper_open)
    if cache_key in gripper_mesh_cache_native:
        return gripper_mesh_cache_native[cache_key]
    # Generate native mesh
    mesh = gripper_mesh_at(*cache_key)
    native_mesh = to_native_mesh(mesh)
    # Caching
    gripper_mesh_cache_native[cache_key] = native_mesh
    return native_mesh

def native_beam_mesh_at(beam_id, position):
    global stat_native_generation, stat_native_retrival
    # Cache retrival
    cache_key = (beam_id, position)
    if cache_key in beam_mesh_cache_native:
        return beam_mesh_cache_native[cache_key]
    # Generate native mesh
    mesh = beam_mesh_at(*cache_key)
    native_mesh = to_native_mesh(mesh)
    # Caching
    beam_mesh_cache_native[cache_key] = native_mesh
    return native_mesh
    
    
def native_env_mesh(mesh):
    native_mesh = to_native_mesh(mesh)
    return native_mesh

##################################################################
# Functions to perform collision check
##################################################################

tolerance = 10e-7

if compas.IPY:
    import Rhino.Geometry
    from compas_ghpython.artists import MeshArtist
    def to_native_mesh(compas_mesh):
        return MeshArtist(compas_mesh).draw_mesh()
    def native_mesh_mesh_collide(a, b, tolerance=None):
        # Semantics of Rhino SDK is a bit different, None tolerance == Zero tolerance instead of fast checker
        if not tolerance:
            lines = Rhino.Geometry.Intersect.Intersection.MeshMeshFast(a, b)
        else:
            lines = Rhino.Geometry.Intersect.Intersection.MeshMeshAccurate(a, b, tolerance)
        if lines and len(lines) > 0:
            return True
        return False
else:
    import trimesh
    import trimesh.boolean
    def to_native_mesh(compas_mesh):
        v, f = compas_mesh.to_vertices_and_faces()
        return trimesh.Trimesh(vertices=v, faces=f)
    def native_mesh_mesh_collide(a, b, tolerance=None):
        try:
            trimesh.boolean.intersection([a, b], engine='scad')
        except subprocess.CalledProcessError:
            return False
        return True


def check_collision_bboxes(mesh_a, mesh_b):
    av = mesh_a.vertices_attributes('xyz')
    bv = mesh_b.vertices_attributes('xyz')
    ax, ay, az = zip(*av)
    bx, by, bz = zip(*bv)
    if max(ax) < min(bx): return False
    if min(ax) > max(bx): return False
    if max(ay) < min(by): return False
    if min(ay) > max(by): return False
    if max(az) < min(bz): return False
    if min(az) > max(bz): return False
    return True


#def check_one_one_collision(mesh_a, mesh_b, tolerance=None):
#    if check_collision_bboxes(mesh_a, mesh_b):
#        if native_mesh_mesh_collide(to_native_mesh(mesh_a), to_native_mesh(mesh_b), tolerance):
#            return True
#    return False

##########################
# Collision Check
##########################

def collision_gripper_pbeam(beam_id, gripper_pos):
    """ Collision between beam gripper (at gripper_pos) with previous-beams
    """
    # Return collision mesh of gripper for visualization (Native mesh)
    collision_meshes =[]
    gripper_mesh = gripper_mesh_at(beam_id, gripper_pos)
    for pbeam in previous_beams(beam_id):
        pbeam_mesh = pbeam.cached_mesh
        # Collision Check (Two Stages)
        collision = check_collision_bboxes(gripper_mesh, pbeam_mesh)
        if collision:
            m1 = native_gripper_mesh_at(beam_id, gripper_pos)
            m2 = native_beam_mesh_at(pbeam.name, 'assembly_wcf_final')
            collision = native_mesh_mesh_collide(m1, m2, tolerance)
        if collision:
            pbeam_id = pbeam.name
            gripper_type = assembly.get_beam_attribute(beam_id, 'gripper_type')
            # Error Message
            print ("Gripper (%s) in Position (%s) is colliding with already-built Beam (%s)" % (gripper_type, gripper_pos, pbeam_id))
            # Return collision mesh of gripper
            col_mesh = native_gripper_mesh_at(beam_id, gripper_pos)
            collision_meshes.append(col_mesh)
    return collision_meshes

def collision_clamp_pbeam(beam_id, joint_id, clamp_pos, gripper_open, clamp_open, skip_clamp_attached_beam):
    """ Collision between joint_clamp (at joint_id) with previous-beams (of beam_id)
    """
    collision_beam_ids = []
    clamp_state = (joint_id, clamp_pos, gripper_open, clamp_open)
    clamp_mesh = clamp_mesh_at(*clamp_state)
    for pbeam in previous_beams(beam_id):
        # Skip over the pbeam where the clamp is attached to.
        if pbeam.name == joint_id[0] and skip_clamp_attached_beam:
            continue
        pbeam_mesh = pbeam.cached_mesh
        # Collision Check (Two Stages)
        collision = check_collision_bboxes(clamp_mesh, pbeam_mesh)
        if collision:
            m1 = native_clamp_mesh_at(*clamp_state)
            m2 = native_beam_mesh_at(pbeam.name, 'assembly_wcf_final')
            collision = native_mesh_mesh_collide(m1, m2, tolerance)
        if collision:
            pbeam_id = pbeam.name
            clamp_type = assembly.get_joint_attribute(joint_id, 'clamp_type')
            print ("Clamp (%s) of Joint (%s-%s) in Position (%s) is colliding with already-built Beam (%s)" % (clamp_type, joint_id[0], joint_id[1], clamp_pos, pbeam_id))
            collision_beam_ids.append(pbeam_id)
    return collision_beam_ids

def collision_clamps_pbeam(beam_id, clamp_pos, gripper_open, clamp_open, skip_clamp_attached_beam):
    # Return collision mesh for visualization (Native mesh)
    collision_meshes =[]
    for joint_id in assembly.get_joint_ids_of_beam_clamps(beam_id):
        col = collision_clamp_pbeam(beam_id, joint_id, clamp_pos, gripper_open, clamp_open, skip_clamp_attached_beam)
        if len(col) > 0: 
            col_mesh = native_clamp_mesh_at(joint_id, clamp_pos, gripper_open, clamp_open)
            collision_meshes.append(col_mesh)
    return collision_meshes

def collision_beam_pbeam(beam_id, beam_pos):
    """ Collision between beam (at beam_pos) with previous-beams
    """
    # Return collision mesh of beam (at beam_pos) for visualization (Native mesh)
    collision_meshes =[]
    beam_mesh = beam_mesh_at(beam_id, beam_pos)
    for pbeam in previous_beams(beam_id):
        pbeam_mesh = pbeam.cached_mesh
        # Collision Check (Two Stages)
        collision = check_collision_bboxes(beam_mesh, pbeam_mesh)
        if collision:
            m1 = native_beam_mesh_at(beam_id, beam_pos)
            m2 = native_beam_mesh_at(pbeam.name, 'assembly_wcf_final')
            collision = native_mesh_mesh_collide(m1, m2, tolerance)
        if collision:
            pbeam_id = pbeam.name
            # Error Message
            print ("Beam (%s) in Position (%s) is colliding with already-built Beam (%s)" % (beam_id, beam_pos, pbeam_id))
            # Return collision mesh of beam
            collision_meshes.append(native_beam_mesh_at(beam_id, beam_pos))
    return collision_meshes

def collision_gripper_clamp_final(beam_id, joint_id, gripper_pos, gripper_open):
    """ Collision between gripper (of beam_id at gripper_pos) and clamp (of joint_id at clamp_wcf_final)
    Gripper jaw position depends on 'gripper_open'
    Clamp jaw position are closed.
    """
    clamp_state = (joint_id, 'clamp_wcf_final', False, False)
    gripper_state = (beam_id, gripper_pos, gripper_open)
    # Collision Check (Two Stages)
    collision = check_collision_bboxes(clamp_mesh_at(*clamp_state), gripper_mesh_at(*gripper_state))
    if collision:
        m1 = native_clamp_mesh_at(*clamp_state)
        m2 = native_gripper_mesh_at(*gripper_state)
        collision = native_mesh_mesh_collide(m1, m2, tolerance)
    if collision:
        gripper_type = assembly.get_beam_attribute(beam_id, 'gripper_type')
        print ("Gripper (%s) in Position (%s) is colliding with Clamp at Joint (%s-%s) " % (gripper_type, gripper_pos, joint_id[0], joint_id[1]))
    return collision

def collision_gripper_clamps_final(beam_id, gripper_pos, gripper_open):
    """ Collision between gripper (of beam_id at gripper_pos) and all clamp (of beam_id)
    """
    # Return collision mesh for visualization (Native mesh)
    collision_meshes =[]
    for joint_id in assembly.get_joint_ids_of_beam_clamps(beam_id):
        if collision_gripper_clamp_final(beam_id, joint_id, gripper_pos, gripper_open):
            # Append both Clamp and Gripper mesh for visualization
            collision_meshes.append(native_clamp_mesh_at(joint_id, 'clamp_wcf_final', False, False))
            collision_meshes.append(native_gripper_mesh_at(beam_id, gripper_pos, gripper_open))
    return collision_meshes

def collision_gripper_env(beam_id, gripper_pos):
    """ Collision between beam gripper (at gripper_pos) with previous-beams
    """
    # Return collision mesh of gripper for visualization (Native mesh)
    collision_meshes =[]
    gripper_mesh = gripper_mesh_at(beam_id, gripper_pos)
    for env_mesh in process.environment_meshes:
        # Collision Check (Two Stages)
        collision = check_collision_bboxes(gripper_mesh, env_mesh)
        if collision:
            m1 = native_gripper_mesh_at(beam_id, gripper_pos)
            m2 = native_env_mesh(env_mesh)
            collision = native_mesh_mesh_collide(m1, m2, tolerance)
        if collision:
            gripper_type = assembly.get_beam_attribute(beam_id, 'gripper_type')
            # Error Message
            print ("Gripper (%s) in Position (%s) is colliding with enviroment." % (gripper_type, gripper_pos))
            # Return collision mesh of gripper
            col_mesh = native_gripper_mesh_at(beam_id, gripper_pos)
            collision_meshes.append(col_mesh)
    return collision_meshes

def collision_clamps_env(beam_id, clamp_pos, gripper_open, clamp_open):
    # Return collision mesh for visualization (Native mesh)
    collision_meshes =[]
    for joint_id in assembly.get_joint_ids_of_beam_clamps(beam_id):
        col = collision_clamp_env(beam_id, joint_id, clamp_pos, gripper_open, clamp_open)
        if len(col) > 0: 
            col_mesh = native_clamp_mesh_at(joint_id, clamp_pos, gripper_open, clamp_open)
            collision_meshes.append(col_mesh)
    return collision_meshes

def collision_clamp_env(beam_id, joint_id, clamp_pos, gripper_open, clamp_open):
    """ Collision between joint_clamp (at joint_id) with env
    """
    collision_beam_ids = []
    clamp_state = (joint_id, clamp_pos, gripper_open, clamp_open)
    clamp_mesh = clamp_mesh_at(*clamp_state)
    for env_mesh in process.environment_meshes:
        # Collision Check (Two Stages)
        collision = check_collision_bboxes(clamp_mesh, env_mesh)
        if collision:
            m1 = native_clamp_mesh_at(*clamp_state)
            m2 = native_env_mesh(env_mesh)
            collision = native_mesh_mesh_collide(m1, m2, tolerance)
        if collision:
            clamp_type = assembly.get_joint_attribute(joint_id, 'clamp_type')
            print ("Clamp (%s) of Joint (%s-%s) in Position (%s) is colliding with environment" % (clamp_type, joint_id[0], joint_id[1], clamp_pos))
            collision_beam_ids.append(m2)
    return collision_beam_ids

##########################
# Call Collision Functions
##########################
current_beam_has_inclampapproach = assembly.get_beam_attribute(beam_id, 'assembly_wcf_inclampapproach') is not None
col_mesh_preview = []

def c1(col_mesh_preview):
    col_mesh_preview += collision_gripper_pbeam(beam_id, 'assembly_wcf_storageapproach')
    col_mesh_preview += collision_gripper_pbeam(beam_id, 'assembly_wcf_storage')
    col_mesh_preview += collision_gripper_pbeam(beam_id, 'assembly_wcf_storageretract')
    col_mesh_preview += collision_gripper_pbeam(beam_id, 'assembly_wcf_inclamp')
    col_mesh_preview += collision_gripper_pbeam(beam_id, 'assembly_wcf_final')
    col_mesh_preview += collision_gripper_pbeam(beam_id, 'assembly_wcf_finalretract')
    if current_beam_has_inclampapproach:
        col_mesh_preview += collision_gripper_pbeam(beam_id, 'assembly_wcf_inclampapproach')

def c2(col_mesh_preview):
    col_mesh_preview += collision_clamps_pbeam(beam_id, 'clamp_wcf_attachapproach1', True, True, skip_clamp_attached_beam = False)
    col_mesh_preview += collision_clamps_pbeam(beam_id, 'clamp_wcf_attachapproach2', True, True, skip_clamp_attached_beam = True)
    col_mesh_preview += collision_clamps_pbeam(beam_id, 'clamp_wcf_detachretract1', True, True, skip_clamp_attached_beam = True)
    col_mesh_preview += collision_clamps_pbeam(beam_id, 'clamp_wcf_detachretract2', True, True, skip_clamp_attached_beam = False)
    
def c3(col_mesh_preview):
    col_mesh_preview += collision_beam_pbeam(beam_id, 'assembly_wcf_storageapproach')
    col_mesh_preview += collision_beam_pbeam(beam_id, 'assembly_wcf_storage')
    col_mesh_preview += collision_beam_pbeam(beam_id, 'assembly_wcf_storageretract')
    col_mesh_preview += collision_beam_pbeam(beam_id, 'assembly_wcf_inclamp')
    if current_beam_has_inclampapproach:
        col_mesh_preview += collision_beam_pbeam(beam_id, 'assembly_wcf_inclampapproach')

def c4(col_mesh_preview):
    col_mesh_preview += collision_gripper_clamps_final(beam_id, 'assembly_wcf_inclampapproach', False)    
    col_mesh_preview += collision_gripper_clamps_final(beam_id, 'assembly_wcf_inclamp', False)    
    col_mesh_preview += collision_gripper_clamps_final(beam_id, 'assembly_wcf_final', False)    
    col_mesh_preview += collision_gripper_clamps_final(beam_id, 'assembly_wcf_finalretract', True)

def c5(col_mesh_preview):
    col_mesh_preview += collision_gripper_env(beam_id, 'assembly_wcf_inclampapproach')
    col_mesh_preview += collision_gripper_env(beam_id, 'assembly_wcf_inclamp')
    col_mesh_preview += collision_gripper_env(beam_id, 'assembly_wcf_final')
    col_mesh_preview += collision_gripper_env(beam_id, 'assembly_wcf_finalretract')
    col_mesh_preview += collision_clamps_env(beam_id, 'clamp_wcf_attachapproach1', True, True)
    col_mesh_preview += collision_clamps_env(beam_id, 'clamp_wcf_attachapproach2', True, True)
    col_mesh_preview += collision_clamps_env(beam_id, 'clamp_wcf_detachapproach', True, True)
    col_mesh_preview += collision_clamps_env(beam_id, 'clamp_wcf_detachretract1', True, True)
    col_mesh_preview += collision_clamps_env(beam_id, 'clamp_wcf_detachretract2', True, True)

c1(col_mesh_preview)
c2(col_mesh_preview)
c3(col_mesh_preview)
c4(col_mesh_preview)
c5(col_mesh_preview)

print("len(gripper_mesh_cache) = %s " % len(gripper_mesh_cache))
print("len(gripper_mesh_cache_native) = %s " % len(gripper_mesh_cache_native))
print("len(clamp_mesh_cache) = %s " % len(clamp_mesh_cache))
print("len(clamp_mesh_cache_native) = %s " % len(clamp_mesh_cache_native))
# ---------- end assembly_collision_check ----------
python = GhPythonScript(many_meshes=assembly_step.previous_beams, one_mesh=graft(assembly_step.gripper))  # -> out, flatten(a); inputs many_meshes: list; disabled
# ---------- python: Python ----------
import subprocess
import compas
from compas.geometry import bounding_box

if compas.IPY:
    import Rhino.Geometry
    from compas_ghpython.artists import MeshArtist
    def to_native_mesh(compas_mesh):
        return MeshArtist(compas_mesh).draw_mesh()
    def native_mesh_mesh_collide(a, b, tolerance=None):
        # Semantics of Rhino SDK is a bit different, None tolerance == Zero tolerance instead of fast checker
        if not tolerance:
            lines = Rhino.Geometry.Intersect.Intersection.MeshMeshFast(a, b)
        else:
            lines = Rhino.Geometry.Intersect.Intersection.MeshMeshAccurate(a, b, tolerance)
        if lines and len(lines) > 0:
            return True
        return False
else:
    import trimesh
    import trimesh.boolean
    def to_native_mesh(compas_mesh):
        v, f = compas_mesh.to_vertices_and_faces()
        return trimesh.Trimesh(vertices=v, faces=f)
    def native_mesh_mesh_collide(a, b, tolerance=None):
        try:
            trimesh.boolean.intersection([a, b], engine='scad')
        except subprocess.CalledProcessError:
            return False
        return True
tolerance = 0.0001

def check_collision_bboxes(a, b):
    av = a.vertices_attributes('xyz')
    bv = b.vertices_attributes('xyz')
    ax, ay, az = zip(*av)
    bx, by, bz = zip(*bv)
    if max(ax) < min(bx): return False
    if min(ax) > max(bx): return False
    if max(ay) < min(by): return False
    if min(ay) > max(by): return False
    if max(az) < min(bz): return False
    if min(az) > max(bz): return False
    return True

def check_collisions(compas_meshes, tolerance=None):
    meshes = compas_meshes
    native_meshes = {}
    for i in range(len(meshes)):
        for j in range(len(meshes)):
            if i == j:
                continue
            if check_collision_bboxes(meshes[i], meshes[j]):
                am = native_meshes.get(str(i))
                if not am:
                    am = to_native_mesh(meshes[i])
                    native_meshes[str(i)] = am
                bm = native_meshes.get(str(j))
                if not bm:
                    bm = to_native_mesh(meshes[j])
                    native_meshes[str(j)] = to_native_mesh(meshes[j])
                if native_mesh_mesh_collide(am, bm, tolerance):
                    return True
    return False

def check_many_one_collision(many_meshes, one_mesh, tolerance=None):
    many_meshes = [(m, to_native_mesh(m)) for m in many_meshes]
    one_mesh = (one_mesh, to_native_mesh(one_mesh))
    
    for other_mesh in many_meshes:
        if check_collision_bboxes(one_mesh[0], other_mesh[0]):
            if native_mesh_mesh_collide(one_mesh[1], other_mesh[1], tolerance):
                return True
    return False                

a = check_many_one_collision(many_meshes, one_mesh, tolerance)
# ---------- end python ----------
panel_5 = Panel(assembly_collision_check.out)
panel_6 = Panel(python.a)  # disabled
filter_5 = StreamFilter(Gate=show_collision, Stream1=assembly_collision_check.col_mesh_preview)
custom_preview_8 = CustomPreview(Geometry=filter_5, Material=ColourSwatch(SwatchColor=RGBA(219, 0, 0, 103)))

# ----
# Save
# Interactive Modify Process
update_environment_meshes_only = Button()
new_process_overwrites = Button()
process_path_3 = GhPythonScript()  # -> path; same code as process_path

# ----
# Debug Use: Load Process File
auto_json_path_2 = GhPythonScript()  # -> folder_path, json_path; disabled
# ---------- auto_json_path_2: Python ----------
from Rhino.RhinoDoc import ActiveDoc
import os
json_path = os.path.splitext(ActiveDoc.Path)[0] + "_assembly.json"
folder_path = os.path.splitext(ActiveDoc.Path)[0]
# ---------- end auto_json_path_2 ----------
panel_7 = Panel("_process.json")  # disabled
panel_8 = Panel("_process.reserial.json")  # disabled
concat = Concatenate(FragmentA=auto_json_path_2.folder_path, FragmentB=panel_7)  # disabled
concat_2 = Concatenate(FragmentA=auto_json_path_2.folder_path, FragmentB=panel_8)  # disabled

concat_3 = Concatenate(FragmentA=auto_json_path_2.folder_path, FragmentB=panel_2)  # disabled

# ----
# Load Proecss file
file_path_3 = FilePath(concat)  # disabled
json_unpickle_3 = GhPythonScript(path=file_path_3, enable=True)  # -> out, a, warn_col, warn_msg, data; inputs enable: Boolean; disabled
# ---------- json_unpickle_3: Python ----------
import jsonpickle
import os
import datetime
if enable:
    exist = os.path.exists(path)
    if exist:
        with open(path, 'r') as f:
            data = jsonpickle.decode(f.read(), keys=True)
        c_time = datetime.datetime.fromtimestamp(os.path.getmtime(path))
        warn_col = "lime"
        warn_msg = "Process File loaded with %s Beams, %s Clamps, %s Grippers.\n File Modified on %s." % (len(list(data.assembly.beams())), len(list(data.clamps)), len(list(data.grippers)), c_time)
    else:
        warn_col = "orange"    
        warn_msg = "Process File not created yet"
# ---------- end json_unpickle_3 ----------
legend_9 = Legend(Colour=json_unpickle_3.warn_col, Tags=json_unpickle_3.warn_msg, LegendType=2)  # disabled
process_3 = Data(json_unpickle_3.data)  # disabled

python_2 = GhPythonScript(process_path_in=file_path_3, process_path_out=concat_3, enable=button_13)  # -> out, a; inputs enable: Boolean; disabled
# ---------- python_2: Python ----------
import time

import jsonpickle

from integral_timber_joints.process.algorithms import *

# File Names
json_path_in = process_path_in
json_path_out = process_path_out

ros_planner_ip = "192.168.43.28"

#########################################################################
# Load process from file
#########################################################################
ms = time.time()*1000.0
f = open(json_path_in, 'r')
json_str = f.read()
print("json_str len:", len(json_str))
# type: RobotClampAssemblyProcess
process = jsonpickle.decode(json_str, keys=True)
f.close()
print("> Loading Process from %s\n    Time: %sms" %
      (json_path_in, time.time()*1000.0 - ms))

#########################################################################
# From process.sequence, create actions (high level actions)
#########################################################################

ms = time.time()*1000.0
create_actions_from_sequence(process, verbose=False)
print("> create_actions_from_sequence(process)\n    Time: %sms" %
      (time.time()*1000.0 - ms))

ms = time.time()*1000.0
optimize_actions_place_pick_gripper(process, verbose=False)
print("> optimize_actions_place_pick_gripper(process)\n    Time: %sms" %
      (time.time()*1000.0 - ms))

ms = time.time()*1000.0
assign_tools_to_actions(process, verbose=False)
print("> assign_tools_to_actions(process)\n    Time: %sms" %
      (time.time()*1000.0 - ms))

ms = time.time()*1000.0
optimize_actions_place_pick_clamp(process, verbose=False)
print("> optimize_actions_place_pick_clamp(process)\n    Time: %sms" %
      (time.time()*1000.0 - ms))


#########################################################################
# Loop through each action, create movements (low level movements)
#########################################################################

ms = time.time()*1000.0
create_movements_from_actions(process)
print("> create_movements_from_actions(process)\n    Time: %sms" %
      (time.time()*1000.0 - ms))

#########################################################################
# List out actions and movements
#########################################################################

#ms = time.time()*1000.0
#debug_print_process_actions_movements(process, movement_log_file_out)
#print("> debug_print_process_actions_movements(process)\n    Time: %sms" %
#      (time.time()*1000.0 - ms))

#########################################################################
# Save process from file
#########################################################################

# ms = time.time()*1000.0
# f = open(json_path_out, 'w')
# json_str = jsonpickle.encode(process, keys=True)
# print ("json_str len:" , len(json_str))
# f.write(json_str)
# f.close()

#########################################################################
# Connect to path planning backend and initialize robot parameters
#########################################################################

ms = time.time()*1000.0
pp = RFLPathPlanner(None)
pp.connect_to_ros_planner(ros_planner_ip)
robot = pp.robot  # type: compas_fab.robots.Robot
pp.current_configuration = pp.rfl_timber_start_configuration()
print("> pp.connect_to_ros_planner(%s)\n    Time: %sms" %
      (ros_planner_ip, time.time()*1000.0 - ms))

assembly = process.assembly  # For convinence

#########################################################################
# Static Collision Mesh
#########################################################################

# Add static collision mesh to planning scene
pp.remove_collision_mesh("PickupStation")
#pp.append_collision_mesh(process.pickup_station.collision_mesh.transformed(Scale.from_factors([0.001]*3)), "PickupStation")
pp.append_collision_mesh(
    process.pickup_station.collision_mesh, "PickupStation")

# TODO: FLoor and other meshes

#########################################################################
# Sequentially copy movement target_frame to next movement source_frame
#########################################################################

_source_frame = None
for ia, action in enumerate(process.actions):
    for im, movement in enumerate(action.movements):
        if isinstance(movement, RoboticMovement):
            movement.source_frame = _source_frame
            _source_frame = movement.target_frame

#########################################################################
# Sequential path planning
#########################################################################
last_configuration = pp.rfl_timber_start_configuration()

t = time.time()
for ia, action in enumerate(process.actions):
    if ia not in list(range(0, 50)):
        continue
    seq_n = action.seq_n
    act_n = action.act_n

    for im, movement in enumerate(action.movements):
        print("Seq(%s) Act (%s) Mov (%s) - %s" % (seq_n, act_n, im, movement))

        if isinstance(movement, RoboticMovement):
            # Add already built beams to planning scene
            already_built_beam_ids = assembly.get_already_built_beams(
                assembly.sequence[seq_n])

            # Attach Tool and Beam to robot

            # Prepare Starting Configuration
            if last_configuration is not None:
                # retrive last planned trajectory's last config
                start_configuration = last_configuration
            else:
                # Previous planning failed, compute config based on source_frame
                # Source frame is created in the beginning of this file.
                start_configuration = pp.ik_solution(
                    movement.source_frame, verbose=True)

            # Perform planning if start_configuration is not None.
            if start_configuration is not None:
                trajectory = pp.plan_motion(
                    movement.target_frame,
                    start_configuration=start_configuration,
                    free_motion=True,
                    verbose=True)
            else:
                trajectory = None

            # Post Planning
            if trajectory and trajectory.fraction == 1.0:
                # Path planning succeeded
                print("> > Motion Planned (%s pts, %.1f secs)" %
                      (len(trajectory.points), trajectory.time_from_start))
                print("> > Last Point: %s" % trajectory.points[-1])

                # Assign Last frame of the path to next configuration.
                last_configuration = robot.merge_group_with_full_configuration(
                    trajectory.points[-1], pp.current_configuration, pp.planning_group)

                # Save trajectory to movement
                movement.trajectory = trajectory
            else:
                # Path planning failed.
                print("> > Motion Plan Fail !!!")
                last_configuration = None
        else:
            print("> > No Robotic Motion")
        print("")
print("> Total Path Plan Time: %.2fs" % (time.time() - t))

pp.ros_client.close()

#########################################################################
# Save Results
#########################################################################

f = open(json_path_out, 'w')
json_str = jsonpickle.encode(process, keys=True)
print("out json_str len:", len(json_str))
f.write(json_str)
f.close()
# ---------- end python_2 ----------
python_3 = GhPythonScript(process=json_unpickle_3.data)  # -> out, a; disabled
# ---------- python_3: Python ----------
if process is not None:
    for t in process.clamps:
        print t.__class__
        for l in t.links:
            print ("     " , l.__class__, l)
# ---------- end python_3 ----------
panel_9 = Panel(python_3.out)  # disabled

# ----
# Load Proecss file
file_path_4 = FilePath(concat_3)  # disabled

json_unpickle_4 = GhPythonScript(path=file_path_4, enable=True)  # -> out, a, warn_col, warn_msg, data; inputs enable: Boolean; disabled; same code as json_unpickle_3
panel_10 = Panel(json_unpickle_4.out)  # disabled

legend_10 = Legend(Colour=json_unpickle_4.warn_col, Tags=json_unpickle_4.warn_msg, LegendType=2)  # disabled
process_4 = Data(json_unpickle_4.data)  # disabled

python_4 = GhPythonScript(process=json_unpickle_4.data)  # -> out, a; disabled; same code as python_3
panel_11 = Panel(python_4.out)  # disabled

unique_tool_id_3 = Panel("cl3m_1")
unique_tool_id_4 = Panel("cl3m_2")
pt_3 = Point(<point referenced from the Rhino model>)
unique_tool_id_5 = Panel("cl3_2")
# Create Clamp / Gripper Instances
# (e.g. multiple idenditical tools of the same type)
unique_tool_id_6 = Panel("cl3_1")
pt_4 = Point(<point referenced from the Rhino model>)
pt_5 = Point(<point referenced from the Rhino model>)
pt_6 = Point(<point referenced from the Rhino model>)
pl_3 = ConstructPlane(Origin=pt_3, XAxis=Vector(1, 0, 0), YAxis=Vector(0, 0, 1))
pl_4 = ConstructPlane(Origin=pt_6, XAxis=Vector(-1, 0, 0), YAxis=Vector(0, 0, -1))
pl_5 = ConstructPlane(Origin=pt_4, XAxis=Vector(1, 0, 0), YAxis=Vector(0, 0, 1))
clamp_instance_3 = GhPythonScript(robot_model=load_tool_2.tool_2, clamp_id=unique_tool_id_3, storage_location_by_tcp=pl_3)  # -> out, robot_model_out, visual; inputs storage_location_by_tcp: Plane; same code as clamp_instance
clamp_instance_4 = GhPythonScript(robot_model=load_tool_2.tool_2, clamp_id=unique_tool_id_4, storage_location_by_tcp=pl_5)  # -> out, robot_model_out, visual; inputs storage_location_by_tcp: Plane; same code as clamp_instance
clamp_instance_5 = GhPythonScript(robot_model=load_tool.tool_2, clamp_id=unique_tool_id_6, storage_location_by_tcp=pl_4)  # -> out, robot_model_out, visual; inputs storage_location_by_tcp: Plane; same code as clamp_instance

pl_6 = ConstructPlane(Origin=pt_5, XAxis=Vector(-1, 0, 0), YAxis=Vector(0, 0, -1))

clamp_instance_6 = GhPythonScript(robot_model=load_tool.tool_2, clamp_id=unique_tool_id_5, storage_location_by_tcp=pl_6)  # -> out, robot_model_out, visual; inputs storage_location_by_tcp: Plane; same code as clamp_instance
merge_5 = Merge(
    Data1=clamp_instance_5.robot_model_out,
    Data2=clamp_instance_6.robot_model_out,
    Data4=clamp_instance_3.robot_model_out,
    Data5=clamp_instance_4.robot_model_out)

# ----
# Create Process
clamp_pos = GhPythonScript(
    clamps=merge_5,
    grippers=merge_2,
    toolchanger=load_tool_5.tool_2,
    robot_wrist_collision_mesh=load_mesh.tool_2,
    assembly=json_unpickle.data,
    environment=mesh_brep)  # -> out, robot_clamp_process; inputs clamps: list, grippers: list, environment: list of Mesh
# ---------- clamp_pos: Python ----------
#from compas_ghpython import unload_modules
#unload_modules("integral_timber_joints")

from compas.geometry import Vector, dot_vectors, sum_vectors
from compas_rhino.geometry import RhinoPlane, RhinoMesh
from integral_timber_joints.process import RobotClampAssemblyProcess

# Create Process
process = RobotClampAssemblyProcess(assembly)

# Add clamps and grippers to process
[process.add_clamp(clamp) for clamp in clamps]
[process.add_gripper(gripper) for gripper in grippers]
process.robot_toolchanger = toolchanger
process.robot_wrist_collision_mesh = robot_wrist_collision_mesh

# Add environment meshes
for mesh in environment:
    process.environment_meshes.append(RhinoMesh.from_geometry(mesh).to_compas())

# Output
robot_clamp_process = process
# ---------- end clamp_pos ----------

# ----
# Compute Clamp Choice
# Clamp Orientation (Auto Assign)
# Jaw Aproach Vector
clamp_pos_2 = GhPythonScript(process=clamp_pos.robot_clamp_process, joint_clamp_matchings=joint_clamp_matching)  # -> out, process_out; inputs joint_clamp_matchings: list
# ---------- clamp_pos_2: Python ----------
from compas.geometry import Vector, dot_vectors, sum_vectors

process_out = process

# Overwrite Clamp Types Preference for Joints.
# According to Joint-Clamp Matching input
clamp_of_joint = {} # Create a dictionary of matching. Key = joint_type, Value = clamp_type
for matching in joint_clamp_matchings:
    joint_type, clamp_type = matching.split(',') # type: (str, str)
    clamp_of_joint[joint_type] = clamp_type
    
for joint in process.assembly.joints():
    joint_type = joint.__class__.__name__ # type: str
    if joint_type in clamp_of_joint:
        joint.clamp_types = [clamp_of_joint[joint_type]]

# Assign clamp_type to joints
# Compute 'is_clamp_attached_side' and 'clamp_type' for each joint
process_out.assign_clamp_type_to_joints()

# Compute Clamp Orientation and Approach Vector
# Set default 'design_guide_vector_jawapproach' to Vector(1,1,1)
guiding_vector = Vector(1,1,1)
## Auto compute clamp assembly orientation 'clamp_wcf_final' based on that guide vector 
for beam_id in  process_out.assembly.beam_ids():
    process_out.assembly.set_beam_attribute(beam_id, 'design_guide_vector_jawapproach', guiding_vector)
    process_out.search_valid_clamp_orientation_with_guiding_vector(beam_id)
    # process_out.search_valid_jawapproach_vector_prioritizing_guide_vector(beam_id)
    process_out.search_valid_jawapproach_vector_prioritizing_beam_side(beam_id)
# ---------- end clamp_pos_2 ----------

# ----
# Compute Gripper Choice,
# Grasp Face (Auto Assign)
beam_grasp_frame = GhPythonScript(process=clamp_pos_2.process_out)  # -> out, process_out
# ---------- beam_grasp_frame: Python ----------
from compas.geometry import Vector

process_out = process
assembly = process.assembly

for beam_id in assembly.sequence:
    beam = assembly.beam(beam_id)
    
    # Set a default guide vector for auto-compute
    design_guide_vector_grasp = Vector(-0.2 ,-0.5, -1)
    assembly.set_beam_attribute(beam_id, "design_guide_vector_grasp", design_guide_vector_grasp)

    # Set Beam Attributes related to Gripper
    gripper_grasp_face = process.search_grasp_face_from_guide_vector_dir(beam_id)
    gripper_grasp_dist_from_start = beam.length / 2.0
    gripper_tcp_in_ocf = beam.grasp_frame_ocf(gripper_grasp_face, gripper_grasp_dist_from_start)

    assembly.set_beam_attribute(beam_id, "gripper_grasp_dist_from_start", gripper_grasp_dist_from_start)
    assembly.set_beam_attribute(beam_id, "gripper_tcp_in_ocf", gripper_tcp_in_ocf)
    assembly.set_beam_attribute(beam_id, "gripper_type", process.grippers[0].type_name)
# ---------- end beam_grasp_frame ----------

# ----
# Compute storage/pickup location
storage_location = GhPythonScript(process=beam_grasp_frame.process_out, pickup_station=pickup_station.pickup_station)  # -> out, process_out
# ---------- storage_location: Python ----------
#from compas_ghpython import unload_modules
#unload_modules("integral_timber_joints")

from compas.geometry import Vector
from compas_rhino.geometry import RhinoPlane

process_out = process
assembly = process.assembly

# Add Pickup station
process.pickup_station = pickup_station

for beam_id in assembly.sequence:
    process.compute_storage_location_at_corner_aligning_pickup_location(beam_id)
# ---------- end storage_location ----------

# ----
# Compute approach retract
beam_grasp_frame_2 = GhPythonScript(process=storage_location.process_out)  # -> out, process_out
# ---------- beam_grasp_frame_2: Python ----------
#from compas_ghpython import unload_modules
#unload_modules("integral_timber_joints")

from compas.geometry import Vector
from compas_rhino.geometry import RhinoVector

process_out = process
assembly = process.assembly

for beam_id in assembly.sequence:
    
    ############################################
    # Approach and Retract For Beams
    ############################################
    
    # Compute approach and retract regarding gripper 
#    print process.assembly.get_beam_attribute(beam_id, 'gripper_grasp_face')
#    print process.assembly.get_beam_attribute(beam_id, 'assembly_wcf_storage')
#    process.assembly.set_beam_attribute(beam_id, 'assembly_wcf_final', process.assembly.beam(beam_id).frame.copy())
# 
#
#    print (process.assembly.get_beam_transformaion_to(beam_id, 'assembly_wcf_storage'))
    
    process.compute_beam_storageapproach_and_finalretract(beam_id)
    
    # Provide guide vector for pickup (storageretract) action.
    design_guide_vector_storage_pickup = process.pickup_station.pickup_retract_vector
    assembly.set_beam_attribute(beam_id, "design_guide_vector_storage_pickup", design_guide_vector_storage_pickup)
    
    # Compute storage station pickup (storageretract) position.
    process.compute_beam_storageretract(beam_id)
    
    ############################################
    # Approach and Retract For Clamps
    ############################################

    process.compute_clamp_attachapproach_attachretract_detachapproach(beam_id)
    process.compute_clamp_detachretract(beam_id)
# ---------- end beam_grasp_frame_2 ----------

data = Data(beam_grasp_frame_2.process_out)

save_new_process = GhPythonScript(stuff=data, path=process_path_3, output=new_process_overwrites)  # -> update_trigger; inputs output: Boolean; same code as json_pickle
update_tools = GhPythonScript(process=data, path=process_path_3, output=update_tools_definiations_only)  # -> update_trigger; inputs output: Boolean
# ---------- update_tools: Python ----------
import integral_timber_joints
from integral_timber_joints.process import RobotClampAssemblyProcess

if output:
    import jsonpickle
    
    # Open Old Process File
    with open(path, 'r') as f:
        json_str = f.read()
        print ("in json_str len:" , len(json_str))
        old_process = jsonpickle.decode(json_str, keys = True)
    
    # Replace their clamps and grippers with new definitions
    for t in process.grippers:
        old_process.add_gripper(t)
    for t in process.clamps:
        old_process.add_clamp(t)
    
    # Save the old_process
    with open(path, 'w') as f:
        json_str = jsonpickle.encode(old_process, keys= True)
        print ("out json_str len:" , len(json_str))
        f.write(json_str)
# ---------- end update_tools ----------
update_tools_2 = GhPythonScript(process=data, path=process_path_3, output=update_environment_meshes_only)  # -> update_trigger; inputs output: Boolean
# ---------- update_tools_2: Python ----------
import integral_timber_joints
from integral_timber_joints.process import RobotClampAssemblyProcess

if output:
    import jsonpickle
    
    # Open Old Process File
    with open(path, 'r') as f:
        json_str = f.read()
        print ("in json_str len:" , len(json_str))
        old_process = jsonpickle.decode(json_str, keys = True)
    
    # Replace their clamps and grippers with new definitions
    old_process.environment_meshes = []
    for mesh in process.environment_meshes:
        old_process.environment_meshes.append(mesh.copy())

    # Save the old_process
    with open(path, 'w') as f:
        json_str = jsonpickle.encode(old_process, keys= True)
        print ("out json_str len:" , len(json_str))
        f.write(json_str)
# ---------- end update_tools_2 ----------

merge_6 = Merge(Data1=save_new_process, Data2=update_tools, Data3=update_tools_2)
item_3 = ListItem(List=flatten(merge_6), Index=0, Wrap=True)

# ==== cluster Cluster
bool = ClusterInput()
override = ClusterInput()
bool_2 = Boolean(bool)
L = ClusterInput()
override_2 = Integer(override)
lng = ListLength(List=L)
counter = Counter(Reset=bool_2)
mod = Modulus(A=counter, B=lng)
filter = StreamFilter(Gate=bool_2, Stream0=mod, Stream1=override_2)
s_1 = ClusterOutput(filter)

# ==== cluster LoadTool
filename = ClusterInput()
auto_path = GhPythonScript(filename=filename)  # -> json_path
# ---------- auto_path: Python ----------
from Rhino.RhinoDoc import ActiveDoc
import os
json_path = os.path.dirname(ActiveDoc.Path) + os.sep + filename
# ---------- end auto_path ----------
json_unpickle_mesh = GhPythonScript(path=auto_path, enable=True)  # -> warn_col, warn_msg, data; inputs enable: Boolean
# ---------- json_unpickle_mesh: Python ----------
import jsonpickle
import os
import datetime
if enable:
    exist = os.path.exists(path)
    if exist:
        with open(path, 'r') as f:
            data = jsonpickle.decode(f.read(), keys=True)
        c_time = datetime.datetime.fromtimestamp(os.path.getmtime(path))
        warn_col = "lime"
        warn_msg = "%s Object loaded.\n File Modified on %s." % (data.__class__.__name__, c_time)
    else:
        warn_col = "orange"    
        warn_msg = "Tool File not exist"
# ---------- end json_unpickle_mesh ----------
warn_col = ClusterOutput(json_unpickle_mesh.warn_col)
warn_msg = ClusterOutput(json_unpickle_mesh.warn_msg)
tool = Data(json_unpickle_mesh.data)
tool_2 = ClusterOutput(tool)
