# Grasshopper definition StickyProcessExplorer.gh (Grasshopper 1.0.7)

# ----
# Development Tools
# Reload Python Modules (if Module Code is Changed)
python_module_to_reload = Panel("""compas
compas_fab
roslibpy
integral_timber_joints""")
reload = Button()
py = PythonScript(reload_module_button=reload, module_names=python_module_to_reload)  # inputs module_names: list
# ---------- py: Python ----------
import compas_ghpython
from compas_ghpython import unload_modules
if reload_module_button:
    for module in module_names:
        unload_modules(module)
# ---------- end py ----------

# ----
# Check Path and Environment
compas_version = GhPythonScript()  # -> out, compas_version, compas_fab_version, compas_path, compas_fab_path, compas_env_name, python_directory
# ---------- compas_version: Python ----------
__author__ = "leungp"
__version__ = "2020.04.20"

import rhinoscriptsyntax as rs
import compas
import compas_fab
compas_version  = compas.__version__
compas_fab_version = compas_fab.__version__
import os
compas_path = os.path.abspath(compas.__file__)
compas_fab_path = os.path.abspath(compas_fab.__file__)

import compas_bootstrapper
compas_env_name = compas_bootstrapper.ENVIRONMENT_NAME
python_directory = compas_bootstrapper.PYTHON_DIRECTORY
# ---------- end compas_version ----------
compas_environment_name = Panel(compas_version.compas_env_name)
compas_version_2 = Panel(compas_version.compas_version)
compas_fab_version = Panel(compas_version.compas_fab_version)
compas_path = Panel(compas_version.compas_path)
compas_fab_path = Panel(compas_version.compas_fab_path)
python_directory = Panel(compas_version.python_directory)

python = GhPythonScript(refresh=Button())  # -> out, process, artist
# ---------- python: Python ----------
__author__ = "leungp"
__version__ = "2021.01.15"

import rhinoscriptsyntax as rs
from integral_timber_joints.rhino.load import get_process, get_process_artist

process = get_process()
artist = get_process_artist()

print("Process in sticky: (%i Beams)." % (len(list(get_process().assembly.beams()))))
# ---------- end python ----------
python_2 = GhPythonScript(process=python.process, artist=python.artist)  # -> out, a
# ---------- python_2: Python ----------
#print (process.robot_wrist)
print (list(artist.guids.keys()))
#print (artist.guids['b2'])
#print (artist.guids[('b9','b13')])

#beam_guids = []
#for beam_id in artist.guids:
#    print beam_id
#    beam_guids += artist.guids[beam_id]['itj::beams_mesh']
    
#print (beam_guids)
#print (process.robot_wrist.get_link_by_name('toolchanger_base').collision)
#print (process.robot_wrist.get_link_by_name('toolchanger_base').collision[0].geometry.geo)
#print (list(process.clamps[0].draw_visual()))
# ---------- end python_2 ----------
panel = Panel(python.out)
