# Grasshopper definition karamba_wip.gh (Grasshopper 1.0.7)
# plug-ins: karambaGH

number_slider = Slider(5, range=0..10)
crv = Curve(<curve referenced from the Rhino model>)
crv_2 = Curve(<curve referenced from the Rhino model>)
license = LicenseKaramba3D()
panel = Panel(license)
divide = DivideCurve(Curve=crv, Count=number_slider, Kinks=False)  # -> Points, Tangents, Parameters
divide_2 = DivideCurve(Curve=crv_2, Count=number_slider, Kinks=False)  # -> Points, Tangents, Parameters
pline = PolyLine(Vertices=divide.Points, Closed=False)
pline_2 = PolyLine(Vertices=divide_2.Points, Closed=False)
end = EndPoints(Curve=crv_2)  # -> Start, End
ln = Line(StartPoint=divide.Points, EndPoint=divide_2.Points)
explode = Explode(Curve=pline, Recursive=True)  # -> Segments, Vertices
# Doubleclick Me!
explode_2 = Explode(Curve=pline_2, Recursive=True)  # -> Segments, Vertices
matselect = MaterialSelectionKaramba3D(menu=[dropdown(4), dropdown(1)])
# Support
supp = SupportKaramba3D(PosInd=end.Start, menu=[buttons(on, on, on, on, on, on)])
supp_2 = SupportKaramba3D(PosInd=end.End, menu=[buttons(on, on, on, off, off, off)])
number_slider_2 = Slider(10, range=0..10)
number_slider_3 = Slider(10, range=0..10)
toggle = BooleanToggle(True)
merge = Merge(Data1=explode.Segments, Data2=explode_2.Segments)
neg = Negative(Value=Slider(2.767, range=0..10))
merge_2 = Merge(Data1=supp, Data2=supp_2)  # -> flatten(Result)
linetobeam = LineToBeamKaramba3D(Line=merge, Identifier="top", New=True, Remove=True, LimitDistance_m=0.005, Bending=toggle)  # -> Element, Points, Info
linetobeam_2 = LineToBeamKaramba3D(Line=ln, Identifier="mid", New=True, Remove=True, LimitDistance_m=0.005, Bending=toggle)  # -> Element, Points, Info
Z = UnitZ(Factor=neg)
loads = LoadsKaramba3D(Vector=Vector(0, 0, -1), LCase=0, mode="Gravity")
loads_2 = LoadsKaramba3D(ForceVector=Z, Local=False, PosInd=divide.Points, LCase=0, mode="Point")
loads_3 = LoadsKaramba3D(Vector=Vector(0, 0, -1), LCase=0, mode="Gravity")
cross_section = CrossSectionKaramba3D(
    FamilyNameOfCrossSection="DefaultCroSec",
    ElementIdentifier="top",
    Material=matselect,
    Height_cm=number_slider_2,
    UpperFlangeWidth_cm=number_slider_2,
    LowerFlangeWidth_cm=number_slider_2,
    mode="Trapezoid")
cross_section_2 = CrossSectionKaramba3D(
    FamilyNameOfCrossSection="DefaultCroSec",
    ElementIdentifier="mid",
    Material=matselect,
    Height_cm=number_slider_3,
    UpperFlangeWidth_cm=number_slider_3,
    LowerFlangeWidth_cm=number_slider_3,
    mode="Trapezoid")
merge_3 = Merge(Data1=linetobeam.Element, Data2=linetobeam_2.Element)  # -> flatten(Result)
assemble = AssembleModelKaramba3D(
    Elem=flatten(merge_3),
    Support=flatten(merge_2),
    Load=flatten([loads, loads_2]),
    CrossSection=flatten([cross_section, cross_section_2]),
    LimitDistance_m=0.005)  # -> Model, Info, Mass_kg, CenterOfGravity
analyze = AnalyzeKaramba3D(Model=assemble.Model)  # -> CalculatedModel, MaximumDisplacement_cm, ResultingForceOfGravity_kN, ElasticEnergy_kNm
panel_2 = Panel(assemble.Model)
modelview = ModelViewKaramba3D(Model=analyze.CalculatedModel, ResultFactors=1, ResultCase=-1)  # -> Model, DeformedMesh, DeformedAxes, DeformedModel
beamview = BeamViewKaramba3D(Model=modelview.Model)  # -> Model, MeshesOfRenderedBeams, DeformedBeamAxes, LegendColors, LegendTags
scale = Scale(Geometry=beamview.MeshesOfRenderedBeams, Center=Point(0, 0, 0), Factor=Slider(100, range=0..100))  # -> Geometry, Transform
