# Grasshopper definition Path Planning Example.gh (Grasshopper 1.0.7)
# plug-ins: Kangaroo Components

create_actions_and_movements_warning_slo = Button()  # "Create Actions and Movements (Warning: Slow)"

# ----
# Robot
# Load robot directly from ROS
# (only working if connected and file_server launched)
panel = Panel("192.168.43.28")
panel_2 = Panel("0. Load example UR5 robot")
load = Button()
# 1. Load from local filesystem
panel_3 = Panel("C:\Users\rustr\workspace\robotic_setups\src")
panel_4 = Panel("3. Load from ROS")
restart = Button()
load_2 = Button()
load_3 = Button()
ur5 = PythonScript(load=load)  # -> robot
# ---------- ur5: Python ----------
from scriptcontext import sticky as st

import compas
from compas_fab.robots.ur5 import Robot

compas.PRECISION = '12f'

# store robot in component
guid = str(ghenv.Component.InstanceGuid)
robot_key = "robot_" + guid

if robot_key not in st:
    st[robot_key] = None

if load:
    st[robot_key] = Robot(load_geometry=True).model

robot = st[robot_key]
# ---------- end ur5 ----------
ros = PythonScript(ip=panel, restart=restart)  # -> out, ros_client, is_connected
# ---------- ros: Python ----------
import sys
import time
import logging
import scriptcontext as sc

from compas_fab.backends import RosClient

from System import TimeSpan
from System.Threading import ManualResetEventSlim

LOGGER = logging.getLogger('roslibpy')

key = 'rosclient_%s' % str(ghenv.Component.InstanceGuid)
previous_client = sc.sticky.get(key, None)
if previous_client:
    previous_client.terminate()

ros_client = RosClient(ip, 9090)
sc.sticky[key] = ros_client

waitLock = ManualResetEventSlim(False)

ros_client.on_ready(lambda: waitLock.Set())

if not waitLock.Wait(TimeSpan.FromSeconds(5)):
    raise Exception('Unable to connect to ROS')

LOGGER.info('ROS connection opened')


is_connected = ros_client.is_connected
# ---------- end ros ----------
local = GhPythonScript(path=panel_3, package="abb_irb4600_40_255", load=load_2)  # -> robot
# ---------- local: Python ----------
from scriptcontext import sticky as st

import compas
from compas.robots import LocalPackageMeshLoader
from compas.robots import RobotModel

compas.PRECISION = '12f'

# store robot in component-based key
robot_key = 'robot_{}'.format(str(ghenv.Component.InstanceGuid))

if robot_key not in st:
    st[robot_key] = None

if load:
    loader = LocalPackageMeshLoader(path, package)
    urdf = loader.load_urdf('abb_irb4600_40_255.urdf')
    robot = RobotModel.from_urdf_file(urdf)
    robot.load_geometry(loader)
    st[robot_key] = robot

robot = st[robot_key]
# ---------- end local ----------
load_4 = Button()
python = PythonScript(repo="ros-industrial/abb", package="abb_irb6600_support", branch="kinetic-devel", load=load_3)  # -> robot
# ---------- python: Python ----------
from scriptcontext import sticky as st
import compas
from compas.robots import GithubPackageMeshLoader
from compas.robots import RobotModel

compas.PRECISION = '12f'

# store robot in component-based key
robot_key = 'robot_{}'.format(str(ghenv.Component.InstanceGuid))

if robot_key not in st:
    st[robot_key] = None

if load:
    # Load robot
    loader = GithubPackageMeshLoader(repo, package, branch)

    robot = RobotModel.from_urdf_file(loader.load_urdf('irb6640.urdf'))
    robot.load_geometry(loader)

    st[robot_key] = robot

robot = st[robot_key]
# ---------- end python ----------
is_connected = Panel(ros.is_connected)
python_2 = PythonScript(client=ros.ros_client, load=load_4)  # -> robot; inputs load: Boolean
# ---------- python_2: Python ----------
from scriptcontext import sticky as st
import compas
from compas.robots import RobotModel
from compas_fab.backends import RosClient
from compas_fab.backends import RosFileServerLoader
from compas_fab.ghpython import RobotArtist

# Set high precision to import meshes defined in meters
compas.PRECISION = '24f'

# store robot in component
guid = str(ghenv.Component.InstanceGuid)
robot_key = "robot_" + guid

if robot_key not in st:
    st[robot_key] = None

if client and client.is_connected and load:
   
    robot = client.load_robot(load_geometry=True)
#    print (robot.__class__.__name__)
#    print (robot.model)
#    print (robot.model.root)
#    robot.info()
    robot.artist = RobotArtist(robot.model)
    robot.scale(1000)
    st[robot_key] = robot

robot = st[robot_key]
# ---------- end python_2 ----------

panel_5 = Panel("2. Load from github")

# ----
# Reload Python Modules (if Module Code is Changed)
python_module_to_reload = Panel("""compas
compas_fab
roslibpy
integral_timber_joints""")
# Development Tools
reload = Button()
py = PythonScript(reload_module_button=reload, module_names=python_module_to_reload)  # inputs module_names: list
# ---------- py: Python ----------
import compas_ghpython
from compas_ghpython import unload_modules
if reload_module_button:
    for module in module_names:
        unload_modules(module)
# ---------- end py ----------

path_planning_warning_takes_long_time = Button()

# ----
# Check Path and Environment
compas_version = GhPythonScript()  # -> out, compas_version, compas_fab_version, compas_path, compas_fab_path, compas_env_name, python_directory
# ---------- compas_version: Python ----------
__author__ = "leungp"
__version__ = "2020.04.20"

import rhinoscriptsyntax as rs
import compas
import compas_fab
compas_version  = compas.__version__
compas_fab_version = compas_fab.__version__
import os
compas_path = os.path.abspath(compas.__file__)
compas_fab_path = os.path.abspath(compas_fab.__file__)

import compas_bootstrapper
compas_env_name = compas_bootstrapper.ENVIRONMENT_NAME
python_directory = compas_bootstrapper.PYTHON_DIRECTORY
# ---------- end compas_version ----------
compas_environment_name = Panel(compas_version.compas_env_name)
compas_version_2 = Panel(compas_version.compas_version)
compas_fab_version = Panel(compas_version.compas_fab_version)
compas_path = Panel(compas_version.compas_path)
compas_fab_path = Panel(compas_version.compas_fab_path)
python_directory = Panel(compas_version.python_directory)

process_json_path = GhPythonScript()  # -> process_json_path, prepathplan_json_path, pathplan_json_path
# ---------- process_json_path: Python ----------
from Rhino.RhinoDoc import ActiveDoc
import os
process_json_path = os.path.splitext(ActiveDoc.Path)[0] + "_process.json"
prepathplan_json_path =  os.path.splitext(ActiveDoc.Path)[0] + "_prepathplan.json"
pathplan_json_path =  os.path.splitext(ActiveDoc.Path)[0] + "_pathplan.json"
# ---------- end process_json_path ----------
# Load Proecss file
number_slider = Slider(0, range=0..1)
file_path = FilePath(process_json_path.prepathplan_json_path)
pre_pathplan = GhPythonScript(
    json_path_in=process_json_path.process_json_path,
    json_path_out=process_json_path.prepathplan_json_path,
    enable=create_actions_and_movements_warning_slo)  # -> out, a; inputs enable: Boolean
# ---------- pre_pathplan: Python ----------
import jsonpickle

from integral_timber_joints.process.algorithms import *

import time

if enable:
    #########################################################################
    # Load process from file
    #########################################################################
    ms = time.time()*1000.0
    f = open(json_path_in, 'r')
    json_str = f.read()
    print ("json_str len:" , len(json_str))
    process = jsonpickle.decode(json_str, keys=True)  # type: RobotClampAssemblyProcess
    f.close()
    print("> Loading Process from %s\n    Time: %sms" % (json_path_in, time.time()*1000.0 - ms))
    
    #########################################################################
    # From process.sequence, create actions (high level actions)
    #########################################################################
    
    ms = time.time()*1000.0
    create_actions_from_sequence(process, verbose=False)
    print("> create_actions_from_sequence(process)\n    Time: %sms" % (time.time()*1000.0 - ms))
    
    ms = time.time()*1000.0
    optimize_actions_place_pick_gripper(process, verbose=False)
    print("> optimize_actions_place_pick_gripper(process)\n    Time: %sms" % (time.time()*1000.0 - ms))
    
    ms = time.time()*1000.0
    assign_tools_to_actions(process, verbose=False)
    print("> assign_tools_to_actions(process)\n    Time: %sms" % (time.time()*1000.0 - ms))
    
    ms = time.time()*1000.0
    optimize_actions_place_pick_clamp(process, verbose=False)
    print("> optimize_actions_place_pick_clamp(process)\n    Time: %sms" % (time.time()*1000.0 - ms))
    
    
    #########################################################################
    # Loop through each action, create movements (low level movements)
    #########################################################################
    
    ms = time.time()*1000.0
    create_movements_from_actions(process)
    print("> create_movements_from_actions(process)\n    Time: %sms" % (time.time()*1000.0 - ms))
    
    #########################################################################
    # List out actions and movements
    #########################################################################
    
    #debug_print_process_actions_movements(process, movement_log_file_out)
    
    #########################################################################
    # Save process from file
    #########################################################################
    
    ms = time.time()*1000.0
    f = open(json_path_out, 'w')
    json_str = jsonpickle.encode(process, keys=True)
    print ("json_str len:" , len(json_str))
    f.write(json_str)
    f.close()
    
    print("> Saving Process to %s \n    Time: %sms" % (json_path_out, time.time()*1000.0 - ms))
# ---------- end pre_pathplan ----------
path_plan = GhPythonScript(
    json_path_in=process_json_path.prepathplan_json_path,
    json_path_out=process_json_path.pathplan_json_path,
    seq=number_slider,
    enable=Toggle(False))  # -> out, a; inputs seq: list of Int32, enable: Boolean
# ---------- path_plan: Python ----------
import jsonpickle

from integral_timber_joints.process.algorithms import *

import time

ros_planner_ip = "192.168.43.28"

if enable:
    #########################################################################
    # Connect to path planning backend and initialize robot parameters
    #########################################################################
    
    pp = RFLPathPlanner(None)
    pp.connect_to_ros_planner(ros_planner_ip)
    robot = pp.robot # type: compas_fab.robots.Robot
    
    pp.current_configuration = pp.rfl_timber_start_configuration()
    
    #########################################################################
    # Load process from file
    #########################################################################
    
    f = open(json_path_in, 'r')
    json_str = f.read()
    print ("json_str len:" , len(json_str))
    process = jsonpickle.decode(json_str, keys=True)  # type: RobotClampAssemblyProcess
    f.close()
    
    assembly = process.assembly # For convinence
    
    #########################################################################
    # Static Collision Mesh
    #########################################################################
    
    # Add static collision mesh to planning scene
    from compas.geometry import Scale
    pp.remove_collision_mesh("PickupStation")
    #pp.append_collision_mesh(process.pickup_station.collision_mesh.transformed(Scale.from_factors([0.001]*3)), "PickupStation")
    pp.append_collision_mesh(process.pickup_station.collision_mesh, "PickupStation")
    
    # TODO: FLoor and other meshes
    
    #########################################################################
    # Sequential path planning
    #########################################################################
    t = time.time()
    for ia, action in enumerate(process.actions):
        #if ia not in list(range(0, 10)): continue
        seq_n = action.seq_n
        if seq_n not in seq: continue
        # print ("Seq(%s) Acion (%s) - %s \n" % (seq_n, ia, action))
    
        for im, movement in enumerate(action.movements):
            print ("Seq(%s) Act (%s) Mov (%s) - %s" % (seq_n, ia, im, movement))
    
            if isinstance(movement, RoboticMovement):
                # Add already built beams to planning scene
                already_built_beam_ids = assembly.get_already_built_beams(assembly.sequence[seq_n])
    
                # Attach Tool and Beam to robot
    
                # Prepare Starting Config and Goal constraints
                # start_configuration = Configuration.from_revolute_values([0, 4.295, 0, -3.327, 4.755, 0.])
                trajectory = pp.plan_motion(movement.target_frame, free_motion = True, verbose = True)
    
                if trajectory:
                    print("> > Motion Planned (%s pts, %.1f secs)" % (len(trajectory.points), trajectory.time_from_start))
                    print("> > Last Point: %s" % trajectory.points[-1])
    
                    # Assign Last frame of the path to next configuration.
                    last_configuration = robot.merge_group_with_full_configuration(trajectory.points[-1], pp.current_configuration, pp.planning_group)
                    pp.current_configuration = last_configuration
    
                    # Save trajectory to movement
                    movement.trajectory = trajectory
                else:
                    print("> > Motion Plan Fail !!!")
            else:
                print("> > No Robotic Motion")
            print("")
    print("> Total Path Plan Time: %.2fs" % (time.time() - t))
    
    pp.ros_client.close()
    
    #########################################################################
    # Save Results
    #########################################################################
    
    f = open(json_path_out, 'w')
    json_str = jsonpickle.encode(process, keys=True)
    print ("json_str len:" , len(json_str))
    f.write(json_str)
    f.close()
# ---------- end path_plan ----------
json_unpickle = GhPythonScript(json_path=file_path, enable=True)  # -> out, a, warn_col, warn_msg, data; inputs enable: Boolean
# ---------- json_unpickle: Python ----------
import jsonpickle
import os
import time
import datetime
load_success = jsonpickle.load_backend('json')
print (load_success)
from compas.rpc import Proxy

    
if enable:
    exist = os.path.exists(json_path)
    if exist:
        with open(json_path, 'r') as f:
            json_str = f.read()
            data = jsonpickle.decode(json_str, keys=True)
        c_time = datetime.datetime.fromtimestamp(os.path.getmtime(json_path))
        warn_col = "lime"    
        warn_msg = "Process File loaded with %s Beams, %s Clamps, %s Grippers.\n File Modified on %s." % (len(list(data.assembly.beams())), len(list(data.clamps)), len(list(data.grippers)), c_time)
    else:
        warn_col = "orange"    
        warn_msg = "Process File not created yet"
# ---------- end json_unpickle ----------
python_3 = GhPythonScript(process=json_unpickle.data)  # -> out, a
# ---------- python_3: Python ----------
print process.pickup_station.collision_mesh
# ---------- end python_3 ----------
finalized_assembly = Data()  # disabled
panel_6 = Panel(path_plan.out)
legend = Legend(Colour=json_unpickle.warn_col, Tags=json_unpickle.warn_msg, LegendType=1)
panel_7 = Panel(json_unpickle.warn_msg)
compute_actions_new = GhPythonScript(assembly=finalized_assembly)  # -> out, actions; disabled
# ---------- compute_actions_new: Python ----------
__author__ = "leungp"
__version__ = "2020.02.13"

from compas_ghpython import unload_modules
unload_modules("integral_timber_joints")

from integral_timber_joints.assembly.action import *
from integral_timber_joints.assembly.target import *

asssembled = []
actions = []
for bid in assembly.sequence():
    beam = assembly.beam(bid)
    print ("Beam %s" % bid)
    actions.append(LoadPickupBeamAction(beam))
    print ('|- ' + actions[-1].__str__())
    # compute if neighbours are already in place
    clamps = []
    placed_neighbours = set(assembly.network.vertex_neighbors(bid)).intersection(set(asssembled))
    
    # compute if clamps is necessary
    for placed_neighbour in placed_neighbours:
        clamps.append((placed_neighbour,bid))

    # move clamps from storage to structure
    for clamp in clamps:
        actions.append(PickToolAction(StorageTarget(), '90lap'))
        print ('|- ' + actions[-1].__str__())
        actions.append(PlaceToolAction(ClampTarget(*clamp)))
        print ('|- ' + actions[-1].__str__())

        #print ("|- Detatch Clamp at Joint %s-%s" % clamp)
        
    # attach gripper
    gripper_type = assembly.get_beam_attribute(bid, "gripper_type")
    actions.append(PickToolAction(StorageTarget(), gripper_type))
    print ('|- ' + actions[-1].__str__())
    
    # pick place beam 
    actions.append(PickWorkpieceAction(StorageTarget(),beam))
    print ('|- ' + actions[-1].__str__())
    
    #Syncronized clamp and move beam action
    if clamps:

        #Move beam to Jaw instead of final target
        #actions.append(MoveBeamAction(beam,"BStorage","JawTarget (?)"))
        #actions.append(MoveBeamAction(beam,"BStorage", UnresolvedBeamInJawLocation(beam)))
        actions.append(FreeMoveWorkpieceAction(BeamAboveJawTarget(beam),beam))
        actions.append(LinearMoveWorkpieceAction(BeamInJawTarget(beam),beam))
        print ('|- ' + actions[-1].__str__())
        
        # Syncronized clamp jaw close
        sync_action = ActionGroup()
        # Clamp close actions
        for clamp in clamps:
            sync_action.append(ClampJawCloseAction(clamp))
        sync_action.append(LinearMoveWorkpieceAction(BeamFinalTarget(beam), beam))
        actions.append(sync_action)
        
        # Syncronized clamp jaw open
        sync_action = ActionGroup()
        # Clamp close actions
        for clamp in clamps:
            sync_action.append(ClampJawOpenAction(clamp))
        # TO DO: Need to add gripper open and retract action.
        #sync_action.append(LinearMoveWorkpieceAction(BeamFinalTarget(beam), beam))
        actions.append(sync_action)
        
        print ("|- Close Clamp Jaws while moving beam")
        for action in sync_action: print ("  |- " + action.__str__())
        
        actions.append(DetachWorkpieceAction(BeamFinalTarget(beam),beam))
        print ('|- ' + actions[-1].__str__())
        
    else:
        #actions.append(MoveBeamAction(beam,"BStorage",  UnresolvedBeamFinalLocation(beam) ))
        actions.append(PlaceWorkpieceAction(BeamFinalTarget(beam),beam))
        print ('|- ' + actions[-1].__str__())
        
    
    # attach gripper
    actions.append(PlaceToolAction(StorageTarget()))
    print ('|- ' + actions[-1].__str__())

    
    # remove clamps from structure to storage
    
    for clamp in clamps:
        #actions.append(AttachClampAction("UnassignedClamp", False, location = UnresolvedClampLocation(*clamp)))
        actions.append(PickToolAction(ClampTarget(*clamp), '90lap'))
        print ('|- ' + actions[-1].__str__())
        #actions.append(DetachClampAction("UnassignedClamp", True, location = UnresolvedStorageLocation()))
        actions.append(PlaceToolAction(StorageTarget()))

        print ('|- ' + actions[-1].__str__())
#        print ("|- Pickup Clamp from joint %s-%s" % clamp)
#        print ("|- Place Clamp at c-storage")
    asssembled.append(bid)
# ---------- end compute_actions_new ----------
panel_8 = Panel(compute_actions_new.actions)  # disabled
reset_preview_engine = Button()
process = Data(json_unpickle.data)
next_mov = Button()
prev_mov = Button()
replay = Button()
timer = Timer(TimerInterval=100, Target=counter)  # disabled

show_tools_in_storage = BooleanToggle(True)
process_tools_in_storage = GhPythonScript(process=process, enable=show_tools_in_storage)  # -> out, tool_meshes; inputs enable: Boolean
# ---------- process_tools_in_storage: Python ----------
import itertools
from Rhino.Geometry import Mesh as RhinoMesh
from compas_ghpython.helpers import mesh_draw

tool_meshes = []
if enable:
    for tool in itertools.chain(process.clamps + process.grippers):
        # Set Tool state
        tool = tool.copy()
        tool.current_frame = tool.tool_storage_frame
        
        # Set State
        if hasattr(tool,"gripper_jaw_limits"):
            limits = tool.gripper_jaw_limits
            tool.gripper_jaw_position = limits[0]
            
        if hasattr(tool,"clamp_jaw_limits"):
            limits = tool.clamp_jaw_limits
            tool.clamp_jaw_position = limits[0]
        
        # Draw Rhino Mesh
        joinedMesh = RhinoMesh()
        meshes = [joinedMesh.Append(mesh_draw(m)) for m in tool.draw_visuals()]
        tool_meshes.append(joinedMesh)
# ---------- end process_tools_in_storage ----------
show_environment_meshes = BooleanToggle(True)
process_environment_meshes = GhPythonScript(process=process, enable=show_environment_meshes)  # -> out, environment_meshes
# ---------- process_environment_meshes: Python ----------
from Rhino.Geometry import Mesh as RhinoMesh
from compas_ghpython.helpers import mesh_draw

environment_meshes = []
if enable:
    for mesh in process.environment_meshes:
        environment_meshes.append(mesh_draw(mesh))
# ---------- end process_environment_meshes ----------

speed_per_frame = Slider(0.06, range=0..0.1)
process_2 = Data(process)  # disabled
movement_selector = GhPythonScript(process=process, reset=reset_preview_engine, next=next_mov, prev=prev_mov)  # -> i, movement, beam_id, seq_n, act_n, mov_n; inputs reset: Boolean, next: Boolean, prev: Boolean
# ---------- movement_selector: Python ----------
from integral_timber_joints.process.action import RoboticMovement
        

# movement_list is used to cache the list of movement for fast retrival
if reset:
    index = 0
    movement_list = []
    all_movements_description = []
    for action in process.actions:
        for mov_n, movement in enumerate(action.movements):
            movement.seq_n = action.seq_n
            movement.act_n = action.act_n
            movement.mov_n = mov_n
            if isinstance(movement, RoboticMovement):
                movement_list.append(movement)
                
if next and index < len(movement_list) - 1:
    index = index + 1
if prev and index > 0:
    index = index - 1
                
i = index

# Pick movement from the movement_list
movement = movement_list[index]
seq_n = movement.seq_n
act_n = movement.act_n
mov_n = movement.mov_n
beam_id = process.assembly.sequence[seq_n]
# ---------- end movement_selector ----------
or = GateOr(A=next_mov, B=prev_mov, C=replay)
python_4 = GhPythonScript(process=process)  # -> out, movements_desc, movements_plan_result, problematic_movements
# ---------- python_4: Python ----------
from integral_timber_joints.process.action import RoboticMovement

movements_desc = []
movements_plan_result = []
problematic_movements = []

for action in process.actions:
    seq_n = action.seq_n
    act_n = action.act_n
    print ("Seq %s Act %s"%(seq_n, action.__str__()))
    movements_plan_result.append("\n Seq(%s) Act(%s) -- %s" %(seq_n, act_n, action.__str__()))
    for m, movement in enumerate(action.movements):

        mov_n = m
        mov_type = movement.__class__.__name__
        if isinstance(movement, RoboticMovement):
            path_planned = movement.trajectory is not None
            movements_desc.append("Seq(%s) Act(%s) Mov(%s) (ROBO) %s"%(seq_n, act_n, mov_n, movement.__str__()))
            if path_planned:
                movements_plan_result.append(" Seq(%s) Act(%s) Mov(%s) %s : Planned"%(seq_n, act_n, mov_n, mov_type))
            else:
                movements_plan_result.append("!Seq(%s) Act(%s) Mov(%s) %s : NOT PLANNED"%(seq_n, act_n, mov_n, mov_type))
                problematic_movements.append("\nSeq(%s) Act(%s): %s \nMov(%s) %s : NOT PLANNED"%(seq_n, act_n, action.__str__(), mov_n, mov_type))
        else:
            movements_desc.append("Seq(%s) Act(%s) Mov(%s) %s"%(action.seq_n, action.act_n, m, movement.__str__()))
            movements_plan_result.append(" Seq(%s) Act(%s) Mov(%s) %s : Non-RoboticMove"%(seq_n, act_n, mov_n, mov_type))
# ---------- end python_4 ----------
panel_9 = Panel(python_4.problematic_movements)
counter = Counter(Reset=or)
python_5 = GhPythonScript(process=process)  # -> out, a
# ---------- python_5: Python ----------
for t in process.clamps:
    print t.__class__
    for l in t.links:
        print ("     " , l.__class__, l)
# ---------- end python_5 ----------
concat = Concatenate(
    FragmentA="Seq(",
    FragmentB=movement_selector.seq_n,
    FragmentC=") Act(",
    FragmentD=movement_selector.act_n,
    FragmentE=") Mov(",
    FragmentF=movement_selector.mov_n,
    FragmentG=")")
multiplication = Multiplication(A=counter, B=speed_per_frame)
panel_10 = Panel(python_5.out)
panel_11 = Panel(concat)
min = Minimum(A=multiplication, B="0.9999")
selected_beam_id = Text(movement_selector.beam_id)  # disabled
pos = Panel(min)
assign_tools_new = GhPythonScript(actions=compute_actions_new.actions)  # -> out, actions_out; inputs grippers: list, clamps: list, actions: list; disabled
# ---------- assign_tools_new: Python ----------
__author__ = "leungp"
__version__ = "2020.02.14"

import rhinoscriptsyntax as rs

from copy import deepcopy
from copy import copy

from compas_ghpython import unload_modules
unload_modules("integral_timber_joints")

from integral_timber_joints.assembly.action import *
from integral_timber_joints.assembly.target import *

attached_tool = None
attached_workpiece = None

#New attempt to store tools
tools = []
for tool in grippers + clamps :
    t = deepcopy(tool)
    t.current_location = StorageTarget()
    tools.append(t)
    
def GetTool(tool_type, from_storage):
    tool = None
    for t in tools:
        if (from_storage and type(t.current_location) is StorageTarget):
            if (gripper.type == tool_type):
                tool = gripper
                break
        if (not from_storage and type(t.current_location) is not StorageTarget):
            pass

def FindToolFromStorage(tool_type):
    for t in tools:
        if (type(t.current_location).__name__ == "StorageTarget"):
            if (t.type == tool_type):
                return t
    raise Exception("Tool Not Found in Storage Error: tool_type = %s"% tool_type)       

def FindToolFromScene(target):
    for t in tools:
        if (t.current_location.__str__() == target.__str__()):
            return t
    raise Exception("Tool Not Found in Scene Error. target = %s"% target)  

def PrintTools():
    for t in tools:
        pass
        print (" |- " + t.__str__() + " in " + t.current_location.__str__())

actions_out = []
for action_org in actions:
    
    action = copy(action_org)
    actions_out.append(action)
    
    # Assign tool to action
    if (action.__class__.__name__ == "PickToolAction") :
        if attached_tool: # Sainity check to make sure tool is not already attached.
            raise Exception("Unable to attach tool becuase %s is already attached to robot" % attached_tool)
        if (type(action.target).__name__ == "StorageTarget"):
            tool = FindToolFromStorage(action.tool_type)
            action.tool = tool
            attached_tool = tool
            tool.current_location = "Location.OnRobot"
        else:
            #print (action.target.__str__())
            tool = FindToolFromScene(action.target)
            action.tool = tool
            attached_tool = tool
        
        
        
    # Free gripper from action (to storage)
    if action.__class__.__name__ == "PlaceToolAction":
        if not attached_tool:
            raise Exception("Unable to detach gripper becuase No Tool is attached to robot")
        tool = attached_tool
        attached_tool = None
        tool.current_location = action.target
        action.tool = tool
        #print (action.target.__str__())
        
    # Placed the assigned clamps that needs to close jaw into their actions.
    if action.__class__.__name__ == "ActionGroup":
        for sub_action in action.actions:
            if sub_action.__class__.__name__ in ["ClampJawCloseAction", "ClampJawOpenAction"]:
                #print (sub_action.target.__str__())
                clamp = FindToolFromScene(sub_action.target)
                sub_action.tool = clamp
            if sub_action.__class__.__name__ == "LinearMoveWorkpieceAction":
                sub_action.tool = attached_tool

    # AttachBeamAction
    if action.__class__.__name__ in ["PickWorkpieceAction", "PlaceWorkpieceAction", "DetachWorkpieceAction", "LinearMoveWorkpieceAction", "FreeMoveWorkpieceAction"]:
        print ("Workpiece: %s is at/detached/moved using %s" % (action.workpiece , attached_tool))
        if not attached_tool:
            raise Exception("Unable to attach %s becuase No Tool is attached to robot" % action.workpiece)
        g = attached_tool
        action.tool = g
    
    
    #print (action.__class__.__name__ , action.__str__())
    #PrintTools()
# ---------- end assign_tools_new ----------
panel_12 = Panel(assign_tools_new.actions_out)  # disabled
trajectory_selector = GhPythonScript(robot=python_2, movement=movement_selector.movement, index=min)  # -> out, configuration, joint_names, values, a
# ---------- trajectory_selector: Python ----------
from copy import deepcopy

trajectory = movement.trajectory

index = int(index * len(trajectory.points))
configuration = deepcopy(trajectory.points[index])

#print (trajectory.joint_names)
#print (trajectory.start_configuration)

configuration.joint_names = trajectory.joint_names
joint_names = trajectory.joint_names
values = configuration.values


configuration = robot.merge_group_with_full_configuration(
    configuration,
    trajectory.start_configuration,
    "robot11_eaXYZ")
#print (configuration)
# ---------- end trajectory_selector ----------
panel_13 = Panel(python_4.movements_plan_result)
visualize_beams_grippers = GhPythonScript(
    process=process_2,
    beam_id=selected_beam_id,
    previous_beams_color=ColourSwatch(SwatchColor=RGB(153, 142, 142)),
    current_beam_color=ColourSwatch(SwatchColor=RGB(107, 181, 51)),
    current_inclamp_color=ColourSwatch(SwatchColor=RGB(188, 191, 0)),
    gripper_color=ColourSwatch(SwatchColor=RGB(199, 165, 101)))  # -> out, previous_beams, current_beam, clamps, gripper; inputs previous_beams_color: Color, current_beam_color: Color
# ---------- visualize_beams_grippers: Python ----------
__author__ = "leungp"
__version__ = "2020.02.19"

from compas_ghpython.helpers import mesh_draw
from compas.geometry import Transformation
from compas.datastructures import meshes_join

from Rhino.Geometry import Mesh as RhinoMesh
assembly = process.assembly

if beam_id is None: beam_id = assembly.sequence[0]

##########################
# Previous Beams
##########################

# Collect the previously-assembled beam(s)
previous_beams = []
#for this_beam_id in assembly.sequence:
#    if this_beam_id == beam_id: break
#    beam = assembly.beam(this_beam_id)
#    previous_beams.append(mesh_draw(beam.cached_mesh, color = previous_beams_color))
#
for this_beam_id in assembly.get_already_built_beams(beam_id):
    beam = assembly.beam(this_beam_id)
    previous_beams.append(mesh_draw(beam.cached_mesh, color = previous_beams_color))

###################################
# Current Beam (Different Location)
###################################

# Select the current beam
beam = assembly.beam(beam_id)

# Translate the beam to various location and display
current_beam = []
current_beam_assembly_wcf_final = mesh_draw(beam.cached_mesh, color = current_beam_color)

def join_meshes(meshes):
    if len(meshes) == 1 : return meshes [0]
    

def draw_beam_at(attribute_name):
    T = assembly.get_beam_transformaion_to(beam_id, attribute_name)
    if T is not None:
        current_beam.append(mesh_draw(beam.cached_mesh.transformed(T), color = current_inclamp_color))
    else: current_beam.append(None)

draw_beam_at('assembly_wcf_storage') # Beam does not go to 'assembly_wcf_storageapproach'
draw_beam_at('assembly_wcf_storage')
draw_beam_at('assembly_wcf_storageretract')
if assembly.get_beam_attribute(beam_id, 'assembly_wcf_inclampapproach') is not None:
    draw_beam_at('assembly_wcf_inclampapproach')
else:
    draw_beam_at('assembly_wcf_inclamp')
draw_beam_at('assembly_wcf_inclamp')
draw_beam_at('assembly_wcf_final')
draw_beam_at('assembly_wcf_final') # Beam does not go to 'assembly_wcf_finalretract'

###################################
# Clamps (multiple clamps)
###################################

clamps = []
# Visualize clamps
for neighbour_id in assembly.get_already_built_neighbors(beam_id):
    joint_id = (neighbour_id, beam_id)
    clamp_wcf_final = assembly.get_joint_attribute(joint_id, 'clamp_wcf_final')
    print (clamp_wcf_final)
    clamp_type = assembly.get_joint_attribute(joint_id, 'clamp_type')
    clamp = process.get_one_clamp_by_type(clamp_type).copy()
    clamp.set_current_frame_from_tcp(clamp_wcf_final)
    clamp.clamp_jaw_position = 120
    clamp.gripper_jaw_position = 0
    clamps.append(clamp)
    print (clamp)
    

###################################
# Gripper (Different Location)
###################################

gripper = []
# Get Gripper and move it to the beam's frame
gripper_type = assembly.get_beam_attribute(beam_id, 'gripper_type')
_gripper = process.get_one_gripper_by_type(gripper_type)

#gripper_tcp_in_ocf = assembly.get_beam_attribute(beam_id, "gripper_tcp_in_ocf")
#gripper_tcp_in_wcf = gripper_tcp_in_ocf.transformed(Transformation.from_frame(beam.frame))

def draw_gripper_at(attribute_name, gripper_open = True, mesh_join_by_rhino = True):
    gripper_t0cp = process.get_gripper_t0cp_for_beam_at(beam_id, attribute_name)
    if gripper_t0cp is not None:
        _gripper.current_frame = gripper_t0cp
        if gripper_open: _gripper.open_gripper()
        else: _gripper.close_gripper()
        # Two different way to join meshes
        if mesh_join_by_rhino:
            joinedMesh = RhinoMesh()
            meshes = [joinedMesh.Append(mesh_draw(m,  color = gripper_color)) for m in _gripper.draw_visuals()]
            gripper.append(joinedMesh)
        else:
            meshes = meshes_join(_gripper.draw_visuals())
            gripper.append(mesh_draw(meshes,  color = gripper_color))
        
    else: gripper.append(None)
    
draw_gripper_at('assembly_wcf_storageapproach', True)
draw_gripper_at('assembly_wcf_storage', True)
draw_gripper_at('assembly_wcf_storageretract', False)
if assembly.get_beam_attribute(beam_id, 'assembly_wcf_inclampapproach') is not None:
    draw_gripper_at('assembly_wcf_inclampapproach', False)
else:
    draw_gripper_at('assembly_wcf_inclamp', False)
draw_gripper_at('assembly_wcf_inclamp', False)
draw_gripper_at('assembly_wcf_final', False)
draw_gripper_at('assembly_wcf_finalretract', True)
# ---------- end visualize_beams_grippers ----------

# ----
# Visualisation
show_end_effector_frame = BooleanToggle(True)
show_base_frame = BooleanToggle(False)
show_collision = BooleanToggle(True)
show_frames = BooleanToggle(False)
show_visual = BooleanToggle(False)
visualize = PythonScript(
    robot=python_2,
    configuration=trajectory_selector.configuration,
    show_visual=show_visual,
    show_collision=show_collision,
    show_frames=show_frames,
    show_base_frame=show_base_frame,
    show_end_effector_frame=show_end_effector_frame)  # -> visual, collision, frames, ee_frame, base_frame
# ---------- visualize: Python ----------
"""Visualizes a robot.
    Inputs:
        robot: The robot
        configuration: :class:`compas_fab.robots.Configuration`
            The robot's full configuration to display.
        show_visual: bool
           Whether or not to show the robot's visual meshes.
        show_collision: bool
           Whether or not to show the robot's collision meshes.
        show_frames: bool
           Whether or not to show the robot's joint frames.
        show_base_frame: bool
           Whether or not to show the robot's base frame.
        show_end_effector_frame: bool
            Whether or not to show the robot's end-effector frame.
    Output:
        visual: The robot's visual meshes.
        collision: The robot's collision meshes.
        frames: The robot's joint frames.
        base_frame: The robot's base frame.
        ee_frame: The robot's end-effector frame.
"""
from __future__ import print_function

print (robot.__class__.__name__)

if robot and configuration:

    robot.update(configuration, visual=show_visual, collision=show_collision)
    
    if show_visual:
        visual = robot.draw_visual()

    if show_collision:
        collision = robot.draw_collision()

    if show_frames:
        axes = robot.transformed_axes(configuration)
        frames = robot.transformed_frames(configuration)

    if show_base_frame:
        frames = robot.transformed_frames(configuration)
        base_frame = frames[0]

    if show_end_effector_frame:
        ee_frame = robot.forward_kinematics(configuration)
        print("End-effector", ee_frame)
# ---------- end visualize ----------
draw = GhPythonScript(frames=[visualize.frames, visualize.ee_frame, visualize.base_frame], scale=Slider(1000, range=0..1000))  # -> P, V, C, W; inputs frames: list
# ---------- draw: Python ----------
from System.Drawing import Color
from compas_ghpython import draw_frame

red = Color.FromArgb(255, 0, 0)
green = Color.FromArgb(0, 255, 0)
blue = Color.FromArgb(0, 0, 255)

P = []
V = []
C = []

scale = float(scale)

for frame in frames:
    if not frame:
        continue
    plane = draw_frame(frame)
    P += [plane.Origin] * 3
    V.append(plane.XAxis * scale)
    V.append(plane.YAxis * scale)
    V.append(plane.ZAxis * scale)
    C += [red, green, blue]

W = 3
# ---------- end draw ----------
geo = Geometry(visualize.visual)
geo_2 = Geometry(visualize.collision)
vdisex = VectorDisplayEx(Point=draw.P, Vector=draw.V, Colour=draw.C, Width=draw.W)

resolve_clamp_pos = GhPythonScript(assembly=finalized_assembly, action=assign_tools_new.actions_out)  # -> out, clamp_frames_0, clamp_frames_1, actions_out; inputs grippers: list, clamps: list, action: list; disabled
# ---------- resolve_clamp_pos: Python ----------
__author__ = "leungp"
__version__ = "2020.02.19"

import rhinoscriptsyntax as rs
from compas.geometry import Frame
from integral_timber_joints.ghpython.utilities import cFrame2rPlane

from compas.geometry import Vector
from compas.geometry import Translation

from compas_ghpython.utilities import draw_frame
clamp_frames_0 = []
clamp_frames_1 = []

from copy import deepcopy

from compas_ghpython import unload_modules
unload_modules("integral_timber_joints")

actions_out = deepcopy(action)
assembly = deepcopy(assembly)
#Creating a dict of clamps and grippers for easy query
tools = {}
for item in clamps + grippers:
    id = item.name
    tools[id] = deepcopy(item)


def compute_clamp_position(bid1, bid2):
            joint_name = '%s-%s'%(bid1, bid2) #bid1 is the beam already placed
            #print("Computing %s Need Clamp"% joint_name)
            
            beam_already_placed = assembly.element(bid1)._source
            joint = beam_already_placed.get_joint(joint_name)
            #print ("Joint face: %s"% joint.face_id)
            clamp_frames = joint.get_clamp_frame(beam_already_placed)
            return clamp_frames
            #clamp_frames_0.append(draw_frame(clamp_frames[0]))
            #clamp_frames_1.append(draw_frame(clamp_frames[1]))



# Reusable function to resolve workpiece tcf
def resolve_workpiece_tcf_in_world_coords(workpiece, target):
    if target.__class__.__name__ == "StorageTarget":
        # Set beam location to storage_location
        workpiece.current_location = workpiece.storage_location.copy()
    if target.__class__.__name__ == "BeamFinalTarget":
        # Set beam location to final_location
        workpiece.current_location = workpiece.frame.copy()
    if target.__class__.__name__ == "BeamInJawTarget":
        # Set beam location to final_location
        T = Translation(workpiece.assembly_direction.scaled(-1))
        beam_in_jaw_location = workpiece.frame.transformed(T)
        workpiece.current_location = workpiece.frame.copy()            
    # Compute pickup frame (tcp in wcf) from the grasping offset (LCS)
    tcf_in_world_coords = workpiece.current_location.to_world_coords(workpiece.grasp_frame)
    return tcf_in_world_coords


# Reusable function to resolve workpiece tcf
def resolve_vector_in_local_coords(workpiece, target):
    if target.__class__.__name__ == "StorageTarget":
        # StorageTarget in AttachWorkpieceAction, Vector is the grasping frame Z value
        #return workpiece.grasp_frame.normal.scaled(0.12)
        return Vector(0,0,0.12)
    if target.__class__.__name__ == "BeamFinalTarget":
        # For Final Target, Vector is the assembly direction
        assembly_direction_wcf = assembly.network.get_vertex_attribute(workpiece.name, "assembly_direction_wcf")
        #return workpiece.frame.to_local_coords(workpiece.assembly_direction)
        return workpiece.frame.to_local_coords(assembly_direction_wcf)
    if target.__class__.__name__ == "BeamInJawTarget":
        # For Placing beam in a jaw. We need to find the jaw opening direction.
        return Vector(0,0,-0.12)
        

def resolve_tool_tocp_from_tcp(tool, tcf_in_world_coords):
    # Set tool location by tooltip frame 
    tool.set_current_location_frame_by_placemnet(tcf_in_world_coords)
    # Get tool location
    t0cf_in_world_coords = tool.current_location
    return t0cf_in_world_coords

def resolve_workpiece_t0cf(workpiece, tool, assembly):
    # Resolve the tcf of workpiece based on grasp pose
    grasp_frame_ocf = assembly.get_beam_attribute(workpiece.name, "grasp_frame_ocf")
    # resolve the t0cf based on tool
    tcf_in_world_coords = workpiece.current_location.to_world_coords(grasp_frame_ocf)
    t0cf_in_world_coords = resolve_tool_tocp_from_tcp(tool, tcf_in_world_coords)
    return t0cf_in_world_coords
    
def resolve_BeamStorageTarget(action, assembly):
    # Set beam location to storage_location
    action.workpiece.current_location = action.workpiece.storage_location.copy()
    # Find tcf and t0cf in world coords
    t0cf_in_world_coords = resolve_workpiece_t0cf(action.workpiece, action.tool, assembly)
    # Assembly vector
    assembly_vector_in_t0cf = Vector(0,0,0.12)
    action.target.resolve(t0cf_in_world_coords, assembly_vector_in_t0cf)
    
def resolve_BeamFinalTarget(action, assembly):
    # Set beam location to final target
    action.workpiece.current_location = action.workpiece.frame.copy()
    # Find tcf and t0cf in world coords
    t0cf_in_world_coords = resolve_workpiece_t0cf(action.workpiece, action.tool, assembly)
    # Assembly Vector
    assembly_direction_wcf = assembly.network.get_vertex_attribute(action.workpiece.name, "assembly_direction_wcf").copy()
    assembly_vector_in_t0cf = t0cf_in_world_coords.to_local_coords(assembly_direction_wcf)
    # Retract Vector (Gripper opening direction)
    retract_vector_in_t0cf = Vector(0,0,-0.12)
    action.target.resolve(t0cf_in_world_coords, assembly_vector_in_t0cf, retract_vector_in_t0cf)
    
def resolve_BeamAboveJawTarget(action, assembly):
    # Set beam location to jaw opening position
    place_in_jaw_direction_wcf = assembly.network.get_vertex_attribute(action.workpiece.name, "place_in_jaw_direction_wcf").copy()
    assembly_direction_wcf = assembly.network.get_vertex_attribute(action.workpiece.name, "assembly_direction_wcf").copy()
    assembly_direction_wcf += place_in_jaw_direction_wcf
    T = Translation(assembly_direction_wcf.scaled(-1))
    action.workpiece.current_location = action.workpiece.frame.transformed(T)         
    # Find tcf and t0cf in world coords
    t0cf_in_world_coords = resolve_workpiece_t0cf(action.workpiece, action.tool, assembly)
    # Assembly vector
    action.target.resolve(t0cf_in_world_coords)
    
def resolve_BeamInJawTarget(action, assembly):
    # Set beam location to in-jaw location
    assembly_direction_wcf = assembly.network.get_vertex_attribute(action.workpiece.name, "assembly_direction_wcf").copy()
    T = Translation(assembly_direction_wcf.scaled(-1))
    action.workpiece.current_location = action.workpiece.frame.transformed(T)         
    # Find tcf and t0cf in world coords
    t0cf_in_world_coords = resolve_workpiece_t0cf(action.workpiece, action.tool, assembly)
    # Assembly vector
    action.target.resolve(t0cf_in_world_coords)

clamp_approach_vector =  Vector(0,0,0.10)
clamp_retract_vector = Vector(0,0,-0.10)
clamp_approach_workpiece_vector =  Vector(0,0,0.30)
clamp_retract_workpiece_vector = Vector(0,0,-0.30)

def resolve_ClampTarget(action, assembly):
    joint_id = (action.target.beam1, action.target.beam2)
    clamp_frame_wcf = assembly.get_joint_attribute(joint_id, "clamp_frame_wcf")
    tool = action.tool
    tool.set_current_location_frame_by_placemnet(clamp_frame_wcf)
    action.target.resolve(tool.current_location, clamp_approach_workpiece_vector, clamp_retract_vector)


def resolve_ToolStorageTarget(action, assembly):
    action.target.resolve(action.tool.storage_location, clamp_approach_vector, clamp_retract_workpiece_vector)

#Loop though all the actions
for action in actions_out:
    
    if action.__class__.__name__ in ["PickWorkpieceAction", "PlaceWorkpieceAction", "DetachWorkpieceAction"]:
        if action.target.__class__.__name__ == "StorageTarget":
            resolve_BeamStorageTarget(action, assembly)
        if action.target.__class__.__name__ == "BeamFinalTarget":
            resolve_BeamFinalTarget(action, assembly)
    
    if action.__class__.__name__ in ["LinearMoveWorkpieceAction", "FreeMoveWorkpieceAction"]:
        if action.target.__class__.__name__ == "BeamAboveJawTarget":
            resolve_BeamAboveJawTarget(action, assembly)
        if action.target.__class__.__name__ == "BeamInJawTarget":
            resolve_BeamInJawTarget(action, assembly)
            
    # Resolve Clamp StorageLocation and Clamp TargetLocation
    if action.__class__.__name__ in ["PickToolAction", "PlaceToolAction"]:
        if action.target.__class__.__name__ == "StorageTarget":
            resolve_ToolStorageTarget(action, assembly)
        if action.target.__class__.__name__ == "ClampTarget":
            #placement_position = compute_clamp_position(action.target.beam1, action.target.beam2)[0] #First result
            resolve_ClampTarget(action, assembly)
            
    # Resolve Items in Action Group
    if action.__class__.__name__ == "ActionGroup":
        for sub_action in action.actions:
            if sub_action.__class__.__name__ in ["LinearMoveWorkpieceAction",]:
                resolve_BeamFinalTarget(sub_action, assembly)
#                tcf_in_world_coords = resolve_workpiece_tcf_in_world_coords(sub_action.workpiece, sub_action.target)
#                t0cf_in_world_coords = resolve_tool_tocp_from_tcp(sub_action.tool, tcf_in_world_coords)
#                sub_action.target.resolve(t0cf_in_world_coords, t0cf_in_world_coords.normal)
# ---------- end resolve_clamp_pos ----------

# ----
# Visualize Action Target
number_slider_2 = Slider(18, range=0..30)  # disabled
item = ListItem(List=resolve_clamp_pos.actions_out, Index=number_slider_2, Wrap=True)  # disabled
python_6 = GhPythonScript(action=item)  # -> out, target_frame, approach_frame, approach_vector; disabled
# ---------- python_6: Python ----------
__author__ = "leungp"
__version__ = "2020.03.03"

from compas_ghpython.utilities import draw_frame
from integral_timber_joints.ghpython.utilities import cVec2rVec
target_frame = draw_frame(action.target.target_frame)
approach_frame = draw_frame(action.target.approach_frame)
approach_vector = cVec2rVec(action.target.approach_vector)
# ---------- end python_6 ----------
vec2pt = Vector2Pt(PointA=python_6.approach_frame, PointB=python_6.target_frame, Unitize=False)  # -> Vector, Length; disabled
vdis = VectorDisplay(Anchor=python_6.approach_frame, Vector=vec2pt.Vector)  # disabled

panel_14 = Panel(resolve_clamp_pos.actions_out)  # disabled
list_item = ListItem(List=visualize_beams_grippers.current_beam, Index=Slider(0, range=0..5), Wrap=True)
custom_preview = CustomPreview(Geometry=list_item, Material=ColourSwatch(SwatchColor=RGBA(255, 255, 255, 171)))
custom_preview_2 = CustomPreview(Geometry=visualize_beams_grippers.previous_beams, Material=ColourSwatch(SwatchColor=RGBA(219, 219, 219, 103)))
number_slider_3 = Slider(26, range=0..100)  # disabled
split = SplitList(List=resolve_clamp_pos.actions_out, Index=number_slider_3)  # -> ListA, ListB; disabled

# ----
# Create Low Level Cheorography
create_animation = GhPythonScript(assembly=finalized_assembly, actions=resolve_clamp_pos.actions_out)  # -> out, scene_objects_out, keyframes_out, keyframes_count, robot_T0CF_keyframes, descriptions; inputs clamps: list, grippers: list, actions: list; disabled
# ---------- create_animation: Python ----------
from compas.geometry import Transformation, Frame

# Scene objects must implement set_state() and get_state().
# Scene objects must implement draw_visual() that create a list of compas meshes using its current state.
scene_objects = {}

# Each keyframe is smply a dictionary of all the objects states.
# The goal is to compute all keyframes
scene_keyframes = []

# Tentative solution for recording robotic T0CF
robot_T0CF_keyframes = []
descriptions = []

def get_keyframe():
    '''
    Creates a dictionary of all the visualization states of the objects.
    '''
    global scene_objects
    scene_state = {}
    # Iterate through all objects and call their get_state() 
    for key, scene_object in scene_objects.items():
        scene_state[key] = scene_object.get_state()
    # Add all 
    return scene_state

def save_keyframe(description = ""):
    global scene_keyframes, robot_T0CF_keyframes, robot_T0CF
    scene_keyframes.append(get_keyframe())
    # Tentative Hack
    robot_T0CF_keyframes.append(robot_T0CF.copy())
    descriptions.append(description)


# Collect all scene objects in a dictionary
# A copy is made becuase we will edit the state of the objects.
from copy import deepcopy

# Prepare all items in their initial location.
# Clamps and Grippers are visible, Beam is not visible
for item in clamps:
    id = item.name
    if id in scene_objects:
        raise KeyAlreadyExistError
    scene_objects[id] = deepcopy(item)
    scene_objects[id].is_visible = True
    scene_objects[id].is_attached = False
    scene_objects[id].current_location = scene_objects[id].storage_location.copy()

for item in grippers:
    id = item.name
    if id in scene_objects:
        raise KeyAlreadyExistError
    scene_objects[id] = deepcopy(item)
    scene_objects[id].is_visible = True
    scene_objects[id].is_attached = False
    scene_objects[id].current_location = scene_objects[id].storage_location.copy()

for id, element in assembly.elements():
    if id in scene_objects:
        raise KeyAlreadyExistError
    scene_objects[id] = deepcopy(assembly.beam(id))
    scene_objects[id].is_visible = False
    scene_objects[id].is_attached = False
    scene_objects[id].current_location = scene_objects[id].storage_location.copy()

    
print ("The following scene objects are loaded:")
print scene_objects.keys()

# Storing the attached tool and workpiece current state
attached_tool = None
attached_workpiece = None
robot_T0CF = Frame.worldXY()


# Initial State
save_keyframe("Initial State")

# Object getter helper function

def getWorkpiece (action):
    return scene_objects[action.workpiece.name]

def getTool (action):
    return scene_objects[action.tool.name]

# Low level action helper function

def goto (t0cf_in_wcf):
    global attached_tool, attached_workpiece, robot_T0CF
    # Move the robot
    robot_T0CF = t0cf_in_wcf
    if (attached_tool is not None):
        # Move the tool
        attached_tool.current_location = t0cf_in_wcf.copy()
    if (attached_workpiece is not None):
        # Move the workpiece
        tcf_in_wcf = attached_tool.current_location.to_world_coords(attached_tool.placement_frame)
        set_current_location_frame_by_placemnet(attached_workpiece, tcf_in_wcf)

def set_current_location_frame_by_placemnet(workpiece, tcf_in_wcf):
    grasp_frame = assembly.get_beam_attribute(workpiece.name, "grasp_frame_ocf")
    T2 = Transformation.from_frame_to_frame(grasp_frame, tcf_in_wcf)
    base_frame = Frame.worldXY().transformed(T2)
    workpiece.current_location = base_frame.copy()

def attach_tool (tool):
    global attached_tool
    assert (attached_tool is None)
    attached_tool = tool
    attached_tool.is_attached = True    # For Visualization Effect

def detach_tool ():
    global attached_tool, attached_workpiece
    assert (attached_tool is not None)
    assert (attached_workpiece is None)
    attached_tool.is_attached = False   # For Visualization Effect
    attached_tool = None


def attach_workpiece (workpiece):
    global attached_tool, attached_workpiece
    assert (attached_tool is not None)
    assert (attached_workpiece is None)
    attached_workpiece = workpiece
    attached_tool.close_gripper()
    attached_workpiece.is_attached = True   # For Visualization Effect    

def detach_workpiece ():
    global attached_tool, attached_workpiece
    assert (attached_tool is not None)
    assert (attached_workpiece is not None)
    attached_workpiece.is_attached = False  # For Visualization Effect
    attached_workpiece = None
    attached_tool.open_gripper()
    

# Create keyframes by the actions:
    
for action in actions:
    
    if action.__class__.__name__ == "LoadPickupBeamAction":
        # Beam Appeare
        getWorkpiece(action).is_visible = True
        save_keyframe("Manually-load %s on pick-up station." % getWorkpiece(action))
        
        
        
    if action.__class__.__name__ in ["PickToolAction", "PlaceToolAction"]:
        # Step 1. Go to Target Approach (Free)
        goto(action.target.approach_frame)
        save_keyframe("Robot (Free) Goto %s -> %s -> Approach Point" % (getTool(action), action.target))
        # Step 2. Go to Final Target (Linear)
        goto(action.target.target_frame)
        save_keyframe("Robot (Linear) Goto %s -> %s -> Target Point" % (getTool(action), action.target))
        

        # Step 3.A (Pick) Lock Tool and Open Gripper
        if action.__class__.__name__ == "PickToolAction":
            attach_tool(getTool(action))
            save_keyframe("Robot (IO) Lock %s" % getTool(action))
            getTool(action).open_gripper()
            save_keyframe("Robot (IO) Open %s Gripper" % (action.tool))
        # Step 3.B (Place) Close Gripper and unlock tool
        if action.__class__.__name__ == "PlaceToolAction":
            getTool(action).close_gripper()
            save_keyframe("Robot (IO) Close %s Gripper" % (action.tool))
            detach_tool()
            save_keyframe("Robot (IO) Unlock %s" % getTool(action))
            
        # Step 4. Go to Target Retract (Linear)
        goto(action.target.retract_frame)
        save_keyframe("Robot (Linear) Goto %s -> %s -> Retract Point" % (getTool(action), action.target))
        
        
        
    if action.__class__.__name__ in ["PickWorkpieceAction", "PlaceWorkpieceAction"]:
        # Step 1. Go to Target Approach (Free)
        goto(action.target.approach_frame)
        save_keyframe("Robot (Free) Goto %s -> %s -> Approach Point" % (getWorkpiece(action), action.target))
        # Step 2. Go to Final Target (Linear)
        goto(action.target.target_frame)
        save_keyframe("Robot (Linear) Goto %s -> %s -> Target Point" % (getWorkpiece(action), action.target))
        
        # Step 3.2 Lock Workpiece / Unlock Workpiece
        if action.__class__.__name__ == "PickWorkpieceAction":
            attach_workpiece(getWorkpiece(action))
            save_keyframe("Robot (IO) Close %s Gripper / Grasping %s" % (getTool(action), action.workpiece))
        elif action.__class__.__name__ == "PlaceWorkpieceAction":
            detach_workpiece()
            save_keyframe("Robot (IO) Open %s Gripper / Releasing %s" % (getTool(action), action.workpiece))

        # Step 4. Go to Target Retract (Linear)
        goto(action.target.retract_frame)
        save_keyframe("Robot (Linear) Goto %s -> %s -> Retract Point" % (getWorkpiece(action), action.target))

    if action.__class__.__name__ in ["DetachWorkpieceAction"]:
        # Step 1. Unlock Workpiece
        detach_workpiece()
        save_keyframe("Robot (IO) Open %s Gripper / Releasing %s" % (getTool(action), action.workpiece))
        # Step 2. Go to Target Retract (Linear)
        goto(action.target.retract_frame)
        save_keyframe("Robot (Linear) Goto %s -> %s -> Retract Point" % (getWorkpiece(action), action.target))

    if action.__class__.__name__ == "FreeMoveWorkpieceAction":
        goto(action.target.target_frame)
        save_keyframe("Move %s to %s (Free)" % (action.workpiece, action.target))

    if action.__class__.__name__ == "LinearMoveWorkpieceAction":
        goto(action.target.target_frame)
        save_keyframe("Move %s to %s (Linear)" % (action.workpiece, action.target))

    if action.__class__.__name__ == "ActionGroup":
        "Syncronized Actions: "
        sub_action_descriptions = []
        for sub_action in action.actions:
            if sub_action.__class__.__name__ in ["LinearMoveWorkpieceAction",]:
                goto(sub_action.target.target_frame)
            if sub_action.__class__.__name__ in ["ClampJawCloseAction",]:    
                getTool(sub_action).close_clamp_jaw()
            if sub_action.__class__.__name__ in ["ClampJawOpenAction",]:    
                getTool(sub_action).open_clamp_jaw()
            sub_action_descriptions.append(sub_action.__str__())
        #save_keyframe("Syncronized Robot (Linear) Goto %s and Clamps %s" % (workpieces, clamps))
        save_keyframe("Syncronized Actions: " + " & ".join(sub_action_descriptions))

# Wrapper to transmit a dictionary across GH Wires
class SceneObjects():
    def __init__(self, objects):
        self.objects = objects
        
    def __getitem__(self, key):
        return self.objects.__getitem__(key)
    
    def __setitem__(self, key, val):
        return self.objects.__setitem__(key, val)
        
keyframes_out = scene_keyframes
scene_objects_out = SceneObjects(scene_objects)
# ---------- end create_animation ----------

panel_15 = Panel(" ")  # disabled
panel_16 = Panel("#")  # disabled
number_slider_4 = Slider(0.07, range=0..0.1)  # disabled
deepcopy = GhPythonScript()  # -> data_out; disabled
# ---------- deepcopy: Python ----------
from copy import deepcopy

data_out = deepcopy(data_in)
# ---------- end deepcopy ----------
create_action_assign_tools = GhPythonScript(process=deepcopy)  # -> out, process_out; disabled
# ---------- create_action_assign_tools: Python ----------
from integral_timber_joints.process.algorithms import *

process_out = process

print("> > > create_actions_from_sequence(process)")
create_actions_from_sequence(process, verbose=False)
print("> > > optimize_actions_place_pick_gripper(process)")
optimize_actions_place_pick_gripper(process, verbose=False)
print("> > > assign_tools_to_actions(process)")
assign_tools_to_actions(process, verbose=False)
print("> > > optimize_actions_place_pick_clamp(process)")
optimize_actions_place_pick_clamp(process, verbose=False)
print("> > > create_movements_from_actions(process)")
create_movements_from_actions(process)

debug_print_process_actions_movements(process)
# ---------- end create_action_assign_tools ----------
panel_17 = Panel(create_action_assign_tools.out)  # disabled
deepcopy_2 = GhPythonScript()  # -> data_out; disabled; same code as deepcopy
create_animation_2 = GhPythonScript(process=deepcopy_2)  # -> out, scene_objects_out, keyframes_out, keyframes_count, robot_T0CF_keyframes, descriptions; disabled; same code as create_animation
resolve_clamp_pos_2 = GhPythonScript(process=deepcopy_2)  # -> out, clamp_frames_0, clamp_frames_1, actions_out; disabled
# ---------- resolve_clamp_pos_2: Python ----------
__author__ = "leungp"
__version__ = "2020.02.19"

import rhinoscriptsyntax as rs
from compas.geometry import Frame
from integral_timber_joints.ghpython.utilities import cFrame2rPlane

from compas.geometry import Vector
from compas.geometry import Translation

from compas_ghpython.utilities import draw_frame
clamp_frames_0 = []
clamp_frames_1 = []


from copy import deepcopy

from compas_ghpython import unload_modules
unload_modules("integral_timber_joints")

actions_out = process.actions
assembly = process.assembly
#Creating a dict of clamps and grippers for easy query
tools = {}
for item in process.clamps + process.grippers:
    id = item.name
    tools[id] = deepcopy(item)


def compute_clamp_position(bid1, bid2):
            joint_name = '%s-%s'%(bid1, bid2) #bid1 is the beam already placed
            #print("Computing %s Need Clamp"% joint_name)
            
            beam_already_placed = assembly.element(bid1)._source
            joint = beam_already_placed.get_joint(joint_name)
            #print ("Joint face: %s"% joint.face_id)
            clamp_frames = joint.get_clamp_frame(beam_already_placed)
            return clamp_frames
            #clamp_frames_0.append(draw_frame(clamp_frames[0]))
            #clamp_frames_1.append(draw_frame(clamp_frames[1]))



# Reusable function to resolve workpiece tcf
def resolve_workpiece_tcf_in_world_coords(workpiece, target):
    if target.__class__.__name__ == "StorageTarget":
        # Set beam location to storage_location
        workpiece.current_location = workpiece.storage_location.copy()
    if target.__class__.__name__ == "BeamFinalTarget":
        # Set beam location to final_location
        workpiece.current_location = workpiece.frame.copy()
    if target.__class__.__name__ == "BeamInJawTarget":
        # Set beam location to final_location
        T = Translation(workpiece.assembly_direction.scaled(-1))
        beam_in_jaw_location = workpiece.frame.transformed(T)
        workpiece.current_location = workpiece.frame.copy()            
    # Compute pickup frame (tcp in wcf) from the grasping offset (LCS)
    tcf_in_world_coords = workpiece.current_location.to_world_coords(workpiece.grasp_frame)
    return tcf_in_world_coords


# Reusable function to resolve workpiece tcf
def resolve_vector_in_local_coords(workpiece, target):
    if target.__class__.__name__ == "StorageTarget":
        # StorageTarget in AttachWorkpieceAction, Vector is the grasping frame Z value
        #return workpiece.grasp_frame.normal.scaled(0.12)
        return Vector(0,0,0.12)
    if target.__class__.__name__ == "BeamFinalTarget":
        # For Final Target, Vector is the assembly direction
        assembly_direction_wcf = assembly.network.get_vertex_attribute(workpiece.name, "assembly_direction_wcf")
        #return workpiece.frame.to_local_coords(workpiece.assembly_direction)
        return workpiece.frame.to_local_coords(assembly_direction_wcf)
    if target.__class__.__name__ == "BeamInJawTarget":
        # For Placing beam in a jaw. We need to find the jaw opening direction.
        return Vector(0,0,-0.12)
        

def resolve_workpiece_t0cf(workpiece, tool, assembly):
    # Resolve the tcf of workpiece based on grasp pose
    grasp_frame_ocf = assembly.get_beam_attribute(workpiece.name, "gripper_tcp_in_ocf")
    # resolve the t0cf based on tool
    tcf_in_world_coords = workpiece.current_location.to_world_coords(grasp_frame_ocf)
    t0cf_in_world_coords = tool.set_current_frame_from_tcp(tcf_in_world_coords)
    return t0cf_in_world_coords
    
def resolve_BeamStorageTarget(action, assembly):
    # Set beam location to storage_location
    action.workpiece.current_location = action.workpiece.storage_location.copy()
    # Find tcf and t0cf in world coords
    t0cf_in_world_coords = resolve_workpiece_t0cf(action.workpiece, action.tool, assembly)
    # Assembly vector
    assembly_vector_in_t0cf = Vector(0,0,0.12)
    action.target.resolve(t0cf_in_world_coords, assembly_vector_in_t0cf)
    
def resolve_BeamFinalTarget(action, assembly):
    # Set beam location to final target
    action.workpiece.current_location = action.workpiece.frame.copy()
    # Find tcf and t0cf in world coords
    t0cf_in_world_coords = resolve_workpiece_t0cf(action.workpiece, action.tool, assembly)
    # Assembly Vector
    assembly_direction_wcf = assembly.get_beam_attribute(action.workpiece.name, "assembly_direction_wcf").copy()
    assembly_vector_in_t0cf = t0cf_in_world_coords.to_local_coords(assembly_direction_wcf)
    # Retract Vector (Gripper opening direction)
    retract_vector_in_t0cf = Vector(0,0,-0.12)
    action.target.resolve(t0cf_in_world_coords, assembly_vector_in_t0cf, retract_vector_in_t0cf)
    
def resolve_BeamAboveJawTarget(action, assembly):
    # Set beam location to jaw opening position
    place_in_jaw_direction_wcf = assembly.network.get_vertex_attribute(action.workpiece.name, "place_in_jaw_direction_wcf").copy()
    assembly_direction_wcf = assembly.network.get_vertex_attribute(action.workpiece.name, "assembly_direction_wcf").copy()
    assembly_direction_wcf += place_in_jaw_direction_wcf
    T = Translation(assembly_direction_wcf.scaled(-1))
    action.workpiece.current_location = action.workpiece.frame.transformed(T)         
    # Find tcf and t0cf in world coords
    t0cf_in_world_coords = resolve_workpiece_t0cf(action.workpiece, action.tool, assembly)
    # Assembly vector
    action.target.resolve(t0cf_in_world_coords)
    
def resolve_BeamInJawTarget(action, assembly):
    # Set beam location to in-jaw location
    assembly_direction_wcf = assembly.network.get_vertex_attribute(action.workpiece.name, "assembly_direction_wcf").copy()
    T = Translation(assembly_direction_wcf.scaled(-1))
    action.workpiece.current_location = action.workpiece.frame.transformed(T)         
    # Find tcf and t0cf in world coords
    t0cf_in_world_coords = resolve_workpiece_t0cf(action.workpiece, action.tool, assembly)
    # Assembly vector
    action.target.resolve(t0cf_in_world_coords)

clamp_approach_vector =  Vector(0,0,0.10)
clamp_retract_vector = Vector(0,0,-0.10)
clamp_approach_workpiece_vector =  Vector(0,0,0.30)
clamp_retract_workpiece_vector = Vector(0,0,-0.30)

def resolve_ClampTarget(action, assembly):
    joint_id = (action.target.beam1, action.target.beam2)
    clamp_frame_wcf = assembly.get_joint_attribute(joint_id, "clamp_frame_wcf")
    tool = action.tool
    tool.set_current_location_frame_by_placemnet(clamp_frame_wcf)
    action.target.resolve(tool.current_location, clamp_approach_workpiece_vector, clamp_retract_vector)


def resolve_ToolStorageTarget(action, assembly):
    action.target.resolve(action.tool.storage_location, clamp_approach_vector, clamp_retract_workpiece_vector)

#Loop though all the actions
for action in actions_out:
    
    if action.__class__.__name__ in ["PickWorkpieceAction", "PlaceWorkpieceAction", "DetachWorkpieceAction"]:
        if action.target.__class__.__name__ == "StorageTarget":
            resolve_BeamStorageTarget(action, assembly)
        if action.target.__class__.__name__ == "BeamFinalTarget":
            resolve_BeamFinalTarget(action, assembly)
    
    if action.__class__.__name__ in ["LinearMoveWorkpieceAction", "FreeMoveWorkpieceAction"]:
        if action.target.__class__.__name__ == "BeamAboveJawTarget":
            resolve_BeamAboveJawTarget(action, assembly)
        if action.target.__class__.__name__ == "BeamInJawTarget":
            resolve_BeamInJawTarget(action, assembly)
            
    # Resolve Clamp StorageLocation and Clamp TargetLocation
    if action.__class__.__name__ in ["PickToolAction", "PlaceToolAction"]:
        if action.target.__class__.__name__ == "StorageTarget":
            resolve_ToolStorageTarget(action, assembly)
        if action.target.__class__.__name__ == "ClampTarget":
            #placement_position = compute_clamp_position(action.target.beam1, action.target.beam2)[0] #First result
            resolve_ClampTarget(action, assembly)
            
    # Resolve Items in Action Group
    if action.__class__.__name__ == "ActionGroup":
        for sub_action in action.actions:
            if sub_action.__class__.__name__ in ["LinearMoveWorkpieceAction",]:
                resolve_BeamFinalTarget(sub_action, assembly)
#                tcf_in_world_coords = resolve_workpiece_tcf_in_world_coords(sub_action.workpiece, sub_action.target)
#                t0cf_in_world_coords = resolve_tool_tocp_from_tcp(sub_action.tool, tcf_in_world_coords)
#                sub_action.target.resolve(t0cf_in_world_coords, t0cf_in_world_coords.normal)
# ---------- end resolve_clamp_pos_2 ----------

# ----
# Animation Visualization
show_step = Slider(690, range=0..690)  # disabled
int = Integer(show_step)  # disabled
show_animation = GhPythonScript(scene_objects=create_animation.scene_objects_out, scene_states=create_animation.keyframes_out, show_step=int)  # -> out, visuals_not_attached, visuals_attached; inputs scene_states: list, show_step: Int32; disabled
# ---------- show_animation: Python ----------
__author__ = "leungp"
__version__ = "2020.02.26"

keyframe = scene_states[show_step]

visuals_not_attached = []
visuals_attached = []

from copy import deepcopy

scene_objects = deepcopy(scene_objects)

for key, state in keyframe.items():
    scene_object = scene_objects[key]
    scene_object.set_state(state)
    print "Drawing: %s" % scene_object.name
    if state['is_attached']:
        visuals_attached += scene_object.draw_visuals()
    else:
        visuals_not_attached += scene_object.draw_visuals()
# ---------- end show_animation ----------
item_2 = ListItem(List=create_animation.descriptions, Index=int, Wrap=True)  # disabled
item_3 = ListItem(List=create_animation.keyframes_out, Index=int, Wrap=True)  # disabled
item_4 = ListItem(List=create_animation.robot_T0CF_keyframes, Index=int, Wrap=True)  # disabled
# Tool Retract with Clamp will require multi step retract.
# Implement Short Gripper.
# Better Looking Mesh Visualization
# Collision check between attached geometry and structure
# 
# 
# Robotic Acion Classes
# - FreeSpace
# - Linear
# - IO
# - Gripper Actions
lng = ListLength(List=create_animation.robot_T0CF_keyframes)  # disabled
total_steps = Panel(lng)  # disabled
python_7 = GhPythonScript(x=item_3)  # -> out, a; disabled
# ---------- python_7: Python ----------
__author__ = "leungp"
__version__ = "2020.02.26"

import rhinoscriptsyntax as rs

from pprint import pprint
pprint(x, width = 1)
# ---------- end python_7 ----------
python_8 = GhPythonScript(x=item_4)  # -> out, a; disabled
# ---------- python_8: Python ----------
__author__ = "leungp"
__version__ = "2020.03.03"

from compas_ghpython.utilities import draw_frame
a  = draw_frame(x)
# ---------- end python_8 ----------
scene_objects_states = Panel(python_7.out)  # disabled
sph = Sphere(Base=python_8.a, Radius=0.04)  # disabled
colour = ColourPicker(PickedColour=RGB(91, 250, 62))  # disabled
colour_2 = ColourPicker(PickedColour=RGB(250, 62, 62))  # disabled
preview = CustomPreview(Geometry=show_animation.visuals_not_attached, Material=colour)  # disabled
preview_2 = CustomPreview(Geometry=show_animation.visuals_attached, Material=colour_2)  # disabled

concat_2 = Concatenate(FragmentA=panel_16, FragmentB=int, FragmentC=panel_15, FragmentD=item_2)  # disabled

step_description = Panel(concat_2)  # disabled

tag = TextTag3D(
    Location=Plane(origin=(16.41141328, 3.827116559, 0), x=(0.9022965756, -0.4311158658, 0), y=(-0.008179768992, -0.01711970757, 0.9998199873)),
    Text=step_description,
    Size=number_slider_4,
    Justification=7)  # disabled
pln = Plane(python_8.a)  # disabled
