# Grasshopper definition Test Load Assembly Process.gh (Grasshopper 1.0.7)

auto_json_path = GhPythonScript()  # -> folder_path, json_path
# ---------- auto_json_path: Python ----------
from Rhino.RhinoDoc import ActiveDoc
import os
json_path = os.path.splitext(ActiveDoc.Path)[0] + "_assembly.json"
folder_path = os.path.splitext(ActiveDoc.Path)[0]
# ---------- end auto_json_path ----------
concat = Concatenate(FragmentA=auto_json_path.folder_path, FragmentB="_assembly.json")
concat_2 = Concatenate(FragmentA=auto_json_path.folder_path, FragmentB="_assembly.reserial.json")
concat_3 = Concatenate(FragmentA=auto_json_path.folder_path, FragmentB="_process.json")
concat_4 = Concatenate(FragmentA=auto_json_path.folder_path, FragmentB="_process.reserial.json")

# ----
# Load assembly file
file_path = FilePath(concat_2)
json_unpickle = GhPythonScript(json_path=file_path, enable=True)  # -> out, warn_col, warn_msg, data; inputs enable: Boolean
# ---------- json_unpickle: Python ----------
import jsonpickle
import os
import datetime

if enable:
    exist = os.path.exists(json_path)
    if exist:
        f = open(json_path, 'r')
        json_str = f.read()
        data = jsonpickle.decode(json_str, keys=True)
        f.close()
        c_time = datetime.datetime.fromtimestamp(os.path.getmtime(json_path))

        warn_col = "lime"    
        warn_msg = "Assembly File loaded with %s Beams.\n File Modified on %s." % (len(list(data.beams())), c_time)
    else:
        warn_col = "orange"    
        warn_msg = "Assembly File not created yet"
# ---------- end json_unpickle ----------
legend = Legend(Colour=json_unpickle.warn_col, Tags=json_unpickle.warn_msg, LegendType=1)

# ----
# Load assembly file
file_path_2 = FilePath(concat)
json_unpickle_2 = GhPythonScript(json_path=file_path_2, enable=True)  # -> out, warn_col, warn_msg, data; inputs enable: Boolean; same code as json_unpickle
legend_2 = Legend(Colour=json_unpickle_2.warn_col, Tags=json_unpickle_2.warn_msg, LegendType=1)

panel = Panel(json_unpickle.out)
panel_2 = Panel(json_unpickle_2.out)

# ----
# Load Proecss file
file_path_3 = FilePath(concat_4)

json_unpickle_3 = GhPythonScript(path=file_path_3, enable=True)  # -> out, a, warn_col, warn_msg, data; inputs enable: Boolean
# ---------- json_unpickle_3: Python ----------
import jsonpickle
import os
import datetime
if enable:
    exist = os.path.exists(path)
    if exist:
        with open(path, 'r') as f:
            data = jsonpickle.decode(f.read(), keys=True)
        c_time = datetime.datetime.fromtimestamp(os.path.getmtime(path))
        warn_col = "lime"
        warn_msg = "Process File loaded with %s Beams, %s Clamps, %s Grippers.\n File Modified on %s." % (len(list(data.assembly.beams())), len(list(data.clamps)), len(list(data.grippers)), c_time)
    else:
        warn_col = "orange"    
        warn_msg = "Process File not created yet"
# ---------- end json_unpickle_3 ----------

legend_3 = Legend(Colour=json_unpickle_3.warn_col, Tags=json_unpickle_3.warn_msg, LegendType=2)
process = Data(json_unpickle_3.data)

panel_3 = Panel(json_unpickle_3.out)

# ----
# Load Proecss file
file_path_4 = FilePath(concat_3)

json_unpickle_4 = GhPythonScript(path=file_path_4, enable=True)  # -> out, a, warn_col, warn_msg, data; inputs enable: Boolean; same code as json_unpickle_3

legend_4 = Legend(Colour=json_unpickle_4.warn_col, Tags=json_unpickle_4.warn_msg, LegendType=2)
process_2 = Data(json_unpickle_4.data)

panel_4 = Panel(json_unpickle_4.out)
