# Grasshopper definition Assembly Design Example.gh (Grasshopper 1.0.7)
# plug-ins: Human

# ----
# Reload Python Modules (if Module Code is Changed)
python_module_to_reload = Panel("""compas
compas_fab
roslibpy
integral_timber_joints""")
# Development Tools
reload = Button()
py = PythonScript(reload_module_button=reload, module_names=python_module_to_reload)  # inputs module_names: list
# ---------- py: Python ----------
import compas_ghpython
from compas_ghpython import unload_modules
if reload_module_button:
    for module in module_names:
        unload_modules(module)
# ---------- end py ----------

# ----
# Check Path and Environment
compas_version = GhPythonScript()  # -> out, compas_version, compas_fab_version, compas_path, compas_fab_path, compas_env_name, python_directory
# ---------- compas_version: Python ----------
__author__ = "leungp"
__version__ = "2020.04.20"

import rhinoscriptsyntax as rs
import compas
import compas_fab
compas_version  = compas.__version__
compas_fab_version = compas_fab.__version__
import os
compas_path = os.path.abspath(compas.__file__)
compas_fab_path = os.path.abspath(compas_fab.__file__)

import compas_bootstrapper
compas_env_name = compas_bootstrapper.ENVIRONMENT_NAME
python_directory = compas_bootstrapper.PYTHON_DIRECTORY
# ---------- end compas_version ----------
compas_environment_name = Panel(compas_version.compas_env_name)
compas_version_2 = Panel(compas_version.compas_version)
compas_fab_version = Panel(compas_version.compas_fab_version)
compas_path = Panel(compas_version.compas_path)
compas_fab_path = Panel(compas_version.compas_fab_path)
python_directory = Panel(compas_version.python_directory)

# ----
# Select Joint Directions
lap_joint_auto_direction = Button()
lap_joint_d1 = Button()
automatic_sequence_bottom_to_top = Button()
move_earlier = Button()
# Assembly Direction
move_later = Button()
enable_interactive_selection_disable_to = BooleanToggle(True)  # "Enable Interactive Selection (disable to resume normal Rhino function)"
lap_joint_d2 = Button()
# Assembly Sequence
flip_lap_joint_on_selected_beam = Button()
# Create Assembly Geometry
# What happens: WARNING: Overwrites previously defined Assembly files
# Creates one Assembly object containing all selected Beams. Beam direction auto detect from input geometry. No Sequence is defined, no joints are defined.
create_new_assembly_overwrite = Button()
# Save Edits
save_assembly_to_disk = Button()
assembly_json_path = GhPythonScript()  # -> json_path
# ---------- assembly_json_path: Python ----------
from Rhino.RhinoDoc import ActiveDoc
import os
json_path = os.path.splitext(ActiveDoc.Path)[0] + "_assembly.json"
# ---------- end assembly_json_path ----------
structure_layer = GeometryPipeline(
    GroupByLayer=False,
    GroupByType=False,
    IncludeHidden=True,
    IncludeLocked=True,
    LayerFilter="Structure",
    NameFilter="*",
    SublayerFiltering=True,
    TypeFilter=1073741848)
mesh_brep = MeshBrep(
    Brep=structure_layer,
    Settings={GridMaxCount=0, GridMinCount=16, JaggedSeams=False, MaxEdgeLength=0, MinEdgeLength=0.0001, MinTolerance=0, Refine=True, RefineAngle=0, RelativeTolerance=0.65, SimplePlanes=True, Tolerance=0})
font = Panel("DejaVu Sans Mono")
auto_beam_frame = AutoBeamFrame(C=mesh_brep)
new_assembly = GhPythonScript(activate=create_new_assembly_overwrite, beam_meshes=mesh_brep, guids=structure_layer, orientation_planes=auto_beam_frame)  # -> warn_col, warn, out, assembly; inputs beam_meshes: list of Mesh, guids: list of Guid, orientation_planes: list
# ---------- new_assembly: Python ----------
if activate:
    
    from compas_rhino.geometry import RhinoMesh, RhinoPlane
    from integral_timber_joints.assembly import Assembly
    from integral_timber_joints.geometry import Beam
    
    # Assert List length of beam_mesh, guid, orientation_plane are same
    assert len(beam_meshes) == len(guids)
    assert len(beam_meshes) == len(orientation_planes)
    
    # Create Assmebly object, the main object.
    assembly = Assembly()
    
    # create Beam Elements and add it to Assembly
    for index, (beam_mesh, guid, orientation_plane) in enumerate(zip(beam_meshes, guids, orientation_planes)):
        
        # Convert input to compas mesh
        compas_mesh = RhinoMesh.from_geometry(beam_mesh).to_compas()
        compas_frame = RhinoPlane.from_geometry(orientation_plane).to_compas()
        # Beam class method
        beam = Beam.from_mesh(compas_mesh, compas_frame)
        
        # Create key/identifier of the beam. The number do not represent sequence
        beam.name ='b%s'% index 
        
        # Guid of the Rhino object is tracked for later interactive selection design process
        beam.guid = guid.__str__()
        
        # Add beam to assembly
        assembly.add_beam(beam)
        print ("%s : Guid(%s)" % (beam, beam.guid))
# ---------- end new_assembly ----------
assembly_json_path_2 = GhPythonScript()  # -> json_path; same code as assembly_json_path
json_pickle = GhPythonScript(stuff=new_assembly.assembly, json_output_path=assembly_json_path_2, output=create_new_assembly_overwrite)  # -> update_trigger; inputs output: Boolean
# ---------- json_pickle: Python ----------
if output:
    import jsonpickle
    jsonpickle.set_preferred_backend('json')
    jsonpickle.set_encoder_options('json')
    
    with open(json_output_path, 'w') as f:
        f.write(jsonpickle.encode(stuff, keys=True, make_refs=False))
# ---------- end json_pickle ----------

# ----
# Load assembly file
reload_assembly_from_disk = Button()
# Interactive Edit
# - Joint , Sequence, Direction Design
auto_json_path = GhPythonScript()  # -> json_path; same code as assembly_json_path
file_path = FilePath(auto_json_path)
json_unpickle = GhPythonScript(json_path=file_path, enable=True, reload=reload_assembly_from_disk, reload_trigger=json_pickle)  # -> warn_col, warn_msg, data; inputs enable: Boolean
# ---------- json_unpickle: Python ----------
import jsonpickle
import os
if enable and not reload:
    exist = os.path.exists(json_path)
    if exist:
        f = open(json_path, 'r')
        json_str = f.read()
        data = jsonpickle.decode(json_str, keys=True)
        f.close()
        warn_col = "lime"    
        warn_msg = "Assembly File loaded with %s Beams" % (len(list(data.beams())))
    else:
        warn_col = "orange"    
        warn_msg = "Assembly File not created yet"
# ---------- end json_unpickle ----------
legend = Legend(Colour=json_unpickle.warn_col, Tags=json_unpickle.warn_msg, LegendType=1)
update_meshes = GhPythonScript(assembly=json_unpickle.data, force=False)  # -> out, assembly_out; inputs force: Boolean
# ---------- update_meshes: Python ----------
__author__ = "leungp"
__version__ = "2020.02.19"

from compas_ghpython.helpers import mesh_draw

assembly_out = assembly

for beam_id in assembly.beam_ids():
    if force or assembly.beam(beam_id).cached_mesh is None:
        assembly.update_beam_mesh_with_joints(beam_id)
# ---------- end update_meshes ----------

python = GhPythonScript(assembly=json_unpickle.data)  # -> out, a
# ---------- python: Python ----------
for beam_id in assembly.sequence:
    beam = assembly.beam(beam_id)
    print assembly.node_attribute(beam_id, 'assembly_wcf_final')
# ---------- end python ----------
panel = Panel(python.out)

# ----
# Clickable Joint  Preview
# Not Selected Joint
# Selected Joint
intersection_joint_selector = GhPythonScript(assembly=update_meshes.assembly_out)  # -> out, joint_breps, joint_ids, assembly_out
# ---------- intersection_joint_selector: Python ----------
from Rhino.Geometry.Brep import CreateBooleanIntersection
from Rhino.RhinoDoc import ActiveDoc
import rhinoscriptsyntax as rs

import System
import Rhino
from Rhino.Geometry.Brep import TryConvertBrep
from ghpythonlib.components import SolidIntersection

assembly_out = assembly

joint_breps = []
joint_ids = []
beam_ids = list(assembly.beam_ids())

# Loop thorugh the list in an Strict Lower triangle 
# Computational cost O(n^2)/2
for i, bid_i in enumerate(beam_ids):
    for j, bid_j in enumerate(beam_ids[:i]):
        
        joint_id = (bid_i, bid_j)
        # Intersect BRep and allow for selection
        i_guid = assembly.beam(bid_i).guid
        j_guid = assembly.beam(bid_j).guid
        i_brep = ActiveDoc.Objects.FindId(System.Guid(i_guid))
        j_brep = ActiveDoc.Objects.FindId(System.Guid(j_guid))
        
        if type(i_brep)==Rhino.DocObjects.ExtrusionObject:
            i_brep = TryConvertBrep(i_brep.ExtrusionGeometry)
        if type(j_brep)==Rhino.DocObjects.ExtrusionObject:
            j_brep = TryConvertBrep(j_brep.ExtrusionGeometry)
            
        # Brep Intersection
        boolean_result = SolidIntersection(i_brep, j_brep)
        
        # If result is not empty, send to output.
        if boolean_result is None:
            print ("Joint(%s-%s) : None" % joint_id)
            continue
        
        if type(boolean_result) is not list :
            print ("Joint(%s-%s) : One Result" % joint_id)
            joint_breps.append(boolean_result)
            joint_ids.append(joint_id)
        else:
            print ("Joint(%s-%s) : len(%s)" % (bid_i, bid_j , len(boolean_result)))
            for result in boolean_result:
                joint_breps.append(result)
                joint_ids.append(joint_id)
# ---------- end intersection_joint_selector ----------
clickable_mesh = ClickableMesh(Enable=enable_interactive_selection_disable_to, Meshes=intersection_joint_selector.joint_breps)  # -> SelectedMeshes, SelectedIndices, MouseLine
all_intersecting_joints = Data(intersection_joint_selector.joint_ids)
stream_filter = StreamFilter(Gate=enable_interactive_selection_disable_to, Stream1=clickable_mesh.SelectedIndices)
cull_index = CullIndex(List=intersection_joint_selector.joint_breps, Indices=clickable_mesh.SelectedMeshes, Wrap=True)
list_item = ListItem(List=intersection_joint_selector.joint_ids, Index=stream_filter, Wrap=True)
list_item_2 = ListItem(List=intersection_joint_selector.joint_breps, Index=stream_filter, Wrap=True)
selected_joint_id = Panel(list_item)
selected_joint_id_2 = Data(list_item)
custom_preview = CustomPreview(Geometry=cull_index, Material=ColourSwatch(SwatchColor=RGBA(209, 206, 0, 36)))
custom_preview_2 = CustomPreview(Geometry=list_item_2, Material=ColourSwatch(SwatchColor=RGBA(147, 21, 158, 215)))

change_joint_type = GhPythonScript(
    all_joints_id=all_intersecting_joints,
    assembly=update_meshes.assembly_out,
    activate_autolapjoint=lap_joint_auto_direction)  # -> out, assembly_out; inputs all_joints_id: list, activate_autolapjoint: Boolean
# ---------- change_joint_type: Python ----------
from compas_ghpython.helpers import mesh_draw

from integral_timber_joints.geometry import Joint_90lap
from integral_timber_joints.geometry import Joint_90lap_from_beam_beam_intersection

assembly_out = assembly
beam_meshes = []

# Interactively change joint definition
if activate_autolapjoint:
    if all_joints_id is not None:
        for bid_1 , bid_2 in all_joints_id:
            beam1 = assembly.beam(bid_1)
            beam2 = assembly.beam(bid_2)
            joint1, joint2 = Joint_90lap_from_beam_beam_intersection(beam1, beam2)
            assembly_out.add_joint_pair(joint1, joint2, bid_1, bid_2)

    for beam_id in assembly.sequence:
        assembly_out.update_beam_mesh_with_joints(beam_id, skip_if_cached=True)
# ---------- end change_joint_type ----------
change_joint_type_2 = GhPythonScript(
    selected_joint_id=selected_joint_id_2,
    assembly=change_joint_type.assembly_out,
    activate_lap1=lap_joint_d1,
    activate_lap2=lap_joint_d2)  # -> out, existing_joint_id, assembly_out; inputs activate_lap1: Boolean, activate_lap2: Boolean
# ---------- change_joint_type_2: Python ----------
from compas_ghpython.helpers import mesh_draw

from integral_timber_joints.geometry import Joint_90lap
from integral_timber_joints.geometry import Joint_90lap_from_beam_beam_intersection

assembly_out = assembly

# Interactively change joint definition
if activate_lap1 or activate_lap2:
    if selected_joint_id is not None:
        bid_1 , bid_2 = selected_joint_id
        beam1 = assembly_out.beam(bid_1)
        beam2 = assembly_out.beam(bid_2)
        joint1, joint2 = Joint_90lap_from_beam_beam_intersection(beam1, beam2, activate_lap2)
        assembly_out.add_joint_pair(joint1, joint2, bid_1, bid_2)
        assembly_out.update_beam_mesh_with_joints(bid_1)
        assembly_out.update_beam_mesh_with_joints(bid_2)

# Output existing joint_id
existing_joint_id = []
for joint_id in assembly_out.joints():
    existing_joint_id.append(joint_id)
# ---------- end change_joint_type_2 ----------

ghpython_script = GhPythonScript(assembly=change_joint_type_2.assembly_out, enable=True)  # -> out, beam_meshes, beam_ids
# ---------- ghpython_script: Python ----------
from compas_ghpython.helpers import mesh_draw

beam_meshes = []
beam_ids = []
if enable:
    for beam_id in assembly.beam_ids():
        beam = assembly.beam(beam_id)
        beam_meshes.append(mesh_draw(beam.cached_mesh))
        beam_ids.append(beam_id)
# ---------- end ghpython_script ----------
clickable_mesh_2 = ClickableMesh(Enable=enable_interactive_selection_disable_to, Meshes=ghpython_script.beam_meshes)  # -> SelectedMeshes, SelectedIndices, MouseLine
cull_index_2 = CullIndex(List=ghpython_script.beam_meshes, Indices=clickable_mesh_2.SelectedIndices, Wrap=True)
list_item_3 = ListItem(List=ghpython_script.beam_meshes, Index=clickable_mesh_2.SelectedIndices, Wrap=True)
list_item_4 = ListItem(List=ghpython_script.beam_ids, Index=clickable_mesh_2.SelectedIndices, Wrap=True)
selected_beam_name = Panel(list_item_4)
custom_preview_3 = CustomPreview(Geometry=list_item_3, Material=ColourSwatch(SwatchColor=RGBA(27, 170, 209, 181)))
custom_preview_4 = CustomPreview(Geometry=cull_index_2, Material=ColourSwatch(SwatchColor=RGBA(219, 219, 219, 103)))
selected_beam_id = Text(selected_beam_name)

change_joint_type_3 = GhPythonScript(
    selected_beam_id=selected_beam_id,
    assembly=change_joint_type_2.assembly_out,
    activate_flip=flip_lap_joint_on_selected_beam)  # -> out, assembly_out; inputs activate_flip: Boolean
# ---------- change_joint_type_3: Python ----------
from compas_ghpython.helpers import mesh_draw

from integral_timber_joints.geometry import Joint_90lap
from integral_timber_joints.geometry import Joint_90lap_from_beam_beam_intersection

assembly_out = assembly
beam_id = selected_beam_id

# Interactively change joint definition
if activate_flip:
    if beam_id is not None:
        beams_to_update = [beam_id]
        # Loop though neighbous and swap joint
        for neighbour_id in assembly.get_already_built_neighbors(beam_id):
            beam1 = assembly_out.beam(beam_id)
            beam2 = assembly_out.beam(neighbour_id)
            
            # checking if the new choice has a different face_id to flip
            joint1, joint2 = Joint_90lap_from_beam_beam_intersection(beam1, beam2, 1)
            if joint1.face_id == assembly.joint((beam_id, neighbour_id)).face_id:
                joint1, joint2 = Joint_90lap_from_beam_beam_intersection(beam1, beam2, 0)
            
            assembly_out.add_joint_pair(joint1, joint2, beam_id, neighbour_id)
            beams_to_update.append(neighbour_id)
        # Update Mesh           
        for beam_id in beams_to_update:         
            assembly_out.update_beam_mesh_with_joints(beam_id)
# ---------- end change_joint_type_3 ----------
seq_auto_bottom_up = GhPythonScript(assembly=change_joint_type_3.assembly_out, activate=automatic_sequence_bottom_to_top)  # -> out, assembly_out
# ---------- seq_auto_bottom_up: Python ----------
assembly_out = assembly

if activate:
    center_points = []
    for beam in assembly.beams():
        center_point = beam.get_center_point()
        center_points.append((center_point.z, beam))
        
    center_points.sort(key=lambda tup: tup[0])
    
    assembly.sequence = []
    i = 0
    for center_point_z, beam in center_points:
       assembly.sequence.append(beam.name)
       print ("Seq[%s] Beam[%s] Center Point z=%s " % (i, beam.name, center_point_z))
       i += 1
# ---------- end seq_auto_bottom_up ----------
seq_auto_bottom_up_2 = GhPythonScript(
    assembly=seq_auto_bottom_up.assembly_out,
    selected_beam_id=selected_beam_id,
    activate_earlier=move_earlier,
    activate_later=move_later)  # -> out, assembly_out
# ---------- seq_auto_bottom_up_2: Python ----------
assembly_out = assembly
sequence = assembly.sequence
if activate_earlier or activate_later:
    i = sequence.index(selected_beam_id)
    print i
    
    if activate_earlier and i > 0:
        sequence[i-1], sequence[i] = sequence[i], sequence[i-1] 
    if activate_later and i < len(sequence) - 1:
        sequence[i+1], sequence[i] = sequence[i], sequence[i+1]
# ---------- end seq_auto_bottom_up_2 ----------

# ----
# Design Method 1 # Infer Assembly Directions
# from JointGeo and Sequence
beam_ass_dir = GhPythonScript(
    assembly=seq_auto_bottom_up_2.assembly_out,
    downward_placement_amount_if_no_joint=Slider(50, range=0..100),
    beam_in_jaw_position_gap_offset=Slider(5, range=0..10))  # -> out, assembly_out
# ---------- beam_ass_dir: Python ----------
__author__ = "leungp"
__version__ = "2020.02.26"

import rhinoscriptsyntax as rs

from compas.geometry import Vector

assembly_out = assembly

assembly_vector_if_no_joint = Vector(0, 0, -downward_placement_amount_if_no_joint)


#assembly_out.compute_assembly_direction_from_joints_and_sequence(
#    assembly_vector_if_no_joint, 
#    beam_in_jaw_position_gap_offset
#    )
         

def compute_assembly_direction_from_joints_and_sequence(self, assembly_vector_if_no_joint, beam_in_jaw_position_gap_offset):
    """Computes the assembly of all beams based on the assembly sequence and the joints the beam

    Based on the assembly sequence of the beams. We can deduce the assembly direction
    from the joints that are to be clamped to the already-assembled beams.

    """
    from compas.geometry import Vector
    from compas.geometry import Translation
    
    def assembly_direction_contradict(vectors):
        for i, vector_i in enumerate(vectors):
            for j, vector_j in enumerate(list(vectors)[i+1:]):
                if vector_i.dot(vector_j) < 0: return True
        return False  
    
    for beam_id in self.sequence:
        
        beam = self.beam(beam_id)
        print ("> %s" % beam)
        # Compute assembly_wcf_final.
        # It is equal to beam.frame, because the beam is modelled in its final position
        self.set_beam_attribute(beam_id, 'assembly_wcf_final', beam.frame.copy())

        # Compute assembly_wcf_inclamp
        # We are going to check all the joint pairs.
        # Vector is computed from averaging the assembly direction of the joint
        # Vector length is computed from the combined height of pairs of joint.
        # The maximum length value is taken if there are multiple joints.
        assembly_direction_wcf = []
        assembly_vector_length = 0.0
        for _, neighbout_beam_id in self.get_joints_of_beam_connected_to_already_built(beam_id):
            print ("neighbout_beam_id: %s" % neighbout_beam_id)
            joint_on_this_beam = self.joint((beam_id, neighbout_beam_id))
            joint_on_this_neighbor = self.joint((neighbout_beam_id, beam_id))
            
            assembly_direction_wcf.append(joint_on_this_beam.get_assembly_direction(beam).unitized())
            assembly_vector_length = max(joint_on_this_neighbor.height + joint_on_this_beam.height, assembly_vector_length)

        if len(assembly_direction_wcf) == 0:
            # No Neighbouring joint case
            # Handles no_clamp (perhaps) grounded beams v.s. typical clamp installed beams
            assembly_vector_wcf = assembly_vector_if_no_joint
            print("Assembly Direction of Beam (%s) using downward movement %s (ref to wcf)." % (beam.name, assembly_direction_wcf))
        else:
            # Test if the list of assembly_direction_wcf contradicts eachother
            contradict = assembly_direction_contradict(assembly_direction_wcf)
            if contradict :
                # No Solution Case
                print("WARNING: Beam (%s) Assembly direction is blocked by joints." % (beam_id))
                assembly_vector_wcf = None
            else:
                # Solution exist Case
                assembly_vector_wcf = Vector.sum_vectors(assembly_direction_wcf).unitized().scaled(assembly_vector_length + beam_in_jaw_position_gap_offset)
                print("Assembly Direction of Beam (%s) computed from Joints to be %s (ref to wcf)." % (beam_id, assembly_direction_wcf))

        self.set_beam_attribute(beam_id, 'assembly_vector_final', assembly_vector_wcf)
        
        # Compute the assembly_wcf_inclamp by moving back along the assembly_direction_wcf.
        if assembly_vector_wcf is None:
            self.set_beam_attribute(beam_id, 'assembly_wcf_inclamp', None)
            print ('assembly_wcf_inclamp set to None')
            
        else:
            wcf_clamp_transform = Translation.from_vector(assembly_vector_wcf.scaled(-1.0))
            self.set_beam_attribute(beam_id, 'assembly_wcf_inclamp', beam.frame.transformed(wcf_clamp_transform))
            
compute_assembly_direction_from_joints_and_sequence(assembly, assembly_vector_if_no_joint, beam_in_jaw_position_gap_offset)
# ---------- end beam_ass_dir ----------
panel_2 = Panel(beam_ass_dir.out)

json_pickle_2 = GhPythonScript(stuff=beam_ass_dir.assembly_out, json_output_path=assembly_json_path, output=save_assembly_to_disk)  # inputs output: Boolean; same code as json_pickle
ghpython_script_2 = GhPythonScript(assembly=seq_auto_bottom_up_2.assembly_out, activate=True, faces=[2, 4])  # -> out, tag_location, tag_text, tag_size, assembly_out; inputs faces: list
# ---------- ghpython_script_2: Python ----------
from compas_ghpython.utilities import draw_frame

assembly_out = assembly
tag_location = []
tag_text = []
tag_size = []

padding_factor = 0.2
size_factor = 0.6

if activate:
    if faces is None: faces = [1]
    for face_id in faces:
        for i, beam_id in enumerate(assembly.sequence):
            beam = assembly.beam(beam_id)
            face_frame = beam.refernce_side_wcf(face_id)
            
            # Padding
            beam_size_min = min(beam.height, beam.width)
            padding = beam_size_min * padding_factor
            padded_location_origin = face_frame.to_world_coordinates([padding, padding , 0])
            face_frame.point = padded_location_origin
            tag_location.append(draw_frame(face_frame))
            
            # Test and Size
            tag_text.append(".%s." % (i))
            tag_size.append(beam_size_min * size_factor)
# ---------- end ghpython_script_2 ----------
justifiedtext3d = JustifiedText3d(
    Location=ghpython_script_2.tag_location,
    Text=ghpython_script_2.tag_text,
    Size=ghpython_script_2.tag_size,
    HorizontalAlignment=0,
    VerticalAlginment=0,
    Font=font,
    UseMeshes=False,
    Bake=False)

basic_assembly_preview = GhPythonScript(assembly=beam_ass_dir.assembly_out, selected_beam_id=selected_beam_id, enable=True)  # -> out, beam_mesh_prev, beam_mesh_curr, assembly_wcf_inclamp_none
# ---------- basic_assembly_preview: Python ----------
from compas_ghpython.helpers import mesh_draw

beam_mesh_prev = []
beam_mesh_curr = None

# Loop using assembly sequence until we reach the selected_beam_id
if selected_beam_id and enable:
    for beam_id in assembly.sequence:
        beam = assembly.beam(beam_id)
        # The selected beam
        if beam_id == selected_beam_id:
            # Draw beam at assembly_wcf_inclamp
            T = assembly.get_beam_transformaion_to(beam_id, "assembly_wcf_inclamp")
            if T is None:
                assembly_wcf_inclamp_none = True
                beam_mesh_curr = mesh_draw(beam.cached_mesh)
            else:
                assembly_wcf_inclamp_none = False
                beam_mesh_curr = mesh_draw(beam.cached_mesh.transformed(T))
            break
            
        # Before reaching the selected beam
        beam_mesh_prev.append(mesh_draw(beam.cached_mesh))
# ---------- end basic_assembly_preview ----------
stream_filter_2 = StreamFilter(
    Gate=basic_assembly_preview.assembly_wcf_inclamp_none,
    Stream0=ColourSwatch(SwatchColor=RGBA(97, 209, 27, 181)),
    Stream1=ColourSwatch(SwatchColor=RGBA(209, 27, 27, 181)))
custom_preview_5 = CustomPreview(Geometry=basic_assembly_preview.beam_mesh_curr, Material=stream_filter_2)
custom_preview_6 = CustomPreview(Geometry=basic_assembly_preview.beam_mesh_prev, Material=ColourSwatch(SwatchColor=RGBA(219, 219, 219, 103)))

font_2 = Panel("DejaVu Sans Mono")
concatenate = Concatenate(Fragment_A="Beam(", Fragment_B=selected_beam_id, A=")")
render_text_to_screen = RenderTextToScreen(
    Text=concatenate,
    Location=Point(10, 50, 10),
    Size=Slider(22, range=0..100),
    Color=RGB(0, 0, 0),
    Font=font_2,
    m_scWithvp=False)

# ==== cluster AutoBeamFrame
C = ClusterInput()

bbox = BoundingBox(Content=C, Plane=PlaneXY(0, 0, 0))  # -> Box, Box_2
boxprop = BoxProperties(Box=bbox.Box)  # -> Center, Diagonal, Area, Volume, Degeneracy
devec = DeconstructVector(Vector=boxprop.Diagonal)  # -> XComponent, YComponent, ZComponent
sort_dormanant_axis = GhPythonScript(x=devec.XComponent, y=devec.YComponent, z=devec.ZComponent)  # -> out, x_dir, y_dir
# ---------- sort_dormanant_axis: Python ----------
__author__ = "leungp"
__version__ = "2020.02.13"

# x_dir is the longest side
# y_dir is the (typically) shortest side
import rhinoscriptsyntax as rs

vx = rs.CreateVector(1.0, 0, 0)
vy = rs.CreateVector(0, 1.0, 0)
vz = rs.CreateVector(0, 0, 1.0)


if x >= y  and  x >= z:
    x_dir = vx
    y_dir = vz
elif y >= x  and  y >= z:
    x_dir = vy
    y_dir = vz
else:
    x_dir = vz
    y_dir = vx
# ---------- end sort_dormanant_axis ----------
pl = ConstructPlane(Origin=boxprop.Center, XAxis=sort_dormanant_axis.x_dir, YAxis=sort_dormanant_axis.y_dir)

pl_2 = ClusterOutput(pl)
