# Grasshopper definition Preview Planned Path.gh (Grasshopper 1.0.7)
# plug-ins: Kangaroo Components

# ----
# Robot
# Load robot directly from ROS
# (only working if connected and file_server launched)
panel = Panel("192.168.43.28")
panel_2 = Panel("0. Load example UR5 robot")
load = Button()
# 1. Load from local filesystem
panel_3 = Panel("C:\Users\rustr\workspace\robotic_setups\src")
panel_4 = Panel("3. Load from ROS")
restart = Button()
load_2 = Button()
load_3 = Button()
ur5 = PythonScript(load=load)  # -> robot
# ---------- ur5: Python ----------
from scriptcontext import sticky as st

import compas
from compas_fab.robots.ur5 import Robot

compas.PRECISION = '12f'

# store robot in component
guid = str(ghenv.Component.InstanceGuid)
robot_key = "robot_" + guid

if robot_key not in st:
    st[robot_key] = None

if load:
    st[robot_key] = Robot(load_geometry=True).model

robot = st[robot_key]
# ---------- end ur5 ----------
ros = PythonScript(ip=panel, restart=restart)  # -> out, ros_client, is_connected
# ---------- ros: Python ----------
import sys
import time
import logging
import scriptcontext as sc

from compas_fab.backends import RosClient

from System import TimeSpan
from System.Threading import ManualResetEventSlim

LOGGER = logging.getLogger('roslibpy')

key = 'rosclient_%s' % str(ghenv.Component.InstanceGuid)
previous_client = sc.sticky.get(key, None)
if previous_client:
    previous_client.terminate()

ros_client = RosClient(ip, 9090)
sc.sticky[key] = ros_client

waitLock = ManualResetEventSlim(False)

ros_client.on_ready(lambda: waitLock.Set())

if not waitLock.Wait(TimeSpan.FromSeconds(5)):
    raise Exception('Unable to connect to ROS')

LOGGER.info('ROS connection opened')


is_connected = ros_client.is_connected
# ---------- end ros ----------
local = GhPythonScript(path=panel_3, package="abb_irb4600_40_255", load=load_2)  # -> robot
# ---------- local: Python ----------
from scriptcontext import sticky as st

import compas
from compas.robots import LocalPackageMeshLoader
from compas.robots import RobotModel

compas.PRECISION = '12f'

# store robot in component-based key
robot_key = 'robot_{}'.format(str(ghenv.Component.InstanceGuid))

if robot_key not in st:
    st[robot_key] = None

if load:
    loader = LocalPackageMeshLoader(path, package)
    urdf = loader.load_urdf('abb_irb4600_40_255.urdf')
    robot = RobotModel.from_urdf_file(urdf)
    robot.load_geometry(loader)
    st[robot_key] = robot

robot = st[robot_key]
# ---------- end local ----------
load_4 = Button()
python = PythonScript(repo="ros-industrial/abb", package="abb_irb6600_support", branch="kinetic-devel", load=load_3)  # -> robot
# ---------- python: Python ----------
from scriptcontext import sticky as st
import compas
from compas.robots import GithubPackageMeshLoader
from compas.robots import RobotModel

compas.PRECISION = '12f'

# store robot in component-based key
robot_key = 'robot_{}'.format(str(ghenv.Component.InstanceGuid))

if robot_key not in st:
    st[robot_key] = None

if load:
    # Load robot
    loader = GithubPackageMeshLoader(repo, package, branch)

    robot = RobotModel.from_urdf_file(loader.load_urdf('irb6640.urdf'))
    robot.load_geometry(loader)

    st[robot_key] = robot

robot = st[robot_key]
# ---------- end python ----------
is_connected = Panel(ros.is_connected)
python_2 = PythonScript(client=ros.ros_client, load=load_4)  # -> robot; inputs load: Boolean
# ---------- python_2: Python ----------
from scriptcontext import sticky as st
import compas
from compas.robots import RobotModel
from compas_fab.backends import RosClient
from compas_fab.backends import RosFileServerLoader
from compas_fab.ghpython import RobotArtist

# Set high precision to import meshes defined in meters
compas.PRECISION = '24f'

# store robot in component
guid = str(ghenv.Component.InstanceGuid)
robot_key = "robot_" + guid

if robot_key not in st:
    st[robot_key] = None

if client and client.is_connected and load:
   
    robot = client.load_robot(load_geometry=True)
#    print (robot.__class__.__name__)
#    print (robot.model)
#    print (robot.model.root)
#    robot.info()
    robot.artist = RobotArtist(robot.model)
    robot.scale(1000)
    st[robot_key] = robot

robot = st[robot_key]
# ---------- end python_2 ----------

panel_5 = Panel("2. Load from github")

# ----
# Reload Python Modules (if Module Code is Changed)
python_module_to_reload = Panel("""compas
compas_fab
roslibpy
integral_timber_joints""")
# Development Tools
reload = Button()
py = PythonScript(reload_module_button=reload, module_names=python_module_to_reload)  # inputs module_names: list
# ---------- py: Python ----------
import compas_ghpython
from compas_ghpython import unload_modules
if reload_module_button:
    for module in module_names:
        unload_modules(module)
# ---------- end py ----------

# ----
# Check Path and Environment
compas_version = GhPythonScript()  # -> out, compas_version, compas_fab_version, compas_path, compas_fab_path, compas_env_name, python_directory
# ---------- compas_version: Python ----------
__author__ = "leungp"
__version__ = "2020.04.20"

import rhinoscriptsyntax as rs
import compas
import compas_fab
compas_version  = compas.__version__
compas_fab_version = compas_fab.__version__
import os
compas_path = os.path.abspath(compas.__file__)
compas_fab_path = os.path.abspath(compas_fab.__file__)

import compas_bootstrapper
compas_env_name = compas_bootstrapper.ENVIRONMENT_NAME
python_directory = compas_bootstrapper.PYTHON_DIRECTORY
# ---------- end compas_version ----------
compas_environment_name = Panel(compas_version.compas_env_name)
compas_version_2 = Panel(compas_version.compas_version)
compas_fab_version = Panel(compas_version.compas_fab_version)
compas_path = Panel(compas_version.compas_path)
compas_fab_path = Panel(compas_version.compas_fab_path)
python_directory = Panel(compas_version.python_directory)

# ----
# Load Proecss file
process_json_path = GhPythonScript()  # -> process_json_path, prepathplan_json_path, pathplan_json_path
# ---------- process_json_path: Python ----------
from Rhino.RhinoDoc import ActiveDoc
import os
process_json_path = os.path.splitext(ActiveDoc.Path)[0] + "_process.json"
prepathplan_json_path =  os.path.splitext(ActiveDoc.Path)[0] + "_prepathplan.json"
pathplan_json_path =  os.path.splitext(ActiveDoc.Path)[0] + "_pathplan.json"
# ---------- end process_json_path ----------
file_path = FilePath(process_json_path.prepathplan_json_path)
json_unpickle = GhPythonScript(json_path=file_path, enable=True)  # -> out, a, warn_col, warn_msg, data; inputs enable: Boolean
# ---------- json_unpickle: Python ----------
import jsonpickle
import os
load_success = jsonpickle.load_backend('json')
print (load_success)

if enable:
    exist = os.path.exists(json_path)
    if exist:
        f = open(json_path, 'r')
        json_str = f.read()
        data = jsonpickle.decode(json_str, keys=True)
        f.close()
        warn_col = "lime"    
        warn_msg = "Process File loaded with %s Beams, %s Clamps, %s Grippers" % (len(list(data.assembly.beams())), len(list(data.clamps)), len(list(data.grippers)))
    else:
        warn_col = "orange"    
        warn_msg = "Process File not created yet"
# ---------- end json_unpickle ----------
python_3 = GhPythonScript()  # -> out, a
# ---------- python_3: Python ----------
import sys 
print("Python version") 
print (sys.version) 
print("Version info.") 
print (sys.version_info)

import jsonpickle


load_success = jsonpickle.load_backend('json')
print (load_success)
# ---------- end python_3 ----------
legend = Legend(Colour=json_unpickle.warn_col, Tags=json_unpickle.warn_msg, LegendType=1)
panel_6 = Panel(json_unpickle.out)
process = Data()
next = Button()
prev = Button()
python_4 = GhPythonScript(process=process)  # -> out, movements
# ---------- python_4: Python ----------
from integral_timber_joints.process.action import RoboticMovement

movement_list = []
for i, action in enumerate(process.actions):
    print ("Seq(%s) Act(%s) %s"%(action.seq_n, i, action.__str__()))
    for movement in action.movements:
        if isinstance(movement, RoboticMovement):
            movement_list.append(movement)
# ---------- end python_4 ----------
number_slider = Slider(0, range=0..0.999)
or = GateOr(A=next, B=prev)
python_5 = GhPythonScript(process=process, reset=Button(), next=next, prev=prev)  # -> i, movement, all_movements; inputs reset: Boolean, next: Boolean, prev: Boolean
# ---------- python_5: Python ----------
from integral_timber_joints.process.action import RoboticMovement
        
if reset:
    index = 0
    movement_list = []
    for action in process.actions:
        for movement in action.movements:
            if isinstance(movement, RoboticMovement):
                movement_list.append(movement)
        
if next and index < len(movement_list) - 1:
    index = index + 1
if prev and index > 0:
    index = index - 1
        
i = index
movement = movement_list[index]
        
all_movements = [m.__str__() for m in movement_list]
# ---------- end python_5 ----------
timer = Timer(TimerInterval=100, Target=counter)
counter = Counter(Reset=or)
number_slider_2 = Slider(0.9999, range=0..1)
multiplication = Multiplication(A=counter, B=Slider(0.06, range=0..0.1))
concat = Concatenate()
panel_7 = Panel(python_5.i)
mod = Modulus(A=multiplication, B=number_slider_2)
min = Minimum(A=multiplication, B=number_slider_2)
python_6 = GhPythonScript(robot=python_2, movement=python_5.movement, index=min)  # -> out, configuration, joint_names, values, a
# ---------- python_6: Python ----------
from copy import deepcopy

trajectory = movement.trajectory

index = int(index * len(trajectory.points))
configuration = deepcopy(trajectory.points[index])

#print (trajectory.joint_names)
#print (trajectory.start_configuration)

configuration.joint_names = trajectory.joint_names
joint_names = trajectory.joint_names
values = configuration.values


configuration = robot.merge_group_with_full_configuration(
    configuration,
    trajectory.start_configuration,
    "robot11_eaXYZ")
#print (configuration)
# ---------- end python_6 ----------

# ----
# Visualisation
show_end_effector_frame = BooleanToggle(True)
show_base_frame = BooleanToggle(False)
show_collision = BooleanToggle(False)
show_frames = BooleanToggle(False)
show_visual = BooleanToggle(True)
visualize = PythonScript(
    robot=python_2,
    configuration=python_6.configuration,
    show_visual=show_visual,
    show_collision=show_collision,
    show_frames=show_frames,
    show_base_frame=show_base_frame,
    show_end_effector_frame=show_end_effector_frame)  # -> visual, collision, frames, ee_frame, base_frame
# ---------- visualize: Python ----------
"""Visualizes a robot.
    Inputs:
        robot: The robot
        configuration: :class:`compas_fab.robots.Configuration`
            The robot's full configuration to display.
        show_visual: bool
           Whether or not to show the robot's visual meshes.
        show_collision: bool
           Whether or not to show the robot's collision meshes.
        show_frames: bool
           Whether or not to show the robot's joint frames.
        show_base_frame: bool
           Whether or not to show the robot's base frame.
        show_end_effector_frame: bool
            Whether or not to show the robot's end-effector frame.
    Output:
        visual: The robot's visual meshes.
        collision: The robot's collision meshes.
        frames: The robot's joint frames.
        base_frame: The robot's base frame.
        ee_frame: The robot's end-effector frame.
"""
from __future__ import print_function

print (robot.__class__.__name__)

if robot and configuration:

    robot.update(configuration, visual=show_visual, collision=show_collision)
    
    if show_visual:
        visual = robot.draw_visual()

    if show_collision:
        collision = robot.draw_collision()

    if show_frames:
        axes = robot.transformed_axes(configuration)
        frames = robot.transformed_frames(configuration)

    if show_base_frame:
        frames = robot.transformed_frames(configuration)
        base_frame = frames[0]

    if show_end_effector_frame:
        ee_frame = robot.forward_kinematics(configuration)
        print("End-effector", ee_frame)
# ---------- end visualize ----------
draw = GhPythonScript(frames=[visualize.frames, visualize.ee_frame, visualize.base_frame], scale=Slider(1000, range=0..1000))  # -> P, V, C, W; inputs frames: list
# ---------- draw: Python ----------
from System.Drawing import Color
from compas_ghpython import draw_frame

red = Color.FromArgb(255, 0, 0)
green = Color.FromArgb(0, 255, 0)
blue = Color.FromArgb(0, 0, 255)

P = []
V = []
C = []

scale = float(scale)

for frame in frames:
    if not frame:
        continue
    plane = draw_frame(frame)
    P += [plane.Origin] * 3
    V.append(plane.XAxis * scale)
    V.append(plane.YAxis * scale)
    V.append(plane.ZAxis * scale)
    C += [red, green, blue]

W = 3
# ---------- end draw ----------
geo = Geometry(visualize.visual)
geo_2 = Geometry(visualize.collision)
vdisex = VectorDisplayEx(Point=draw.P, Vector=draw.V, Colour=draw.C, Width=draw.W)

python_7 = GhPythonScript(Movement=python_5.movement)  # -> Out, A
pos = Panel(min)
panel_8 = Panel(python_6.joint_names)
panel_9 = Panel(python_6.values)
