# Grasshopper definition Process Design Development.gh (Grasshopper 1.0.7)
# plug-ins: Kangaroo Components

# ----
# Check Path and Environment
compas_version = GhPythonScript()  # -> out, compas_version, compas_fab_version, compas_path, compas_fab_path, compas_env_name, python_directory
# ---------- compas_version: Python ----------
__author__ = "leungp"
__version__ = "2020.04.20"

import rhinoscriptsyntax as rs
import compas
import compas_fab
compas_version  = compas.__version__
compas_fab_version = compas_fab.__version__
import os
compas_path = os.path.abspath(compas.__file__)
compas_fab_path = os.path.abspath(compas_fab.__file__)

import compas_bootstrapper
compas_env_name = compas_bootstrapper.ENVIRONMENT_NAME
python_directory = compas_bootstrapper.PYTHON_DIRECTORY
# ---------- end compas_version ----------
compas_environment_name = Panel(compas_version.compas_env_name)
compas_version_2 = Panel(compas_version.compas_version)
compas_fab_version = Panel(compas_version.compas_fab_version)
compas_path = Panel(compas_version.compas_path)
compas_fab_path = Panel(compas_version.compas_fab_path)
python_directory = Panel(compas_version.python_directory)

# ----
# Sort Sequence by Name
brep = Brep([<brep referenced from the Rhino model> x14])
id = Guid(brep)
# Define Beams by converting from Rhino BRep
bbox = BoundingBox(Content=brep, Plane=PlaneXY(0, 0, 0))  # -> Box, Box_2
name = PythonScript(id=id)  # -> a
# ---------- name: Python ----------
import rhinoscriptsyntax as rs
import scriptcontext as sc
import Rhino

sc.doc = Rhino.RhinoDoc.ActiveDoc

o = sc.doc.Objects.Find(id)
a = o.Attributes.Name

sc.doc = ghdoc
# ---------- end name ----------
volume = Volume(Geometry=bbox.Box)  # -> Volume, Centroid
sort = SortList(Keys=name, ValuesB=brep, ValuesA=volume.Centroid)  # -> Keys, ValuesB, ValuesA
beam_centroid = Point(sort.ValuesA)
beam_geo = Geometry(sort.ValuesB)

vector = Vector("{0,0,-180}")
vector_2 = Vector("{-120,0,-5}")

# ----
# Define Clamp / Gripper Types
number_slider = Slider(105, range=0..1000)
geo = Geometry(<mesh referenced from the Rhino model>)
pt = Point(<point referenced from the Rhino model>)
unit_z = UnitZ(Factor=number_slider)
geo_2 = Geometry(<mesh referenced from the Rhino model>)
geo_3 = Geometry(<mesh referenced from the Rhino model>)
pt_2 = Point(<point referenced from the Rhino model>)
geo_4 = Geometry(<brep referenced from the Rhino model>)
geo_5 = Geometry(<brep referenced from the Rhino model>)
pt_3 = Point(<point referenced from the Rhino model>)
geo_6 = Geometry(<brep referenced from the Rhino model>)
geo_7 = Geometry(<brep referenced from the Rhino model>)
geo_8 = Geometry(<brep referenced from the Rhino model>)
pt_4 = Point(<point referenced from the Rhino model>)
unit_z_2 = UnitZ(Factor=Slider(105, range=0..1000))
xy = XYPlane(Origin=pt_2)
xy_2 = XYPlane(Origin=pt)
xy_3 = XYPlane(Origin=Point(0, 0, 0))
xy_4 = XYPlane(Origin=pt_4)
xy_5 = XYPlane(Origin=pt_3)
xy_6 = XYPlane(Origin=Point(0, 0, 0))
mesh = Mesh(geo)
mesh_2 = Mesh(geo_2)
mesh_3 = Mesh(geo_3)
mesh_4 = Mesh(geo_7)
mesh_5 = Mesh(geo_4)
mesh_6 = Mesh(geo_5)
mesh_7 = Mesh(geo_6)
mesh_8 = Mesh(geo_8)
create_gripper = GhPythonScript(
    name="g1",
    type_name="long_gripper",
    base_mesh=mesh_2,
    l_jaw_mesh=mesh_3,
    r_jaw_mesh=mesh,
    tool_coordinate_frame=xy,
    tool_pick_up_frame=xy_2,
    tool_storage_frame=xy_3,
    approach_vector=unit_z)  # -> out, visual, robot_model; inputs base_mesh: Mesh, l_jaw_mesh: Mesh, tool_coordinate_frame: Plane, tool_pick_up_frame: Plane, tool_storage_frame: Plane, approach_vector: Vector3d
# ---------- create_gripper: Python ----------
#from compas_ghpython import unload_modules
#unload_modules("integral_timber_joints")

from compas.geometry import Frame
from compas_rhino.geometry import RhinoPlane, RhinoMesh, RhinoVector
from integral_timber_joints.tools import Gripper

from compas_ghpython.helpers import mesh_draw

#robot_model = Gripper(name, type_name)
robot_model = Gripper.ParallelGripperFactory(
    name,
    type_name,
    0,100,
    tool_coordinate_frame = RhinoPlane.from_geometry(tool_coordinate_frame).to_compas(),
    tool_pick_up_frame = RhinoPlane.from_geometry(tool_pick_up_frame).to_compas(),
    tool_storage_frame = RhinoPlane.from_geometry(tool_storage_frame).to_compas(),
    mesh_gripper_base = RhinoMesh.from_geometry(base_mesh).to_compas(),
    mesh_gripper_jaw_l = RhinoMesh.from_geometry(l_jaw_mesh).to_compas(),
    mesh_gripper_jaw_r = RhinoMesh.from_geometry(r_jaw_mesh).to_compas(),
    approach_vector = RhinoVector.from_geometry(approach_vector).to_compas(),
    )

visual = [mesh_draw(mesh) for mesh in robot_model.draw_visuals()]
# ---------- end create_gripper ----------
create_clamp = GhPythonScript(
    name="generic_clamp",
    type_name="90lap",
    base_mesh=mesh_7,
    l_body_mesh=mesh_4,
    r_body_mesh=mesh_5,
    l_jaw_mesh=mesh_8,
    r_jaw_mesh=mesh_6,
    tool_coordinate_frame=xy_4,
    tool_pick_up_frame=xy_5,
    tool_storage_frame=xy_6,
    approach_vector=unit_z_2,
    detachretract1_vector=vector_2,
    detachretract2_vector=vector)  # -> out, visual, robot_model; inputs base_mesh: Mesh, l_body_mesh: Mesh, tool_coordinate_frame: Plane, tool_pick_up_frame: Plane, tool_storage_frame: Plane, detachretract1_vector: Vector3d, detachretract2_vector: Vector3d
# ---------- create_clamp: Python ----------
#from compas_ghpython import unload_modules
#unload_modules("integral_timber_joints")

from compas.geometry import Frame
from compas_rhino.geometry import RhinoPlane, RhinoMesh, RhinoVector
from integral_timber_joints.tools import Clamp

from compas_ghpython.helpers import mesh_draw

robot_model = Clamp.Lap90ClampFactory(
    name,
    type_name,
    0,20,
    0,120,
    tool_coordinate_frame = RhinoPlane.from_geometry(tool_coordinate_frame).to_compas(),
    tool_pick_up_frame = RhinoPlane.from_geometry(tool_pick_up_frame).to_compas(),
    tool_storage_frame = RhinoPlane.from_geometry(tool_storage_frame).to_compas(),
    mesh_gripper_base = RhinoMesh.from_geometry(base_mesh).to_compas(),
    mesh_gripper_jaw_l = RhinoMesh.from_geometry(l_body_mesh).to_compas(),
    mesh_gripper_jaw_r = RhinoMesh.from_geometry(r_body_mesh).to_compas(),
    mesh_clamp_jaw_l = RhinoMesh.from_geometry(l_jaw_mesh).to_compas(),
    mesh_clamp_jaw_r = RhinoMesh.from_geometry(r_jaw_mesh).to_compas(),
    approach_vector = RhinoVector.from_geometry(approach_vector).to_compas(),
    detachretract1_vector = RhinoVector.from_geometry(detachretract1_vector).to_compas(),
    detachretract2_vector = RhinoVector.from_geometry(detachretract2_vector).to_compas(),
    )

visual = [mesh_draw(mesh) for mesh in robot_model.draw_visuals()]
# ---------- end create_clamp ----------

enable_interactive_input = BooleanToggle(False)
assembly_step = Slider(9, range=0..13)

# ----
# Interactive design workflow
# Load
ghpython_script = GhPythonScript()  # -> json_path
# ---------- ghpython_script: Python ----------
__author__ = "leungp"
__version__ = "2020.04.29"

import rhinoscriptsyntax as rs
from Rhino.RhinoDoc import ActiveDoc
import os
json_path = os.path.splitext(ActiveDoc.Path)[0] + ".json"
# ---------- end ghpython_script ----------
file_path = FilePath(ghpython_script)
json_unpickle = GhPythonScript(json_path=file_path, enable=enable_interactive_input)  # -> json_str, data; inputs enable: Boolean
# ---------- json_unpickle: Python ----------
import jsonpickle
#import compas
#print( compas.__version__)
#from integral_timber_joints.geometry import Beam
if enable:
    f = open(json_path, 'r')
    json_str = f.read()
    data = jsonpickle.decode(json_str, keys=True)
    f.close()
# ---------- end json_unpickle ----------
update_meshes = GhPythonScript(process=json_unpickle.data)  # -> out, process_out
# ---------- update_meshes: Python ----------
__author__ = "leungp"
__version__ = "2020.02.19"

from compas_ghpython.helpers import mesh_draw

process_out = process
[process_out.assembly.update_beam_mesh_with_joints(beam_id, skip_if_cached = True) for beam_id in process_out.assembly.beam_ids()]
# ---------- end update_meshes ----------

# ----
# Gripper Orientation
# (vector_grasp)
button = Button()
button_2 = Button()
button_3 = Button()
button_4 = Button()
button_5 = Button()
button_6 = Button()
interactive_vec_button = GhPythonScript(x_pos=button, x_neg=button_2, y_pos=button_3, y_neg=button_4, z_pos=button_5, z_neg=button_6)  # -> output
# ---------- interactive_vec_button: Python ----------
from Rhino.Geometry import Vector3d

if x_pos: output = Vector3d(1,0,0)
if x_neg: output = Vector3d(-1,0,0)
if y_pos: output = Vector3d(0,1,0)
if y_neg: output = Vector3d(0,-1,0)
if z_pos: output = Vector3d(0,0,1)
if z_neg: output = Vector3d(0,0,-1)
# ---------- end interactive_vec_button ----------

# ----
# Clamp Orientation
# vector_jawapproach
button_7 = Button()
button_8 = Button()
button_9 = Button()
button_10 = Button()
button_11 = Button()
button_12 = Button()
interactive_vec_button_2 = GhPythonScript(x_pos=button_7, x_neg=button_8, y_pos=button_9, y_neg=button_10, z_pos=button_11, z_neg=button_12)  # -> output; same code as interactive_vec_button

# ----
# Fancy Animate
timer = Timer(TimerInterval=500, Target=counter)  # disabled
counter = Counter(Reset=invert(enable_interactive_input))
evaluate = Evaluate(Expression="x%y+1", x=counter, y="3")

# ----
# Sort Beam Direction and Axis
bbox_2 = BoundingBox(Content=beam_geo, Plane=PlaneXY(0, 0, 0))  # -> Box, Box_2
boxprop = BoxProperties(Box=bbox_2.Box)  # -> Center, Diagonal, Area, Volume, Degeneracy
devec = DeconstructVector(Vector=boxprop.Diagonal)  # -> XComponent, YComponent, ZComponent
sort_dormanant_axis = GhPythonScript(x=devec.XComponent, y=devec.YComponent, z=devec.ZComponent)  # -> out, x_dir, y_dir
# ---------- sort_dormanant_axis: Python ----------
__author__ = "leungp"
__version__ = "2020.02.13"

# x_dir is the longest side
# y_dir is the (typically) shortest side
import rhinoscriptsyntax as rs

vx = rs.CreateVector(1.0, 0, 0)
vy = rs.CreateVector(0, 1.0, 0)
vz = rs.CreateVector(0, 0, 1.0)


if x >= y  and  x >= z:
    x_dir = vx
    y_dir = vz
elif y >= x  and  y >= z:
    x_dir = vy
    y_dir = vz
else:
    x_dir = vz
    y_dir = vx
# ---------- end sort_dormanant_axis ----------
pl = ConstructPlane(Origin=boxprop.Center, XAxis=sort_dormanant_axis.x_dir, YAxis=sort_dormanant_axis.y_dir)

# ----
# Define Clamp / Gripper Instances
# (e.g. multiple idenditical clamps of the same type)
# Define Gripper Instances
number_slider_2 = Slider(16, range=0..20)
pt_5 = ConstructPoint(XCoordinate=Slider(15, range=0..15), YCoordinate=Slider(3, range=0..15), ZCoordinate=0)
pt_6 = ConstructPoint(XCoordinate=Slider(14.5, range=0..15), YCoordinate=Slider(3, range=0..15), ZCoordinate=0)
pt_7 = ConstructPoint(XCoordinate=number_slider_2, YCoordinate=Slider(3, range=0..15), ZCoordinate=0)
pt_8 = Point(<point referenced from the Rhino model>)
pt_9 = Point(<point referenced from the Rhino model>)
pt_10 = Point(<point referenced from the Rhino model>)
pl_2 = ConstructPlane(Origin=pt_10, XAxis=Vector(-2.098851206, 0, 0), YAxis=Vector(0, 1, 0))
pl_3 = ConstructPlane(Origin=pt_8, XAxis=Vector(-2.098851206, 0, 0), YAxis=Vector(0, 1, 0))
pl_4 = ConstructPlane(Origin=pt_9, XAxis=Vector(-2.098851206, 0, 0), YAxis=Vector(0, 1, 0))
clamp_instance = GhPythonScript(robot_model=create_clamp.robot_model, clamp_id="c1", storage_location=pl_2)  # -> out, robot_model_out
# ---------- clamp_instance: Python ----------
from copy import deepcopy
from integral_timber_joints.ghpython.utilities import rPlane2cFrame

# Deep copy should be performed before editing
robot_model_out = deepcopy(robot_model)

# Set State
robot_model_out.current_frame = rPlane2cFrame(storage_location)
robot_model_out.tool_storage_frame = rPlane2cFrame(storage_location)
robot_model_out.name = clamp_id
# ---------- end clamp_instance ----------
clamp_instance_2 = GhPythonScript(robot_model=create_gripper.robot_model, clamp_id="g1", storage_location=pl_4)  # -> out, robot_model_out
# ---------- clamp_instance_2: Python ----------
from copy import deepcopy
from integral_timber_joints.ghpython.utilities import rPlane2cFrame

# Deep copy should be performed before editing
robot_model_out = deepcopy(robot_model)

# Set State
robot_model_out.current_location = rPlane2cFrame(storage_location)
robot_model_out.tool_storage_frame = rPlane2cFrame(storage_location)
robot_model_out.name = clamp_id
# ---------- end clamp_instance_2 ----------
clamp_instance_3 = GhPythonScript(robot_model=create_clamp.robot_model, clamp_id="c2", storage_location=pl_3)  # -> out, robot_model_out; same code as clamp_instance_2
merge = Merge(Data1=clamp_instance.robot_model_out, Data2=clamp_instance_3.robot_model_out)
data = Data(clamp_instance_2.robot_model_out)

# ----
# Compute Clamp Orientation by Custom Guide
clamp_pos = GhPythonScript(process=update_meshes.process_out, step=assembly_step, guide_vector=interactive_vec_button_2)  # -> out, process_out; inputs step: Int32, guide_vector: Vector3d
# ---------- clamp_pos: Python ----------
#from compas_ghpython import unload_modules
#unload_modules("integral_timber_joints")

from compas_rhino.geometry import RhinoVector

# Process object by default through the component unmodified.
process_out = process

# Interactive interface - guide_vector is None when UI Buttons are not pressed

if guide_vector is not None:
    beam_id =  process_out.assembly.sequence[step]

    # Set guide vector according to input
    guide_vector_compas = RhinoVector.from_geometry(guide_vector).to_compas()
    process_out.assembly.set_beam_attribute(beam_id, 'design_guide_vector_jawapproach', guide_vector_compas)
    print("design_guide_vector_jawapproach = %s" % guide_vector_compas)
    
    # Recompute clamp orientation
    clamp_orientations = process_out.search_valid_clamp_orientation_with_guiding_vector(beam_id)
    print("clamp_orientations = %s" % clamp_orientations)

    # Recompute Jaw Approach Vector
    assembly_vector_jawapproach = process_out.search_valid_jawapproach_vector_prioritizing_guide_vector(beam_id)
    print("assembly_vector_jawapproach = %s" % assembly_vector_jawapproach)
# ---------- end clamp_pos ----------

# ----
# Compute Grasp Face by Custom Guide
beam_grasp_frame = GhPythonScript(process=clamp_pos.process_out, step=assembly_step, guide_vector=interactive_vec_button)  # -> out, process_out; inputs step: Int32
# ---------- beam_grasp_frame: Python ----------
#from compas_ghpython import unload_modules
#unload_modules("integral_timber_joints")

from compas.geometry import Vector

from compas_rhino.geometry import RhinoVector

# Process object by default through the component unmodified.
process_out = process

# Interactive interface - guide_vector is None when UI Buttons are not pressed
# In that case, process should simply pass through unmodified.
if guide_vector is not None:
    assembly = process.assembly
    beam_id =  assembly.sequence[step]
    beam = assembly.beam(beam_id)
    
    # Set guide vector according to input
    guide_vector_compas = RhinoVector.from_geometry(guide_vector).to_compas()
    assembly.set_beam_attribute(beam_id, "design_guide_vector_grasp", guide_vector_compas)

    # Recompute best clamp face and update grasp frame
    gripper_grasp_face = process.search_grasp_face_from_guide_vector_dir(beam_id)
    gripper_grasp_dist_from_start = assembly.get_beam_attribute(beam_id, "gripper_grasp_dist_from_start")
    gripper_tcp_in_ocf = beam.grasp_frame_ocf(gripper_grasp_face, gripper_grasp_dist_from_start)

    assembly.set_beam_attribute(beam_id, "gripper_tcp_in_ocf", gripper_tcp_in_ocf)
# ---------- end beam_grasp_frame ----------

# ----
# Visualize Assembly Direction and Clamp Location
colour_swatch = ColourSwatch(SwatchColor=RGB(153, 142, 142))
assembly_step_2 = GhPythonScript(
    process=beam_grasp_frame.process_out,
    step=assembly_step,
    previous_color=colour_swatch,
    current_final_color=ColourSwatch(SwatchColor=RGB(107, 181, 51)),
    current_inclamp_color=ColourSwatch(SwatchColor=RGB(188, 191, 0)),
    current_inclampapproach_color=ColourSwatch(SwatchColor=RGB(199, 165, 101)))  # -> out, previous_beams, current_beam_assembly_wcf_final, current_beam_assembly_wcf_inclamp, current_beam_assembly_wcf_inclampapproach, clamps, gripper_assembly_wcf_final, gripper_assembly_wcf_inclamp, gripper_assembly_wcf_inclampapproach; inputs step: Int32, previous_color: Color, current_final_color: Color
# ---------- assembly_step_2: Python ----------
__author__ = "leungp"
__version__ = "2020.02.19"

from compas_ghpython.helpers import mesh_draw
from compas.geometry import Transformation

assembly = process.assembly

print(assembly.sequence)

# Pick and output the current beam
beam_id = assembly.sequence[step]
beam = assembly.beam(beam_id)
current_beam_assembly_wcf_final = mesh_draw(beam.cached_mesh, color = current_final_color)

# Visualize other locations
T = assembly.get_beam_transformaion_to(beam_id, 'assembly_wcf_inclamp')
current_beam_assembly_wcf_inclamp = mesh_draw(beam.cached_mesh.transformed(T), color = current_inclamp_color)
if assembly.get_beam_attribute(beam_id, 'assembly_wcf_inclampapproach') is not None:
    T = assembly.get_beam_transformaion_to(beam_id, 'assembly_wcf_inclampapproach')
    current_beam_assembly_wcf_inclampapproach = mesh_draw(beam.cached_mesh.transformed(T), color = current_inclampapproach_color)

clamps = []
# Visualize clamps
for neighbour_id in assembly.get_already_built_neighbors(beam_id):
    joint_id = (neighbour_id, beam_id)
    clamp_wcf_final = assembly.get_joint_attribute(joint_id, 'clamp_wcf_final')
    print (clamp_wcf_final)
    clamp_type = assembly.get_joint_attribute(joint_id, 'clamp_type')
    clamp = process.get_one_clamp_by_type(clamp_type).copy()
    clamp.set_current_frame_from_tcp(clamp_wcf_final)
    clamp.clamp_jaw_position = 120
    clamp.gripper_jaw_position = 0
    clamps.append(clamp)
    print (clamp)
    

# Visualize Gripper
gripper_type = assembly.get_beam_attribute(beam_id, 'gripper_type')
gripper = process.get_one_gripper_by_type(gripper_type)
gripper_tcp_in_ocf = assembly.get_beam_attribute(beam_id, "gripper_tcp_in_ocf")
gripper_tcp_in_wcf = gripper_tcp_in_ocf.transformed(Transformation.from_frame(beam.frame))
gripper.set_current_frame_from_tcp(gripper_tcp_in_wcf)
gripper_assembly_wcf_final = [mesh_draw(mesh, current_final_color) for mesh in gripper.draw_visuals()]

T = assembly.get_beam_transformaion_to(beam_id, 'assembly_wcf_inclamp')
gripper.set_current_frame_from_tcp(gripper_tcp_in_wcf.transformed(T))
gripper_assembly_wcf_inclamp = [mesh_draw(mesh, current_inclamp_color) for mesh in gripper.draw_visuals()]

if assembly.get_beam_attribute(beam_id, 'assembly_wcf_inclampapproach') is not None:
    T = assembly.get_beam_transformaion_to(beam_id, 'assembly_wcf_inclampapproach')
    gripper.set_current_frame_from_tcp(gripper_tcp_in_wcf.transformed(T))
    gripper_assembly_wcf_inclampapproach = [mesh_draw(mesh, current_inclampapproach_color) for mesh in gripper.draw_visuals()]


# Pick and output the previously assembled beam(s)
if step > 0:
    previous_beams = []
    for beam_id in assembly.sequence[:step]:
        beam = assembly.beam(beam_id)
        previous_beams.append(mesh_draw(beam.cached_mesh, color = previous_color))
# ---------- end assembly_step_2 ----------
robot_artist = GhPythonScript(robot_model=assembly_step_2.clamps, color=ColourSwatch(SwatchColor=RGB(51, 142, 181)))  # -> out, visual; inputs color: Color
# ---------- robot_artist: Python ----------
if robot_model is not None:

    from compas_ghpython.helpers import mesh_draw
    print(robot_model.name) 
    print (robot_model.links)
    
    visual = [mesh_draw(mesh, color) for mesh in robot_model.draw_visuals()]
# ---------- end robot_artist ----------
unit_x = UnitX(Factor=Slider(2000, range=0..10000))
stream_filter = StreamFilter(
    Gate=evaluate,
    Stream0=[assembly_step_2.gripper_assembly_wcf_final, assembly_step_2.gripper_assembly_wcf_inclamp, assembly_step_2.gripper_assembly_wcf_inclampapproach],
    Stream1=assembly_step_2.gripper_assembly_wcf_inclampapproach,
    Stream2=assembly_step_2.gripper_assembly_wcf_inclamp,
    Stream3=assembly_step_2.gripper_assembly_wcf_final)
stream_filter_2 = StreamFilter(
    Gate=evaluate,
    Stream0=[assembly_step_2.current_beam_assembly_wcf_final, assembly_step_2.current_beam_assembly_wcf_inclamp, assembly_step_2.current_beam_assembly_wcf_inclampapproach],
    Stream1=assembly_step_2.current_beam_assembly_wcf_inclampapproach,
    Stream2=assembly_step_2.current_beam_assembly_wcf_inclamp,
    Stream3=assembly_step_2.current_beam_assembly_wcf_final)
move = Move(Geometry=robot_artist.visual, Motion=unit_x)  # -> Geometry, Transform
move_2 = Move(Geometry=stream_filter, Motion=unit_x)  # -> Geometry, Transform
move_3 = Move(Geometry=assembly_step_2.previous_beams, Motion=unit_x)  # -> Geometry, Transform
move_4 = Move(Geometry=stream_filter_2, Motion=unit_x)  # -> Geometry, Transform

# ----
# Create Beams
mesh_9 = MeshBrep(
    Brep=beam_geo,
    Settings={GridMaxCount=0, GridMinCount=0, JaggedSeams=False, MaxEdgeLength=0, MinEdgeLength=0.0001, MinTolerance=0, Refine=True, RefineAngle=0, RelativeTolerance=0, SimplePlanes=True, Tolerance=0})
createbeamobjects = GhPythonScript(beam_mesh=mesh_9, orientation_plane=pl)  # -> out, beam; inputs beam_mesh: Mesh, orientation_plane: Plane
# ---------- createbeamobjects: Python ----------
__author__ = "leungp"
__version__ = "2020.02.13"

from compas_ghpython import unload_modules
unload_modules("integral_timber_joints")

import compas
from compas.datastructures import Mesh
from compas.geometry import Frame

from integral_timber_joints.geometry import Beam
from compas_rhino.geometry import RhinoMesh, RhinoPlane

# Convert input to compas mesh
compas_mesh = RhinoMesh.from_geometry(beam_mesh).to_compas()
compas_frame = RhinoPlane.from_geometry(orientation_plane).to_compas()

# Beam class method
beam = Beam.from_mesh(compas_mesh, compas_frame)
# ---------- end createbeamobjects ----------

beam_artist = GhPythonScript(beam=createbeamobjects.beam)  # -> out, name, plane, length, width, height, face_frame_1, face_frame_2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
# ---------- beam_artist: Python ----------
__author__ = "leungp"
__version__ = "2020.02.13"

import rhinoscriptsyntax as rs
from compas_ghpython.utilities import draw_frame, draw_mesh

name = beam.name
plane  = draw_frame(beam.frame)
length = beam.length
width = beam.width
height = beam.height
face_frame_1 = draw_frame(beam.get_face_frame(1))
face_frame_2 = draw_frame(beam.get_face_frame(2))
face_frame_3 = draw_frame(beam.get_face_frame(3))
face_frame_4 = draw_frame(beam.get_face_frame(4))
if beam.cached_mesh is None:
    beam = beam.copy()
    beam.update_cached_mesh()
cached_mesh = draw_mesh(*beam.cached_mesh.to_vertices_and_faces())
# ---------- end beam_artist ----------
text_tag_3d = TextTag3D(Location=beam_artist.face_frame_2, Text=beam_artist.name, Size=Slider(80, range=0..100), Justification=7)
custom_preview = CustomPreview(
    Geometry=beam_artist.cached_mesh,
    Material={diffuse=RGB(221, 160, 221), emission=RGB(66, 48, 66), shine=0.5, specular=RGB(255, 255, 255), transparency=0})

# ----
# Generic Clamp Visualization
number_slider_3 = Slider(100, range=0..100)
pt_11 = ConstructPoint(XCoordinate=number_slider_3, YCoordinate=Slider(500, range=0..500), ZCoordinate=0)
yz = YZPlane(Origin=pt_11)
set_clamp_state = GhPythonScript(
    robot_model=clamp_instance.robot_model_out,
    gripper_jaw_position=Slider(0, range=0..100),
    clamp_jaw_position=Slider(0, range=0..100),
    current_location=yz)  # -> out, robot_model_out; inputs current_location: Plane
# ---------- set_clamp_state: Python ----------
from integral_timber_joints.ghpython.utilities import rPlane2cFrame
from compas_rhino.geometry import RhinoPlane
# Deep copy should be performed before editing
robot_model_out = robot_model.copy()

# Set State
robot_model_out.gripper_jaw_position = gripper_jaw_position
robot_model_out.clamp_jaw_position = clamp_jaw_position
robot_model_out.current_frame = RhinoPlane.from_geometry(current_location).to_compas()
# ---------- end set_clamp_state ----------
robot_artist_2 = GhPythonScript(robot_model=set_clamp_state.robot_model_out)  # -> out, visual
# ---------- robot_artist_2: Python ----------
from compas_ghpython.helpers import mesh_draw
visual = [mesh_draw(mesh) for mesh in robot_model.draw_visuals()]
# ---------- end robot_artist_2 ----------

# ----
# Create Assembly / Connectivity
connectivity = Panel("""0-2
0-3
0-7
0-8
1-2
1-3
1-5
1-6
4-2
4-3
9-7
9-8
9-11
9-12
10-5
10-6
10-11
10-12
13-11
13-12""")
create_assembly = GhPythonScript(beams=createbeamobjects.beam, connectivity=connectivity)  # -> out, number_of_beams, number_of_joints, assembly; inputs beams: list, connectivity: list
# ---------- create_assembly: Python ----------
"""
This script contains the function to create a Assembly obect with associated Element objects.
The list of Beam input assumes to be in the correct assembly sequence.

Beam is stored in Element object and can be retrived by
- beam = element._source
- beam = assembly.beam(key)

Element object has an automatically generated identifier/key/id.
- assembly.elements(True) will give all the elements in (key, element, attr) tuple


assembly.network.attributes['sequence']
- contains the assembly sequence as a list of element id


"""

__author__ = "leungp"
__version__ = "2020.02.13"

import rhinoscriptsyntax as rs

#from compas_ghpython import unload_modules
#unload_modules("integral_timber_joints")
 
from integral_timber_joints.assembly import Assembly

assembly = Assembly()

# create Element and add it to Assembly
for index, beam in enumerate(beams):
    # Create key/identifier of the beam
    beam.name ='b%s'% index 
    
    #element_key = index
    assembly.add_beam(beam)
    
# Create connections between Elements
# Two connections (bidirectional network edges) are created.

for conn in connectivity:
    beam1_id = 'b%s'% int(conn.split('-')[0])
    beam2_id = 'b%s'% int(conn.split('-')[1])
    assembly.add_joint_pair(None, None, beam1_id, beam2_id)
    # print ('%s -> %s' % (beam1_id, beam2_id))
    
number_of_beams = assembly.number_of_beams
number_of_joints = assembly.number_of_joints

# Print out Beam Connecion Valance
for beam_id in assembly.sequence:
    neighbors_out = assembly.neighbors_out(beam_id)
    print ('Beam: %s has neighbours: %s (%s)' % (beam_id, ", ".join(neighbors_out), assembly.degree(beam_id)) )
# ---------- end create_assembly ----------

# ----
# Visualize Clamp Attach & Detach
position_of_clamp = Slider(5, range=0..6)

# ----
# Save
data_dam = DataDam(DataDataA=beam_grasp_frame.process_out, BufferDelay=10000000, BufferMode=0)
json_pickle = GhPythonScript(stuff=data_dam, json_output_path=ghpython_script)
# ---------- json_pickle: Python ----------
if stuff is not None:
    import jsonpickle
    jsonpickle.set_preferred_backend('json')
    jsonpickle.set_encoder_options('json', indent=4)
    
    f = open(json_output_path, 'w')
    f.write(jsonpickle.encode(stuff, keys=True))
    f.close()
# ---------- end json_pickle ----------

list_item = ListItem(Index=Slider(2, range=0..10), Wrap=True)
reload = Button()

# ----
# Reload Python Modules (if Module Code is Changed)
python_module_to_reload = Panel("""compas
compas_fab
roslibpy
integral_timber_joints""")
# Development Tools
reload_2 = Button()
py = PythonScript(reload_module_button=[reload_2, reload], module_names=python_module_to_reload)  # inputs module_names: list
# ---------- py: Python ----------
import compas_ghpython
from compas_ghpython import unload_modules
if reload_module_button:
    for module in module_names:
        unload_modules(module)
# ---------- end py ----------

robot_artist_3 = GhPythonScript(robot_state=list_item, color=ColourSwatch(SwatchColor=RGB(51, 142, 181)))  # -> out, visual; inputs color: Color; same code as robot_artist

# ----
# Add Joints
assembly_90_lap_joint = GhPythonScript(assembly=create_assembly.assembly)  # -> out, assembly_out
# ---------- assembly_90_lap_joint: Python ----------
__author__ = "leungp"
__version__ = "2020.02.17"

#from compas_ghpython import unload_modules
#unload_modules("integral_timber_joints")

from compas.geometry import Line
from compas.geometry import distance_point_point
from compas.geometry import intersection_line_line
from compas.geometry import is_point_on_plane
from compas.geometry import is_coplanar

from integral_timber_joints.geometry import Joint_90lap
from integral_timber_joints.geometry import Joint_90lap_from_beam_beam_intersection
from integral_timber_joints.geometry import Beam
from integral_timber_joints.assembly import Assembly
tol = 0.0000001

# Make a copy of the assembly before changing it.
assembly_out = assembly.copy() # type: Assembly

# Go through each pair of connection to create joints
for bid_1, bid_2 in assembly_out.earlier_joint_ids():

    beam1 = assembly_out.beam(bid_1)
    beam2 = assembly_out.beam(bid_2)
    joint1, joint2 = Joint_90lap_from_beam_beam_intersection(beam1, beam2)
    
    assembly_out.add_joint_pair(joint1, joint2, bid_1, bid_2)

# update all beam's mesh
#if recompute_mesh:
#    for beam_id in assembly_out.beam_ids():
#        assembly_out.update_beam_mesh_with_joints(beam_id)
# ---------- end assembly_90_lap_joint ----------

# ----
# Joint Directions Input Override
# Joint Direction Input
panel = Panel("""b1-b5
b1-b6
b0-b2
b0-b3
b1-b2
b1-b3
b2-b4
b3-b4
b7-b9
b11-b9
b11-b10
b12-b9
b12-b10
b8-b9
b11-b13
b12-b13""")
flip_joint_pairs = GhPythonScript(assembly=assembly_90_lap_joint.assembly_out, pair_names=panel)  # -> out, assembly_out; inputs pair_names: list
# ---------- flip_joint_pairs: Python ----------
__author__ = "leungp"
__version__ = "2020.02.24"

from compas_ghpython import unload_modules
unload_modules("integral_timber_joints")

def swap_90Lap_face(joint):
    old_id = joint.face_id
    new_id = (old_id + 1) % 4 + 1
    joint.face_id = new_id
    print ("Id Changed from %s to %s" % (old_id, new_id))
    return joint
    
assembly_out = assembly.copy()
beams_modified = set()
for pair_name in pair_names:
    bid1, bid2 = pair_name.split('-')
    assembly_out.joint((bid1,bid2)).swap_faceid_to_opposite_face()
    assembly_out.joint((bid2,bid1)).swap_faceid_to_opposite_face()
    beams_modified.add(bid1)
    beams_modified.add(bid2)
    
#[assembly_out.update_beam_mesh_with_joints(beam_id) for beam_id in beams_modified]
# ---------- end flip_joint_pairs ----------

panel_2 = Panel(assembly_90_lap_joint.out)
ghpython_script_2 = GhPythonScript()  # -> out, a
# ---------- ghpython_script_2: Python ----------
__author__ = "leungp"
__version__ = "2020.05.12"

import rhinoscriptsyntax as rs

a = x.__class__.__name__
# ---------- end ghpython_script_2 ----------
create_set = CreateSet(List=ghpython_script_2.a)  # -> Set, Map
panel_3 = Panel(create_set.Set)
panel_4 = Panel(ghpython_script_2.a)

# ----
# Design Method 1 # Infer Assembly Directions
# from JointGeo and Sequence
# Joint adding function should be more interactive in the future.
# Allowing user to pick were the joints go onto which direction and
#  alow easy flipping.
# 
# Alternative method is allow computer to
# decide which way the joints should go.
# However there are many constraints involved
# and it is best not to try replace human intution here.
beam_ass_dir = GhPythonScript(
    assembly=flip_joint_pairs.assembly_out,
    downward_placement_amount_if_no_joint=Slider(50, range=0..100),
    beam_in_jaw_position_gap_offset=Slider(5, range=0..10))  # -> out, assembly_out
# ---------- beam_ass_dir: Python ----------
__author__ = "leungp"
__version__ = "2020.02.26"

import rhinoscriptsyntax as rs

from compas.geometry import Vector

assembly_out = assembly.copy()
assembly = None

assembly_vector_if_no_joint = Vector(0, 0, -downward_placement_amount_if_no_joint)
assembly_out.compute_assembly_direction_from_joints_and_sequence(
    assembly_vector_if_no_joint, beam_in_jaw_position_gap_offset)
# ---------- end beam_ass_dir ----------
panel_5 = Panel(beam_ass_dir.out)

# ----
# Save Process Data (Initialization Save)
clamp_pos_2 = GhPythonScript(clamps=merge, grippers=data, assembly=beam_ass_dir.assembly_out)  # -> out, robot_clamp_process; inputs clamps: list, grippers: list
# ---------- clamp_pos_2: Python ----------
#from compas_ghpython import unload_modules
#unload_modules("integral_timber_joints")

from compas.geometry import Vector, dot_vectors, sum_vectors

from integral_timber_joints.process import RobotClampAssemblyProcess

process = RobotClampAssemblyProcess(assembly)
[process.add_clamp(clamp) for clamp in clamps]
[process.add_gripper(gripper) for gripper in grippers]

robot_clamp_process = process
# ---------- end clamp_pos_2 ----------
auto_json_path = GhPythonScript()  # -> json_path; same code as ghpython_script
json_pickle_2 = GhPythonScript(stuff=clamp_pos_2.robot_clamp_process, json_output_path=auto_json_path, output=Button())  # inputs output: Boolean
# ---------- json_pickle_2: Python ----------
if output:
    import jsonpickle
    jsonpickle.set_preferred_backend('json')
    jsonpickle.set_encoder_options('json', indent=4)
    
    f = open(json_output_path, 'w')
    f.write(jsonpickle.encode(stuff, keys=True))
    f.close()
# ---------- end json_pickle_2 ----------

# ----
# Visualize Assembly Sequence
step = Slider(13, range=0..13)  # disabled
colour_swatch_2 = ColourSwatch(SwatchColor=RGB(153, 142, 142))  # disabled
colour_swatch_3 = ColourSwatch(SwatchColor=RGB(107, 181, 51))  # disabled
update_meshes_2 = GhPythonScript(assembly=beam_ass_dir.assembly_out)  # -> out, assembly_out; disabled
# ---------- update_meshes_2: Python ----------
__author__ = "leungp"
__version__ = "2020.02.19"

from compas_ghpython.helpers import mesh_draw

assembly_out = assembly.copy()

[assembly_out.update_beam_mesh_with_joints(beam_id) for beam_id in assembly_out.beam_ids()]
# ---------- end update_meshes_2 ----------
assembly_step_3 = GhPythonScript(assembly=update_meshes_2.assembly_out, step=step, previous_color=colour_swatch_2, current_color=colour_swatch_3)  # -> out, previous_beams, current_beam_assembly_wcf_final, current_beam_assembly_wcf_inclamp; inputs step: Int32, previous_color: Color, current_color: Color; disabled
# ---------- assembly_step_3: Python ----------
__author__ = "leungp"
__version__ = "2020.02.19"

from compas_ghpython.helpers import mesh_draw

print(assembly.sequence)
# Pick and output the current beam
beam_id = assembly.sequence[step]
beam = assembly.beam(beam_id)
current_beam_assembly_wcf_final = mesh_draw(beam.cached_mesh, color = current_color)

# Visualize other locations
T = assembly.get_beam_transformaion_to(beam_id, 'assembly_wcf_inclamp')
current_beam_assembly_wcf_inclamp = mesh_draw(beam.cached_mesh.transformed(T), color = current_color)

# Pick and output the previously assembled beam(s)
if step > 0:
    previous_beams = []
    for beam_id in assembly.sequence[:step]:
        beam = assembly.beam(beam_id)
        previous_beams.append(mesh_draw(beam.cached_mesh, color = previous_color))
# ---------- end assembly_step_3 ----------
number_slider_4 = Slider(2000, range=0..10000)  # disabled
unit_x_2 = UnitX(Factor=number_slider_4)  # disabled
move_5 = Move(Geometry=assembly_step_3.previous_beams, Motion=unit_x_2)  # -> Geometry, Transform; disabled
move_6 = Move(Geometry=assembly_step_3.current_beam_assembly_wcf_inclamp, Motion=unit_x_2)  # -> Geometry, Transform; disabled

finalized_assembly = Data()  # disabled
compute_actions_new = GhPythonScript(assembly=finalized_assembly)  # -> out, actions; disabled
# ---------- compute_actions_new: Python ----------
__author__ = "leungp"
__version__ = "2020.02.13"

from compas_ghpython import unload_modules
unload_modules("integral_timber_joints")

from integral_timber_joints.assembly.action import *
from integral_timber_joints.assembly.target import *

asssembled = []
actions = []
for bid in assembly.sequence():
    beam = assembly.beam(bid)
    print ("Beam %s" % bid)
    actions.append(LoadPickupBeamAction(beam))
    print ('|- ' + actions[-1].__str__())
    # compute if neighbours are already in place
    clamps = []
    placed_neighbours = set(assembly.network.vertex_neighbors(bid)).intersection(set(asssembled))
    
    # compute if clamps is necessary
    for placed_neighbour in placed_neighbours:
        clamps.append((placed_neighbour,bid))

    # move clamps from storage to structure
    for clamp in clamps:
        actions.append(PickToolAction(StorageTarget(), '90lap'))
        print ('|- ' + actions[-1].__str__())
        actions.append(PlaceToolAction(ClampTarget(*clamp)))
        print ('|- ' + actions[-1].__str__())

        #print ("|- Detatch Clamp at Joint %s-%s" % clamp)
        
    # attach gripper
    gripper_type = assembly.get_beam_attribute(bid, "gripper_type")
    actions.append(PickToolAction(StorageTarget(), gripper_type))
    print ('|- ' + actions[-1].__str__())
    
    # pick place beam 
    actions.append(PickWorkpieceAction(StorageTarget(),beam))
    print ('|- ' + actions[-1].__str__())
    
    #Syncronized clamp and move beam action
    if clamps:

        #Move beam to Jaw instead of final target
        #actions.append(MoveBeamAction(beam,"BStorage","JawTarget (?)"))
        #actions.append(MoveBeamAction(beam,"BStorage", UnresolvedBeamInJawLocation(beam)))
        actions.append(FreeMoveWorkpieceAction(BeamAboveJawTarget(beam),beam))
        actions.append(LinearMoveWorkpieceAction(BeamInJawTarget(beam),beam))
        print ('|- ' + actions[-1].__str__())
        
        # Syncronized clamp jaw close
        sync_action = ActionGroup()
        # Clamp close actions
        for clamp in clamps:
            sync_action.append(ClampJawCloseAction(clamp))
        sync_action.append(LinearMoveWorkpieceAction(BeamFinalTarget(beam), beam))
        actions.append(sync_action)
        
        # Syncronized clamp jaw open
        sync_action = ActionGroup()
        # Clamp close actions
        for clamp in clamps:
            sync_action.append(ClampJawOpenAction(clamp))
        # TO DO: Need to add gripper open and retract action.
        #sync_action.append(LinearMoveWorkpieceAction(BeamFinalTarget(beam), beam))
        actions.append(sync_action)
        
        print ("|- Close Clamp Jaws while moving beam")
        for action in sync_action: print ("  |- " + action.__str__())
        
        actions.append(DetachWorkpieceAction(BeamFinalTarget(beam),beam))
        print ('|- ' + actions[-1].__str__())
        
    else:
        #actions.append(MoveBeamAction(beam,"BStorage",  UnresolvedBeamFinalLocation(beam) ))
        actions.append(PlaceWorkpieceAction(BeamFinalTarget(beam),beam))
        print ('|- ' + actions[-1].__str__())
        
    
    # attach gripper
    actions.append(PlaceToolAction(StorageTarget()))
    print ('|- ' + actions[-1].__str__())

    
    # remove clamps from structure to storage
    
    for clamp in clamps:
        #actions.append(AttachClampAction("UnassignedClamp", False, location = UnresolvedClampLocation(*clamp)))
        actions.append(PickToolAction(ClampTarget(*clamp), '90lap'))
        print ('|- ' + actions[-1].__str__())
        #actions.append(DetachClampAction("UnassignedClamp", True, location = UnresolvedStorageLocation()))
        actions.append(PlaceToolAction(StorageTarget()))

        print ('|- ' + actions[-1].__str__())
#        print ("|- Pickup Clamp from joint %s-%s" % clamp)
#        print ("|- Place Clamp at c-storage")
    asssembled.append(bid)
# ---------- end compute_actions_new ----------
panel_6 = Panel(compute_actions_new.actions)  # disabled

beams = GhPythonScript(assembly=update_meshes_2.assembly_out)  # -> out, beams; disabled
# ---------- beams: Python ----------
__author__ = "leungp"
__version__ = "2020.02.19"

import rhinoscriptsyntax as rs

beams = [beam for beam in assembly.beams()]
# ---------- end beams ----------
don_t_force_it = BooleanToggle(False)  # disabled
colour_swatch_4 = ColourSwatch(SwatchColor=RGB(214, 152, 152))  # disabled
assembly_artist = GhPythonScript(assembly=update_meshes_2.assembly_out, force_update_mesh=don_t_force_it, mesh_color=colour_swatch_4)  # -> out, cached_mesh; disabled
# ---------- assembly_artist: Python ----------
__author__ = "leungp"
__version__ = "2020.02.19"

from compas_ghpython.helpers import mesh_draw
# Technically no copy is needed as the mesh cache is safe to modify
#assembly_out = assembly.copy()

if force_update_mesh:
    [assembly.update_beam_mesh_with_joints(beam_id) for beam_id in assembly.beam_ids()]
else:
    [assembly.update_beam_mesh_with_joints(beam_id) for beam_id in assembly.beam_ids() if assembly.beam(beam_id).cached_mesh is None ]

cached_mesh = []
for beam in assembly.beams():
    cached_mesh.append(mesh_draw(beam.cached_mesh, color = mesh_color))
# ---------- end assembly_artist ----------
beam_artist_2 = GhPythonScript(beam=beams.beams)  # -> out, name, plane, length, width, height, face_frame_1, face_frame_2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; disabled
# ---------- beam_artist_2: Python ----------
__author__ = "leungp"
__version__ = "2020.02.13"

import rhinoscriptsyntax as rs
from compas_ghpython.utilities import draw_frame, draw_mesh

name = beam.name
plane  = draw_frame(beam.frame)
length = beam.length
width = beam.width
height = beam.height
face_frame_1 = draw_frame(beam.get_face_frame(1))
face_frame_2 = draw_frame(beam.get_face_frame(2))
face_frame_3 = draw_frame(beam.get_face_frame(3))
face_frame_4 = draw_frame(beam.get_face_frame(4))

cached_mesh = draw_mesh(*beam.cached_mesh.to_vertices_and_faces())
# ---------- end beam_artist_2 ----------

assign_tools_new = GhPythonScript(grippers=data, clamps=merge, actions=compute_actions_new.actions)  # -> out, actions_out; inputs grippers: list, clamps: list, actions: list; disabled
# ---------- assign_tools_new: Python ----------
__author__ = "leungp"
__version__ = "2020.02.14"

import rhinoscriptsyntax as rs

from copy import deepcopy
from copy import copy

from compas_ghpython import unload_modules
unload_modules("integral_timber_joints")

from integral_timber_joints.assembly.action import *
from integral_timber_joints.assembly.target import *

attached_tool = None
attached_workpiece = None

#New attempt to store tools
tools = []
for tool in grippers + clamps :
    t = deepcopy(tool)
    t.current_location = StorageTarget()
    tools.append(t)
    
def GetTool(tool_type, from_storage):
    tool = None
    for t in tools:
        if (from_storage and type(t.current_location) is StorageTarget):
            if (gripper.type == tool_type):
                tool = gripper
                break
        if (not from_storage and type(t.current_location) is not StorageTarget):
            pass

def FindToolFromStorage(tool_type):
    for t in tools:
        if (type(t.current_location).__name__ == "StorageTarget"):
            if (t.type == tool_type):
                return t
    raise Exception("Tool Not Found in Storage Error: tool_type = %s"% tool_type)       

def FindToolFromScene(target):
    for t in tools:
        if (t.current_location.__str__() == target.__str__()):
            return t
    raise Exception("Tool Not Found in Scene Error. target = %s"% target)  

def PrintTools():
    for t in tools:
        pass
        print (" |- " + t.__str__() + " in " + t.current_location.__str__())

actions_out = []
for action_org in actions:
    
    action = copy(action_org)
    actions_out.append(action)
    
    # Assign tool to action
    if (action.__class__.__name__ == "PickToolAction") :
        if attached_tool: # Sainity check to make sure tool is not already attached.
            raise Exception("Unable to attach tool becuase %s is already attached to robot" % attached_tool)
        if (type(action.target).__name__ == "StorageTarget"):
            tool = FindToolFromStorage(action.tool_type)
            action.tool = tool
            attached_tool = tool
            tool.current_location = "Location.OnRobot"
        else:
            #print (action.target.__str__())
            tool = FindToolFromScene(action.target)
            action.tool = tool
            attached_tool = tool
        
        
        
    # Free gripper from action (to storage)
    if action.__class__.__name__ == "PlaceToolAction":
        if not attached_tool:
            raise Exception("Unable to detach gripper becuase No Tool is attached to robot")
        tool = attached_tool
        attached_tool = None
        tool.current_location = action.target
        action.tool = tool
        #print (action.target.__str__())
        
    # Placed the assigned clamps that needs to close jaw into their actions.
    if action.__class__.__name__ == "ActionGroup":
        for sub_action in action.actions:
            if sub_action.__class__.__name__ in ["ClampJawCloseAction", "ClampJawOpenAction"]:
                #print (sub_action.target.__str__())
                clamp = FindToolFromScene(sub_action.target)
                sub_action.tool = clamp
            if sub_action.__class__.__name__ == "LinearMoveWorkpieceAction":
                sub_action.tool = attached_tool

    # AttachBeamAction
    if action.__class__.__name__ in ["PickWorkpieceAction", "PlaceWorkpieceAction", "DetachWorkpieceAction", "LinearMoveWorkpieceAction", "FreeMoveWorkpieceAction"]:
        print ("Workpiece: %s is at/detached/moved using %s" % (action.workpiece , attached_tool))
        if not attached_tool:
            raise Exception("Unable to attach %s becuase No Tool is attached to robot" % action.workpiece)
        g = attached_tool
        action.tool = g
    
    
    #print (action.__class__.__name__ , action.__str__())
    #PrintTools()
# ---------- end assign_tools_new ----------
panel_7 = Panel(assign_tools_new.actions_out)  # disabled
resolve_clamp_pos = GhPythonScript(grippers=data, clamps=merge, assembly=finalized_assembly, action=assign_tools_new.actions_out)  # -> out, clamp_frames_0, clamp_frames_1, actions_out; inputs grippers: list, clamps: list, action: list; disabled
# ---------- resolve_clamp_pos: Python ----------
__author__ = "leungp"
__version__ = "2020.02.19"

import rhinoscriptsyntax as rs
from compas.geometry import Frame
from integral_timber_joints.ghpython.utilities import cFrame2rPlane

from compas.geometry import Vector
from compas.geometry import Translation

from compas_ghpython.utilities import draw_frame
clamp_frames_0 = []
clamp_frames_1 = []

from copy import deepcopy

from compas_ghpython import unload_modules
unload_modules("integral_timber_joints")

actions_out = deepcopy(action)
assembly = deepcopy(assembly)
#Creating a dict of clamps and grippers for easy query
tools = {}
for item in clamps + grippers:
    id = item.name
    tools[id] = deepcopy(item)


def compute_clamp_position(bid1, bid2):
            joint_name = '%s-%s'%(bid1, bid2) #bid1 is the beam already placed
            #print("Computing %s Need Clamp"% joint_name)
            
            beam_already_placed = assembly.element(bid1)._source
            joint = beam_already_placed.get_joint(joint_name)
            #print ("Joint face: %s"% joint.face_id)
            clamp_frames = joint.get_clamp_frame(beam_already_placed)
            return clamp_frames
            #clamp_frames_0.append(draw_frame(clamp_frames[0]))
            #clamp_frames_1.append(draw_frame(clamp_frames[1]))



# Reusable function to resolve workpiece tcf
def resolve_workpiece_tcf_in_world_coords(workpiece, target):
    if target.__class__.__name__ == "StorageTarget":
        # Set beam location to storage_location
        workpiece.current_location = workpiece.storage_location.copy()
    if target.__class__.__name__ == "BeamFinalTarget":
        # Set beam location to final_location
        workpiece.current_location = workpiece.frame.copy()
    if target.__class__.__name__ == "BeamInJawTarget":
        # Set beam location to final_location
        T = Translation(workpiece.assembly_direction.scaled(-1))
        beam_in_jaw_location = workpiece.frame.transformed(T)
        workpiece.current_location = workpiece.frame.copy()            
    # Compute pickup frame (tcp in wcf) from the grasping offset (LCS)
    tcf_in_world_coords = workpiece.current_location.to_world_coords(workpiece.grasp_frame)
    return tcf_in_world_coords


# Reusable function to resolve workpiece tcf
def resolve_vector_in_local_coords(workpiece, target):
    if target.__class__.__name__ == "StorageTarget":
        # StorageTarget in AttachWorkpieceAction, Vector is the grasping frame Z value
        #return workpiece.grasp_frame.normal.scaled(0.12)
        return Vector(0,0,0.12)
    if target.__class__.__name__ == "BeamFinalTarget":
        # For Final Target, Vector is the assembly direction
        assembly_direction_wcf = assembly.network.get_vertex_attribute(workpiece.name, "assembly_direction_wcf")
        #return workpiece.frame.to_local_coords(workpiece.assembly_direction)
        return workpiece.frame.to_local_coords(assembly_direction_wcf)
    if target.__class__.__name__ == "BeamInJawTarget":
        # For Placing beam in a jaw. We need to find the jaw opening direction.
        return Vector(0,0,-0.12)
        

def resolve_tool_tocp_from_tcp(tool, tcf_in_world_coords):
    # Set tool location by tooltip frame 
    tool.set_current_location_frame_by_placemnet(tcf_in_world_coords)
    # Get tool location
    t0cf_in_world_coords = tool.current_location
    return t0cf_in_world_coords

def resolve_workpiece_t0cf(workpiece, tool, assembly):
    # Resolve the tcf of workpiece based on grasp pose
    grasp_frame_ocf = assembly.get_beam_attribute(workpiece.name, "grasp_frame_ocf")
    # resolve the t0cf based on tool
    tcf_in_world_coords = workpiece.current_location.to_world_coords(grasp_frame_ocf)
    t0cf_in_world_coords = resolve_tool_tocp_from_tcp(tool, tcf_in_world_coords)
    return t0cf_in_world_coords
    
def resolve_BeamStorageTarget(action, assembly):
    # Set beam location to storage_location
    action.workpiece.current_location = action.workpiece.storage_location.copy()
    # Find tcf and t0cf in world coords
    t0cf_in_world_coords = resolve_workpiece_t0cf(action.workpiece, action.tool, assembly)
    # Assembly vector
    assembly_vector_in_t0cf = Vector(0,0,0.12)
    action.target.resolve(t0cf_in_world_coords, assembly_vector_in_t0cf)
    
def resolve_BeamFinalTarget(action, assembly):
    # Set beam location to final target
    action.workpiece.current_location = action.workpiece.frame.copy()
    # Find tcf and t0cf in world coords
    t0cf_in_world_coords = resolve_workpiece_t0cf(action.workpiece, action.tool, assembly)
    # Assembly Vector
    assembly_direction_wcf = assembly.network.get_vertex_attribute(action.workpiece.name, "assembly_direction_wcf").copy()
    assembly_vector_in_t0cf = t0cf_in_world_coords.to_local_coords(assembly_direction_wcf)
    # Retract Vector (Gripper opening direction)
    retract_vector_in_t0cf = Vector(0,0,-0.12)
    action.target.resolve(t0cf_in_world_coords, assembly_vector_in_t0cf, retract_vector_in_t0cf)
    
def resolve_BeamAboveJawTarget(action, assembly):
    # Set beam location to jaw opening position
    place_in_jaw_direction_wcf = assembly.network.get_vertex_attribute(action.workpiece.name, "place_in_jaw_direction_wcf").copy()
    assembly_direction_wcf = assembly.network.get_vertex_attribute(action.workpiece.name, "assembly_direction_wcf").copy()
    assembly_direction_wcf += place_in_jaw_direction_wcf
    T = Translation(assembly_direction_wcf.scaled(-1))
    action.workpiece.current_location = action.workpiece.frame.transformed(T)         
    # Find tcf and t0cf in world coords
    t0cf_in_world_coords = resolve_workpiece_t0cf(action.workpiece, action.tool, assembly)
    # Assembly vector
    action.target.resolve(t0cf_in_world_coords)
    
def resolve_BeamInJawTarget(action, assembly):
    # Set beam location to in-jaw location
    assembly_direction_wcf = assembly.network.get_vertex_attribute(action.workpiece.name, "assembly_direction_wcf").copy()
    T = Translation(assembly_direction_wcf.scaled(-1))
    action.workpiece.current_location = action.workpiece.frame.transformed(T)         
    # Find tcf and t0cf in world coords
    t0cf_in_world_coords = resolve_workpiece_t0cf(action.workpiece, action.tool, assembly)
    # Assembly vector
    action.target.resolve(t0cf_in_world_coords)

clamp_approach_vector =  Vector(0,0,0.10)
clamp_retract_vector = Vector(0,0,-0.10)
clamp_approach_workpiece_vector =  Vector(0,0,0.30)
clamp_retract_workpiece_vector = Vector(0,0,-0.30)

def resolve_ClampTarget(action, assembly):
    joint_id = (action.target.beam1, action.target.beam2)
    clamp_frame_wcf = assembly.get_joint_attribute(joint_id, "clamp_frame_wcf")
    tool = action.tool
    tool.set_current_location_frame_by_placemnet(clamp_frame_wcf)
    action.target.resolve(tool.current_location, clamp_approach_workpiece_vector, clamp_retract_vector)


def resolve_ToolStorageTarget(action, assembly):
    action.target.resolve(action.tool.storage_location, clamp_approach_vector, clamp_retract_workpiece_vector)

#Loop though all the actions
for action in actions_out:
    
    if action.__class__.__name__ in ["PickWorkpieceAction", "PlaceWorkpieceAction", "DetachWorkpieceAction"]:
        if action.target.__class__.__name__ == "StorageTarget":
            resolve_BeamStorageTarget(action, assembly)
        if action.target.__class__.__name__ == "BeamFinalTarget":
            resolve_BeamFinalTarget(action, assembly)
    
    if action.__class__.__name__ in ["LinearMoveWorkpieceAction", "FreeMoveWorkpieceAction"]:
        if action.target.__class__.__name__ == "BeamAboveJawTarget":
            resolve_BeamAboveJawTarget(action, assembly)
        if action.target.__class__.__name__ == "BeamInJawTarget":
            resolve_BeamInJawTarget(action, assembly)
            
    # Resolve Clamp StorageLocation and Clamp TargetLocation
    if action.__class__.__name__ in ["PickToolAction", "PlaceToolAction"]:
        if action.target.__class__.__name__ == "StorageTarget":
            resolve_ToolStorageTarget(action, assembly)
        if action.target.__class__.__name__ == "ClampTarget":
            #placement_position = compute_clamp_position(action.target.beam1, action.target.beam2)[0] #First result
            resolve_ClampTarget(action, assembly)
            
    # Resolve Items in Action Group
    if action.__class__.__name__ == "ActionGroup":
        for sub_action in action.actions:
            if sub_action.__class__.__name__ in ["LinearMoveWorkpieceAction",]:
                resolve_BeamFinalTarget(sub_action, assembly)
#                tcf_in_world_coords = resolve_workpiece_tcf_in_world_coords(sub_action.workpiece, sub_action.target)
#                t0cf_in_world_coords = resolve_tool_tocp_from_tcp(sub_action.tool, tcf_in_world_coords)
#                sub_action.target.resolve(t0cf_in_world_coords, t0cf_in_world_coords.normal)
# ---------- end resolve_clamp_pos ----------
panel_8 = Panel(resolve_clamp_pos.actions_out)  # disabled

# ----
# Visualize Action Target
number_slider_5 = Slider(18, range=0..30)  # disabled
item = ListItem(List=resolve_clamp_pos.actions_out, Index=number_slider_5, Wrap=True)  # disabled
python = GhPythonScript(action=item)  # -> out, target_frame, approach_frame, approach_vector; disabled
# ---------- python: Python ----------
__author__ = "leungp"
__version__ = "2020.03.03"

from compas_ghpython.utilities import draw_frame
from integral_timber_joints.ghpython.utilities import cVec2rVec
target_frame = draw_frame(action.target.target_frame)
approach_frame = draw_frame(action.target.approach_frame)
approach_vector = cVec2rVec(action.target.approach_vector)
# ---------- end python ----------
vec2pt = Vector2Pt(PointA=python.approach_frame, PointB=python.target_frame, Unitize=False)  # -> Vector, Length; disabled
# Tool Retract with Clamp will require multi step retract.
# Implement Short Gripper.
# Better Looking Mesh Visualization
# Collision check between attached geometry and structure
# 
# 
# Robotic Acion Classes
# - FreeSpace
# - Linear
# - IO
# - Gripper Actions
vdis = VectorDisplay(Anchor=python.approach_frame, Vector=vec2pt.Vector)  # disabled

number_slider_6 = Slider(26, range=0..100)  # disabled
split = SplitList(List=resolve_clamp_pos.actions_out, Index=number_slider_6)  # -> ListA, ListB; disabled

# ----
# Create Low Level Cheorography
create_animation = GhPythonScript(clamps=merge, grippers=data, assembly=finalized_assembly, actions=resolve_clamp_pos.actions_out)  # -> out, scene_objects_out, keyframes_out, keyframes_count, robot_T0CF_keyframes, descriptions; inputs clamps: list, grippers: list, actions: list; disabled
# ---------- create_animation: Python ----------
from compas.geometry import Transformation, Frame

# Scene objects must implement set_state() and get_state().
# Scene objects must implement draw_visual() that create a list of compas meshes using its current state.
scene_objects = {}

# Each keyframe is smply a dictionary of all the objects states.
# The goal is to compute all keyframes
scene_keyframes = []

# Tentative solution for recording robotic T0CF
robot_T0CF_keyframes = []
descriptions = []

def get_keyframe():
    '''
    Creates a dictionary of all the visualization states of the objects.
    '''
    global scene_objects
    scene_state = {}
    # Iterate through all objects and call their get_state() 
    for key, scene_object in scene_objects.items():
        scene_state[key] = scene_object.get_state()
    # Add all 
    return scene_state

def save_keyframe(description = ""):
    global scene_keyframes, robot_T0CF_keyframes, robot_T0CF
    scene_keyframes.append(get_keyframe())
    # Tentative Hack
    robot_T0CF_keyframes.append(robot_T0CF.copy())
    descriptions.append(description)


# Collect all scene objects in a dictionary
# A copy is made becuase we will edit the state of the objects.
from copy import deepcopy

# Prepare all items in their initial location.
# Clamps and Grippers are visible, Beam is not visible
for item in clamps:
    id = item.name
    if id in scene_objects:
        raise KeyAlreadyExistError
    scene_objects[id] = deepcopy(item)
    scene_objects[id].is_visible = True
    scene_objects[id].is_attached = False
    scene_objects[id].current_location = scene_objects[id].storage_location.copy()

for item in grippers:
    id = item.name
    if id in scene_objects:
        raise KeyAlreadyExistError
    scene_objects[id] = deepcopy(item)
    scene_objects[id].is_visible = True
    scene_objects[id].is_attached = False
    scene_objects[id].current_location = scene_objects[id].storage_location.copy()

for id, element in assembly.elements():
    if id in scene_objects:
        raise KeyAlreadyExistError
    scene_objects[id] = deepcopy(assembly.beam(id))
    scene_objects[id].is_visible = False
    scene_objects[id].is_attached = False
    scene_objects[id].current_location = scene_objects[id].storage_location.copy()

    
print ("The following scene objects are loaded:")
print scene_objects.keys()

# Storing the attached tool and workpiece current state
attached_tool = None
attached_workpiece = None
robot_T0CF = Frame.worldXY()


# Initial State
save_keyframe("Initial State")

# Object getter helper function

def getWorkpiece (action):
    return scene_objects[action.workpiece.name]

def getTool (action):
    return scene_objects[action.tool.name]

# Low level action helper function

def goto (t0cf_in_wcf):
    global attached_tool, attached_workpiece, robot_T0CF
    # Move the robot
    robot_T0CF = t0cf_in_wcf
    if (attached_tool is not None):
        # Move the tool
        attached_tool.current_location = t0cf_in_wcf.copy()
    if (attached_workpiece is not None):
        # Move the workpiece
        tcf_in_wcf = attached_tool.current_location.to_world_coords(attached_tool.placement_frame)
        set_current_location_frame_by_placemnet(attached_workpiece, tcf_in_wcf)

def set_current_location_frame_by_placemnet(workpiece, tcf_in_wcf):
    grasp_frame = assembly.get_beam_attribute(workpiece.name, "grasp_frame_ocf")
    T2 = Transformation.from_frame_to_frame(grasp_frame, tcf_in_wcf)
    base_frame = Frame.worldXY().transformed(T2)
    workpiece.current_location = base_frame.copy()

def attach_tool (tool):
    global attached_tool
    assert (attached_tool is None)
    attached_tool = tool
    attached_tool.is_attached = True    # For Visualization Effect

def detach_tool ():
    global attached_tool, attached_workpiece
    assert (attached_tool is not None)
    assert (attached_workpiece is None)
    attached_tool.is_attached = False   # For Visualization Effect
    attached_tool = None


def attach_workpiece (workpiece):
    global attached_tool, attached_workpiece
    assert (attached_tool is not None)
    assert (attached_workpiece is None)
    attached_workpiece = workpiece
    attached_tool.close_gripper()
    attached_workpiece.is_attached = True   # For Visualization Effect    

def detach_workpiece ():
    global attached_tool, attached_workpiece
    assert (attached_tool is not None)
    assert (attached_workpiece is not None)
    attached_workpiece.is_attached = False  # For Visualization Effect
    attached_workpiece = None
    attached_tool.open_gripper()
    

# Create keyframes by the actions:
    
for action in actions:
    
    if action.__class__.__name__ == "LoadPickupBeamAction":
        # Beam Appeare
        getWorkpiece(action).is_visible = True
        save_keyframe("Manually-load %s on pick-up station." % getWorkpiece(action))
        
        
        
    if action.__class__.__name__ in ["PickToolAction", "PlaceToolAction"]:
        # Step 1. Go to Target Approach (Free)
        goto(action.target.approach_frame)
        save_keyframe("Robot (Free) Goto %s -> %s -> Approach Point" % (getTool(action), action.target))
        # Step 2. Go to Final Target (Linear)
        goto(action.target.target_frame)
        save_keyframe("Robot (Linear) Goto %s -> %s -> Target Point" % (getTool(action), action.target))
        

        # Step 3.A (Pick) Lock Tool and Open Gripper
        if action.__class__.__name__ == "PickToolAction":
            attach_tool(getTool(action))
            save_keyframe("Robot (IO) Lock %s" % getTool(action))
            getTool(action).open_gripper()
            save_keyframe("Robot (IO) Open %s Gripper" % (action.tool))
        # Step 3.B (Place) Close Gripper and unlock tool
        if action.__class__.__name__ == "PlaceToolAction":
            getTool(action).close_gripper()
            save_keyframe("Robot (IO) Close %s Gripper" % (action.tool))
            detach_tool()
            save_keyframe("Robot (IO) Unlock %s" % getTool(action))
            
        # Step 4. Go to Target Retract (Linear)
        goto(action.target.retract_frame)
        save_keyframe("Robot (Linear) Goto %s -> %s -> Retract Point" % (getTool(action), action.target))
        
        
        
    if action.__class__.__name__ in ["PickWorkpieceAction", "PlaceWorkpieceAction"]:
        # Step 1. Go to Target Approach (Free)
        goto(action.target.approach_frame)
        save_keyframe("Robot (Free) Goto %s -> %s -> Approach Point" % (getWorkpiece(action), action.target))
        # Step 2. Go to Final Target (Linear)
        goto(action.target.target_frame)
        save_keyframe("Robot (Linear) Goto %s -> %s -> Target Point" % (getWorkpiece(action), action.target))
        
        # Step 3.2 Lock Workpiece / Unlock Workpiece
        if action.__class__.__name__ == "PickWorkpieceAction":
            attach_workpiece(getWorkpiece(action))
            save_keyframe("Robot (IO) Close %s Gripper / Grasping %s" % (getTool(action), action.workpiece))
        elif action.__class__.__name__ == "PlaceWorkpieceAction":
            detach_workpiece()
            save_keyframe("Robot (IO) Open %s Gripper / Releasing %s" % (getTool(action), action.workpiece))

        # Step 4. Go to Target Retract (Linear)
        goto(action.target.retract_frame)
        save_keyframe("Robot (Linear) Goto %s -> %s -> Retract Point" % (getWorkpiece(action), action.target))

    if action.__class__.__name__ in ["DetachWorkpieceAction"]:
        # Step 1. Unlock Workpiece
        detach_workpiece()
        save_keyframe("Robot (IO) Open %s Gripper / Releasing %s" % (getTool(action), action.workpiece))
        # Step 2. Go to Target Retract (Linear)
        goto(action.target.retract_frame)
        save_keyframe("Robot (Linear) Goto %s -> %s -> Retract Point" % (getWorkpiece(action), action.target))

    if action.__class__.__name__ == "FreeMoveWorkpieceAction":
        goto(action.target.target_frame)
        save_keyframe("Move %s to %s (Free)" % (action.workpiece, action.target))

    if action.__class__.__name__ == "LinearMoveWorkpieceAction":
        goto(action.target.target_frame)
        save_keyframe("Move %s to %s (Linear)" % (action.workpiece, action.target))

    if action.__class__.__name__ == "ActionGroup":
        "Syncronized Actions: "
        sub_action_descriptions = []
        for sub_action in action.actions:
            if sub_action.__class__.__name__ in ["LinearMoveWorkpieceAction",]:
                goto(sub_action.target.target_frame)
            if sub_action.__class__.__name__ in ["ClampJawCloseAction",]:    
                getTool(sub_action).close_clamp_jaw()
            if sub_action.__class__.__name__ in ["ClampJawOpenAction",]:    
                getTool(sub_action).open_clamp_jaw()
            sub_action_descriptions.append(sub_action.__str__())
        #save_keyframe("Syncronized Robot (Linear) Goto %s and Clamps %s" % (workpieces, clamps))
        save_keyframe("Syncronized Actions: " + " & ".join(sub_action_descriptions))

# Wrapper to transmit a dictionary across GH Wires
class SceneObjects():
    def __init__(self, objects):
        self.objects = objects
        
    def __getitem__(self, key):
        return self.objects.__getitem__(key)
    
    def __setitem__(self, key, val):
        return self.objects.__setitem__(key, val)
        
keyframes_out = scene_keyframes
scene_objects_out = SceneObjects(scene_objects)
# ---------- end create_animation ----------
panel_9 = Panel(" ")  # disabled
panel_10 = Panel("#")  # disabled
number_slider_7 = Slider(0.07, range=0..0.1)  # disabled

number_slider_8 = Slider(0.05, range=0..0.1)  # disabled
# Info
number_slider_9 = Slider(0.05, range=0..0.1)  # disabled
Z = UnitZ(Factor=number_slider_8)  # disabled
Z_2 = UnitZ(Factor=number_slider_9)  # disabled

# ----
# Define Clamp Type
# Define GripperType
panel_11 = Panel("generic_clamp")  # disabled
panel_12 = Panel("90lap")  # disabled
geo_9 = Geometry(<brep referenced from the Rhino model>)  # disabled
geo_10 = Geometry(<brep referenced from the Rhino model>)  # disabled
geo_11 = Geometry(<brep referenced from the Rhino model>)  # disabled
geo_12 = Geometry(<brep referenced from the Rhino model>)  # disabled
geo_13 = Geometry(<brep referenced from the Rhino model>)  # disabled
pt_12 = Point(<point referenced from the Rhino model>)  # disabled
panel_13 = Panel("g1")  # disabled
panel_14 = Panel("long_gripper")  # disabled
geo_14 = Geometry(<mesh referenced from the Rhino model>)  # disabled
geo_15 = Geometry(<mesh referenced from the Rhino model>)  # disabled
geo_16 = Geometry(<mesh referenced from the Rhino model>)  # disabled
pt_13 = Point(<point referenced from the Rhino model>)  # disabled
xy_7 = XYPlane(Origin=pt_12)  # disabled
mesh_10 = Mesh(geo_9)  # disabled
mesh_11 = Mesh(geo_10)  # disabled
mesh_12 = Mesh(geo_11)  # disabled
mesh_13 = Mesh(geo_12)  # disabled
mesh_14 = Mesh(geo_13)  # disabled
xy_8 = XYPlane(Origin=pt_13)  # disabled
mesh_15 = Mesh(geo_14)  # disabled
mesh_16 = Mesh(geo_15)  # disabled
mesh_17 = Mesh(geo_16)  # disabled
create_clamp_2 = GhPythonScript(
    name=panel_11,
    type_name=panel_12,
    base_mesh=mesh_10,
    l_body_mesh=mesh_11,
    r_body_mesh=mesh_13,
    l_jaw_mesh=mesh_12,
    r_jaw_mesh=mesh_14,
    placement_frame=xy_7,
    approach_vector=Z_2)  # -> out, visual, robot_model; inputs base_mesh: Mesh, l_body_mesh: Mesh, placement_frame: Plane, approach_vector: Vector3d; disabled
# ---------- create_clamp_2: Python ----------
__author__ = "leungp"
__version__ = "2020.02.14"

#from compas_fab.robots import Robot

from compas.robots import RobotModel
from compas.robots import Axis
from compas.robots import Joint
from compas.robots import Link

#from compas_fab.ghpython import RobotArtist
from compas_fab.robots import Configuration

from compas.geometry import Frame
from compas.geometry import Point
from compas.geometry import Vector
from compas.geometry import Transformation
from compas.datastructures import Mesh
from compas_rhino.geometry import RhinoMesh

from compas_ghpython.geometry import xtransformed

class Clamp (RobotModel):
    def __init__(self, name, type_name):

        RobotModel.__init__(self, name)
        #self.artist = None #Turns out not possible to store the artist in itself.

        self.placement_frame = None #Intrinsic offset of the tool to part relationship
        self.approach_vector = None #Vector for Robot to approach when picking up the tool

        self.name = name        #uid like name
        self.type = type_name
        
        # Attribute for animation visualization
        self.is_visible = True # Decides if the self.draw_visuals() draw or not.
        self.is_attached = True # Decides if the self.draw_visuals() draws it differently.
        self.current_location = Frame.worldXY() #Current frame
        self.storage_location = Frame.worldXY() #Storage frame

    def ToString(self): # For GH Display
        return "Clamp (%s)" % self.name
        
    def __str__(self):  # For In-line String Representation
        return self.ToString()
        
    def set_current_location_frame(self, frame):
        self.current_location = frame.copy()
        #self.get_joint_by_name('world_base_fixed_joint').origin = frame.copy()
    
    def set_current_location_frame_by_placemnet(self, frame):
        T2 = Transformation.from_frame_to_frame( self.placement_frame, frame)
        base_frame = Frame.worldXY().transformed(T2)
        self.set_current_location_frame(base_frame)
        
    def set_jaw_position(self, position):
        self.get_joint_by_name('clamp_jaw_joint_l').position = position
        self.get_joint_by_name('clamp_jaw_joint_r').position = position
        
    def set_attacher_position(self, position):
        self.get_joint_by_name('base_clamp_joint_l').position = position
        self.get_joint_by_name('base_clamp_joint_r').position = position

    def open_clamp_jaw(self):
        self.set_jaw_position(0.0)
    def close_clamp_jaw(self):
        self.set_jaw_position(0.12)
        
        
    def open_gripper(self):
        self.set_attacher_position(0.02)
    def close_gripper(self):
        self.set_attacher_position(0.0)
        
    def draw_visuals(self):
        # Return empty list if is_visible is False
        if not self.is_visible: return []
        
        # Create a new robot artist is necessary
        from compas_fab.ghpython import RobotArtist
        artist = RobotArtist(self)

        # Grab all joint values and create a Configuration (Artist want it)
        joint_names = [j.name for j in self.get_configurable_joints()]
        joint_positions = [j.position for j in self.get_configurable_joints()]
        robot_configuration = Configuration.from_prismatic_and_revolute_values(joint_positions,[])
        # Artist performs update of the transformations
        artist.update(robot_configuration, joint_names)
        
        print (joint_positions)
        
        # Post-transforming the visualization mesh according to world joint.
        #base_joint = self.get_joint_by_name('world_base_fixed_joint')
        #T = Transformation.from_frame_to_frame(Frame.worldXY(), base_joint.origin)
        T = Transformation.from_frame_to_frame(Frame.worldXY(), self.current_location)
        visuals = [xtransformed(mesh, T) for mesh in artist.draw_visual()]
        return visuals
    
    def set_state(self, state_dict):
        self.set_jaw_position(state_dict['jaw_position'])                       # Float
        self.set_attacher_position(state_dict['attacher_position'])             # Float
        self.set_current_location_frame(state_dict['current_location'].copy())  # Frame
        self.is_visible = state_dict['is_visible']                              # Boolean
        self.is_attached = state_dict['is_attached']                            # Boolean
        
    def get_state(self):
        state_dict = {}
        state_dict['jaw_position'] = self.get_joint_by_name('clamp_jaw_joint_l').position
        state_dict['attacher_position'] = self.get_joint_by_name('base_clamp_joint_l').position
        state_dict['current_location'] = self.current_location.copy()
        state_dict['is_visible'] = self.is_visible
        state_dict['is_attached'] = self.is_attached
        
        return state_dict

# Define Robot Model with Links and Joints

#robot_model = RobotModel('clamp')
robot_model = Clamp(name, type_name)
tool_origin = Frame.worldXY()

#world_link = robot_model.add_link('world') # Not needed anymore
base_link = robot_model.add_link('base_link', RhinoMesh.from_geometry(base_mesh).to_compas())
l_body_link = robot_model.add_link('l_body_link', RhinoMesh.from_geometry(l_body_mesh).to_compas())
r_body_link = robot_model.add_link('r_body_link', RhinoMesh.from_geometry(r_body_mesh).to_compas())
l_jaw_link = robot_model.add_link('l_jaw_link', RhinoMesh.from_geometry(l_jaw_mesh).to_compas())
r_jaw_link = robot_model.add_link('r_jaw_link', RhinoMesh.from_geometry(r_jaw_mesh).to_compas())

#robot_model.add_joint('world_base_fixed_joint', Joint.FIXED, world_link, base_link)
robot_model.add_joint('base_clamp_joint_l', Joint.PRISMATIC, base_link, l_body_link, axis = [0,-1,0], limit = (1000,-1000))
robot_model.add_joint('base_clamp_joint_r', Joint.PRISMATIC, base_link, r_body_link, axis = [0,1,0], limit = (1000,-1000))
robot_model.add_joint('clamp_jaw_joint_l', Joint.PRISMATIC, l_body_link, l_jaw_link, axis = [0,0,-1.], limit = (1000,-1000))
robot_model.add_joint('clamp_jaw_joint_r', Joint.PRISMATIC, r_body_link, r_jaw_link, axis = [0,0,-1.], limit = (1000,-1000))

from integral_timber_joints.ghpython.utilities import rPlane2cFrame, rVec2cVec
robot_model.placement_frame = rPlane2cFrame(placement_frame)
robot_model.approach_vector = rVec2cVec(approach_vector)

# Wrong Artist at the moment
#from compas_fab.ghpython import RobotArtist
#artist = RobotArtist(robot_model)

# Default position visualization
#visual = artist.draw_visual()
# ---------- end create_clamp_2 ----------
create_gripper_2 = GhPythonScript(
    name=panel_13,
    type_name=panel_14,
    base_mesh=mesh_15,
    l_jaw_mesh=mesh_16,
    r_jaw_mesh=mesh_17,
    placement_frame=xy_8,
    approach_vector=Z)  # -> out, visual, robot_model; inputs base_mesh: Mesh, l_jaw_mesh: Mesh, placement_frame: Plane, approach_vector: Vector3d; disabled
# ---------- create_gripper_2: Python ----------
__author__ = "leungp"
__version__ = "2020.02.14"

#from compas_fab.robots import Robot

from compas.robots import RobotModel
from compas.robots import Axis
from compas.robots import Joint
from compas.robots import Link

from compas_fab.ghpython import RobotArtist
from compas_fab.robots import Configuration

from compas.geometry import Frame
from compas.geometry import Point
from compas.geometry import Vector
from compas.geometry import Transformation
from compas.datastructures import Mesh
from compas_rhino.helpers import mesh_from_guid

from compas_ghpython.geometry import xtransformed

class Gripper (RobotModel):
    def __init__(self, name, type_name):
        super(Gripper, self).__init__(name)
        #self.artist = None #Turns out not possible to store the artist in itself.

        self.placement_frame = None #Intrinsic offset of the tool to part relationship
        self.approach_vector = None #Vector for Robot to approach when picking up the tool
        
        self.name = name        #uid like name
        self.type = type_name
        
        # Attribute for animation visualization
        self.is_visible = True  # Decides if the self.draw_visuals() draw or not.
        self.is_attached = True # Decides if the self.draw_visuals() draws it differently.
        self.current_location = Frame.worldXY() #Current frame
        self.storage_location = Frame.worldXY() #Storage frame
        
    def ToString(self): # For GH Display
        return "Gripper (%s)" % self.name
        
    def __str__(self):  # For In-line String Representation
        return self.ToString()
        
    def set_current_location_frame(self, frame):
        self.current_location = frame.copy()
        #self.get_joint_by_name('world_base_fixed_joint').origin = frame.copy()
    
#    def set_current_location_frame_by_placemnet(self, frame):
#        T = Transformation.from_frame_to_frame(Frame.worldXY(),self.placement_frame)
#        base_frame = frame.transformed(T)
#        self.set_current_location_frame(base_frame)
    def set_current_location_frame_by_placemnet(self, frame):
        T2 = Transformation.from_frame_to_frame( self.placement_frame, frame)
        base_frame = Frame.worldXY().transformed(T2)
        self.set_current_location_frame(base_frame)
        
    def set_jaw_position(self, position):
        self.get_joint_by_name('clamp_jaw_joint_l').position = position
        self.get_joint_by_name('clamp_jaw_joint_r').position = position
        
    def open_gripper(self):
        self.set_jaw_position(0.05)
    def close_gripper(self):
        self.set_jaw_position(0.0)
        
    def draw_visuals(self):
        # Return empty list if is_visible is False
        if not self.is_visible: return []
        
        # Create a new robot artist is necessary
        artist = RobotArtist(self)

        # Grab all joint values and create a Configuration (Artist want it)
        joint_names = [j.name for j in self.get_configurable_joints()]
        joint_positions = [j.position for j in self.get_configurable_joints()]
        robot_configuration = Configuration.from_prismatic_and_revolute_values(joint_positions,[])
        # Artist performs update of the transformations
        artist.update(robot_configuration, joint_names)
        
        print (joint_positions)
        
        # Post-transforming the visualization mesh according to world joint.
        #base_joint = self.get_joint_by_name('world_base_fixed_joint')
        #T = Transformation.from_frame_to_frame(Frame.worldXY(), base_joint.origin)
        T = Transformation.from_frame_to_frame(Frame.worldXY(), self.current_location)
        visuals = [xtransformed(mesh, T) for mesh in artist.draw_visual()]
        return visuals
    
    def set_state(self, state_dict):
        self.set_jaw_position(state_dict['jaw_position'])                       # Float
        self.set_current_location_frame(state_dict['current_location'].copy())  # Frame
        self.is_visible = state_dict['is_visible']                              # Boolean
        self.is_attached = state_dict['is_attached']                            # Boolean
        
    def get_state(self):
        state_dict = {}
        state_dict['jaw_position'] = self.get_joint_by_name('clamp_jaw_joint_l').position
        state_dict['current_location'] = self.current_location.copy()
        state_dict['is_visible'] = self.is_visible
        state_dict['is_attached'] = self.is_attached

        return state_dict
    

# Define Robot Model with Links and Joints

#robot_model = RobotModel('clamp')
robot_model = Gripper(name, type_name)
tool_origin = Frame.worldXY()

#world_link = robot_model.add_link('world') # Not needed anymore
base_link = robot_model.add_link('base_link', mesh_from_guid(Mesh, base_mesh))
l_jaw_link = robot_model.add_link('l_jaw_link', mesh_from_guid(Mesh, l_jaw_mesh))
r_jaw_link = robot_model.add_link('r_jaw_link', mesh_from_guid(Mesh, r_jaw_mesh))

#robot_model.add_joint('world_base_fixed_joint', Joint.FIXED, world_link, base_link)
robot_model.add_joint('clamp_jaw_joint_l', Joint.PRISMATIC, base_link, l_jaw_link, axis = [0,-1,0], limit = (1,-1))
robot_model.add_joint('clamp_jaw_joint_r', Joint.PRISMATIC, base_link, r_jaw_link, axis = [0,1,0], limit = (1,-1))


from integral_timber_joints.ghpython.utilities import rPlane2cFrame, rVec2cVec
robot_model.placement_frame = rPlane2cFrame(placement_frame)
robot_model.approach_vector = rVec2cVec(approach_vector)

# Wrong Artist at the moment
from compas_fab.ghpython import RobotArtist
artist = RobotArtist(robot_model)

# Default position visualization
visual = artist.draw_visual()
# ---------- end create_gripper_2 ----------

# ----
# Manual Input:
# Assembly Sequence
# Clamp Placement Pose
# Grasp Pose (Gripper on Beam Face / Location)
# Place-In-Clamp Vector
# Joint Closure Vector (Assembly Direction)
# 
# Inferred:
# Joint Geo ( Parameters / Geo / Direction)
mjoin = MeshJoin(Meshes=[mesh_15, mesh_16, mesh_17])  # disabled

load_process_from_file_else_use_process = BooleanToggle(False)  # "Load Process from file? (else, use process fm abv)"
stream_filter_3 = StreamFilter(Gate=load_process_from_file_else_use_process, Stream0=clamp_pos_2.robot_clamp_process)
deepcopy = GhPythonScript(data_in=stream_filter_3)  # -> data_out
# ---------- deepcopy: Python ----------
from copy import deepcopy

data_out = deepcopy(data_in)
# ---------- end deepcopy ----------

# ----
# Auto computation workflow
# Load
ghpython_script_3 = GhPythonScript()  # -> json_path; same code as ghpython_script
file_path_2 = FilePath(ghpython_script_3)
json_unpickle_2 = GhPythonScript(json_path=file_path_2, enable=load_process_from_file_else_use_process)  # -> json_str, data; inputs enable: Boolean
# ---------- json_unpickle_2: Python ----------
from compas_ghpython import unload_modules
unload_modules("integral_timber_joints")

import jsonpickle
#import compas
#print( compas.__version__)
#from integral_timber_joints.geometry import Beam
if enable:
    f = open(json_path, 'r')
    json_str = f.read()
    data = jsonpickle.decode(json_str, keys=True)
    f.close()
# ---------- end json_unpickle_2 ----------

stream_filter_4 = StreamFilter(Gate=load_process_from_file_else_use_process, Stream0=deepcopy, Stream1=json_unpickle_2.data)

update_meshes_3 = GhPythonScript(process=stream_filter_4)  # -> out, process_out; same code as update_meshes

# ----
# Compute Clamp Choice,
# Clamp Orientation,
# Jaw Aproach Vector
clamp_pos_3 = GhPythonScript(process=update_meshes_3.process_out)  # -> out, process_out
# ---------- clamp_pos_3: Python ----------
from compas_ghpython import unload_modules
unload_modules("integral_timber_joints")

from compas.geometry import Vector, dot_vectors, sum_vectors

from integral_timber_joints.process import RobotClampAssemblyProcess

process_out = process

# Auto compute 'is_clamp_attached_side' and 'clamp_type' for each joint
process_out.assign_clamp_type_to_joints()

guiding_vector = Vector(1,1,1)
# Set default 'design_guide_vector_jawapproach' to Vector(1,1,1)
# Auto compute clamp assembly orientation 'clamp_wcf_final' based on that guide vector 
for beam_id in  process_out.assembly.beam_ids():

    process_out.assembly.set_beam_attribute(beam_id, 'design_guide_vector_jawapproach', guiding_vector)
    process_out.search_valid_clamp_orientation_with_guiding_vector(beam_id)
    process_out.search_valid_jawapproach_vector_prioritizing_guide_vector(beam_id)
    
#    print(process_out.assembly.get_beam_attribute(beam_id, 'design_guide_vector_jawapproach'))
#    print(process_out.assembly.get_beam_attribute(beam_id, 'assembly_vector_jawapproach'))
#    print(process_out.assembly.get_beam_attribute(beam_id, 'assembly_wcf_inclamp'))
#    print(process_out.assembly.get_beam_attribute(beam_id, 'assembly_wcf_inclampapproach'))
#
# ---------- end clamp_pos_3 ----------

# ----
# Compute Gripper Choice,
# Grasp Face
beam_grasp_frame_2 = GhPythonScript(process=clamp_pos_3.process_out)  # -> out, process_out
# ---------- beam_grasp_frame_2: Python ----------
from compas_ghpython import unload_modules
from compas.geometry import Vector

unload_modules("integral_timber_joints")

process_out = process
assembly = process.assembly


for beam_id in assembly.sequence:
    beam = assembly.beam(beam_id)
    
    # Set a default guide vector for auto-compute
    design_guide_vector_grasp = Vector(-0.2 ,-0.5, -1)
    assembly.set_beam_attribute(beam_id, "design_guide_vector_grasp", design_guide_vector_grasp)

    # Set Beam Attributes related to Gripper
    gripper_grasp_face = process.search_grasp_face_from_guide_vector_dir(beam_id)
    gripper_grasp_dist_from_start = beam.length / 2.0
    gripper_tcp_in_ocf = beam.grasp_frame_ocf(gripper_grasp_face, gripper_grasp_dist_from_start)

    assembly.set_beam_attribute(beam_id, "gripper_grasp_dist_from_start", gripper_grasp_dist_from_start)
    assembly.set_beam_attribute(beam_id, "gripper_tcp_in_ocf", gripper_tcp_in_ocf)
    assembly.set_beam_attribute(beam_id, "gripper_type", process.grippers[0].type_name)
# ---------- end beam_grasp_frame_2 ----------

# ----
# Compute storage/pickup location
pt_14 = Point(Point(19013.06833, 4392.269334, 500))
xy_plane = XYPlane(Origin=pt_14)
storage_location = GhPythonScript(process=beam_grasp_frame_2.process_out, storage_station_frame=xy_plane)  # -> out, process_out
# ---------- storage_location: Python ----------
#from compas_ghpython import unload_modules
#unload_modules("integral_timber_joints")

from compas.geometry import Vector
from compas_rhino.geometry import RhinoPlane

process_out = process
assembly = process.assembly

for beam_id in assembly.sequence:
    beam = assembly.beam(beam_id)
    
    storage_station_cframe = RhinoPlane.from_geometry(storage_station_frame).to_compas()
    process.compute_storage_location_at_corner_aligning_pickup_location(beam_id, storage_station_cframe)
# ---------- end storage_location ----------

# ----
# Compute approach retract
number_slider_10 = Slider(50, range=0..100)
unit_z_3 = UnitZ(Factor=number_slider_10)
beam_grasp_frame_3 = GhPythonScript(process=storage_location.process_out, pickup_retract_vector=unit_z_3)  # -> out, process_out; inputs pickup_retract_vector: Vector3d
# ---------- beam_grasp_frame_3: Python ----------
#from compas_ghpython import unload_modules
#unload_modules("integral_timber_joints")

from compas.geometry import Vector
from compas_rhino.geometry import RhinoVector

process_out = process
assembly = process.assembly

for beam_id in assembly.sequence:
    
    ############################################
    # Approach and Retract For Beams
    ############################################
    
    # Compute approach and retract regarding gripper 
    process.compute_beam_storageapproach_and_finalretract(beam_id)
    
    # Provide guide vector for pickup (storageretract) action.
    design_guide_vector_storage_pickup = RhinoVector.from_geometry(pickup_retract_vector).to_compas()
    assembly.set_beam_attribute(beam_id, "design_guide_vector_storage_pickup", design_guide_vector_storage_pickup)
    
    # Compute storage station pickup (storageretract) position.
    process.compute_beam_storageretract(beam_id)
    
    ############################################
    # Approach and Retract For Clamps
    ############################################

    process.compute_clamp_attachapproach_attachretract_detachapproach(beam_id)
    process.compute_clamp_detachretract(beam_id)
# ---------- end beam_grasp_frame_3 ----------

deepcopy_2 = GhPythonScript(data_in=beam_grasp_frame_3.process_out)  # -> data_out; same code as deepcopy

# ----
# Save
data_dam_2 = DataDam(DataDataA=beam_grasp_frame_3.process_out, BufferDelay=10000000, BufferMode=0)
json_pickle_3 = GhPythonScript(stuff=data_dam_2, json_output_path=ghpython_script_3)  # same code as json_pickle

beam_grasp_frame_4 = GhPythonScript(process=deepcopy_2)  # -> out, process_out
# ---------- beam_grasp_frame_4: Python ----------
from integral_timber_joints.process.algorithms import create_actions_from_sequence, assign_tools_to_actions

process_out = process
create_actions_from_sequence(process)
assign_tools_to_actions(process)
# ---------- end beam_grasp_frame_4 ----------
deepcopy_3 = GhPythonScript(data_in=beam_grasp_frame_4.process_out)  # -> data_out; same code as deepcopy
resolve_clamp_pos_2 = GhPythonScript(process=deepcopy_3)  # -> out, clamp_frames_0, clamp_frames_1, actions_out; disabled
# ---------- resolve_clamp_pos_2: Python ----------
__author__ = "leungp"
__version__ = "2020.02.19"

import rhinoscriptsyntax as rs
from compas.geometry import Frame
from integral_timber_joints.ghpython.utilities import cFrame2rPlane

from compas.geometry import Vector
from compas.geometry import Translation

from compas_ghpython.utilities import draw_frame
clamp_frames_0 = []
clamp_frames_1 = []


from copy import deepcopy

from compas_ghpython import unload_modules
unload_modules("integral_timber_joints")

actions_out = process.actions
assembly = process.assembly
#Creating a dict of clamps and grippers for easy query
tools = {}
for item in process.clamps + process.grippers:
    id = item.name
    tools[id] = deepcopy(item)


def compute_clamp_position(bid1, bid2):
            joint_name = '%s-%s'%(bid1, bid2) #bid1 is the beam already placed
            #print("Computing %s Need Clamp"% joint_name)
            
            beam_already_placed = assembly.element(bid1)._source
            joint = beam_already_placed.get_joint(joint_name)
            #print ("Joint face: %s"% joint.face_id)
            clamp_frames = joint.get_clamp_frame(beam_already_placed)
            return clamp_frames
            #clamp_frames_0.append(draw_frame(clamp_frames[0]))
            #clamp_frames_1.append(draw_frame(clamp_frames[1]))



# Reusable function to resolve workpiece tcf
def resolve_workpiece_tcf_in_world_coords(workpiece, target):
    if target.__class__.__name__ == "StorageTarget":
        # Set beam location to storage_location
        workpiece.current_location = workpiece.storage_location.copy()
    if target.__class__.__name__ == "BeamFinalTarget":
        # Set beam location to final_location
        workpiece.current_location = workpiece.frame.copy()
    if target.__class__.__name__ == "BeamInJawTarget":
        # Set beam location to final_location
        T = Translation(workpiece.assembly_direction.scaled(-1))
        beam_in_jaw_location = workpiece.frame.transformed(T)
        workpiece.current_location = workpiece.frame.copy()            
    # Compute pickup frame (tcp in wcf) from the grasping offset (LCS)
    tcf_in_world_coords = workpiece.current_location.to_world_coords(workpiece.grasp_frame)
    return tcf_in_world_coords


# Reusable function to resolve workpiece tcf
def resolve_vector_in_local_coords(workpiece, target):
    if target.__class__.__name__ == "StorageTarget":
        # StorageTarget in AttachWorkpieceAction, Vector is the grasping frame Z value
        #return workpiece.grasp_frame.normal.scaled(0.12)
        return Vector(0,0,0.12)
    if target.__class__.__name__ == "BeamFinalTarget":
        # For Final Target, Vector is the assembly direction
        assembly_direction_wcf = assembly.network.get_vertex_attribute(workpiece.name, "assembly_direction_wcf")
        #return workpiece.frame.to_local_coords(workpiece.assembly_direction)
        return workpiece.frame.to_local_coords(assembly_direction_wcf)
    if target.__class__.__name__ == "BeamInJawTarget":
        # For Placing beam in a jaw. We need to find the jaw opening direction.
        return Vector(0,0,-0.12)
        

def resolve_workpiece_t0cf(workpiece, tool, assembly):
    # Resolve the tcf of workpiece based on grasp pose
    grasp_frame_ocf = assembly.get_beam_attribute(workpiece.name, "gripper_tcp_in_ocf")
    # resolve the t0cf based on tool
    tcf_in_world_coords = workpiece.current_location.to_world_coords(grasp_frame_ocf)
    t0cf_in_world_coords = tool.set_current_frame_from_tcp(tcf_in_world_coords)
    return t0cf_in_world_coords
    
def resolve_BeamStorageTarget(action, assembly):
    # Set beam location to storage_location
    action.workpiece.current_location = action.workpiece.storage_location.copy()
    # Find tcf and t0cf in world coords
    t0cf_in_world_coords = resolve_workpiece_t0cf(action.workpiece, action.tool, assembly)
    # Assembly vector
    assembly_vector_in_t0cf = Vector(0,0,0.12)
    action.target.resolve(t0cf_in_world_coords, assembly_vector_in_t0cf)
    
def resolve_BeamFinalTarget(action, assembly):
    # Set beam location to final target
    action.workpiece.current_location = action.workpiece.frame.copy()
    # Find tcf and t0cf in world coords
    t0cf_in_world_coords = resolve_workpiece_t0cf(action.workpiece, action.tool, assembly)
    # Assembly Vector
    assembly_direction_wcf = assembly.get_beam_attribute(action.workpiece.name, "assembly_direction_wcf").copy()
    assembly_vector_in_t0cf = t0cf_in_world_coords.to_local_coords(assembly_direction_wcf)
    # Retract Vector (Gripper opening direction)
    retract_vector_in_t0cf = Vector(0,0,-0.12)
    action.target.resolve(t0cf_in_world_coords, assembly_vector_in_t0cf, retract_vector_in_t0cf)
    
def resolve_BeamAboveJawTarget(action, assembly):
    # Set beam location to jaw opening position
    place_in_jaw_direction_wcf = assembly.network.get_vertex_attribute(action.workpiece.name, "place_in_jaw_direction_wcf").copy()
    assembly_direction_wcf = assembly.network.get_vertex_attribute(action.workpiece.name, "assembly_direction_wcf").copy()
    assembly_direction_wcf += place_in_jaw_direction_wcf
    T = Translation(assembly_direction_wcf.scaled(-1))
    action.workpiece.current_location = action.workpiece.frame.transformed(T)         
    # Find tcf and t0cf in world coords
    t0cf_in_world_coords = resolve_workpiece_t0cf(action.workpiece, action.tool, assembly)
    # Assembly vector
    action.target.resolve(t0cf_in_world_coords)
    
def resolve_BeamInJawTarget(action, assembly):
    # Set beam location to in-jaw location
    assembly_direction_wcf = assembly.network.get_vertex_attribute(action.workpiece.name, "assembly_direction_wcf").copy()
    T = Translation(assembly_direction_wcf.scaled(-1))
    action.workpiece.current_location = action.workpiece.frame.transformed(T)         
    # Find tcf and t0cf in world coords
    t0cf_in_world_coords = resolve_workpiece_t0cf(action.workpiece, action.tool, assembly)
    # Assembly vector
    action.target.resolve(t0cf_in_world_coords)

clamp_approach_vector =  Vector(0,0,0.10)
clamp_retract_vector = Vector(0,0,-0.10)
clamp_approach_workpiece_vector =  Vector(0,0,0.30)
clamp_retract_workpiece_vector = Vector(0,0,-0.30)

def resolve_ClampTarget(action, assembly):
    joint_id = (action.target.beam1, action.target.beam2)
    clamp_frame_wcf = assembly.get_joint_attribute(joint_id, "clamp_frame_wcf")
    tool = action.tool
    tool.set_current_location_frame_by_placemnet(clamp_frame_wcf)
    action.target.resolve(tool.current_location, clamp_approach_workpiece_vector, clamp_retract_vector)


def resolve_ToolStorageTarget(action, assembly):
    action.target.resolve(action.tool.storage_location, clamp_approach_vector, clamp_retract_workpiece_vector)

#Loop though all the actions
for action in actions_out:
    
    if action.__class__.__name__ in ["PickWorkpieceAction", "PlaceWorkpieceAction", "DetachWorkpieceAction"]:
        if action.target.__class__.__name__ == "StorageTarget":
            resolve_BeamStorageTarget(action, assembly)
        if action.target.__class__.__name__ == "BeamFinalTarget":
            resolve_BeamFinalTarget(action, assembly)
    
    if action.__class__.__name__ in ["LinearMoveWorkpieceAction", "FreeMoveWorkpieceAction"]:
        if action.target.__class__.__name__ == "BeamAboveJawTarget":
            resolve_BeamAboveJawTarget(action, assembly)
        if action.target.__class__.__name__ == "BeamInJawTarget":
            resolve_BeamInJawTarget(action, assembly)
            
    # Resolve Clamp StorageLocation and Clamp TargetLocation
    if action.__class__.__name__ in ["PickToolAction", "PlaceToolAction"]:
        if action.target.__class__.__name__ == "StorageTarget":
            resolve_ToolStorageTarget(action, assembly)
        if action.target.__class__.__name__ == "ClampTarget":
            #placement_position = compute_clamp_position(action.target.beam1, action.target.beam2)[0] #First result
            resolve_ClampTarget(action, assembly)
            
    # Resolve Items in Action Group
    if action.__class__.__name__ == "ActionGroup":
        for sub_action in action.actions:
            if sub_action.__class__.__name__ in ["LinearMoveWorkpieceAction",]:
                resolve_BeamFinalTarget(sub_action, assembly)
#                tcf_in_world_coords = resolve_workpiece_tcf_in_world_coords(sub_action.workpiece, sub_action.target)
#                t0cf_in_world_coords = resolve_tool_tocp_from_tcp(sub_action.tool, tcf_in_world_coords)
#                sub_action.target.resolve(t0cf_in_world_coords, t0cf_in_world_coords.normal)
# ---------- end resolve_clamp_pos_2 ----------
create_animation_2 = GhPythonScript(process=deepcopy_3)  # -> out, scene_objects_out, keyframes_out, keyframes_count, robot_T0CF_keyframes, descriptions; same code as create_animation

# ----
# Visualize Beam Assembly
step_2 = Slider(6, range=0..13)
select_position_to_visualize = Slider(0, range=0..6)
assembly_step_4 = GhPythonScript(
    process=beam_grasp_frame_3.process_out,
    step=step_2,
    previous_beams_color=ColourSwatch(SwatchColor=RGB(153, 142, 142)),
    current_beam_color=ColourSwatch(SwatchColor=RGB(107, 181, 51)),
    current_inclamp_color=ColourSwatch(SwatchColor=RGB(188, 191, 0)),
    current_inclampapproach_color=ColourSwatch(SwatchColor=RGB(199, 165, 101)))  # -> out, previous_beams, current_beam, clamps, gripper; inputs step: Int32, previous_beams_color: Color, current_beam_color: Color
# ---------- assembly_step_4: Python ----------
__author__ = "leungp"
__version__ = "2020.02.19"

from compas_ghpython.helpers import mesh_draw
from compas.geometry import Transformation
from compas.datastructures import meshes_join

from Rhino.Geometry import Mesh as RhinoMesh
assembly = process.assembly


##########################
# Previous Beams
##########################

# Collect the previously-assembled beam(s)
if step > 0:
    previous_beams = []
    for beam_id in assembly.sequence[:step]:
        beam = assembly.beam(beam_id)
        previous_beams.append(mesh_draw(beam.cached_mesh, color = previous_beams_color))

###################################
# Current Beam (Different Location)
###################################

# Select the current beam
beam_id = assembly.sequence[step]
beam = assembly.beam(beam_id)

# Translate the beam to various location and display
current_beam = []
current_beam_assembly_wcf_final = mesh_draw(beam.cached_mesh, color = current_beam_color)

def join_meshes(meshes):
    if len(meshes) == 1 : return meshes [0]
    

def draw_beam_at(attribute_name):
    T = assembly.get_beam_transformaion_to(beam_id, attribute_name)
    if T is not None:
        current_beam.append(mesh_draw(beam.cached_mesh.transformed(T), color = current_inclamp_color))
    else: current_beam.append(None)

draw_beam_at('assembly_wcf_storage') # Beam does not go to 'assembly_wcf_storageapproach'
draw_beam_at('assembly_wcf_storage')
draw_beam_at('assembly_wcf_storageretract')
draw_beam_at('assembly_wcf_inclampapproach')
draw_beam_at('assembly_wcf_inclamp')
draw_beam_at('assembly_wcf_final')
draw_beam_at('assembly_wcf_final') # Beam does not go to 'assembly_wcf_finalretract'

###################################
# Clamps (multiple clamps)
###################################

clamps = []
# Visualize clamps
for neighbour_id in assembly.get_already_built_neighbors(beam_id):
    joint_id = (neighbour_id, beam_id)
    clamp_wcf_final = assembly.get_joint_attribute(joint_id, 'clamp_wcf_final')
    print (clamp_wcf_final)
    clamp_type = assembly.get_joint_attribute(joint_id, 'clamp_type')
    clamp = process.get_one_clamp_by_type(clamp_type).copy()
    clamp.set_current_frame_from_tcp(clamp_wcf_final)
    clamp.clamp_jaw_position = 120
    clamp.gripper_jaw_position = 0
    clamps.append(clamp)
    print (clamp)
    

###################################
# Gripper (Different Location)
###################################

gripper = []
# Get Gripper and move it to the beam's frame
gripper_type = assembly.get_beam_attribute(beam_id, 'gripper_type')
_gripper = process.get_one_gripper_by_type(gripper_type)

#gripper_tcp_in_ocf = assembly.get_beam_attribute(beam_id, "gripper_tcp_in_ocf")
#gripper_tcp_in_wcf = gripper_tcp_in_ocf.transformed(Transformation.from_frame(beam.frame))

def draw_gripper_at(attribute_name, mesh_join_by_rhino = True):
    gripper_t0cp = process.get_gripper_t0cp_for_beam_at(beam_id, attribute_name)
    if gripper_t0cp is not None:
        _gripper.current_frame = gripper_t0cp
        
        # Two different way to join meshes
        if mesh_join_by_rhino:
            joinedMesh = RhinoMesh()
            meshes = [joinedMesh.Append(mesh_draw(m,  color = current_inclamp_color)) for m in _gripper.draw_visuals()]
            gripper.append(joinedMesh)
        else:
            meshes = meshes_join(_gripper.draw_visuals())
            gripper.append(mesh_draw(meshes,  color = current_inclamp_color))
        
    else: gripper.append(None)
    
draw_gripper_at('assembly_wcf_storageapproach')
draw_gripper_at('assembly_wcf_storage')
draw_gripper_at('assembly_wcf_storageretract')
draw_gripper_at('assembly_wcf_inclampapproach')
draw_gripper_at('assembly_wcf_inclamp')
draw_gripper_at('assembly_wcf_final')
draw_gripper_at('assembly_wcf_finalretract')
# ---------- end assembly_step_4 ----------
robot_artist_4 = GhPythonScript(robot_model=assembly_step_4.clamps, color=ColourSwatch(SwatchColor=RGB(51, 142, 181)))  # -> out, visual; inputs color: Color; same code as robot_artist
unit_x_3 = UnitX(Factor=Slider(0, range=0..10000))
move_7 = Move(Geometry=robot_artist_4.visual, Motion=unit_x_3)  # -> Geometry, Transform

assembly_step_5 = GhPythonScript(
    process=beam_grasp_frame_3.process_out,
    step=step_2,
    position=position_of_clamp,
    clamp_color=ColourSwatch(SwatchColor=RGB(51, 142, 181)))  # -> out, clamps, clamps_action_states, clamps_mesh; inputs step: Int32
# ---------- assembly_step_5: Python ----------
from Rhino.Geometry import Mesh as RhinoMesh
from compas_ghpython.utilities import list_to_ghtree
import jsonpickle

from compas_ghpython.helpers import mesh_draw

###################################
# Clamps (multiple clamps)
###################################

assembly = process.assembly
beam_id = assembly.sequence[step]

joint_ids = assembly.get_joint_ids_of_beam_clamps(beam_id)
clamps = [process.get_clamp_of_joint(joint_id, set_position_to_clamp_wcf_final=False) for joint_id in joint_ids]

# Stores the clamp states of each step
clamps_action_states = {}
for joint_id in joint_ids:
    clamps_action_states[joint_id] = []

clamps_mesh = []

def draw_clamps_at(attribute_name, gripper_open, clamp_open, mesh_join_by_rhino = True):
    for joint_id , clamp in zip(joint_ids, clamps):
        # Retrive the target location frame
        clamp_t0cp = process.assembly.get_joint_attribute(joint_id, attribute_name)
        if clamp_t0cp is not None:
            # Set Clamp State
            clamp.current_frame = clamp_t0cp
            if gripper_open: clamp.open_gripper()
            else: clamp.close_gripper()
            if clamp_open: clamp.open_clamp()
            else: clamp.close_clamp()
            
            # Each Clamp have multiple moveable link and therefore multiple meshes
            # Two different way to join meshes of a clamp
            if mesh_join_by_rhino:
                joinedMesh = RhinoMesh()
                meshes = [joinedMesh.Append(mesh_draw(m,  color = clamp_color)) for m in clamp.draw_visuals()]
                clamps_mesh.append(joinedMesh)
            else:
                meshes = meshes_join(clamp.draw_visuals())
                clamps_mesh.append(mesh_draw(meshes,  color = clamp_color))
        
        else: clamps_mesh.append(None)

if position == 0: draw_clamps_at('clamp_wcf_attachapproach', True, True)
if position == 1: draw_clamps_at('clamp_wcf_final', True, True)
if position == 2: draw_clamps_at('clamp_wcf_final', False, True)
if position == 3: draw_clamps_at('clamp_wcf_final', False, False)
if position == 4: draw_clamps_at('clamp_wcf_final', True, True)
if position == 5: draw_clamps_at('clamp_wcf_detachretract1', True, True)
if position == 6: draw_clamps_at('clamp_wcf_detachretract2', True, True)
# ---------- end assembly_step_5 ----------
mesh_18 = Mesh(assembly_step_5.clamps_mesh)
list_item_2 = ListItem(List=assembly_step_4.gripper, Index=select_position_to_visualize, Wrap=True)
list_item_3 = ListItem(List=assembly_step_4.current_beam, Index=select_position_to_visualize, Wrap=True)
move_8 = Move(Geometry=list_item_2, Motion=unit_x_3)  # -> Geometry, Transform

move_9 = Move(Geometry=list_item_3, Motion=unit_x_3)  # -> Geometry, Transform

move_10 = Move(Geometry=assembly_step_4.previous_beams, Motion=unit_x_3)  # -> Geometry, Transform

# ----
# Animation Visualization
show_step = Slider(690, range=0..690)  # disabled
int = Integer(show_step)  # disabled
show_animation = GhPythonScript(scene_objects=create_animation.scene_objects_out, scene_states=create_animation.keyframes_out, show_step=int)  # -> out, visuals_not_attached, visuals_attached; inputs scene_states: list, show_step: Int32; disabled
# ---------- show_animation: Python ----------
__author__ = "leungp"
__version__ = "2020.02.26"

keyframe = scene_states[show_step]

visuals_not_attached = []
visuals_attached = []

from copy import deepcopy

scene_objects = deepcopy(scene_objects)

for key, state in keyframe.items():
    scene_object = scene_objects[key]
    scene_object.set_state(state)
    print "Drawing: %s" % scene_object.name
    if state['is_attached']:
        visuals_attached += scene_object.draw_visuals()
    else:
        visuals_not_attached += scene_object.draw_visuals()
# ---------- end show_animation ----------
item_2 = ListItem(List=create_animation.descriptions, Index=int, Wrap=True)  # disabled
item_3 = ListItem(List=create_animation.keyframes_out, Index=int, Wrap=True)  # disabled
item_4 = ListItem(List=create_animation.robot_T0CF_keyframes, Index=int, Wrap=True)  # disabled
lng = ListLength(List=create_animation.robot_T0CF_keyframes)  # disabled
total_steps = Panel(lng)  # disabled
python_2 = GhPythonScript(x=item_3)  # -> out, a; disabled
# ---------- python_2: Python ----------
__author__ = "leungp"
__version__ = "2020.02.26"

import rhinoscriptsyntax as rs

from pprint import pprint
pprint(x, width = 1)
# ---------- end python_2 ----------
python_3 = GhPythonScript(x=item_4)  # -> out, a; disabled
# ---------- python_3: Python ----------
__author__ = "leungp"
__version__ = "2020.03.03"

from compas_ghpython.utilities import draw_frame
a  = draw_frame(x)
# ---------- end python_3 ----------
scene_objects_states = Panel(python_2.out)  # disabled
sph = Sphere(Base=python_3.a, Radius=0.04)  # disabled
colour = ColourPicker(PickedColour=RGB(91, 250, 62))  # disabled
colour_2 = ColourPicker(PickedColour=RGB(250, 62, 62))  # disabled
preview = CustomPreview(Geometry=show_animation.visuals_not_attached, Material=colour)  # disabled
preview_2 = CustomPreview(Geometry=show_animation.visuals_attached, Material=colour_2)  # disabled

concat = Concatenate(FragmentA=panel_10, FragmentB=int, FragmentC=panel_9, FragmentD=item_2)  # disabled

step_description = Panel(concat)  # disabled

tag = TextTag3D(
    Location=Plane(origin=(16.41141328, 3.827116559, 0), x=(0.9022965756, -0.4311158658, 0), y=(-0.008179768992, -0.01711970757, 0.9998199873)),
    Text=step_description,
    Size=number_slider_7,
    Justification=7)  # disabled
pln = Plane(python_3.a)  # disabled
