# Grasshopper definition Process Design Example.gh (Grasshopper 1.0.7)
# plug-ins: Human

# ----
# Reload Python Modules (if Module Code is Changed)
python_module_to_reload = Panel("""compas
compas_fab
roslibpy
integral_timber_joints""")
# Development Tools
reload = Button()
py = PythonScript(reload_module_button=reload, module_names=python_module_to_reload)  # inputs module_names: list
# ---------- py: Python ----------
import compas_ghpython
from compas_ghpython import unload_modules
if reload_module_button:
    for module in module_names:
        unload_modules(module)
# ---------- end py ----------

# ----
# Check Path and Environment
compas_version = GhPythonScript()  # -> out, compas_version, compas_fab_version, compas_path, compas_fab_path, compas_env_name, python_directory
# ---------- compas_version: Python ----------
__author__ = "leungp"
__version__ = "2020.04.20"

import rhinoscriptsyntax as rs
import compas
import compas_fab
compas_version  = compas.__version__
compas_fab_version = compas_fab.__version__
import os
compas_path = os.path.abspath(compas.__file__)
compas_fab_path = os.path.abspath(compas_fab.__file__)

import compas_bootstrapper
compas_env_name = compas_bootstrapper.ENVIRONMENT_NAME
python_directory = compas_bootstrapper.PYTHON_DIRECTORY
# ---------- end compas_version ----------
compas_environment_name = Panel(compas_version.compas_env_name)
compas_version_2 = Panel(compas_version.compas_version)
compas_fab_version = Panel(compas_version.compas_fab_version)
compas_path = Panel(compas_version.compas_path)
compas_fab_path = Panel(compas_version.compas_fab_path)
python_directory = Panel(compas_version.python_directory)

# ----
# Gripper Orientation
# (vector_grasp)
button = Button()
button_2 = Button()
button_3 = Button()
button_4 = Button()
button_5 = Button()
button_6 = Button()
interactive_vec_button = GhPythonScript(x_pos=button, x_neg=button_2, y_pos=button_3, y_neg=button_4, z_pos=button_5, z_neg=button_6)  # -> output
# ---------- interactive_vec_button: Python ----------
from Rhino.Geometry import Vector3d

if x_pos: output = Vector3d(1,0,0)
if x_neg: output = Vector3d(-1,0,0)
if y_pos: output = Vector3d(0,1,0)
if y_neg: output = Vector3d(0,-1,0)
if z_pos: output = Vector3d(0,0,1)
if z_neg: output = Vector3d(0,0,-1)
# ---------- end interactive_vec_button ----------

# ----
# Clamp Orientation
# vector_jawapproach
button_7 = Button()
button_8 = Button()
button_9 = Button()
button_10 = Button()
button_11 = Button()
button_12 = Button()
interactive_vec_button_2 = GhPythonScript(x_pos=button_8, x_neg=button_7, y_pos=button_10, y_neg=button_9, z_pos=button_12, z_neg=button_11)  # -> output; same code as interactive_vec_button

enable_interactive_selection_disable_to = BooleanToggle(True)  # "Enable Interactive Selection (disable to resume normal Rhino function)"

# ----
# Gripper Type
long = Button()
short = Button()

# ----
# Load Proecss file
process_json_path = GhPythonScript()  # -> json_path
# ---------- process_json_path: Python ----------
from Rhino.RhinoDoc import ActiveDoc
import os
json_path = os.path.splitext(ActiveDoc.Path)[0] + "_process.json"
# ---------- end process_json_path ----------
file_path = FilePath(process_json_path)
json_unpickle = GhPythonScript(json_path=file_path, enable=True)  # -> warn_col, warn_msg, data; inputs enable: Boolean
# ---------- json_unpickle: Python ----------
import jsonpickle
import os
if enable:
    exist = os.path.exists(json_path)
    if exist:
        f = open(json_path, 'r')
        json_str = f.read()
        data = jsonpickle.decode(json_str, keys=True)
        f.close()
        warn_col = "lime"    
        warn_msg = "Process File loaded with %s Beams, %s Clamps, %s Grippers" % (len(list(data.assembly.beams())), len(list(data.clamps)), len(list(data.grippers)))
    else:
        warn_col = "orange"    
        warn_msg = "Process File not created yet"
# ---------- end json_unpickle ----------
legend = Legend(Colour=json_unpickle.warn_col, Tags=json_unpickle.warn_msg, LegendType=1)
process = Data(json_unpickle.data)

# ----
# Pickup Station
number_slider = Slider(50, range=0..100)
geo = Geometry([<brep referenced from the Rhino model> x3])
pickup_station_corner = Point(<point referenced from the Rhino model>)
mjoin = MeshJoin(Meshes=geo)
pickup_station_collision_mesh = Mesh(mjoin)
unit_z = UnitZ(Factor=number_slider)
xy_plane = XYPlane(Origin=pickup_station_corner)

# ----
# Create Process from Assembly + Tools
# Load assembly file
auto_json_path = GhPythonScript()  # -> json_path
# ---------- auto_json_path: Python ----------
from Rhino.RhinoDoc import ActiveDoc
import os
json_path = os.path.splitext(ActiveDoc.Path)[0] + "_assembly.json"
# ---------- end auto_json_path ----------
file_path_2 = FilePath(auto_json_path)
json_unpickle_2 = GhPythonScript(json_path=file_path_2, enable=True)  # -> warn_col, warn_msg, data; inputs enable: Boolean
# ---------- json_unpickle_2: Python ----------
import jsonpickle
import os
if enable:
    exist = os.path.exists(json_path)
    if exist:
        f = open(json_path, 'r')
        json_str = f.read()
        data = jsonpickle.decode(json_str, keys=True)
        f.close()
        warn_col = "lime"    
        warn_msg = "Assembly File loaded with %s Beams" % (len(list(data.beams())))
    else:
        warn_col = "orange"    
        warn_msg = "Assembly File not created yet"
# ---------- end json_unpickle_2 ----------
legend_2 = Legend(Colour=json_unpickle_2.warn_col, Tags=json_unpickle_2.warn_msg, LegendType=1)

# ----
# Load Grippers
tool_definition_file_location = Panel("C:\Users\leungp\Documents\GitHub\integral_timber_joints\examples\tools_example\PG2.json")
json_unpickle_3 = GhPythonScript(json_path=tool_definition_file_location, enable=True)  # -> warn_col, warn_msg, data; inputs enable: Boolean
# ---------- json_unpickle_3: Python ----------
import jsonpickle
import os
if enable:
    exist = os.path.exists(json_path)
    if exist:
        f = open(json_path, 'r')
        json_str = f.read()
        data = jsonpickle.decode(json_str, keys=True)
        f.close()
        warn_col = "lime"    
        warn_msg = "%s Object (type: %s) loaded." % (data.__class__.__name__, data.type_name)
    else:
        warn_col = "orange"    
        warn_msg = "Tool File not exist"
# ---------- end json_unpickle_3 ----------
legend_3 = Legend(Colour=json_unpickle_3.warn_col, Tags=json_unpickle_3.warn_msg, LegendType=1)
tool = Data(json_unpickle_3.data)

# ----
# Load Clamps
tool_definition_file_location_2 = Panel("C:\Users\leungp\Documents\GitHub\integral_timber_joints\examples\tools_example\CL1.json")
json_unpickle_4 = GhPythonScript(json_path=tool_definition_file_location_2, enable=True)  # -> warn_col, warn_msg, data; inputs enable: Boolean; same code as json_unpickle_3
legend_4 = Legend(Colour=json_unpickle_4.warn_col, Tags=json_unpickle_4.warn_msg, LegendType=2)
tool_2 = Data(json_unpickle_4.data)

# ----
# Load Grippers
tool_definition_file_location_3 = Panel("C:\Users\leungp\Documents\GitHub\integral_timber_joints\examples\tools_example\PG1.json")
json_unpickle_5 = GhPythonScript(json_path=tool_definition_file_location_3, enable=True)  # -> warn_col, warn_msg, data; inputs enable: Boolean; same code as json_unpickle_3
legend_5 = Legend(Colour=json_unpickle_5.warn_col, Tags=json_unpickle_5.warn_msg, LegendType=1)
tool_3 = Data(json_unpickle_5.data)

long_gripper_type = Panel("PG1")
short_gripper_type = Panel("PG2")
filter = StreamFilter(Gate=long, Stream1=long_gripper_type)
filter_2 = StreamFilter(Gate=short, Stream1=short_gripper_type)
unique_tool_id = Panel("c3")
pt = Point(<point referenced from the Rhino model>)
unique_tool_id_2 = Panel("g2")
pt_2 = Point(<point referenced from the Rhino model>)
merge = Merge(Data1=filter, Data2=filter_2)
pickup_station = GhPythonScript(alignment_frame=xy_plane, pickup_retract_vector=unit_z, collision_mesh=pickup_station_collision_mesh)  # -> out, pickup_station; inputs collision_mesh: Mesh
# ---------- pickup_station: Python ----------
from integral_timber_joints.tools import PickupStation
from compas_rhino.geometry import RhinoPlane, RhinoVector, RhinoMesh

alignment_frame = RhinoPlane.from_geometry(alignment_frame).to_compas()
pickup_retract_vector = RhinoVector.from_geometry(pickup_retract_vector).to_compas()
pickup_station = PickupStation(alignment_frame, pickup_retract_vector)
pickup_station.collision_mesh = RhinoMesh.from_geometry(collision_mesh).to_compas()
# ---------- end pickup_station ----------
pl = ConstructPlane(Origin=pt, XAxis=Vector(-2.098851206, 0, 0), YAxis=Vector(0, 1, 0))
pl_2 = ConstructPlane(Origin=pt_2, XAxis=Vector(-2.098851206, 0, 0), YAxis=Vector(0, 1, 0))
python = GhPythonScript()  # -> Out, A
clamp_instance = GhPythonScript(robot_model=tool_2, clamp_id=unique_tool_id, storage_location_by_tcp=pl)  # -> out, robot_model_out, visual; inputs storage_location_by_tcp: Plane
# ---------- clamp_instance: Python ----------
from compas_rhino.geometry import RhinoPlane

# Deep copy should be performed before editing
robot_model_out = robot_model.copy()

# Set the instance properity
robot_model_out.set_current_frame_from_tcp(RhinoPlane.from_geometry(storage_location_by_tcp).to_compas())
robot_model_out.tool_storage_frame = robot_model_out.current_frame
robot_model_out.name = clamp_id

# Preview
from compas_ghpython.helpers import mesh_draw
visual = [mesh_draw(mesh) for mesh in robot_model_out.draw_visuals()]
# ---------- end clamp_instance ----------

# ----
# Create Clamp / Gripper Instances
# (e.g. multiple idenditical tools of the same type)
unique_tool_id_3 = Panel("c2")
unique_tool_id_4 = Panel("c1")
pt_3 = Point(<point referenced from the Rhino model>)
pt_4 = Point(<point referenced from the Rhino model>)
unique_tool_id_5 = Panel("g1")
pt_5 = Point(<point referenced from the Rhino model>)
pl_3 = ConstructPlane(Origin=pt_3, XAxis=Vector(-2.098851206, 0, 0), YAxis=Vector(0, 1, 0))
pl_4 = ConstructPlane(Origin=pt_4, XAxis=Vector(-2.098851206, 0, 0), YAxis=Vector(0, 1, 0))
pl_5 = ConstructPlane(Origin=pt_5, XAxis=Vector(-2.098851206, 0, 0), YAxis=Vector(0, 1, 0))
clamp_instance_2 = GhPythonScript(robot_model=tool_2, clamp_id=unique_tool_id_3, storage_location_by_tcp=pl_3)  # -> out, robot_model_out, visual; inputs storage_location_by_tcp: Plane; same code as clamp_instance
clamp_instance_3 = GhPythonScript(robot_model=tool_2, clamp_id=unique_tool_id_4, storage_location_by_tcp=pl_4)  # -> out, robot_model_out, visual; inputs storage_location_by_tcp: Plane; same code as clamp_instance
clamp_instance_4 = GhPythonScript(robot_model=tool_3, clamp_id=unique_tool_id_5, storage_location_by_tcp=pl_5)  # -> out, robot_model_out, visual; inputs storage_location_by_tcp: Plane; same code as clamp_instance
merge_2 = Merge(Data1=clamp_instance_3.robot_model_out, Data2=clamp_instance_2.robot_model_out, Data3=clamp_instance.robot_model_out)

clamp_instance_5 = GhPythonScript(robot_model=tool, clamp_id=unique_tool_id_2, storage_location_by_tcp=pl_2)  # -> out, robot_model_out, visual; inputs storage_location_by_tcp: Plane; same code as clamp_instance

# ----
# Visualize Assembly - Clickable Mesh
# (Perspective Viewport)
ghpython_script = GhPythonScript(process=process, enable=True)  # -> out, beam_meshes, beam_ids
# ---------- ghpython_script: Python ----------
from compas_ghpython.helpers import mesh_draw

assembly = process.assembly
beam_meshes = []
beam_ids = []
if enable:
    for beam_id in assembly.beam_ids():
        beam = assembly.beam(beam_id)
        beam_meshes.append(mesh_draw(beam.cached_mesh))
        beam_ids.append(beam_id)
# ---------- end ghpython_script ----------
clickable_mesh = ClickableMesh(Enable=enable_interactive_selection_disable_to, Meshes=ghpython_script.beam_meshes)  # -> SelectedMeshes, SelectedIndices, MouseLine
cull_index = CullIndex(List=ghpython_script.beam_meshes, Indices=clickable_mesh.SelectedIndices, Wrap=True)
list_item = ListItem(List=ghpython_script.beam_meshes, Index=clickable_mesh.SelectedIndices, Wrap=True)
list_item_2 = ListItem(List=ghpython_script.beam_ids, Index=clickable_mesh.SelectedIndices, Wrap=True)
filter_3 = StreamFilter(Gate=enable_interactive_selection_disable_to, Stream1=list_item_2)
selected_beam_id = Text(filter_3)
custom_preview = CustomPreview(Geometry=list_item, Material=ColourSwatch(SwatchColor=RGBA(27, 170, 209, 181)))
custom_preview_2 = CustomPreview(Geometry=cull_index, Material=ColourSwatch(SwatchColor=RGBA(219, 219, 219, 103)))
selected_beam = Panel(selected_beam_id)

# ----
# Compute Clamp Orientation by Custom Guide
selected_beam_id_2 = Text(selected_beam_id)
change_clamp_orientation = GhPythonScript(process=process, beam_id=selected_beam_id_2, guide_vector=interactive_vec_button_2)  # -> out, process_out; inputs guide_vector: Vector3d
# ---------- change_clamp_orientation: Python ----------
#from compas_ghpython import unload_modules
#unload_modules("integral_timber_joints")

from compas_rhino.geometry import RhinoVector

# Process object by default through the component unmodified.
process_out = process

# Interactive interface - guide_vector is None when UI Buttons are not pressed

if guide_vector is not None and beam_id is not None:

    # Set guide vector according to input
    guide_vector_compas = RhinoVector.from_geometry(guide_vector).to_compas()
    process_out.assembly.set_beam_attribute(beam_id, 'design_guide_vector_jawapproach', guide_vector_compas)
    print("design_guide_vector_jawapproach = %s" % guide_vector_compas)
    
    # Recompute clamp orientation
    clamp_orientations = process_out.search_valid_clamp_orientation_with_guiding_vector(beam_id)
    print("clamp_orientations = %s" % clamp_orientations)

    # Recompute Jaw Approach Vector
    assembly_vector_jawapproach = process_out.search_valid_jawapproach_vector_prioritizing_guide_vector(beam_id)
    print("assembly_vector_jawapproach = %s" % assembly_vector_jawapproach)
    
    # Recompute retract positions of clamps
    process.compute_clamp_attachapproach_attachretract_detachapproach(beam_id)
    process.compute_clamp_detachretract(beam_id)
# ---------- end change_clamp_orientation ----------

# ----
# Compute Grasp Face by Custom Guide
selected_beam_id_3 = Text(selected_beam_id)
change_gripper_orientation = GhPythonScript(process=process, beam_id=selected_beam_id_3, guide_vector=interactive_vec_button)  # -> out, process_out
# ---------- change_gripper_orientation: Python ----------
#from compas_ghpython import unload_modules
#unload_modules("integral_timber_joints")

from compas.geometry import Vector

from compas_rhino.geometry import RhinoVector

# Process object by default through the component unmodified.
process_out = process

# Interactive interface - guide_vector is None when UI Buttons are not pressed
# In that case, process should simply pass through unmodified.
if guide_vector is not None and beam_id is not None:
    assembly = process.assembly
    beam = assembly.beam(beam_id)
    
    # Set guide vector according to input
    guide_vector_compas = RhinoVector.from_geometry(guide_vector).to_compas()
    assembly.set_beam_attribute(beam_id, "design_guide_vector_grasp", guide_vector_compas)

    # Recompute best clamp face and update grasp frame
    gripper_grasp_face = process.search_grasp_face_from_guide_vector_dir(beam_id)
    gripper_grasp_dist_from_start = assembly.get_beam_attribute(beam_id, "gripper_grasp_dist_from_start")
    gripper_tcp_in_ocf = beam.grasp_frame_ocf(gripper_grasp_face, gripper_grasp_dist_from_start)

    assembly.set_beam_attribute(beam_id, "gripper_tcp_in_ocf", gripper_tcp_in_ocf)
    
    # Recompute Pickup Alignment at Pickup Station
    process.compute_storage_location_at_corner_aligning_pickup_location(beam_id)
    
    # Recompute approach and retract regarding gripper 
    process.compute_beam_storageapproach_and_finalretract(beam_id)
    process.compute_beam_storageretract(beam_id)
# ---------- end change_gripper_orientation ----------

# ----
# Save Edits
data_dam = DataDam(DataDataA=change_gripper_orientation.process_out, BufferDelay=10000000, BufferMode=0)
process_json_path_2 = GhPythonScript()  # -> json_path; same code as process_json_path
json_pickle = GhPythonScript(stuff=data_dam, json_output_path=process_json_path_2)
# ---------- json_pickle: Python ----------
if stuff is not None:
    import jsonpickle
    jsonpickle.set_preferred_backend('json')
    jsonpickle.set_encoder_options('json')
    
    f = open(json_output_path, 'w')
    f.write(jsonpickle.encode(stuff, keys=True))
    f.close()
# ---------- end json_pickle ----------

merge_3 = Merge(Data1=clamp_instance_4.robot_model_out, Data2=clamp_instance_5.robot_model_out)

# ----
# Select Gripper Type
selected_beam_id_4 = Text(selected_beam_id)
change_clamp_type = GhPythonScript(process=process, beam_id=selected_beam_id_4, gripper_type=merge)  # -> out, process_out
# ---------- change_clamp_type: Python ----------
#from compas_ghpython import unload_modules
#unload_modules("integral_timber_joints")

from compas.geometry import Vector

from compas_rhino.geometry import RhinoVector

# Process object by default through the component unmodified.
process_out = process

# Interactive interface - clamp_type is None when UI Buttons are not pressed
# In that case, process should simply pass through unmodified.
if gripper_type is not None and beam_id is not None:
    assembly = process.assembly
    beam = assembly.beam(beam_id)
    
    # Change clamp type
    assembly.set_beam_attribute(beam_id, "gripper_type", gripper_type)
    
    # Recompute best clamp face and update grasp frame
    gripper_grasp_face = process.search_grasp_face_from_guide_vector_dir(beam_id)
    gripper_grasp_dist_from_start = assembly.get_beam_attribute(beam_id, "gripper_grasp_dist_from_start")
    gripper_tcp_in_ocf = beam.grasp_frame_ocf(gripper_grasp_face, gripper_grasp_dist_from_start)
    assembly.set_beam_attribute(beam_id, "gripper_tcp_in_ocf", gripper_tcp_in_ocf)
    
    # Recompute Pickup Alignment at Pickup Station
    process.compute_storage_location_at_corner_aligning_pickup_location(beam_id)
    
    # Recompute approach and retract regarding gripper 
    process.compute_beam_storageapproach_and_finalretract(beam_id)
    process.compute_beam_storageretract(beam_id)
# ---------- end change_clamp_type ----------

joint_clamp_matching = Panel("Joint_90lap,CL1")
# Create Process
clamp_pos = GhPythonScript(clamps=merge_2, grippers=merge_3, assembly=json_unpickle_2.data)  # -> out, robot_clamp_process; inputs clamps: list, grippers: list
# ---------- clamp_pos: Python ----------
#from compas_ghpython import unload_modules
#unload_modules("integral_timber_joints")

from compas.geometry import Vector, dot_vectors, sum_vectors
from compas_rhino.geometry import RhinoPlane
from integral_timber_joints.process import RobotClampAssemblyProcess

# Create Process
process = RobotClampAssemblyProcess(assembly)

# Add clamps and grippers to process
[process.add_clamp(clamp) for clamp in clamps]
[process.add_gripper(gripper) for gripper in grippers]

# Output
robot_clamp_process = process
# ---------- end clamp_pos ----------

# ----
# Compute Clamp Choice
# Clamp Orientation (Auto Assign)
# Jaw Aproach Vector
clamp_pos_2 = GhPythonScript(process=clamp_pos.robot_clamp_process, joint_clamp_matchings=joint_clamp_matching)  # -> out, process_out; inputs joint_clamp_matchings: list
# ---------- clamp_pos_2: Python ----------
from compas_ghpython import unload_modules
unload_modules("integral_timber_joints")

from compas.geometry import Vector, dot_vectors, sum_vectors

from integral_timber_joints.process import RobotClampAssemblyProcess

process_out = process

# Assign Clamp Types according to Joint-Clamp Matching 
clamp_of_joint = {}
for matching in joint_clamp_matchings:
    joint_type, clamp_type = matching.split(',')
    clamp_of_joint[joint_type] = clamp_type
for joint in process.assembly.joints():
    joint_type = joint.__class__.__name__
    if joint_type in clamp_of_joint:
        joint.clamp_types = [clamp_of_joint[joint_type]]

# Assign clamp_type to joints
# Compute 'is_clamp_attached_side' and 'clamp_type' for each joint
process_out.assign_clamp_type_to_joints()

# Compute Clamp Orientation and Approach Vector
# Set default 'design_guide_vector_jawapproach' to Vector(1,1,1)
guiding_vector = Vector(1,1,1)
# Auto compute clamp assembly orientation 'clamp_wcf_final' based on that guide vector 
for beam_id in  process_out.assembly.beam_ids():
    process_out.assembly.set_beam_attribute(beam_id, 'design_guide_vector_jawapproach', guiding_vector)
    process_out.search_valid_clamp_orientation_with_guiding_vector(beam_id)
    process_out.search_valid_jawapproach_vector_prioritizing_guide_vector(beam_id)
# ---------- end clamp_pos_2 ----------

# ----
# Update Management
# Trigger Downstream
merge_4 = Merge(
    Data1=change_clamp_orientation.process_out,
    Data2=change_gripper_orientation.process_out,
    Data3=change_clamp_type.process_out)
item = ListItem(List=merge_4, Index=0, Wrap=True)

# ----
# Avoid downstream on button-pressed
merge_5 = Merge(
    Data1=button_7,
    Data2=button_8,
    Data3=button_9,
    Data4=button_10,
    Data5=button_11,
    Data6=button_12,
    Data7=button,
    Data8=button_2,
    Data9=button_3,
    Data10=button_4,
    Data11=button_5,
    Data12=button_6,
    Data13=long,
    Data14=short)  # -> flatten(Result)
ma = MassAddition(Input=merge_5)  # -> Result, PartialResults
filter_4 = StreamFilter(Gate=ma.Result, Stream0=item)

# ----
# Visualize Assembly Key Location
# (PerspectiveAlt Viewport)
autoplay_loops = BooleanToggle(False)
process_2 = Data(filter_4)
position_of_clamp = Slider(10, range=0..11)
panel = Panel("""0,0
0,1
0,2
1,2
2,2
3,2
4,2
5,3
6,3
6,4
6,5
6,6""")
timer = Timer(TimerInterval=500, Target=cluster)  # disabled
cluster = Cluster(bool=invert(autoplay_loops), L=panel, override=position_of_clamp)
int = Integer(cluster)
list_item_3 = ListItem(List=panel, Index=int, Wrap=True)
split = TextSplit(Text=list_item_3, Separators=",")
selected_beam_id_5 = Text(selected_beam_id)
item_2 = ListItem(List=split, Index=0, Wrap=True)  # -> Item, Item1
int_gripper_pos_index = Integer(item_2.Item)
int_clamp_pos_index = Integer(item_2.Item1)
visualize_beams_grippers = GhPythonScript(
    process=process_2,
    beam_id=selected_beam_id_5,
    previous_beams_color=ColourSwatch(SwatchColor=RGB(153, 142, 142)),
    current_beam_color=ColourSwatch(SwatchColor=RGB(107, 181, 51)),
    current_inclamp_color=ColourSwatch(SwatchColor=RGB(188, 191, 0)),
    gripper_color=ColourSwatch(SwatchColor=RGB(199, 165, 101)))  # -> out, previous_beams, current_beam, clamps, gripper; inputs previous_beams_color: Color, current_beam_color: Color
# ---------- visualize_beams_grippers: Python ----------
__author__ = "leungp"
__version__ = "2020.02.19"

from compas_ghpython.helpers import mesh_draw
from compas.geometry import Transformation
from compas.datastructures import meshes_join

from Rhino.Geometry import Mesh as RhinoMesh
assembly = process.assembly

if beam_id is None: beam_id = assembly.sequence[0]

##########################
# Previous Beams
##########################

# Collect the previously-assembled beam(s)
previous_beams = []
#for this_beam_id in assembly.sequence:
#    if this_beam_id == beam_id: break
#    beam = assembly.beam(this_beam_id)
#    previous_beams.append(mesh_draw(beam.cached_mesh, color = previous_beams_color))
#
for this_beam_id in assembly.get_already_built_beams(beam_id):
    beam = assembly.beam(this_beam_id)
    previous_beams.append(mesh_draw(beam.cached_mesh, color = previous_beams_color))

###################################
# Current Beam (Different Location)
###################################

# Select the current beam
beam = assembly.beam(beam_id)

# Translate the beam to various location and display
current_beam = []
current_beam_assembly_wcf_final = mesh_draw(beam.cached_mesh, color = current_beam_color)

def join_meshes(meshes):
    if len(meshes) == 1 : return meshes [0]
    

def draw_beam_at(attribute_name):
    T = assembly.get_beam_transformaion_to(beam_id, attribute_name)
    if T is not None:
        current_beam.append(mesh_draw(beam.cached_mesh.transformed(T), color = current_inclamp_color))
    else: current_beam.append(None)

draw_beam_at('assembly_wcf_storage') # Beam does not go to 'assembly_wcf_storageapproach'
draw_beam_at('assembly_wcf_storage')
draw_beam_at('assembly_wcf_storageretract')
if assembly.get_beam_attribute(beam_id, 'assembly_wcf_inclampapproach') is not None:
    draw_beam_at('assembly_wcf_inclampapproach')
else:
    draw_beam_at('assembly_wcf_inclamp')
draw_beam_at('assembly_wcf_inclamp')
draw_beam_at('assembly_wcf_final')
draw_beam_at('assembly_wcf_final') # Beam does not go to 'assembly_wcf_finalretract'

###################################
# Clamps (multiple clamps)
###################################

clamps = []
# Visualize clamps
for neighbour_id in assembly.get_already_built_neighbors(beam_id):
    joint_id = (neighbour_id, beam_id)
    clamp_wcf_final = assembly.get_joint_attribute(joint_id, 'clamp_wcf_final')
    print (clamp_wcf_final)
    clamp_type = assembly.get_joint_attribute(joint_id, 'clamp_type')
    clamp = process.get_one_clamp_by_type(clamp_type).copy()
    clamp.set_current_frame_from_tcp(clamp_wcf_final)
    clamp.clamp_jaw_position = 120
    clamp.gripper_jaw_position = 0
    clamps.append(clamp)
    print (clamp)
    

###################################
# Gripper (Different Location)
###################################

gripper = []
# Get Gripper and move it to the beam's frame
gripper_type = assembly.get_beam_attribute(beam_id, 'gripper_type')
_gripper = process.get_one_gripper_by_type(gripper_type)

#gripper_tcp_in_ocf = assembly.get_beam_attribute(beam_id, "gripper_tcp_in_ocf")
#gripper_tcp_in_wcf = gripper_tcp_in_ocf.transformed(Transformation.from_frame(beam.frame))

def draw_gripper_at(attribute_name, gripper_open = True, mesh_join_by_rhino = True):
    gripper_t0cp = process.get_gripper_t0cp_for_beam_at(beam_id, attribute_name)
    if gripper_t0cp is not None:
        _gripper.current_frame = gripper_t0cp
        if gripper_open: _gripper.open_gripper()
        else: _gripper.close_gripper()
        # Two different way to join meshes
        if mesh_join_by_rhino:
            joinedMesh = RhinoMesh()
            meshes = [joinedMesh.Append(mesh_draw(m,  color = gripper_color)) for m in _gripper.draw_visuals()]
            gripper.append(joinedMesh)
        else:
            meshes = meshes_join(_gripper.draw_visuals())
            gripper.append(mesh_draw(meshes,  color = gripper_color))
        
    else: gripper.append(None)
    
draw_gripper_at('assembly_wcf_storageapproach', True)
draw_gripper_at('assembly_wcf_storage', True)
draw_gripper_at('assembly_wcf_storageretract', False)
if assembly.get_beam_attribute(beam_id, 'assembly_wcf_inclampapproach') is not None:
    draw_gripper_at('assembly_wcf_inclampapproach', False)
else:
    draw_gripper_at('assembly_wcf_inclamp', False)
draw_gripper_at('assembly_wcf_inclamp', False)
draw_gripper_at('assembly_wcf_final', False)
draw_gripper_at('assembly_wcf_finalretract', True)
# ---------- end visualize_beams_grippers ----------
visualize_clamps = GhPythonScript(
    process=process_2,
    beam_id=selected_beam_id_5,
    position=int_clamp_pos_index,
    clamp_color=ColourSwatch(SwatchColor=RGB(51, 181, 125)))  # -> out, clamps, clamps_action_states, clamps_mesh
# ---------- visualize_clamps: Python ----------
from Rhino.Geometry import Mesh as RhinoMesh
from compas_ghpython.utilities import list_to_ghtree
import jsonpickle

from compas_ghpython.helpers import mesh_draw

###################################
# Clamps (multiple clamps)
###################################

assembly = process.assembly

if beam_id is None: beam_id = assembly.sequence[-1]

joint_ids = assembly.get_joint_ids_of_beam_clamps(beam_id)
clamps = [process.get_clamp_of_joint(joint_id, set_position_to_clamp_wcf_final=False) for joint_id in joint_ids]

# Stores the clamp states of each step
clamps_action_states = {}
for joint_id in joint_ids:
    clamps_action_states[joint_id] = []

clamps_mesh = []

def draw_clamps_at(attribute_name, gripper_open, clamp_open, mesh_join_by_rhino = True):
    for joint_id , clamp in zip(joint_ids, clamps):
        # Retrive the target location frame
        clamp_t0cp = process.assembly.get_joint_attribute(joint_id, attribute_name)
        if clamp_t0cp is not None:
            # Set Clamp State
            clamp.current_frame = clamp_t0cp
            if gripper_open: clamp.open_gripper()
            else: clamp.close_gripper()
            if clamp_open: clamp.open_clamp()
            else: clamp.close_clamp()
            
            # Each Clamp have multiple moveable link and therefore multiple meshes
            # Two different way to join meshes of a clamp
            if mesh_join_by_rhino:
                joinedMesh = RhinoMesh()
                meshes = [joinedMesh.Append(mesh_draw(m,  color = clamp_color)) for m in clamp.draw_visuals()]
                clamps_mesh.append(joinedMesh)
            else:
                meshes = meshes_join(clamp.draw_visuals())
                clamps_mesh.append(mesh_draw(meshes,  color = clamp_color))
        
        else: clamps_mesh.append(None)

if position == 0: draw_clamps_at('clamp_wcf_attachapproach', True, True)
if position == 1: draw_clamps_at('clamp_wcf_final', True, True)
if position == 2: draw_clamps_at('clamp_wcf_final', False, True)
if position == 3: draw_clamps_at('clamp_wcf_final', False, False)
if position == 4: draw_clamps_at('clamp_wcf_final', True, True)
if position == 5: draw_clamps_at('clamp_wcf_detachretract1', True, True)
if position == 6: draw_clamps_at('clamp_wcf_detachretract2', True, True)
# ---------- end visualize_clamps ----------
list_item_4 = ListItem(List=visualize_beams_grippers.current_beam, Index=int_gripper_pos_index, Wrap=True)
list_item_5 = ListItem(List=visualize_beams_grippers.gripper, Index=int_gripper_pos_index, Wrap=True)
custom_preview_3 = CustomPreview(Geometry=list_item_4, Material=ColourSwatch(SwatchColor=RGBA(255, 255, 255, 171)))
custom_preview_4 = CustomPreview(Geometry=list_item_5, Material=ColourSwatch(SwatchColor=RGBA(255, 255, 255, 171)))
custom_preview_5 = CustomPreview(Geometry=visualize_clamps.clamps_mesh, Material=ColourSwatch(SwatchColor=RGB(29, 105, 72)))
custom_preview_6 = CustomPreview(Geometry=visualize_beams_grippers.previous_beams, Material=ColourSwatch(SwatchColor=RGBA(219, 219, 219, 103)))

# ----
# Compute Gripper Choice,
# Grasp Face (Auto Assign)
beam_grasp_frame = GhPythonScript(process=clamp_pos_2.process_out)  # -> out, process_out
# ---------- beam_grasp_frame: Python ----------
from compas.geometry import Vector

process_out = process
assembly = process.assembly

for beam_id in assembly.sequence:
    beam = assembly.beam(beam_id)
    
    # Set a default guide vector for auto-compute
    design_guide_vector_grasp = Vector(-0.2 ,-0.5, -1)
    assembly.set_beam_attribute(beam_id, "design_guide_vector_grasp", design_guide_vector_grasp)

    # Set Beam Attributes related to Gripper
    gripper_grasp_face = process.search_grasp_face_from_guide_vector_dir(beam_id)
    gripper_grasp_dist_from_start = beam.length / 2.0
    gripper_tcp_in_ocf = beam.grasp_frame_ocf(gripper_grasp_face, gripper_grasp_dist_from_start)

    assembly.set_beam_attribute(beam_id, "gripper_grasp_dist_from_start", gripper_grasp_dist_from_start)
    assembly.set_beam_attribute(beam_id, "gripper_tcp_in_ocf", gripper_tcp_in_ocf)
    assembly.set_beam_attribute(beam_id, "gripper_type", process.grippers[0].type_name)
# ---------- end beam_grasp_frame ----------

# ----
# Compute storage/pickup location
storage_location = GhPythonScript(process=beam_grasp_frame.process_out, pickup_station=pickup_station.pickup_station)  # -> out, process_out
# ---------- storage_location: Python ----------
#from compas_ghpython import unload_modules
#unload_modules("integral_timber_joints")

from compas.geometry import Vector
from compas_rhino.geometry import RhinoPlane

process_out = process
assembly = process.assembly

# Add Pickup station
process.pickup_station = pickup_station

for beam_id in assembly.sequence:
    process.compute_storage_location_at_corner_aligning_pickup_location(beam_id)
# ---------- end storage_location ----------

# ----
# Compute approach retract
beam_grasp_frame_2 = GhPythonScript(process=storage_location.process_out)  # -> out, process_out
# ---------- beam_grasp_frame_2: Python ----------
#from compas_ghpython import unload_modules
#unload_modules("integral_timber_joints")

from compas.geometry import Vector
from compas_rhino.geometry import RhinoVector

process_out = process
assembly = process.assembly

for beam_id in assembly.sequence:
    
    ############################################
    # Approach and Retract For Beams
    ############################################
    
    # Compute approach and retract regarding gripper 
    process.compute_beam_storageapproach_and_finalretract(beam_id)
    
    # Provide guide vector for pickup (storageretract) action.
    design_guide_vector_storage_pickup = process.pickup_station.pickup_retract_vector
    assembly.set_beam_attribute(beam_id, "design_guide_vector_storage_pickup", design_guide_vector_storage_pickup)
    
    # Compute storage station pickup (storageretract) position.
    process.compute_beam_storageretract(beam_id)
    
    ############################################
    # Approach and Retract For Clamps
    ############################################

    process.compute_clamp_attachapproach_attachretract_detachapproach(beam_id)
    process.compute_clamp_detachretract(beam_id)
# ---------- end beam_grasp_frame_2 ----------

# ----
# Save
# Interactive Modify Process
button_13 = Button()
process_json_path_3 = GhPythonScript()  # -> json_path; same code as process_json_path
json_pickle_2 = GhPythonScript(stuff=beam_grasp_frame_2.process_out, json_output_path=process_json_path_3, output=button_13)  # inputs output: Boolean
# ---------- json_pickle_2: Python ----------
if output:
    import jsonpickle
    jsonpickle.set_preferred_backend('json')
    jsonpickle.set_encoder_options('json')
    
    f = open(json_output_path, 'w')
    f.write(jsonpickle.encode(stuff, keys=True, make_refs=True))
    f.close()
# ---------- end json_pickle_2 ----------

assembly_step = GhPythonScript(process=process_2, beam_id=selected_beam_id_5)  # -> out, previous_beams, current_beam, clamps, gripper; disabled
# ---------- assembly_step: Python ----------
__author__ = "leungp"
__version__ = "2020.02.19"

from compas_ghpython.helpers import mesh_draw
from compas.geometry import Transformation
from compas.datastructures import meshes_join

from Rhino.Geometry import Mesh as RhinoMesh
assembly = process.assembly

if beam_id is None: beam_id = assembly.sequence[-1]

##########################
# Previous Beams
##########################

# Collect the previously-assembled beam(s)
previous_beams = []
for this_beam_id in assembly.sequence:
    if this_beam_id == beam_id: break
    beam = assembly.beam(this_beam_id)
    previous_beams.append(beam.cached_mesh)

###################################
# Current Beam (Different Location)
###################################

# Select the current beam
beam = assembly.beam(beam_id)

# Translate the beam to various location and display
current_beam = []
current_beam_assembly_wcf_final = beam.cached_mesh

def join_meshes(meshes):
    if len(meshes) == 1 : return meshes [0]
    

def draw_beam_at(attribute_name):
    T = assembly.get_beam_transformaion_to(beam_id, attribute_name)
    if T is not None:
        current_beam.append(beam.cached_mesh.transformed(T))
    else: current_beam.append(None)

draw_beam_at('assembly_wcf_storage') # Beam does not go to 'assembly_wcf_storageapproach'
draw_beam_at('assembly_wcf_storage')
draw_beam_at('assembly_wcf_storageretract')
if assembly.get_beam_attribute(beam_id, 'assembly_wcf_inclampapproach') is not None:
    draw_beam_at('assembly_wcf_inclampapproach')
else:
    draw_beam_at('assembly_wcf_inclamp')
draw_beam_at('assembly_wcf_inclamp')
draw_beam_at('assembly_wcf_final')
draw_beam_at('assembly_wcf_final') # Beam does not go to 'assembly_wcf_finalretract'

###################################
# Clamps (multiple clamps)
###################################

clamps = []
# Visualize clamps
for neighbour_id in assembly.get_already_built_neighbors(beam_id):
    joint_id = (neighbour_id, beam_id)
    clamp_wcf_final = assembly.get_joint_attribute(joint_id, 'clamp_wcf_final')
    print (clamp_wcf_final)
    clamp_type = assembly.get_joint_attribute(joint_id, 'clamp_type')
    clamp = process.get_one_clamp_by_type(clamp_type).copy()
    clamp.set_current_frame_from_tcp(clamp_wcf_final)
    clamp.clamp_jaw_position = 120
    clamp.gripper_jaw_position = 0
    clamps.append(clamp)
    print (clamp)
    

###################################
# Gripper (Different Location)
###################################

gripper = []
# Get Gripper and move it to the beam's frame
gripper_type = assembly.get_beam_attribute(beam_id, 'gripper_type')
_gripper = process.get_one_gripper_by_type(gripper_type)

#gripper_tcp_in_ocf = assembly.get_beam_attribute(beam_id, "gripper_tcp_in_ocf")
#gripper_tcp_in_wcf = gripper_tcp_in_ocf.transformed(Transformation.from_frame(beam.frame))

def draw_gripper_at(attribute_name):
    gripper_t0cp = process.get_gripper_t0cp_for_beam_at(beam_id, attribute_name)
    if gripper_t0cp is not None:
        _gripper.current_frame = gripper_t0cp
        
        meshes = meshes_join(_gripper.draw_visuals())
        gripper.append(meshes)
        
    else: gripper.append(None)
    
draw_gripper_at('assembly_wcf_storageapproach')
draw_gripper_at('assembly_wcf_storage')
draw_gripper_at('assembly_wcf_storageretract')
if assembly.get_beam_attribute(beam_id, 'assembly_wcf_inclampapproach') is not None:
    draw_gripper_at('assembly_wcf_inclampapproach')
else:
    draw_gripper_at('assembly_wcf_inclamp')
draw_gripper_at('assembly_wcf_inclamp')
draw_gripper_at('assembly_wcf_final')
draw_gripper_at('assembly_wcf_finalretract')
# ---------- end assembly_step ----------
assembly_collision_check = GhPythonScript(process=process_2, beam_id=selected_beam_id_5)  # -> out, result, col_mesh_preview
# ---------- assembly_collision_check: Python ----------
from compas_ghpython.helpers import mesh_draw
from compas.geometry import Transformation
from compas.datastructures import meshes_join
import compas
from Rhino.Geometry import Mesh as RhinoMesh
from time import time

assembly = process.assembly

if beam_id is None: beam_id = assembly.sequence[-1]

##################################################################
# Functions to retrive object mesh at the right location
##################################################################

clamp_mesh_cache ={}
clamp_mesh_cache_native ={}
gripper_mesh_cache ={}
gripper_mesh_cache_native ={}
beam_mesh_cache ={}
beam_mesh_cache_native ={}

# Native Geometry Cache


def beam_mesh_at(beam_id, position):
    # Cache retrival
    cache_key = (beam_id, position)
    if cache_key in beam_mesh_cache:
        return beam_mesh_cache[cache_key]
    # Generate mesh at
    beam = assembly.beam(beam_id)
    T = assembly.get_beam_transformaion_to(beam_id, position)
    mesh = beam.cached_mesh.transformed(T)
    # Caching
    beam_mesh_cache[cache_key] = mesh
    return mesh
    
def gripper_mesh_at(beam_id, position, gripper_open = True):
    # Cache retrival
    cache_key = (beam_id, position, gripper_open)
    if cache_key in gripper_mesh_cache:
        return gripper_mesh_cache[cache_key]
    # Generate mesh at
    gripper_type = assembly.get_beam_attribute(beam_id, 'gripper_type')
    gripper = process.get_one_gripper_by_type(gripper_type)
    gripper_t0cp = process.get_gripper_t0cp_for_beam_at(beam_id, position)
    gripper.current_frame = gripper_t0cp
    if gripper_open: gripper.open_gripper() 
    else: gripper.close_gripper()
    mesh = meshes_join(gripper.draw_visuals())
    # Caching
    gripper_mesh_cache[cache_key] = mesh
    return mesh

def clamp_mesh_at(joint_id, position, gripper_open, clamp_open):
    # Cache retrival
    cache_key = (joint_id, position, gripper_open, clamp_open)
    if cache_key in clamp_mesh_cache:
        return clamp_mesh_cache[cache_key]
    # Generate mesh at
    clamp_type = assembly.get_joint_attribute(joint_id, 'clamp_type')
    clamp = process.get_one_clamp_by_type(clamp_type)
    clamp_wcf_final = assembly.get_joint_attribute(joint_id, position)
    clamp.current_frame = clamp_wcf_final
    if gripper_open: clamp.open_gripper() 
    else: clamp.close_gripper()
    if clamp_open: clamp.open_clamp() 
    else: clamp.close_clamp()
    mesh = meshes_join(clamp.draw_visuals())
    # Caching
    clamp_mesh_cache[cache_key] = mesh
    return mesh

def previous_beams(beam_id):
    beams = []
    for earlier_beam_id in assembly.sequence:
        if earlier_beam_id == beam_id: break
        beams.append(assembly.beam(earlier_beam_id))
    return beams

def native_clamp_mesh_at(joint_id, position, gripper_open, clamp_open):
    global stat_native_generation, stat_native_retrival
    # Cache retrival
    cache_key = (joint_id, position, gripper_open, clamp_open)
    if cache_key in clamp_mesh_cache_native:
        return clamp_mesh_cache_native[cache_key]
    # Generate native mesh
    mesh = clamp_mesh_at(*cache_key)
    native_mesh = to_native_mesh(mesh)
    # Caching
    clamp_mesh_cache_native[cache_key] = native_mesh
    return native_mesh

def native_gripper_mesh_at(beam_id, position, gripper_open = True):
    global stat_native_generation, stat_native_retrival
    # Cache retrival
    cache_key = (beam_id, position, gripper_open)
    if cache_key in gripper_mesh_cache_native:
        return gripper_mesh_cache_native[cache_key]
    # Generate native mesh
    mesh = gripper_mesh_at(*cache_key)
    native_mesh = to_native_mesh(mesh)
    # Caching
    gripper_mesh_cache_native[cache_key] = native_mesh
    return native_mesh

def native_beam_mesh_at(beam_id, position):
    global stat_native_generation, stat_native_retrival
    # Cache retrival
    cache_key = (beam_id, position)
    if cache_key in beam_mesh_cache_native:
        return beam_mesh_cache_native[cache_key]
    # Generate native mesh
    mesh = beam_mesh_at(*cache_key)
    native_mesh = to_native_mesh(mesh)
    # Caching
    beam_mesh_cache_native[cache_key] = native_mesh
    return native_mesh
    

##################################################################
# Functions to perform collision check
##################################################################

tolerance = 10e-7

if compas.IPY:
    import Rhino.Geometry
    from compas_ghpython.artists import MeshArtist
    def to_native_mesh(compas_mesh):
        return MeshArtist(compas_mesh).draw_mesh()
    def native_mesh_mesh_collide(a, b, tolerance=None):
        # Semantics of Rhino SDK is a bit different, None tolerance == Zero tolerance instead of fast checker
        if not tolerance:
            lines = Rhino.Geometry.Intersect.Intersection.MeshMeshFast(a, b)
        else:
            lines = Rhino.Geometry.Intersect.Intersection.MeshMeshAccurate(a, b, tolerance)
        if lines and len(lines) > 0:
            return True
        return False
else:
    import trimesh
    import trimesh.boolean
    def to_native_mesh(compas_mesh):
        v, f = compas_mesh.to_vertices_and_faces()
        return trimesh.Trimesh(vertices=v, faces=f)
    def native_mesh_mesh_collide(a, b, tolerance=None):
        try:
            trimesh.boolean.intersection([a, b], engine='scad')
        except subprocess.CalledProcessError:
            return False
        return True


def check_collision_bboxes(mesh_a, mesh_b):
    av = mesh_a.vertices_attributes('xyz')
    bv = mesh_b.vertices_attributes('xyz')
    ax, ay, az = zip(*av)
    bx, by, bz = zip(*bv)
    if max(ax) < min(bx): return False
    if min(ax) > max(bx): return False
    if max(ay) < min(by): return False
    if min(ay) > max(by): return False
    if max(az) < min(bz): return False
    if min(az) > max(bz): return False
    return True


#def check_one_one_collision(mesh_a, mesh_b, tolerance=None):
#    if check_collision_bboxes(mesh_a, mesh_b):
#        if native_mesh_mesh_collide(to_native_mesh(mesh_a), to_native_mesh(mesh_b), tolerance):
#            return True
#    return False

##########################
# Collision Check
##########################

def collision_gripper_pbeam(beam_id, gripper_pos):
    """ Collision between beam gripper (at gripper_pos) with previous-beams
    """
    # Return collision mesh of gripper for visualization (Native mesh)
    collision_meshes =[]
    gripper_mesh = gripper_mesh_at(beam_id, gripper_pos)
    for pbeam in previous_beams(beam_id):
        pbeam_mesh = pbeam.cached_mesh
        # Collision Check (Two Stages)
        collision = check_collision_bboxes(gripper_mesh, pbeam_mesh)
        if collision:
            m1 = native_gripper_mesh_at(beam_id, gripper_pos)
            m2 = native_beam_mesh_at(pbeam.name, 'assembly_wcf_final')
            collision = native_mesh_mesh_collide(m1, m2, tolerance)
        if collision:
            pbeam_id = pbeam.name
            gripper_type = assembly.get_beam_attribute(beam_id, 'gripper_type')
            # Error Message
            print ("Gripper (%s) in Position (%s) is colliding with already-built Beam (%s)" % (gripper_type, gripper_pos, pbeam_id))
            # Return collision mesh of gripper
            col_mesh = native_gripper_mesh_at(beam_id, gripper_pos)
            collision_meshes.append(col_mesh)
    return collision_meshes

def collision_clamp_pbeam(beam_id, joint_id, clamp_pos, gripper_open, clamp_open):
    """ Collision between joint_clamp (at joint_id) with previous-beams (of beam_id)
    """
    collision_beam_ids = []
    clamp_state = (joint_id, clamp_pos, gripper_open, clamp_open)
    clamp_mesh = clamp_mesh_at(*clamp_state)
    for pbeam in previous_beams(beam_id):
        pbeam_mesh = pbeam.cached_mesh
        # Collision Check (Two Stages)
        collision = check_collision_bboxes(clamp_mesh, pbeam_mesh)
        if collision:
            m1 = native_clamp_mesh_at(*clamp_state)
            m2 = native_beam_mesh_at(pbeam.name, 'assembly_wcf_final')
            collision = native_mesh_mesh_collide(m1, m2, tolerance)
        if collision:
            pbeam_id = pbeam.name
            clamp_type = assembly.get_joint_attribute(joint_id, 'clamp_type')
            print ("Clamp (%s) of Joint (%s-%s) in Position (%s) is colliding with already-built Beam (%s)" % (clamp_type, joint_id[0], joint_id[1], clamp_pos, pbeam_id))
            collision_beam_ids.append(pbeam_id)
    return collision_beam_ids

def collision_clamps_pbeam(beam_id, clamp_pos, gripper_open, clamp_open):
    # Return collision mesh for visualization (Native mesh)
    collision_meshes =[]
    for joint_id in assembly.get_joint_ids_of_beam_clamps(beam_id):
        col = collision_clamp_pbeam(beam_id, joint_id, clamp_pos, gripper_open, clamp_open)
        if len(col) > 0: 
            col_mesh = native_clamp_mesh_at(joint_id, clamp_pos, gripper_open, clamp_open)
            collision_meshes.append(col_mesh)
    return collision_meshes

def collision_beam_pbeam(beam_id, beam_pos):
    """ Collision between beam (at beam_pos) with previous-beams
    """
    # Return collision mesh of beam (at beam_pos) for visualization (Native mesh)
    collision_meshes =[]
    beam_mesh = beam_mesh_at(beam_id, beam_pos)
    for pbeam in previous_beams(beam_id):
        pbeam_mesh = pbeam.cached_mesh
        # Collision Check (Two Stages)
        collision = check_collision_bboxes(beam_mesh, pbeam_mesh)
        if collision:
            m1 = native_beam_mesh_at(beam_id, beam_pos)
            m2 = native_beam_mesh_at(pbeam.name, 'assembly_wcf_final')
            collision = native_mesh_mesh_collide(m1, m2, tolerance)
        if collision:
            pbeam_id = pbeam.name
            # Error Message
            print ("Beam (%s) in Position (%s) is colliding with already-built Beam (%s)" % (beam_id, beam_pos, pbeam_id))
            # Return collision mesh of beam
            collision_meshes.append(native_beam_mesh_at(beam_id, beam_pos))
    return collision_meshes

def collision_gripper_clamp_final(beam_id, joint_id, gripper_pos, gripper_open):
    """ Collision between gripper (of beam_id at gripper_pos) and clamp (of joint_id at clamp_wcf_final)
    Gripper jaw position depends on 'gripper_open'
    Clamp jaw position are closed.
    """
    clamp_state = (joint_id, 'clamp_wcf_final', False, False)
    gripper_state = (beam_id, gripper_pos, gripper_open)
    # Collision Check (Two Stages)
    collision = check_collision_bboxes(clamp_mesh_at(*clamp_state), gripper_mesh_at(*gripper_state))
    if collision:
        m1 = native_clamp_mesh_at(*clamp_state)
        m2 = native_gripper_mesh_at(*gripper_state)
        collision = native_mesh_mesh_collide(m1, m2, tolerance)
    if collision:
        gripper_type = assembly.get_beam_attribute(beam_id, 'gripper_type')
        print ("Gripper (%s) in Position (%s) is colliding with Clamp at Joint (%s-%s) " % (gripper_type, gripper_pos, joint_id[0], joint_id[1]))
    return collision

def collision_gripper_clamps_final(beam_id, gripper_pos, gripper_open):
    """ Collision between gripper (of beam_id at gripper_pos) and all clamp (of beam_id)
    """
    # Return collision mesh for visualization (Native mesh)
    collision_meshes =[]
    for joint_id in assembly.get_joint_ids_of_beam_clamps(beam_id):
        if collision_gripper_clamp_final(beam_id, joint_id, gripper_pos, gripper_open):
            # Append both Clamp and Gripper mesh for visualization
            collision_meshes.append(native_clamp_mesh_at(joint_id, 'clamp_wcf_final', False, False))
            collision_meshes.append(native_gripper_mesh_at(beam_id, gripper_pos, gripper_open))
    return collision_meshes

##########################
# Call Collision Functions
##########################
current_beam_has_inclampapproach = assembly.get_beam_attribute(beam_id, 'assembly_wcf_inclampapproach') is not None
col_mesh_preview = []

def c1(col_mesh_preview):
    col_mesh_preview += collision_gripper_pbeam(beam_id, 'assembly_wcf_storageapproach')
    col_mesh_preview += collision_gripper_pbeam(beam_id, 'assembly_wcf_storage')
    col_mesh_preview += collision_gripper_pbeam(beam_id, 'assembly_wcf_storageretract')
    col_mesh_preview += collision_gripper_pbeam(beam_id, 'assembly_wcf_inclamp')
    col_mesh_preview += collision_gripper_pbeam(beam_id, 'assembly_wcf_final')
    col_mesh_preview += collision_gripper_pbeam(beam_id, 'assembly_wcf_finalretract')
    if current_beam_has_inclampapproach:
        col_mesh_preview += collision_gripper_pbeam(beam_id, 'assembly_wcf_inclampapproach')

def c2(col_mesh_preview):
    col_mesh_preview += collision_clamps_pbeam(beam_id, 'clamp_wcf_attachapproach', True, True)
    col_mesh_preview += collision_clamps_pbeam(beam_id, 'clamp_wcf_detachapproach', True, True)
    col_mesh_preview += collision_clamps_pbeam(beam_id, 'clamp_wcf_detachretract1', True, True)
    col_mesh_preview += collision_clamps_pbeam(beam_id, 'clamp_wcf_detachretract2', True, True)
    
def c3(col_mesh_preview):
    col_mesh_preview += collision_beam_pbeam(beam_id, 'assembly_wcf_storageapproach')
    col_mesh_preview += collision_beam_pbeam(beam_id, 'assembly_wcf_storage')
    col_mesh_preview += collision_beam_pbeam(beam_id, 'assembly_wcf_storageretract')
    col_mesh_preview += collision_beam_pbeam(beam_id, 'assembly_wcf_inclamp')
    if current_beam_has_inclampapproach:
        col_mesh_preview += collision_beam_pbeam(beam_id, 'assembly_wcf_inclampapproach')

def c4(col_mesh_preview):
    col_mesh_preview += collision_gripper_clamps_final(beam_id, 'assembly_wcf_inclampapproach', False)    
    col_mesh_preview += collision_gripper_clamps_final(beam_id, 'assembly_wcf_inclamp', False)    
    col_mesh_preview += collision_gripper_clamps_final(beam_id, 'assembly_wcf_final', False)    
    col_mesh_preview += collision_gripper_clamps_final(beam_id, 'assembly_wcf_finalretract', True)

c1(col_mesh_preview)
c2(col_mesh_preview)
c3(col_mesh_preview)
c4(col_mesh_preview)

print(len(gripper_mesh_cache))
print(len(gripper_mesh_cache_native))
print(len(clamp_mesh_cache))
print(len(clamp_mesh_cache_native))
# ---------- end assembly_collision_check ----------
python_2 = GhPythonScript(many_meshes=assembly_step.previous_beams, one_mesh=graft(assembly_step.gripper))  # -> out, flatten(a); inputs many_meshes: list; disabled
# ---------- python_2: Python ----------
import subprocess
import compas
from compas.geometry import bounding_box

if compas.IPY:
    import Rhino.Geometry
    from compas_ghpython.artists import MeshArtist
    def to_native_mesh(compas_mesh):
        return MeshArtist(compas_mesh).draw_mesh()
    def native_mesh_mesh_collide(a, b, tolerance=None):
        # Semantics of Rhino SDK is a bit different, None tolerance == Zero tolerance instead of fast checker
        if not tolerance:
            lines = Rhino.Geometry.Intersect.Intersection.MeshMeshFast(a, b)
        else:
            lines = Rhino.Geometry.Intersect.Intersection.MeshMeshAccurate(a, b, tolerance)
        if lines and len(lines) > 0:
            return True
        return False
else:
    import trimesh
    import trimesh.boolean
    def to_native_mesh(compas_mesh):
        v, f = compas_mesh.to_vertices_and_faces()
        return trimesh.Trimesh(vertices=v, faces=f)
    def native_mesh_mesh_collide(a, b, tolerance=None):
        try:
            trimesh.boolean.intersection([a, b], engine='scad')
        except subprocess.CalledProcessError:
            return False
        return True
tolerance = 0.0001

def check_collision_bboxes(a, b):
    av = a.vertices_attributes('xyz')
    bv = b.vertices_attributes('xyz')
    ax, ay, az = zip(*av)
    bx, by, bz = zip(*bv)
    if max(ax) < min(bx): return False
    if min(ax) > max(bx): return False
    if max(ay) < min(by): return False
    if min(ay) > max(by): return False
    if max(az) < min(bz): return False
    if min(az) > max(bz): return False
    return True

def check_collisions(compas_meshes, tolerance=None):
    meshes = compas_meshes
    native_meshes = {}
    for i in range(len(meshes)):
        for j in range(len(meshes)):
            if i == j:
                continue
            if check_collision_bboxes(meshes[i], meshes[j]):
                am = native_meshes.get(str(i))
                if not am:
                    am = to_native_mesh(meshes[i])
                    native_meshes[str(i)] = am
                bm = native_meshes.get(str(j))
                if not bm:
                    bm = to_native_mesh(meshes[j])
                    native_meshes[str(j)] = to_native_mesh(meshes[j])
                if native_mesh_mesh_collide(am, bm, tolerance):
                    return True
    return False

def check_many_one_collision(many_meshes, one_mesh, tolerance=None):
    many_meshes = [(m, to_native_mesh(m)) for m in many_meshes]
    one_mesh = (one_mesh, to_native_mesh(one_mesh))
    
    for other_mesh in many_meshes:
        if check_collision_bboxes(one_mesh[0], other_mesh[0]):
            if native_mesh_mesh_collide(one_mesh[1], other_mesh[1], tolerance):
                return True
    return False                

a = check_many_one_collision(many_meshes, one_mesh, tolerance)
# ---------- end python_2 ----------
panel_2 = Panel(assembly_collision_check.out)
panel_3 = Panel(python_2.a)  # disabled
deepcopy = GhPythonScript(data_in=item)  # -> data_out; disabled
# ---------- deepcopy: Python ----------
from copy import deepcopy

data_out = deepcopy(data_in)
# ---------- end deepcopy ----------
custom_preview_7 = CustomPreview(Geometry=assembly_collision_check.col_mesh_preview, Material=ColourSwatch(SwatchColor=RGBA(219, 0, 0, 103)))
create_action_assign_tools = GhPythonScript(process=deepcopy)  # -> out, process_out; disabled
# ---------- create_action_assign_tools: Python ----------
from integral_timber_joints.process.algorithms import *

process_out = process

print("> > > create_actions_from_sequence(process)")
create_actions_from_sequence(process, verbose=False)
print("> > > optimize_actions_place_pick_gripper(process)")
optimize_actions_place_pick_gripper(process, verbose=False)
print("> > > assign_tools_to_actions(process)")
assign_tools_to_actions(process, verbose=False)
print("> > > optimize_actions_place_pick_clamp(process)")
optimize_actions_place_pick_clamp(process, verbose=False)
print("> > > create_movements_from_actions(process)")
create_movements_from_actions(process)

debug_print_process_actions_movements(process)
# ---------- end create_action_assign_tools ----------
panel_4 = Panel(create_action_assign_tools.out)  # disabled
deepcopy_2 = GhPythonScript()  # -> data_out; disabled; same code as deepcopy
create_animation = GhPythonScript(process=deepcopy_2)  # -> out, scene_objects_out, keyframes_out, keyframes_count, robot_T0CF_keyframes, descriptions; disabled
# ---------- create_animation: Python ----------
from compas.geometry import Transformation, Frame

# Scene objects must implement set_state() and get_state().
# Scene objects must implement draw_visual() that create a list of compas meshes using its current state.
scene_objects = {}

# Each keyframe is smply a dictionary of all the objects states.
# The goal is to compute all keyframes
scene_keyframes = []

# Tentative solution for recording robotic T0CF
robot_T0CF_keyframes = []
descriptions = []

def get_keyframe():
    '''
    Creates a dictionary of all the visualization states of the objects.
    '''
    global scene_objects
    scene_state = {}
    # Iterate through all objects and call their get_state() 
    for key, scene_object in scene_objects.items():
        scene_state[key] = scene_object.get_state()
    # Add all 
    return scene_state

def save_keyframe(description = ""):
    global scene_keyframes, robot_T0CF_keyframes, robot_T0CF
    scene_keyframes.append(get_keyframe())
    # Tentative Hack
    robot_T0CF_keyframes.append(robot_T0CF.copy())
    descriptions.append(description)


# Collect all scene objects in a dictionary
# A copy is made becuase we will edit the state of the objects.
from copy import deepcopy

# Prepare all items in their initial location.
# Clamps and Grippers are visible, Beam is not visible
for item in clamps:
    id = item.name
    if id in scene_objects:
        raise KeyAlreadyExistError
    scene_objects[id] = deepcopy(item)
    scene_objects[id].is_visible = True
    scene_objects[id].is_attached = False
    scene_objects[id].current_location = scene_objects[id].storage_location.copy()

for item in grippers:
    id = item.name
    if id in scene_objects:
        raise KeyAlreadyExistError
    scene_objects[id] = deepcopy(item)
    scene_objects[id].is_visible = True
    scene_objects[id].is_attached = False
    scene_objects[id].current_location = scene_objects[id].storage_location.copy()

for id, element in assembly.elements():
    if id in scene_objects:
        raise KeyAlreadyExistError
    scene_objects[id] = deepcopy(assembly.beam(id))
    scene_objects[id].is_visible = False
    scene_objects[id].is_attached = False
    scene_objects[id].current_location = scene_objects[id].storage_location.copy()

    
print ("The following scene objects are loaded:")
print scene_objects.keys()

# Storing the attached tool and workpiece current state
attached_tool = None
attached_workpiece = None
robot_T0CF = Frame.worldXY()


# Initial State
save_keyframe("Initial State")

# Object getter helper function

def getWorkpiece (action):
    return scene_objects[action.workpiece.name]

def getTool (action):
    return scene_objects[action.tool.name]

# Low level action helper function

def goto (t0cf_in_wcf):
    global attached_tool, attached_workpiece, robot_T0CF
    # Move the robot
    robot_T0CF = t0cf_in_wcf
    if (attached_tool is not None):
        # Move the tool
        attached_tool.current_location = t0cf_in_wcf.copy()
    if (attached_workpiece is not None):
        # Move the workpiece
        tcf_in_wcf = attached_tool.current_location.to_world_coords(attached_tool.placement_frame)
        set_current_location_frame_by_placemnet(attached_workpiece, tcf_in_wcf)

def set_current_location_frame_by_placemnet(workpiece, tcf_in_wcf):
    grasp_frame = assembly.get_beam_attribute(workpiece.name, "grasp_frame_ocf")
    T2 = Transformation.from_frame_to_frame(grasp_frame, tcf_in_wcf)
    base_frame = Frame.worldXY().transformed(T2)
    workpiece.current_location = base_frame.copy()

def attach_tool (tool):
    global attached_tool
    assert (attached_tool is None)
    attached_tool = tool
    attached_tool.is_attached = True    # For Visualization Effect

def detach_tool ():
    global attached_tool, attached_workpiece
    assert (attached_tool is not None)
    assert (attached_workpiece is None)
    attached_tool.is_attached = False   # For Visualization Effect
    attached_tool = None


def attach_workpiece (workpiece):
    global attached_tool, attached_workpiece
    assert (attached_tool is not None)
    assert (attached_workpiece is None)
    attached_workpiece = workpiece
    attached_tool.close_gripper()
    attached_workpiece.is_attached = True   # For Visualization Effect    

def detach_workpiece ():
    global attached_tool, attached_workpiece
    assert (attached_tool is not None)
    assert (attached_workpiece is not None)
    attached_workpiece.is_attached = False  # For Visualization Effect
    attached_workpiece = None
    attached_tool.open_gripper()
    

# Create keyframes by the actions:
    
for action in actions:
    
    if action.__class__.__name__ == "LoadPickupBeamAction":
        # Beam Appeare
        getWorkpiece(action).is_visible = True
        save_keyframe("Manually-load %s on pick-up station." % getWorkpiece(action))
        
        
        
    if action.__class__.__name__ in ["PickToolAction", "PlaceToolAction"]:
        # Step 1. Go to Target Approach (Free)
        goto(action.target.approach_frame)
        save_keyframe("Robot (Free) Goto %s -> %s -> Approach Point" % (getTool(action), action.target))
        # Step 2. Go to Final Target (Linear)
        goto(action.target.target_frame)
        save_keyframe("Robot (Linear) Goto %s -> %s -> Target Point" % (getTool(action), action.target))
        

        # Step 3.A (Pick) Lock Tool and Open Gripper
        if action.__class__.__name__ == "PickToolAction":
            attach_tool(getTool(action))
            save_keyframe("Robot (IO) Lock %s" % getTool(action))
            getTool(action).open_gripper()
            save_keyframe("Robot (IO) Open %s Gripper" % (action.tool))
        # Step 3.B (Place) Close Gripper and unlock tool
        if action.__class__.__name__ == "PlaceToolAction":
            getTool(action).close_gripper()
            save_keyframe("Robot (IO) Close %s Gripper" % (action.tool))
            detach_tool()
            save_keyframe("Robot (IO) Unlock %s" % getTool(action))
            
        # Step 4. Go to Target Retract (Linear)
        goto(action.target.retract_frame)
        save_keyframe("Robot (Linear) Goto %s -> %s -> Retract Point" % (getTool(action), action.target))
        
        
        
    if action.__class__.__name__ in ["PickWorkpieceAction", "PlaceWorkpieceAction"]:
        # Step 1. Go to Target Approach (Free)
        goto(action.target.approach_frame)
        save_keyframe("Robot (Free) Goto %s -> %s -> Approach Point" % (getWorkpiece(action), action.target))
        # Step 2. Go to Final Target (Linear)
        goto(action.target.target_frame)
        save_keyframe("Robot (Linear) Goto %s -> %s -> Target Point" % (getWorkpiece(action), action.target))
        
        # Step 3.2 Lock Workpiece / Unlock Workpiece
        if action.__class__.__name__ == "PickWorkpieceAction":
            attach_workpiece(getWorkpiece(action))
            save_keyframe("Robot (IO) Close %s Gripper / Grasping %s" % (getTool(action), action.workpiece))
        elif action.__class__.__name__ == "PlaceWorkpieceAction":
            detach_workpiece()
            save_keyframe("Robot (IO) Open %s Gripper / Releasing %s" % (getTool(action), action.workpiece))

        # Step 4. Go to Target Retract (Linear)
        goto(action.target.retract_frame)
        save_keyframe("Robot (Linear) Goto %s -> %s -> Retract Point" % (getWorkpiece(action), action.target))

    if action.__class__.__name__ in ["DetachWorkpieceAction"]:
        # Step 1. Unlock Workpiece
        detach_workpiece()
        save_keyframe("Robot (IO) Open %s Gripper / Releasing %s" % (getTool(action), action.workpiece))
        # Step 2. Go to Target Retract (Linear)
        goto(action.target.retract_frame)
        save_keyframe("Robot (Linear) Goto %s -> %s -> Retract Point" % (getWorkpiece(action), action.target))

    if action.__class__.__name__ == "FreeMoveWorkpieceAction":
        goto(action.target.target_frame)
        save_keyframe("Move %s to %s (Free)" % (action.workpiece, action.target))

    if action.__class__.__name__ == "LinearMoveWorkpieceAction":
        goto(action.target.target_frame)
        save_keyframe("Move %s to %s (Linear)" % (action.workpiece, action.target))

    if action.__class__.__name__ == "ActionGroup":
        "Syncronized Actions: "
        sub_action_descriptions = []
        for sub_action in action.actions:
            if sub_action.__class__.__name__ in ["LinearMoveWorkpieceAction",]:
                goto(sub_action.target.target_frame)
            if sub_action.__class__.__name__ in ["ClampJawCloseAction",]:    
                getTool(sub_action).close_clamp_jaw()
            if sub_action.__class__.__name__ in ["ClampJawOpenAction",]:    
                getTool(sub_action).open_clamp_jaw()
            sub_action_descriptions.append(sub_action.__str__())
        #save_keyframe("Syncronized Robot (Linear) Goto %s and Clamps %s" % (workpieces, clamps))
        save_keyframe("Syncronized Actions: " + " & ".join(sub_action_descriptions))

# Wrapper to transmit a dictionary across GH Wires
class SceneObjects():
    def __init__(self, objects):
        self.objects = objects
        
    def __getitem__(self, key):
        return self.objects.__getitem__(key)
    
    def __setitem__(self, key, val):
        return self.objects.__setitem__(key, val)
        
keyframes_out = scene_keyframes
scene_objects_out = SceneObjects(scene_objects)
# ---------- end create_animation ----------
resolve_clamp_pos = GhPythonScript(process=deepcopy_2)  # -> out, clamp_frames_0, clamp_frames_1, actions_out; disabled
# ---------- resolve_clamp_pos: Python ----------
__author__ = "leungp"
__version__ = "2020.02.19"

import rhinoscriptsyntax as rs
from compas.geometry import Frame
from integral_timber_joints.ghpython.utilities import cFrame2rPlane

from compas.geometry import Vector
from compas.geometry import Translation

from compas_ghpython.utilities import draw_frame
clamp_frames_0 = []
clamp_frames_1 = []


from copy import deepcopy

from compas_ghpython import unload_modules
unload_modules("integral_timber_joints")

actions_out = process.actions
assembly = process.assembly
#Creating a dict of clamps and grippers for easy query
tools = {}
for item in process.clamps + process.grippers:
    id = item.name
    tools[id] = deepcopy(item)


def compute_clamp_position(bid1, bid2):
            joint_name = '%s-%s'%(bid1, bid2) #bid1 is the beam already placed
            #print("Computing %s Need Clamp"% joint_name)
            
            beam_already_placed = assembly.element(bid1)._source
            joint = beam_already_placed.get_joint(joint_name)
            #print ("Joint face: %s"% joint.face_id)
            clamp_frames = joint.get_clamp_frame(beam_already_placed)
            return clamp_frames
            #clamp_frames_0.append(draw_frame(clamp_frames[0]))
            #clamp_frames_1.append(draw_frame(clamp_frames[1]))



# Reusable function to resolve workpiece tcf
def resolve_workpiece_tcf_in_world_coords(workpiece, target):
    if target.__class__.__name__ == "StorageTarget":
        # Set beam location to storage_location
        workpiece.current_location = workpiece.storage_location.copy()
    if target.__class__.__name__ == "BeamFinalTarget":
        # Set beam location to final_location
        workpiece.current_location = workpiece.frame.copy()
    if target.__class__.__name__ == "BeamInJawTarget":
        # Set beam location to final_location
        T = Translation(workpiece.assembly_direction.scaled(-1))
        beam_in_jaw_location = workpiece.frame.transformed(T)
        workpiece.current_location = workpiece.frame.copy()            
    # Compute pickup frame (tcp in wcf) from the grasping offset (LCS)
    tcf_in_world_coords = workpiece.current_location.to_world_coords(workpiece.grasp_frame)
    return tcf_in_world_coords


# Reusable function to resolve workpiece tcf
def resolve_vector_in_local_coords(workpiece, target):
    if target.__class__.__name__ == "StorageTarget":
        # StorageTarget in AttachWorkpieceAction, Vector is the grasping frame Z value
        #return workpiece.grasp_frame.normal.scaled(0.12)
        return Vector(0,0,0.12)
    if target.__class__.__name__ == "BeamFinalTarget":
        # For Final Target, Vector is the assembly direction
        assembly_direction_wcf = assembly.network.get_vertex_attribute(workpiece.name, "assembly_direction_wcf")
        #return workpiece.frame.to_local_coords(workpiece.assembly_direction)
        return workpiece.frame.to_local_coords(assembly_direction_wcf)
    if target.__class__.__name__ == "BeamInJawTarget":
        # For Placing beam in a jaw. We need to find the jaw opening direction.
        return Vector(0,0,-0.12)
        

def resolve_workpiece_t0cf(workpiece, tool, assembly):
    # Resolve the tcf of workpiece based on grasp pose
    grasp_frame_ocf = assembly.get_beam_attribute(workpiece.name, "gripper_tcp_in_ocf")
    # resolve the t0cf based on tool
    tcf_in_world_coords = workpiece.current_location.to_world_coords(grasp_frame_ocf)
    t0cf_in_world_coords = tool.set_current_frame_from_tcp(tcf_in_world_coords)
    return t0cf_in_world_coords
    
def resolve_BeamStorageTarget(action, assembly):
    # Set beam location to storage_location
    action.workpiece.current_location = action.workpiece.storage_location.copy()
    # Find tcf and t0cf in world coords
    t0cf_in_world_coords = resolve_workpiece_t0cf(action.workpiece, action.tool, assembly)
    # Assembly vector
    assembly_vector_in_t0cf = Vector(0,0,0.12)
    action.target.resolve(t0cf_in_world_coords, assembly_vector_in_t0cf)
    
def resolve_BeamFinalTarget(action, assembly):
    # Set beam location to final target
    action.workpiece.current_location = action.workpiece.frame.copy()
    # Find tcf and t0cf in world coords
    t0cf_in_world_coords = resolve_workpiece_t0cf(action.workpiece, action.tool, assembly)
    # Assembly Vector
    assembly_direction_wcf = assembly.get_beam_attribute(action.workpiece.name, "assembly_direction_wcf").copy()
    assembly_vector_in_t0cf = t0cf_in_world_coords.to_local_coords(assembly_direction_wcf)
    # Retract Vector (Gripper opening direction)
    retract_vector_in_t0cf = Vector(0,0,-0.12)
    action.target.resolve(t0cf_in_world_coords, assembly_vector_in_t0cf, retract_vector_in_t0cf)
    
def resolve_BeamAboveJawTarget(action, assembly):
    # Set beam location to jaw opening position
    place_in_jaw_direction_wcf = assembly.network.get_vertex_attribute(action.workpiece.name, "place_in_jaw_direction_wcf").copy()
    assembly_direction_wcf = assembly.network.get_vertex_attribute(action.workpiece.name, "assembly_direction_wcf").copy()
    assembly_direction_wcf += place_in_jaw_direction_wcf
    T = Translation(assembly_direction_wcf.scaled(-1))
    action.workpiece.current_location = action.workpiece.frame.transformed(T)         
    # Find tcf and t0cf in world coords
    t0cf_in_world_coords = resolve_workpiece_t0cf(action.workpiece, action.tool, assembly)
    # Assembly vector
    action.target.resolve(t0cf_in_world_coords)
    
def resolve_BeamInJawTarget(action, assembly):
    # Set beam location to in-jaw location
    assembly_direction_wcf = assembly.network.get_vertex_attribute(action.workpiece.name, "assembly_direction_wcf").copy()
    T = Translation(assembly_direction_wcf.scaled(-1))
    action.workpiece.current_location = action.workpiece.frame.transformed(T)         
    # Find tcf and t0cf in world coords
    t0cf_in_world_coords = resolve_workpiece_t0cf(action.workpiece, action.tool, assembly)
    # Assembly vector
    action.target.resolve(t0cf_in_world_coords)

clamp_approach_vector =  Vector(0,0,0.10)
clamp_retract_vector = Vector(0,0,-0.10)
clamp_approach_workpiece_vector =  Vector(0,0,0.30)
clamp_retract_workpiece_vector = Vector(0,0,-0.30)

def resolve_ClampTarget(action, assembly):
    joint_id = (action.target.beam1, action.target.beam2)
    clamp_frame_wcf = assembly.get_joint_attribute(joint_id, "clamp_frame_wcf")
    tool = action.tool
    tool.set_current_location_frame_by_placemnet(clamp_frame_wcf)
    action.target.resolve(tool.current_location, clamp_approach_workpiece_vector, clamp_retract_vector)


def resolve_ToolStorageTarget(action, assembly):
    action.target.resolve(action.tool.storage_location, clamp_approach_vector, clamp_retract_workpiece_vector)

#Loop though all the actions
for action in actions_out:
    
    if action.__class__.__name__ in ["PickWorkpieceAction", "PlaceWorkpieceAction", "DetachWorkpieceAction"]:
        if action.target.__class__.__name__ == "StorageTarget":
            resolve_BeamStorageTarget(action, assembly)
        if action.target.__class__.__name__ == "BeamFinalTarget":
            resolve_BeamFinalTarget(action, assembly)
    
    if action.__class__.__name__ in ["LinearMoveWorkpieceAction", "FreeMoveWorkpieceAction"]:
        if action.target.__class__.__name__ == "BeamAboveJawTarget":
            resolve_BeamAboveJawTarget(action, assembly)
        if action.target.__class__.__name__ == "BeamInJawTarget":
            resolve_BeamInJawTarget(action, assembly)
            
    # Resolve Clamp StorageLocation and Clamp TargetLocation
    if action.__class__.__name__ in ["PickToolAction", "PlaceToolAction"]:
        if action.target.__class__.__name__ == "StorageTarget":
            resolve_ToolStorageTarget(action, assembly)
        if action.target.__class__.__name__ == "ClampTarget":
            #placement_position = compute_clamp_position(action.target.beam1, action.target.beam2)[0] #First result
            resolve_ClampTarget(action, assembly)
            
    # Resolve Items in Action Group
    if action.__class__.__name__ == "ActionGroup":
        for sub_action in action.actions:
            if sub_action.__class__.__name__ in ["LinearMoveWorkpieceAction",]:
                resolve_BeamFinalTarget(sub_action, assembly)
#                tcf_in_world_coords = resolve_workpiece_tcf_in_world_coords(sub_action.workpiece, sub_action.target)
#                t0cf_in_world_coords = resolve_tool_tocp_from_tcp(sub_action.tool, tcf_in_world_coords)
#                sub_action.target.resolve(t0cf_in_world_coords, t0cf_in_world_coords.normal)
# ---------- end resolve_clamp_pos ----------

# ==== cluster Cluster
bool = ClusterInput()
override = ClusterInput()
bool_2 = Boolean(bool)
L = ClusterInput()
override_2 = Integer(override)
lng = ListLength(List=L)
counter = Counter(Reset=bool_2)
mod = Modulus(A=counter, B=lng)
filter = StreamFilter(Gate=bool_2, Stream0=mod, Stream1=override_2)
s_1 = ClusterOutput(filter)
