# Grasshopper definition robot_slider_visualize.gh (Grasshopper 1.0.7)

rhino_doc_dir = RhinoDocDir()  # -> rhino_doc_dir
# ---------- rhino_doc_dir: Python ----------
import scriptcontext as sc
from os import path

rhino_doc_dir = path.abspath(path.dirname(sc.doc.Path))
# ---------- end rhino_doc_dir ----------
ghpython_script = GhPythonScript(current_path=rhino_doc_dir)  # -> out, path
# ---------- ghpython_script: Python ----------
import os

path = os.path.abspath(os.path.join(current_path, '..', '..', 'external', 'itj_design_study', 
    '210128_RemodelFredPavilion'))
# ---------- end ghpython_script ----------
ghpython_script_2 = GhPythonScript(current_path=rhino_doc_dir)  # -> out, path
# ---------- ghpython_script_2: Python ----------
import os

path = os.path.abspath(os.path.join(current_path, '..', '..', 'external',))
# ---------- end ghpython_script_2 ----------
concatenate = Concatenate(Fragment_A=ghpython_script.path, Fragment_B="\", C="results", A="\", B="pavilion_process.json")

panel = Panel(concatenate)
panel_2 = Panel(ghpython_script_2.path)

panel_3 = Panel("C:\Users\harry\Dropbox (MIT)\code_ws_dropbox\itj_ws\integral_timber_joints\external\itj_design_study\210128_RemodelFredPavilion\YJ_tmp\pavilion_process.json")

# ----
# Development Tools
# Reload Python Modules (if Module Code is Changed)
python_module_to_reload = Panel("""compas
compas_fab
roslibpy
integral_timber_joints""")
reload = Button()
py = PythonScript(reload_module_button=reload, module_names=python_module_to_reload)  # inputs module_names: list
# ---------- py: Python ----------
import compas_ghpython
from compas_ghpython import unload_modules
if reload_module_button:
    for module in module_names:
        unload_modules(module)
# ---------- end py ----------

# ----
# Check Path and Environment
compas_version = GhPythonScript()  # -> out, compas_version, compas_fab_version, compas_path, compas_fab_path, compas_env_name, python_directory
# ---------- compas_version: Python ----------
__author__ = "leungp"
__version__ = "2020.04.20"

import rhinoscriptsyntax as rs
import compas
import compas_fab
compas_version  = compas.__version__
compas_fab_version = compas_fab.__version__
import os
compas_path = os.path.abspath(compas.__file__)
compas_fab_path = os.path.abspath(compas_fab.__file__)

import compas_bootstrapper
compas_env_name = compas_bootstrapper.ENVIRONMENT_NAME
python_directory = compas_bootstrapper.PYTHON_DIRECTORY
# ---------- end compas_version ----------
compas_environment_name = Panel(compas_version.compas_env_name)
compas_version_2 = Panel(compas_version.compas_version)
compas_fab_version = Panel(compas_version.compas_fab_version)
compas_path = Panel(compas_version.compas_path)
compas_fab_path = Panel(compas_version.compas_fab_path)
python_directory = Panel(compas_version.python_directory)

# ----
# Robot
load_robot = Button()
ghpython_script_3 = PythonScript(load=load_robot, pkg_path=panel_2, pkg_name="rfl_description", urdf_file="rfl_pybullet.urdf", srdf_file="rfl.srdf")  # -> out, robot, configuration_in_m_deg
# ---------- ghpython_script_3: Python ----------
from scriptcontext import sticky as st
import os
import compas

from compas.robots import RobotModel
from compas.robots import GithubPackageMeshLoader
from compas.robots import LocalPackageMeshLoader
from compas_fab.robots import Robot
from compas_fab.robots import RobotSemantics
from compas_ghpython.artists import RobotModelArtist

# Robot meshes are usually in meters
# Set a high percision to prevent parsing errors
# and configure Rhino itself in meters
compas.PRECISION = '12f'

# Store robot in component-based key
robot_key = 'robot_{}'.format(str(ghenv.Component.InstanceGuid))

if robot_key not in st:
    st[robot_key] = None

if load:
    # Also load geometry
    loader = LocalPackageMeshLoader(os.path.join(pkg_path, 'rfl_description'), pkg_name)
    abb_loader = LocalPackageMeshLoader(os.path.join(pkg_path), "abb_irb4600_40_255")
    
    # Create robot model from URDF
    model = RobotModel.from_urdf_string(loader.load_urdf(urdf_file).read())
    model.load_geometry(loader, abb_loader)

    artist = RobotModelArtist(model)
    robot_semantics = None
    if srdf_file:
        robot_semantics = RobotSemantics.from_srdf_file(loader.build_path('urdf', srdf_file), model)
    
    robot = Robot(model, artist, semantics=robot_semantics)
    robot.scale(1000)
    st[robot_key] = robot

robot = st[robot_key]
configuration_in_m_deg = robot.zero_configuration().scaled(0.001)
#repo    = 'ros-industrial/abb'
#package = 'abb_irb6600_support'
#branch  = 'kinetic-devel'
#
#github = GithubPackageMeshLoader(repo, package, branch)
#
#model = RobotModel.from_urdf_file(github.load_urdf('irb6640.urdf'))
#model.load_geometry(github)
#artist = RobotModelArtist(model)
#robot = Robot(model, artist)
# ---------- end ghpython_script_3 ----------
robot = Data(ghpython_script_3.robot)

panel_4 = Panel(ghpython_script_3.out)

series = Series(Start=Slider(52, range=0..100), Step=1, Count=Slider(30, range=0..30))
merge = Merge(
    Data1=Slider(0, range=0..100),
    Data2=Slider(1, range=0..100),
    Data3=series,
    Data4=Slider(82, range=0..100),
    Data5=Slider(83, range=0..100))  # -> flatten(Result)

# ---- group: Config in meters
# Configuration (meter rad)
ea_z = Slider(-4.11, range=-5..-1.7)
ea_y = Slider(0, range=-9.5..0)
gantry_x = Slider(20, range=0..40)
a5 = Slider(0, range=-2.18..2.18)
a4 = Slider(0, range=-6.98..6.98)
a3 = Slider(0, range=-3.14..1.3)
a2 = Slider(0, range=-1.57..2.61)
a1 = Slider(0, range=-3.14..3.14)
a6 = Slider(0, range=-6.98..6.98)
panel_5 = Panel("""2,bridge1_joint_EA_X
2,robot11_joint_EA_Y
2,robot11_joint_EA_Z
0,robot11_joint_1
0,robot11_joint_2
0,robot11_joint_3
0,robot11_joint_4
0,robot11_joint_5
0,robot11_joint_6""")
merge_2 = Merge(Data1=gantry_x, Data2=ea_y, Data3=ea_z, Data4=a1, Data5=a2, Data6=a3, Data7=a4, Data8=a5, Data9=a6)

# ----
ghpython_script_4 = GhPythonScript(joint_type_names=panel_5, joint_values=merge_2)  # -> out, new_config; inputs joint_type_names: list, joint_values: list
# ---------- ghpython_script_4: Python ----------
from compas.robots import Configuration

joint_types= [int(str.split(',')[0]) for str in joint_type_names]
joint_names= [str.split(',')[1] for str in joint_type_names]


new_config = Configuration(joint_values, joint_types, joint_names)
print(new_config)
# ---------- end ghpython_script_4 ----------
ghpython_script_5 = GhPythonScript(robot_model=robot, joint_values=merge_2)  # -> out, new_config, merged_config; inputs joint_values: list
# ---------- ghpython_script_5: Python ----------
from compas_fab.robots import Configuration

robot_11_joint_names= ['bridge1_joint_EA_X', 'robot11_joint_EA_Y', 'robot11_joint_EA_Z', 'robot11_joint_1', 'robot11_joint_2', 'robot11_joint_3', 'robot11_joint_4', 'robot11_joint_5', 'robot11_joint_6']
robot_11_joint_types= [2, 2, 2, 0, 0, 0, 0, 0, 0]


new_config = Configuration(joint_values, robot_11_joint_types, robot_11_joint_names).scaled(1000)
zero_confg = robot_model.zero_configuration()
merged_config = zero_confg.copy()
merged_config.merge(new_config)
print(new_config)
print(merged_config.to_data())
# ---------- end ghpython_script_5 ----------

# ---- group: Config in meters
# Configuration (meter rad)
ea_z_2 = Slider(-4.12, range=-5..-1.7)
ea_y_2 = Slider(-9, range=-9.5..0)
a5_2 = Slider(0, range=-2.18..2.18)
a4_2 = Slider(0, range=-6.98..6.98)
a2_2 = Slider(0, range=-1.57..2.61)
a3_2 = Slider(0, range=-3.14..1.3)
a1_2 = Slider(0, range=-3.14..3.14)
a6_2 = Slider(0, range=-6.98..6.98)
panel_6 = Panel("""2,robot12_joint_EA_Y
2,robot12_joint_EA_Z
0,robot12_joint_1
0,robot12_joint_2
0,robot12_joint_3
0,robot12_joint_4
0,robot12_joint_5
0,robot12_joint_6""")
panel_7 = Panel(ghpython_script_5.out)
merge_3 = Merge(Data1=ea_y_2, Data2=ea_z_2, Data3=a1_2, Data4=a2_2, Data5=a3_2, Data6=a4_2, Data7=a5_2, Data8=a6_2)

# ----
ghpython_script_6 = GhPythonScript(joint_type_names=panel_6, joint_values=merge_3)  # -> out, new_config; inputs joint_type_names: list, joint_values: list; same code as ghpython_script_4

# ---- group: Config in meters
# Configuration (meter rad)
ea_z_3 = Slider(-4.21, range=-5..-1.7)
ea_y_3 = Slider(0, range=-9.5..0)
gantry_x_2 = Slider(35, range=0..40)
a5_3 = Slider(0, range=-2.18..2.18)
a4_3 = Slider(0, range=-6.98..6.98)
a2_3 = Slider(0, range=-1.57..2.61)
a3_3 = Slider(0, range=-3.14..1.3)
a1_3 = Slider(0, range=-3.14..3.14)
a6_3 = Slider(0, range=-6.98..6.98)
panel_9 = Panel("""2,bridge2_joint_EA_X
2,robot21_joint_EA_Y
2,robot21_joint_EA_Z
0,robot21_joint_1
0,robot21_joint_2
0,robot21_joint_3
0,robot21_joint_4
0,robot21_joint_5
0,robot21_joint_6""")
merge_4 = Merge(Data1=gantry_x_2, Data2=ea_y_3, Data3=ea_z_3, Data4=a1_3, Data5=a2_3, Data6=a3_3, Data7=a4_3, Data8=a5_3, Data9=a6_3)

# Configuration (meter rad)
ea_z_4 = Slider(-4.22, range=-5..-1.7)
ea_y_4 = Slider(-9, range=-9.5..0)
a5_4 = Slider(0, range=-2.18..2.18)
a4_4 = Slider(0, range=-6.98..6.98)
a3_4 = Slider(0, range=-3.14..1.3)
a2_4 = Slider(0, range=-1.57..2.61)
a1_4 = Slider(0, range=-3.14..3.14)
a6_4 = Slider(0, range=-6.98..6.98)
panel_11 = Panel("""2,robot22_joint_EA_Y
2,robot22_joint_EA_Z
0,robot22_joint_1
0,robot22_joint_2
0,robot22_joint_3
0,robot22_joint_4
0,robot22_joint_5
0,robot22_joint_6""")
merge_5 = Merge(Data1=ea_y_4, Data2=ea_z_4, Data3=a1_4, Data4=a2_4, Data5=a3_4, Data6=a4_4, Data7=a5_4, Data8=a6_4)

# ----
ghpython_script_7 = GhPythonScript(joint_type_names=panel_11, joint_values=merge_5)  # -> out, new_config; inputs joint_type_names: list, joint_values: list; same code as ghpython_script_4
ghpython_script_8 = GhPythonScript(joint_type_names=panel_9, joint_values=merge_4)  # -> out, new_config; inputs joint_type_names: list, joint_values: list; same code as ghpython_script_4
merge_6 = Merge(
    Data1=ghpython_script_4.new_config,
    Data2=ghpython_script_6.new_config,
    Data3=ghpython_script_8.new_config,
    Data4=ghpython_script_7.new_config)

# ----
# Robot Visualisation
show_end_effector_frame = BooleanToggle(True)
show_base_frame = BooleanToggle(False)
show_collision = BooleanToggle(True)
show_frames = BooleanToggle(False)
show_visual = BooleanToggle(True)
visualize = PythonScript(
    robot=robot,
    configurations=merge_6,
    show_visual=show_visual,
    show_collision=show_collision,
    show_frames=show_frames,
    show_base_frame=show_base_frame,
    show_end_effector_frame=show_end_effector_frame)  # -> out, visual, collision, frames, ee_frame, base_frame; inputs configurations: list
# ---------- visualize: Python ----------
"""Visualizes a robot.
    Inputs:
        robot: The robot
        configuration: :class:`compas_fab.robots.Configuration`
            The robot's full configuration to display.
        show_visual: bool
           Whether or not to show the robot's visual meshes.
        show_collision: bool
           Whether or not to show the robot's collision meshes.
        show_frames: bool
           Whether or not to show the robot's joint frames.
        show_base_frame: bool
           Whether or not to show the robot's base frame.
        show_end_effector_frame: bool
            Whether or not to show the robot's end-effector frame.
    Output:
        visual: The robot's visual meshes.
        collision: The robot's collision meshes.
        frames: The robot's joint frames.
        base_frame: The robot's base frame.
        ee_frame: The robot's end-effector frame.
"""
from __future__ import print_function
from compas.geometry import Frame
print (robot.group_names)
if robot:
    configuration = robot.zero_configuration()
    for partial_config in configurations:
        configuration.merge(partial_config.scaled(1000))
    print (configuration)
    
    group = group or robot.main_group_name
#    robot.update(configuration, group, visual=show_visual, collision=show_collision)
    robot.artist.update(configuration, visual=show_visual, collision=show_collision)
    print(robot.get_end_effector_link_name(group))
    if show_visual:
        visual = robot.artist.draw_visual()

    if show_collision:
        collision = robot.artist.draw_collision()

    if show_frames:
        axes = robot.transformed_axes(configuration, group)
        frames = robot.transformed_frames(configuration, group)

    if show_base_frame:
        frames = robot.transformed_frames(configuration, group)
        base_frame = frames[0]

    if show_end_effector_frame:
        ee_frame = robot.forward_kinematics(configuration, group)
        ee_frame = Frame.from_data(ee_frame.data)
        
        print ("End-effector", ee_frame)
# ---------- end visualize ----------
ghpython_script_9 = GhPythonScript(frame=visualize.ee_frame)  # -> out, plane
# ---------- ghpython_script_9: Python ----------
from compas_ghpython import draw_frame
plane = draw_frame(frame)
# ---------- end ghpython_script_9 ----------
draw = GhPythonScript(frames=[visualize.frames, visualize.ee_frame, visualize.base_frame], scale=Slider(1, range=0..1))  # -> P, V, C, W, flatten(planes); inputs frames: list
# ---------- draw: Python ----------
from System.Drawing import Color
from compas_ghpython import draw_frame

red = Color.FromArgb(255, 0, 0)
green = Color.FromArgb(0, 255, 0)
blue = Color.FromArgb(0, 0, 255)

P = []
V = []
C = []
planes = []

scale = float(scale)

for frame in frames:
    if not frame:
        continue
    plane = draw_frame(frame)
    P += [plane.Origin] * 3
    V.append(plane.XAxis * scale)
    V.append(plane.YAxis * scale)
    V.append(plane.ZAxis * scale)
    C += [red, green, blue]
    planes.append(plane)

W = 3
# ---------- end draw ----------
geometry = Geometry(visualize.collision)
geometry_2 = Geometry(visualize.visual)
scale = Scale(Geometry=draw.P, Center=Point(0, 0, 0), Factor=1000)  # -> Geometry, Transform
scale_2 = Scale(Geometry=ghpython_script_9.plane, Center=Point(0, 0, 0), Factor=1000)  # -> Geometry, Transform
scale_3 = Scale(Geometry=geometry, Center=Point(0, 0, 0), Factor=1000)  # -> Geometry, Transform
scale_4 = Scale(Geometry=geometry_2, Center=Point(0, 0, 0), Factor=1000)  # -> Geometry, Transform
vector_display_ex = VectorDisplayEx(Point=scale.Geometry, Vector=draw.V, Colour=draw.C, Width=draw.W)
cull_index = CullIndex(List=scale_4.Geometry, Indices=merge, Wrap=True)
cull_index_2 = CullIndex(List=scale_3.Geometry, Indices=merge, Wrap=True)
panel_14 = Panel(scale_2.Geometry)
custom_preview = CustomPreview(Geometry=cull_index, Material=ColourSwatch(SwatchColor=RGBA(50, 119, 168, 137)))
custom_preview_2 = CustomPreview(Geometry=cull_index_2, Material=ColourSwatch(SwatchColor=RGBA(176, 99, 99, 42)))

merge_7 = Merge(Data1=ghpython_script_3.configuration_in_m_deg, Data2=merge_6)
python = GhPythonScript(configurations=flatten(merge_7))  # -> out, merged_configuration; inputs configurations: list
# ---------- python: Python ----------
merged_configuration = configurations[0]
for config in configurations[1:]:
    merged_configuration.merge(config)
# ---------- end python ----------

# ----
# Print Configuration
ghpython_script_10 = GhPythonScript(configuration=python.merged_configuration)  # -> out, json_dumps
# ---------- ghpython_script_10: Python ----------
print (configuration)

import json
from compas.utilities import DataEncoder
json_dumps = json.dumps(configuration, cls=DataEncoder)
# ---------- end ghpython_script_10 ----------
panel_15 = Panel(ghpython_script_10.out)
