# Grasshopper definition robot_trajectory_visualize.gh (Grasshopper 1.0.7)
# plug-ins: MetaHopper, Kangaroo2 Components

rhino_doc_dir = RhinoDocDir()  # -> rhino_doc_dir
# ---------- rhino_doc_dir: Python ----------
import scriptcontext as sc
from os import path

rhino_doc_dir = path.abspath(path.dirname(sc.doc.Path))
# ---------- end rhino_doc_dir ----------
ghpython_script = GhPythonScript(current_path=rhino_doc_dir)  # -> out, path
# ---------- ghpython_script: Python ----------
import os

path = os.path.abspath(os.path.join(current_path, '..', '..', 'external', 'itj_design_study', 
    '210128_RemodelFredPavilion'))
# ---------- end ghpython_script ----------
ghpython_script_2 = GhPythonScript(current_path=rhino_doc_dir)  # -> out, path
# ---------- ghpython_script_2: Python ----------
import os

path = os.path.abspath(os.path.join(current_path, '..', '..', 'external', 'compas_fab_pychoreo', 
    'data', 'robots'))
# ---------- end ghpython_script_2 ----------
concatenate = Concatenate(Fragment_A=ghpython_script.path, Fragment_B="\", C="21-03-15_21-20-53", A="\", B="twelve_pieces_process.json")
panel = Panel(concatenate)

next_movement_hold_1_sec = Button()
movement_id = Slider(7, range=0..12)
trajectorypoint = Slider(0, range=0..6)

a1 = Slider(238, range=-360..360)
a4 = Slider(0, range=-360..360)
a5 = Slider(0, range=-120..120)
a6 = Slider(0, range=-360..360)
a2 = Slider(0, range=-360..360)
a3 = Slider(-179, range=-360..360)
gantry_x = Slider(0, range=0..26000)
gantry_y = Slider(0, range=-17001..0)
gantry_z = Slider(-3000, range=-4700..500)
a2_2 = Slider(-70, range=-360..360)
a4_2 = Slider(0, range=-360..360)
a5_2 = Slider(0, range=-360..360)
a1_2 = Slider(0, range=-360..360)
a3_2 = Slider(70, range=-360..360)
a6_2 = Slider(0, range=-360..360)
gantry_y_2 = Slider(-17001, range=-17001..0)
gantry_z_2 = Slider(-4700, range=-4700..500)
panel_2 = Panel("C:\Users\leungp\Documents\GitHub\temp_abb_urdf")
panel_3 = Panel("C:\Users\leungp\Documents\GitHub")
panel_4 = Panel(ghpython_script_2.path)

# ----
# Development Tools
# Reload Python Modules (if Module Code is Changed)
python_module_to_reload = Panel("""compas
compas_fab
roslibpy
integral_timber_joints""")
reload = Button()
py = PythonScript(reload_module_button=reload, module_names=python_module_to_reload)  # inputs module_names: list
# ---------- py: Python ----------
import compas_ghpython
from compas_ghpython import unload_modules
if reload_module_button:
    for module in module_names:
        unload_modules(module)
# ---------- end py ----------

# ----
# Check Path and Environment
compas_version = GhPythonScript()  # -> out, compas_version, compas_fab_version, compas_path, compas_fab_path, compas_env_name, python_directory
# ---------- compas_version: Python ----------
__author__ = "leungp"
__version__ = "2020.04.20"

import rhinoscriptsyntax as rs
import compas
import compas_fab
compas_version  = compas.__version__
compas_fab_version = compas_fab.__version__
import os
compas_path = os.path.abspath(compas.__file__)
compas_fab_path = os.path.abspath(compas_fab.__file__)

import compas_bootstrapper
compas_env_name = compas_bootstrapper.ENVIRONMENT_NAME
python_directory = compas_bootstrapper.PYTHON_DIRECTORY
# ---------- end compas_version ----------
compas_environment_name = Panel(compas_version.compas_env_name)
compas_version_2 = Panel(compas_version.compas_version)
compas_fab_version = Panel(compas_version.compas_fab_version)
compas_path = Panel(compas_version.compas_path)
compas_fab_path = Panel(compas_version.compas_fab_path)
python_directory = Panel(compas_version.python_directory)

merge = Merge(Data1=gantry_x, Data2=gantry_y, Data3=gantry_z, Data4=a1, Data5=a2, Data6=a3, Data7=a4, Data8=a5, Data9=a6)
merge_2 = Merge(Data1=gantry_y_2, Data2=gantry_z_2, Data3=a1_2, Data4=a2_2, Data5=a3_2, Data6=a4_2, Data7=a5_2, Data8=a6_2)
python_script = PythonScript(robot11=merge, robot12=merge_2)  # -> out, c; inputs robot11: list, robot12: list
# ---------- python_script: Python ----------
from compas_fab.robots import Configuration
from math import radians as rad

print robot11
print robot12

start_full_configuration = Configuration(
    values = (
        robot11[0],
        robot11[1], robot11[2],
        rad(robot11[3]), rad(robot11[4]), rad(robot11[5]), rad(robot11[6]), rad(robot11[7]), rad(robot11[8]),
        robot12[0], robot12[1],
        rad(robot12[2]), rad(robot12[3]), rad(robot12[4]), rad(robot12[5]), rad(robot12[6]), rad(robot12[7]),
        38000,
        0, -4915,
        0, 0, 0, 0, 0, 0,
        -12237, -4915,
        0, 0, 0, 0, 0, 0
        ),
    types = (
        2,
        2, 2,
        0, 0, 0, 0, 0, 0,
        2, 2,
        0, 0, 0, 0, 0, 0,
        2,
        2, 2,
        0, 0, 0, 0, 0, 0,
        2, 2,
        0, 0, 0, 0, 0, 0
        ),
    joint_names = (
        'bridge1_joint_EA_X',
        'robot11_joint_EA_Y', 'robot11_joint_EA_Z',
        'robot11_joint_1', 'robot11_joint_2', 'robot11_joint_3', 'robot11_joint_4', 'robot11_joint_5', 'robot11_joint_6',
        'robot12_joint_EA_Y', 'robot12_joint_EA_Z',
        'robot12_joint_1', 'robot12_joint_2', 'robot12_joint_3', 'robot12_joint_4', 'robot12_joint_5', 'robot12_joint_6',
        'bridge2_joint_EA_X',
        'robot21_joint_EA_Y', 'robot21_joint_EA_Z',
        'robot21_joint_1', 'robot21_joint_2', 'robot21_joint_3', 'robot21_joint_4', 'robot21_joint_5', 'robot21_joint_6',
        'robot22_joint_EA_Y', 'robot22_joint_EA_Z',
        'robot22_joint_1', 'robot22_joint_2', 'robot22_joint_3', 'robot22_joint_4', 'robot22_joint_5', 'robot22_joint_6'
        )
    )

c = start_full_configuration.scaled(1e-3)
# ---------- end python_script ----------

# ----
# Robot
load = Button()
ghpython_script_3 = PythonScript(load=load, pkg_path=panel_4, pkg_name="rfl_description", urdf_file="rfl.urdf", srdf_file="rfl.srdf")  # -> out, robot
# ---------- ghpython_script_3: Python ----------
from scriptcontext import sticky as st
import os
import compas

from compas.robots import RobotModel
from compas.robots import GithubPackageMeshLoader
from compas.robots import LocalPackageMeshLoader
from compas_fab.robots import Robot
from compas_fab.robots import RobotSemantics
from compas_ghpython.artists import RobotModelArtist

# Robot meshes are usually in meters
# Set a high percision to prevent parsing errors
# and configure Rhino itself in meters
compas.PRECISION = '12f'

# Store robot in component-based key
robot_key = 'robot_{}'.format(str(ghenv.Component.InstanceGuid))

if robot_key not in st:
    st[robot_key] = None

if load:
    # Also load geometry
    loader = LocalPackageMeshLoader(os.path.join(pkg_path, 'rfl_description'), pkg_name)
    abb_loader = LocalPackageMeshLoader(os.path.join(pkg_path), "abb_irb4600_40_255")
    
    # Create robot model from URDF
    model = RobotModel.from_urdf_string(loader.load_urdf(urdf_file).read())
    model.load_geometry(loader, abb_loader)

    artist = RobotModelArtist(model)
    
    robot_semantics = None
    if srdf_file:
        robot_semantics = RobotSemantics.from_srdf_file(loader.build_path('urdf', srdf_file), model)
    
    robot = Robot(model, artist, semantics=robot_semantics)
#    robot.scale(1000)
    st[robot_key] = robot

robot = st[robot_key]

#repo    = 'ros-industrial/abb'
#package = 'abb_irb6600_support'
#branch  = 'kinetic-devel'
#
#github = GithubPackageMeshLoader(repo, package, branch)
#
#model = RobotModel.from_urdf_file(github.load_urdf('irb6640.urdf'))
#model.load_geometry(github)
#artist = RobotModelArtist(model)
#robot = Robot(model, artist)
# ---------- end ghpython_script_3 ----------
robot = Data(ghpython_script_3.robot)

# ----
# Process
load_2 = Button()
ghpython_script_4 = PythonScript(load=load_2, process_path=panel)  # -> out, process
# ---------- ghpython_script_4: Python ----------
from scriptcontext import sticky as st
import compas
import json
import os
from compas.utilities import DataDecoder, DataEncoder

# Robot meshes are usually in meters
# Set a high percision to prevent parsing errors
# and configure Rhino itself in meters
compas.PRECISION = '12f'

# Store robot in component-based key
process_key = 'process_{}'.format(str(ghenv.Component.InstanceGuid))

if process_key not in st:
    st[process_key] = None

if load:
    with open(process_path, 'r') as f:
        process = json.load(f, cls=DataDecoder)
    external_m = process.load_external_movements(os.path.dirname(process_path))
    
    st[process_key] = process

process = st[process_key]
# ---------- end ghpython_script_4 ----------

movements = GhPythonScript(process=ghpython_script_4.process, filter_seq_n=Slider(5, range=0..40), filter_only_with_traj=Toggle(True))  # -> out, movements, movement_descriptions, movement_ids, trajectory, trajectory_points; inputs filter_seq_n: Int32, filter_only_with_traj: Boolean
# ---------- movements: Python ----------
from integral_timber_joints.process import RoboticFreeMovement, RoboticLinearMovement, RoboticMovement

movement_descriptions = []
movement_ids = []
trajectory = []
trajectory_points = []

for action in process.actions:
    if (filter_seq_n is not None) and filter_seq_n != action.seq_n:
        continue
    for movement in action.movements:
        if filter_only_with_traj and not isinstance(movement, RoboticMovement):
            continue
        if filter_only_with_traj and (movement.trajectory is None):
            continue

        speed_type = (" ; " + movement.speed_type) if hasattr(movement, 'speed_type') else ""
        movement_descriptions.append(movement.movement_id + ": " + movement.tag + speed_type)
        movement_ids.append(movement.movement_id)
        if isinstance(movement, RoboticMovement):
            trajectory.append(movement.trajectory)
            if movement.trajectory is not None:
                trajectory_points.append(len(movement.trajectory.points))
            else:
                trajectory_points.append(0)
        else:
            trajectory.append(None)
            trajectory_points.append(0)
# ---------- end movements ----------
panel_5 = Panel(movements.movement_descriptions)
item = ListItem(List=movements.movement_ids, Index=movement_id, Wrap=True)
addition = Addition(A=movement_id, B=1)
movement_id_2 = Text(item)
filter = StreamFilter(Gate=next_movement_hold_1_sec, Stream0=movement_id, Stream1=addition)
item_2 = ListItem(List=movements.trajectory_points, Index=movement_id, Wrap=True)
number_of_points = Panel(item_2)
item_3 = ListItem(List=movements.movement_descriptions, Index=movement_id, Wrap=True)
chosen_movement = Panel(item_3)
dam = DataDam(DataA=filter, BufferDelay=20000000, BufferMode=2)
panel_6 = Panel(ghpython_script_3.out)
show_end_effector_frame = BooleanToggle(True)
# Visualisation
panel_7 = Panel("robot11_eaXYZ")
trajectory = GhPythonScript(robot=robot, group=panel_7, process=ghpython_script_4.process, movement_id=movement_id_2, full_config=python_script.c)  # -> out, start_t0cp_frame, attached_toolchanger_mesh_at_start, attached_tool_mesh_at_start, attached_beam_mesh_at_start, graft(robot_t0cp_frames)
# ---------- trajectory: Python ----------
from integral_timber_joints.process import RoboticFreeMovement, RoboticLinearMovement, RoboticMovement
from compas.geometry import Frame
from compas.geometry import Transformation, Frame, Scale
from compas_ghpython import draw_frame
from copy import deepcopy
from compas_ghpython.artists import RobotModelArtist
from compas_ghpython.artists import MeshArtist

movement = process.get_movement_by_movement_id(movement_id)
start_state = process.get_movement_start_state(movement)

robot_11_joints= ['bridge1_joint_EA_X', 'robot11_joint_EA_Y', 'robot11_joint_EA_Z', 'robot11_joint_1', 'robot11_joint_2', 'robot11_joint_3', 'robot11_joint_4', 'robot11_joint_5', 'robot11_joint_6']

full_config = deepcopy(full_config)

robot_t0cp_frames = []

if hasattr(movement,'trajectory'):
    # Get robotic configutation at traj point
    for i, point in enumerate(movement.trajectory.points):
        point.joint_names = movement.trajectory.joint_names
        full_config.merge(point)

        robot_t0cp_frame = movement.path_from_link['robot11_tool0'][i]
        T = Scale.from_factors([1000] * 3)
        robot_t0cp_frame = robot_t0cp_frame.transformed(T)
        robot_t0cp_frames.append(draw_frame(robot_t0cp_frame))
        if i == 0 :
            start_t0cp_frame = draw_frame(robot_t0cp_frame)
    
    # Get tool changer
    toolchanger = process.robot_toolchanger
    toolchanger.set_state(start_state['tool_changer'])
    artist = RobotModelArtist(toolchanger)
    attached_toolchanger_mesh_at_start = toolchanger.draw_visual(artist)


# Get attached tool
for id, state in start_state.items():
    if id in process.tool_ids:
        if state.attached_to_robot:
            attached_tool = process.tool(id)
            attached_tool.set_state(state)
            artist = RobotModelArtist(attached_tool)
            attached_tool_mesh_at_start = attached_tool.draw_visual(artist)
            break
            
# Get attached beam
for id, state in start_state.items():
    if id in process.assembly.beam_ids():
        if state.attached_to_robot:
            beam = process.assembly.beam(id)
            beam.set_state(state)
            T = Transformation.from_frame_to_frame(beam.frame, beam.current_frame)
            mesh = beam.cached_mesh.transformed(T)
            artist = MeshArtist(mesh)
            attached_beam_mesh_at_start = artist.draw()
            break
# ---------- end trajectory ----------
trajectory_2 = GhPythonScript(
    robot=robot,
    group=panel_7,
    process=ghpython_script_4.process,
    movement_id=movement_id_2,
    trajectory_point_n=trajectorypoint,
    full_config=python_script.c)  # -> out, trajectory, start_state, robot_t0cp_frame, attached_toolchanger, attached_tool, other_tools, attached_beam, other_beams, configuration; inputs trajectory_point_n: Int32
# ---------- trajectory_2: Python ----------
from integral_timber_joints.process import RoboticFreeMovement, RoboticLinearMovement, RoboticMovement
from compas.geometry import Frame
from compas.geometry import Transformation, Frame, Scale
from copy import deepcopy

movement = process.get_movement_by_movement_id(movement_id)
start_state = process.get_movement_start_state(movement)

robot_11_joints= ['bridge1_joint_EA_X', 'robot11_joint_EA_Y', 'robot11_joint_EA_Z', 'robot11_joint_1', 'robot11_joint_2', 'robot11_joint_3', 'robot11_joint_4', 'robot11_joint_5', 'robot11_joint_6']
full_config = deepcopy(full_config)
if isinstance(movement, RoboticMovement):
    # Get robotic configutation at traj point
    point = movement.trajectory.points[trajectory_point_n]
    point.joint_names = movement.trajectory.joint_names
    full_config.merge(point)
    
    # Robot FK
    robot_t0cp_frame = robot.forward_kinematics(full_config, group)
    robot_t0cp_frame = Frame.from_data(robot_t0cp_frame.data)
    T = Scale.from_factors([1000] * 3)
    robot_t0cp_frame.transform(T)
else:
    # bug here hot fix
    start_state['robot'].kinematic_config.joint_names = robot_11_joints
    full_config.merge(start_state['robot'].kinematic_config)
    
    # Robot at TargetFrame
    robot_t0cp_frame = start_state['robot'].current_frame



# Get tool changer
attached_toolchanger = process.robot_toolchanger
other_tools = []
other_beams = []
# Get attached tool
for id, state in start_state.items():
    if id in process.tool_ids:
        tool_id = id
        tool = process.tool(id)
        tool.set_state(start_state[id])
        if state.attached_to_robot:
            attached_tool = tool
        else:
            other_tools.append(tool)
    
    # Get attached beam
    if id in process.assembly.beam_ids():
        beam = process.assembly.beam(id)
        beam.current_frame = state.current_frame
        if state.attached_to_robot:
            attached_beam = beam
        else:
            other_beams.append(beam)
configuration = full_config
# ---------- end trajectory_2 ----------
python = GhPythonScript(configuration=trajectory_2.configuration)  # -> out
# ---------- python: Python ----------
print (configuration)
# ---------- end python ----------
panel_8 = Panel(python)
demesh = DeconstructMesh(Mesh=trajectory.attached_toolchanger_mesh_at_start)  # -> flatten(Vertices), Faces, Colours, Normals
demesh_2 = DeconstructMesh(Mesh=trajectory.attached_beam_mesh_at_start)  # -> flatten(Vertices), Faces, Colours, Normals
demesh_3 = DeconstructMesh(Mesh=trajectory.attached_tool_mesh_at_start)  # -> flatten(Vertices), Faces, Colours, Normals
# floor mount
configurations_at_pickup = Data(trajectory_2.configuration)
duppt = RemoveDuplicatePts(Points=demesh.Vertices, Tolerance=0.01)
duppt_2 = RemoveDuplicatePts(Points=demesh_2.Vertices, Tolerance=0.01)
show_base_frame = BooleanToggle(False)
duppt_3 = RemoveDuplicatePts(Points=demesh_3.Vertices, Tolerance=0.01)
show_visual = BooleanToggle(True)
show_collision = BooleanToggle(True)
subtraction = Subtraction(A=number_of_points, B=1)
show_frames = BooleanToggle(False)
orient = Orient(Geometry=graft(duppt), Source=trajectory.start_t0cp_frame, Target=flatten(trajectory.robot_t0cp_frames))  # -> Geometry, Transform
orient_2 = Orient(Geometry=graft(duppt_2), Source=trajectory.start_t0cp_frame, Target=flatten(trajectory.robot_t0cp_frames))  # -> Geometry, Transform
orient_3 = Orient(Geometry=graft(duppt_3), Source=trajectory.start_t0cp_frame, Target=flatten(trajectory.robot_t0cp_frames))  # -> Geometry, Transform

selobj = GetSelectedObjects(AllObjects_Object=movement_id)  # -> ComponentObjects, ParamObjects, OtherObjects
lng = ListLength(List=movements.movement_ids)
dom = ConstructDomain(DomainStart=0, DomainEnd=lng)
set_slider = SetSliderProperties(Slider=selobj.ParamObjects, Value=dam, Range=dom)

selobj_2 = GetSelectedObjects(AllObjects_Object=trajectorypoint)  # -> ComponentObjects, ParamObjects, OtherObjects
dom_2 = ConstructDomain(DomainStart=0, DomainEnd=subtraction)
set_slider_2 = SetSliderProperties(Slider=selobj_2.ParamObjects, Value=Slider(0, range=0..100), Range=dom_2)

visualize = PythonScript(
    robot=robot,
    group=panel_7,
    configuration=configurations_at_pickup,
    show_visual=show_visual,
    show_collision=show_collision,
    show_frames=show_frames,
    show_base_frame=show_base_frame,
    show_end_effector_frame=show_end_effector_frame)  # -> out, visual, collision, frames, ee_frame, base_frame
# ---------- visualize: Python ----------
"""Visualizes a robot.
    Inputs:
        robot: The robot
        configuration: :class:`compas_fab.robots.Configuration`
            The robot's full configuration to display.
        show_visual: bool
           Whether or not to show the robot's visual meshes.
        show_collision: bool
           Whether or not to show the robot's collision meshes.
        show_frames: bool
           Whether or not to show the robot's joint frames.
        show_base_frame: bool
           Whether or not to show the robot's base frame.
        show_end_effector_frame: bool
            Whether or not to show the robot's end-effector frame.
    Output:
        visual: The robot's visual meshes.
        collision: The robot's collision meshes.
        frames: The robot's joint frames.
        base_frame: The robot's base frame.
        ee_frame: The robot's end-effector frame.
"""
from __future__ import print_function
from compas.geometry import Frame
print (robot.group_names)
if robot and configuration:
    group = group or None
    robot.update(configuration, group, visual=show_visual, collision=show_collision)
    print(robot.get_end_effector_link_name(group))
    
    if show_visual:
        visual = robot.artist.draw_visual()

    if show_collision:
        collision = robot.artist.draw_collision()

    if show_frames:
        axes = robot.transformed_axes(configuration, group)
        frames = robot.transformed_frames(configuration, group)

    if show_base_frame:
        frames = robot.transformed_frames(configuration, group)
        base_frame = frames[0]

    if show_end_effector_frame:
        ee_frame = robot.forward_kinematics(configuration, group)
        ee_frame = Frame.from_data(ee_frame.data)
        
        print ("End-effector", ee_frame)
# ---------- end visualize ----------
pline = PolyLine(Vertices=orient.Geometry, Closed=False)
pline_2 = PolyLine(Vertices=orient_2.Geometry, Closed=False)
pline_3 = PolyLine(Vertices=orient_3.Geometry, Closed=False)

panel_9 = Panel("Attached")
robot_artist = GhPythonScript(tool_model=trajectory_2.attached_toolchanger, current_frame=trajectory_2.robot_t0cp_frame)  # -> out, visual, tcf
# ---------- robot_artist: Python ----------
from compas_ghpython.artists import RobotModelArtist
from compas_rhino.geometry import RhinoPlane
from compas.geometry import Transformation, Frame, Scale
from Rhino.Geometry import Plane


# Create a transformation for base location
if current_frame:
    if isinstance(current_frame, Plane):
        current_frame = RhinoPlane.from_geometry(current_frame).to_compas()
        print("frame converted from RhinoPlane")
    tool_model.current_frame = current_frame


artist = RobotModelArtist(tool_model)
visual = tool_model.draw_visual(artist)
tcf = tool_model.current_tcf
# ---------- end robot_artist ----------
robot_artist_2 = GhPythonScript(tool_model=trajectory_2.attached_tool, current_frame=robot_artist.tcf)  # -> out, visual, tcf
# ---------- robot_artist_2: Python ----------
from compas_ghpython.artists import RobotModelArtist
from compas_rhino.geometry import RhinoPlane
from compas.geometry import Transformation, Frame, Scale
from Rhino.Geometry import Plane


# Create a transformation for base location
if current_frame:
    if isinstance(current_frame, Plane):
        current_frame = RhinoPlane.from_geometry(current_frame).to_compas()
        print("frame converted from RhinoPlane")
    tool_model.current_frame = current_frame

    artist = RobotModelArtist(tool_model)
    visual = tool_model.draw_visual(artist)
    tcf = tool_model.current_tcf
# ---------- end robot_artist_2 ----------
beam_artist = GhPythonScript(process=ghpython_script_4.process, beam=trajectory_2.attached_beam, current_frame=robot_artist_2.tcf)  # -> out, visual
# ---------- beam_artist: Python ----------
from compas_ghpython.artists import MeshArtist
from compas_rhino.geometry import RhinoPlane
from compas.geometry import Transformation, Frame, Scale
from Rhino.Geometry import Plane


# Create a transformation for base location



if beam:
    # Beam frame
    if current_frame:
        if isinstance(current_frame, Plane):
            current_frame = RhinoPlane.from_geometry(current_frame).to_compas()
        print("frame converted from RhinoPlane")

        # Transform Beam to frame
        beam_id = beam.name
        beam_from_gripper_tcp = Transformation.from_frame(process.assembly.get_beam_attribute(beam_id, 'gripper_tcp_in_ocf'))
        world_from_gripper_tcp = Transformation.from_frame(current_frame)
        world_from_beam_final = Transformation.from_frame(beam.frame)
        beam_final_from_beam = world_from_gripper_tcp * beam_from_gripper_tcp.inverse() * world_from_beam_final.inverse()
        mesh = beam.cached_mesh.transformed( beam_final_from_beam )
    else:
        world_from_beam_final = Transformation.from_frame(beam.frame)
        T = Transformation.from_frame(beam.current_frame)
        mesh = beam.cached_mesh.transformed( T * world_from_beam_final.inverse())

    artist = MeshArtist(mesh)
    visual = artist.draw()
# ---------- end beam_artist ----------
panel_10 = Panel("Detached")
beam_artist_2 = GhPythonScript(process=ghpython_script_4.process, beam=trajectory_2.other_beams)  # -> out, visual
# ---------- beam_artist_2: Python ----------
from compas_ghpython.artists import MeshArtist
from compas_rhino.geometry import RhinoPlane
from compas.geometry import Transformation, Frame, Scale
from Rhino.Geometry import Plane


# Create a transformation for base location



if beam:
    # Beam frame
    if current_frame:
        if isinstance(current_frame, Plane):
            current_frame = RhinoPlane.from_geometry(current_frame).to_compas()
        print("frame converted from RhinoPlane")

        # Transform Beam to frame
        beam_id = beam.name
        beam_from_gripper_tcp = Transformation.from_frame(process.assembly.get_beam_attribute(beam_id, 'gripper_tcp_in_ocf'))
        world_from_gripper_tcp = Transformation.from_frame(current_frame)
        world_from_beam_final = Transformation.from_frame(beam.frame)
        beam_final_from_beam = world_from_gripper_tcp * beam_from_gripper_tcp.inverse() * world_from_beam_final.inverse()
        mesh = beam.cached_mesh.transformed( beam_final_from_beam )
    else:
        world_from_beam_final = Transformation.from_frame(beam.frame)
        T = Transformation.from_frame(beam.current_frame)
        mesh = beam.cached_mesh.transformed( T * world_from_beam_final.inverse())

artist = MeshArtist(mesh)
visual = artist.draw()
# ---------- end beam_artist_2 ----------
robot_artist_3 = GhPythonScript(tool_model=trajectory_2.other_tools)  # -> out, visual, tcf
# ---------- robot_artist_3: Python ----------
from compas_ghpython.artists import RobotModelArtist
from compas_rhino.geometry import RhinoPlane
from compas.geometry import Transformation, Frame, Scale
from Rhino.Geometry import Plane


# Create a transformation for base location
if current_frame:
    if isinstance(current_frame, Plane):
        current_frame = RhinoPlane.from_geometry(current_frame).to_compas()
        print("frame converted from RhinoPlane")
    tool_model.current_frame = current_frame

artist = RobotModelArtist(tool_model)
visual = tool_model.draw_visual(artist)
tcf = tool_model.current_tcf
# ---------- end robot_artist_3 ----------
panel_11 = Panel("Tool Changer")
panel_12 = Panel("Tool")
panel_13 = Panel("Beam")

python_2 = GhPythonScript(frame=visualize.ee_frame)  # -> out, plane
# ---------- python_2: Python ----------
from compas_ghpython import draw_frame
plane = draw_frame(frame)
# ---------- end python_2 ----------
draw = GhPythonScript(frames=[visualize.frames, visualize.ee_frame, visualize.base_frame], scale=Slider(1, range=0..1))  # -> P, V, C, W, flatten(planes); inputs frames: list
# ---------- draw: Python ----------
from System.Drawing import Color
from compas_ghpython import draw_frame

red = Color.FromArgb(255, 0, 0)
green = Color.FromArgb(0, 255, 0)
blue = Color.FromArgb(0, 0, 255)

P = []
V = []
C = []
planes = []

scale = float(scale)

for frame in frames:
    if not frame:
        continue
    plane = draw_frame(frame)
    P += [plane.Origin] * 3
    V.append(plane.XAxis * scale)
    V.append(plane.YAxis * scale)
    V.append(plane.ZAxis * scale)
    C += [red, green, blue]
    planes.append(plane)

W = 3
# ---------- end draw ----------
geometry = Geometry(visualize.collision)
geometry_2 = Geometry(visualize.visual)
scale = Scale(Geometry=draw.P, Center=Point(0, 0, 0), Factor=1000)  # -> Geometry, Transform
scale_2 = Scale(Geometry=python_2.plane, Center=Point(0, 0, 0), Factor=1000)  # -> Geometry, Transform
scale_3 = Scale(Geometry=geometry_2, Center=Point(0, 0, 0), Factor=1000)  # -> Geometry, Transform
scale_4 = Scale(Geometry=geometry, Center=Point(0, 0, 0), Factor=1000)  # -> Geometry, Transform
vector_display_ex = VectorDisplayEx(Point=scale.Geometry, Vector=draw.V, Colour=draw.C, Width=draw.W)
panel_14 = Panel(scale_2.Geometry)
preview = CustomPreview(Geometry=scale_3.Geometry, Material=ColourSwatch(SwatchColor=RGBA(50, 119, 168, 137)))
preview_2 = CustomPreview(Geometry=scale_4.Geometry, Material=ColourSwatch(SwatchColor=RGBA(176, 99, 99, 42)))
