# Grasshopper definition robot_trajectory_visualize_Victor_diagram.gh (Grasshopper 1.0.7)
# plug-ins: MetaHopper

rhino_doc_dir = RhinoDocDir()  # -> rhino_doc_dir
# ---------- rhino_doc_dir: Python ----------
import scriptcontext as sc
from os import path

rhino_doc_dir = path.abspath(path.dirname(sc.doc.Path))
# ---------- end rhino_doc_dir ----------
ghpython_script = GhPythonScript(current_path=rhino_doc_dir)  # -> out, path
# ---------- ghpython_script: Python ----------
import os

path = os.path.abspath(os.path.join(current_path, '..', '..', 'external', 'itj_design_study', 
    '210128_RemodelFredPavilion'))
# ---------- end ghpython_script ----------
ghpython_script_2 = GhPythonScript(current_path=rhino_doc_dir)  # -> out, path
# ---------- ghpython_script_2: Python ----------
import os

path = os.path.abspath(os.path.join(current_path, '..', '..', 'external',))
# ---------- end ghpython_script_2 ----------
concatenate = Concatenate(Fragment_A=ghpython_script.path, Fragment_B="\", C="results", A="\", B="pavilion_process.json")

ea_z = Slider(-4.265, range=-5..-1.7)
ea_y = Slider(-5.467, range=-9.5..0)
gantry_x = Slider(15.867, range=12..16)
a5 = Slider(1.248, range=-2.18..2.18)
a4 = Slider(2.49, range=-6.98..6.98)
a3 = Slider(-2.279, range=-3.14..1.3)
a2 = Slider(1.226, range=-1.57..2.61)
a1 = Slider(2.625, range=-3.14..3.14)
a6 = Slider(3.461, range=-6.98..6.98)

# ---- group: collision points
point = Point()

# ----
panel = Panel(concatenate)
panel_2 = Panel(ghpython_script_2.path)

panel_3 = Panel("C:\Users\harry\Dropbox (MIT)\code_ws_dropbox\itj_ws\integral_timber_joints\external\itj_design_study\210128_RemodelFredPavilion\YJ_tmp\pavilion_process.json")

# ----
# Development Tools
# Reload Python Modules (if Module Code is Changed)
python_module_to_reload = Panel("""compas
compas_fab
roslibpy
integral_timber_joints""")
reload = Button()
py = PythonScript(reload_module_button=reload, module_names=python_module_to_reload)  # inputs module_names: list
# ---------- py: Python ----------
import compas_ghpython
from compas_ghpython import unload_modules
if reload_module_button:
    for module in module_names:
        unload_modules(module)
# ---------- end py ----------

# ----
# Check Path and Environment
compas_version = GhPythonScript()  # -> out, compas_version, compas_fab_version, compas_path, compas_fab_path, compas_env_name, python_directory
# ---------- compas_version: Python ----------
__author__ = "leungp"
__version__ = "2020.04.20"

import rhinoscriptsyntax as rs
import compas
import compas_fab
compas_version  = compas.__version__
compas_fab_version = compas_fab.__version__
import os
compas_path = os.path.abspath(compas.__file__)
compas_fab_path = os.path.abspath(compas_fab.__file__)

import compas_bootstrapper
compas_env_name = compas_bootstrapper.ENVIRONMENT_NAME
python_directory = compas_bootstrapper.PYTHON_DIRECTORY
# ---------- end compas_version ----------
compas_environment_name = Panel(compas_version.compas_env_name)
compas_version_2 = Panel(compas_version.compas_version)
compas_fab_version = Panel(compas_version.compas_fab_version)
compas_path = Panel(compas_version.compas_path)
compas_fab_path = Panel(compas_version.compas_fab_path)
python_directory = Panel(compas_version.python_directory)

# ---- group: feasible conf
number = Number([17.082, -4.271, -6.76, 2.999, 1.539, -5.845, -3.109, 0.83, -2.081])

# ---- group: interwined conf
number_2 = Number([17.082, -4.271, -6.76, 2.999, 1.539, -5.845, -3.109, 0.83, -2.081])

# ----
# Robot
load_robot = Button()
ghpython_script_3 = PythonScript(load=load_robot, pkg_path=panel_2, pkg_name="rfl_description", urdf_file="rfl_pybullet.urdf", srdf_file="rfl.srdf")  # -> out, robot
# ---------- ghpython_script_3: Python ----------
from scriptcontext import sticky as st
import os
import compas

from compas.robots import RobotModel
from compas.robots import GithubPackageMeshLoader
from compas.robots import LocalPackageMeshLoader
from compas_fab.robots import Robot
from compas_fab.robots import RobotSemantics
from compas_ghpython.artists import RobotModelArtist

# Robot meshes are usually in meters
# Set a high percision to prevent parsing errors
# and configure Rhino itself in meters
compas.PRECISION = '12f'

# Store robot in component-based key
robot_key = 'robot_{}'.format(str(ghenv.Component.InstanceGuid))

if robot_key not in st:
    st[robot_key] = None

if load:
    # Also load geometry
    loader = LocalPackageMeshLoader(os.path.join(pkg_path, 'rfl_description'), pkg_name)
    abb_loader = LocalPackageMeshLoader(os.path.join(pkg_path), "abb_irb4600_40_255")
    
    # Create robot model from URDF
    model = RobotModel.from_urdf_string(loader.load_urdf(urdf_file).read())
    model.load_geometry(loader, abb_loader)

    artist = RobotModelArtist(model)
    
    robot_semantics = None
    if srdf_file:
        robot_semantics = RobotSemantics.from_srdf_file(loader.build_path('urdf', srdf_file), model)
    
    robot = Robot(model, artist, semantics=robot_semantics)
#    robot.scale(1000)
    st[robot_key] = robot

robot = st[robot_key]

#repo    = 'ros-industrial/abb'
#package = 'abb_irb6600_support'
#branch  = 'kinetic-devel'
#
#github = GithubPackageMeshLoader(repo, package, branch)
#
#model = RobotModel.from_urdf_file(github.load_urdf('irb6640.urdf'))
#model.load_geometry(github)
#artist = RobotModelArtist(model)
#robot = Robot(model, artist)
# ---------- end ghpython_script_3 ----------
robot = Data(ghpython_script_3.robot)

ea_z_2 = Slider(-4.309, range=-5..-1.7)
ea_y_2 = Slider(-4.693, range=-9.5..0)
gantry_x_2 = Slider(14.383, range=12..16)
a5_2 = Slider(1.539, range=-2.18..2.18)
a4_2 = Slider(-5.845, range=-6.98..6.98)
a3_2 = Slider(-3.109, range=-3.14..1.3)
a2_2 = Slider(0.83, range=-1.57..2.61)
a1_2 = Slider(-2.081, range=-3.14..3.14)
a6_2 = Slider(2.999, range=-6.98..6.98)
configuration_change = GhPythonScript(
    robot=robot,
    bridge1_joint_EA_X=gantry_x_2,
    robot11_joint_EA_Y=ea_y_2,
    robot11_joint_EA_Z=ea_z_2,
    robot11_joint_1=a1_2,
    robot11_joint_2=a2_2,
    robot11_joint_3=a3_2,
    robot11_joint_4=a4_2,
    robot11_joint_5=a5_2,
    robot11_joint_6=a6_2)  # -> out, configuration
# ---------- configuration_change: Python ----------
configuration = robot.zero_configuration()
configuration['bridge1_joint_EA_X'] = bridge1_joint_EA_X
configuration['robot11_joint_EA_Y'] = robot11_joint_EA_Y
configuration['robot11_joint_EA_Z'] = robot11_joint_EA_Z
configuration['robot11_joint_1'] = robot11_joint_1
configuration['robot11_joint_2'] = robot11_joint_2
configuration['robot11_joint_3'] = robot11_joint_3
configuration['robot11_joint_4'] = robot11_joint_4
configuration['robot11_joint_5'] = robot11_joint_5
configuration['robot11_joint_6'] = robot11_joint_6
print (configuration)
# ---------- end configuration_change ----------

configuration_change_2 = GhPythonScript(
    robot=robot,
    bridge1_joint_EA_X=gantry_x,
    robot11_joint_EA_Y=ea_y,
    robot11_joint_EA_Z=ea_z,
    robot11_joint_1=a1,
    robot11_joint_2=a2,
    robot11_joint_3=a3,
    robot11_joint_4=a4,
    robot11_joint_5=a5,
    robot11_joint_6=a6)  # -> out, configuration; same code as configuration_change

# ----
# Process
panel_4 = Panel("robot11_eaXYZ")
load_process = Button()
ghpython_script_4 = PythonScript(load=Toggle(True), process_path=panel, robot_group_name=panel_4)  # -> out, process
# ---------- ghpython_script_4: Python ----------
from scriptcontext import sticky as st
import compas
import json
import os
from compas.utilities import DataDecoder, DataEncoder

# Robot meshes are usually in meters
# Set a high percision to prevent parsing errors
# and configure Rhino itself in meters
compas.PRECISION = '12f'

# Store robot in component-based key
process_key = 'process_{}'.format(str(ghenv.Component.InstanceGuid))

if process_key not in st:
    st[process_key] = None

if load:
    with open(process_path, 'r') as f:
        process = json.load(f, cls=DataDecoder)
    external_m = process.load_external_movements(os.path.dirname(process_path), movement_id=movement_id)
    process.robot_group_name = robot_group_name
    st[process_key] = process

process = st[process_key]
# ---------- end ghpython_script_4 ----------

# ---- group: Global joint flip checks
jump_across_all_movements = GhPythonScript(process=ghpython_script_4.process, threshold="0.1")  # -> out, avg_jump, max_jump, problems
# ---------- jump_across_all_movements: Python ----------
from integral_timber_joints.process import RoboticFreeMovement, RoboticLinearMovement, RoboticMovement
problems = []
diffs = [[],[],[],[],[],[],[],[],[]]
threshold
previous_point = None
for action in process.actions:
    for movement in action.movements:
        if not isinstance(movement, RoboticMovement):
            continue
        if (movement.trajectory is None):
            problems.append ("Skipping seq #%s, %s because no trajectory" % (action.seq_n, movement.movement_id))
            continue
        t = movement.trajectory
        for p in range(len(t.points)):
            
           # Compare with previous_point 
           if previous_point is not None:
                for i in range (9):
                    diff = abs(t.points[p].joint_values[i] - previous_point.joint_values[i])
                    diffs[i].append(diff)
                    if diff > threshold:
                        problems.append ("Problem at seq #%i, %s, Point %i, Joint %i: Jump = %.4g" % (action.seq_n, movement.movement_id, p, i, diff))
           # Store point for next loop
           previous_point = t.points[p]
            
avg_jump = [sum(diffs[i]) / len(diffs[i]) for i in range(9)]
max_jump = [max(diffs[i]) for i in range(9)]
# ---------- end jump_across_all_movements ----------
panel_5 = Panel(jump_across_all_movements.problems)
avg = Panel(jump_across_all_movements.avg_jump)
# Beam Pickup: 0 clamp - Movement 6
# 1 clamps - Movement 14
# 2 clamps - Movement 22
max = Panel(jump_across_all_movements.max_jump)

# ----
panel_6 = Panel(ghpython_script_3.out)
panel_7 = Panel(ghpython_script_4.out)

series = Series(Start=Slider(52, range=0..100), Step=1, Count=Slider(30, range=0..30))
merge = Merge(
    Data1=Slider(0, range=0..100),
    Data2=Slider(1, range=0..100),
    Data3=series,
    Data4=Slider(82, range=0..100),
    Data5=Slider(83, range=0..100))  # -> flatten(Result)

ea_z_3 = Slider(-4.271, range=-5..-1.7)
ea_y_3 = Slider(-6.76, range=-9.5..0)
gantry_x_3 = Slider(0, range=0..1)
a5_3 = Slider(1.539, range=-2.18..2.18)
a4_3 = Slider(-5.845, range=-6.98..6.98)
a2_3 = Slider(0.83, range=-1.57..2.61)
a3_3 = Slider(-3.109, range=-3.14..1.3)
a1_3 = Slider(-2.081, range=-3.14..3.14)
a6_3 = Slider(2.999, range=-6.98..6.98)
manual_jog = BooleanToggle(True)
merge_2 = Merge(Data1=gantry_x_3, Data2=ea_z_3, Data3=ea_y_3, Data4=a6_3, Data5=a5_3, Data6=a4_3, Data7=a3_3, Data8=a2_3, Data9=a1_3)

ghpython_script_5 = GhPythonScript(robot=robot, joint_values=merge_2)  # -> out, config; inputs joint_values: list
# ---------- ghpython_script_5: Python ----------
from compas_fab.robots import Configuration

config = robot.zero_configuration()
# ---------- end ghpython_script_5 ----------

# ----
# Main Control
movement_number_not_meaningful_if_sorted = Slider(1, range=0..1)
filter = ValueList({"All": None, "RoboticFreeMovement", "RoboticLinearMovement"}, selected="RoboticLinearMovement")
next_movement_hold_1_sec = Button()
seq_n = Slider(9, range=0..40)
trajectorypoint = Slider(0, range=0..4)

movements = GhPythonScript(
    process=ghpython_script_4.process,
    filter_seq_n=seq_n,
    filter_only_with_traj=Toggle(True),
    filter_by_movement_type=filter)  # -> out, movements, movement_descriptions, movement_ids, beam_ids, trajectory, trajectory_points; inputs filter_seq_n: Int32, filter_only_with_traj: Boolean
# ---------- movements: Python ----------
from integral_timber_joints.process import RoboticFreeMovement, RoboticLinearMovement, RoboticMovement

movement_descriptions = []
movement_ids = []
trajectory = []
trajectory_points = []
beam_ids = process.assembly.sequence

for action in process.actions:
    
    if (filter_seq_n is not None) and filter_seq_n != action.seq_n:
        continue
    for movement in action.movements:
        #print(movement.__class__.__name__)
        if filter_only_with_traj and not isinstance(movement, RoboticMovement):
            continue
        if filter_only_with_traj and (movement.trajectory is None):
            continue
        if filter_by_movement_type is not None and (movement.__class__.__name__ != filter_by_movement_type):
            continue

        speed_type = (" ; " + movement.speed_type) if hasattr(movement, 'speed_type') else ""
        movement_descriptions.append(movement.movement_id + ": " + movement.tag + speed_type)
        movement_ids.append(movement.movement_id)
        if isinstance(movement, RoboticMovement):
            trajectory.append(movement.trajectory)
            if movement.trajectory is not None:
                trajectory_points.append(len(movement.trajectory.points))
            else:
                trajectory_points.append(0)
        else:
            trajectory.append(None)
            trajectory_points.append(0)
# ---------- end movements ----------
panel_8 = Panel(movements.movement_descriptions)
list_item = ListItem(List=movements.movement_ids, Index=movement_number_not_meaningful_if_sorted, Wrap=True)
addition = Addition(A=movement_number_not_meaningful_if_sorted, B=1)
movement_id = Text(list_item)
panel_9 = Panel(movement_id)
stream_filter = StreamFilter(Gate=next_movement_hold_1_sec, Stream0=movement_number_not_meaningful_if_sorted, Stream1=addition)

list_item_2 = ListItem(List=movements.trajectory_points, Index=movement_number_not_meaningful_if_sorted, Wrap=True)
list_length = ListLength(List=movements.movement_ids)
number_of_points = Panel(list_item_2)
subtraction = Subtraction(A=list_length, B=1)
data_dam = DataDam(DataDataA=stream_filter, BufferDelay=20000000, BufferMode=2)
get_selected_objects = GetSelectedObjects(AllObjects_Object=movement_number_not_meaningful_if_sorted)  # -> ComponentObjects, ParamObjects, OtherObjects
subtraction_2 = Subtraction(A=number_of_points, B=1)
construct_domain = ConstructDomain(DomainStart=0, DomainEnd=subtraction)
set_slider_properties = SetSliderProperties(Slider=get_selected_objects.ParamObjects, Value=data_dam, Range=construct_domain)

list_item_3 = ListItem(List=movements.movement_descriptions, Index=movement_number_not_meaningful_if_sorted, Wrap=True)

chosen_movement = Panel(list_item_3)
list_item_4 = ListItem(List=movements.beam_ids, Index=seq_n, Wrap=True)
beam_id = Panel(list_item_4)

get_selected_objects_2 = GetSelectedObjects(AllObjects_Object=gantry_x_3)  # -> ComponentObjects, ParamObjects, OtherObjects
construct_domain_2 = ConstructDomain(DomainStart=0, DomainEnd=subtraction_2)
set_slider_properties_2 = SetSliderProperties(Slider=get_selected_objects_2.ParamObjects, Value=Slider(0, range=0..100), Range=construct_domain_2)

trajectory = GhPythonScript(robot=robot, process=ghpython_script_4.process, movement_id=movement_id, trajectory_point_n=trajectorypoint)  # -> out, trajectory, start_state, robot_t0cp_frame, attached_toolchanger, attached_tool, other_tools, attached_beam, other_beams, configuration; inputs trajectory_point_n: Int32
# ---------- trajectory: Python ----------
from integral_timber_joints.process import RoboticFreeMovement, RoboticLinearMovement, RoboticMovement
from compas.geometry import Frame
from compas.geometry import Transformation, Frame, Scale
from copy import deepcopy

movement = process.get_movement_by_movement_id(movement_id)
start_state = process.get_movement_start_state(movement)

robot_11_joints= ['bridge1_joint_EA_X', 'robot11_joint_EA_Y', 'robot11_joint_EA_Z', 'robot11_joint_1', 'robot11_joint_2', 'robot11_joint_3', 'robot11_joint_4', 'robot11_joint_5', 'robot11_joint_6']
#full_config = deepcopy(full_config)
full_config = deepcopy(process.robot_initial_config)
if isinstance(movement, RoboticMovement):
    # Get robotic configutation at traj point
    point = movement.trajectory.points[trajectory_point_n]
    point.joint_names = movement.trajectory.joint_names
    full_config.merge(point)
    
    # Robot FK
    robot_t0cp_frame = robot.forward_kinematics(full_config, process.robot_group_name)
    robot_t0cp_frame = Frame.from_data(robot_t0cp_frame.data)
    T = Scale.from_factors([1000] * 3)
    robot_t0cp_frame.transform(T)
else:
    # bug here hot fix
    start_state['robot'].kinematic_config.joint_names = robot_11_joints
    full_config.merge(start_state['robot'].kinematic_config)
    
    # Robot at TargetFrame
    robot_t0cp_frame = start_state['robot'].current_frame



# Get tool changer
attached_toolchanger = process.robot_toolchanger
other_tools = []
other_beams = []
# Get attached tool
for id, state in start_state.items():
    if id in process.tool_ids:
        tool_id = id
        tool = process.tool(id)
        tool.set_state(start_state[id])
        if state.attached_to_robot:
            attached_tool = tool
        else:
            other_tools.append(tool)
    
    # Get attached beam
    if id in process.assembly.beam_ids():
        beam = process.assembly.beam(id)
        beam.current_frame = state.current_frame
        if state.attached_to_robot:
            attached_beam = beam
        else:
            other_beams.append(beam)
configuration = full_config
# ---------- end trajectory ----------

# ----
# Configuration (at point)
ghpython_script_6 = GhPythonScript(configuration=trajectory.configuration)  # -> out
# ---------- ghpython_script_6: Python ----------
print (configuration)
# ---------- end ghpython_script_6 ----------
panel_10 = Panel(ghpython_script_6)

ghpython_script_7 = GhPythonScript(conf=trajectory.configuration, joint_values=merge_2)  # -> out, a; inputs joint_values: list
# ---------- ghpython_script_7: Python ----------
from compas_fab.robots import Configuration
from copy import deepcopy

new_conf = deepcopy(conf)
new_conf.joint_values = joint_values
print(new_conf)

a = new_conf
# ---------- end ghpython_script_7 ----------

panel_11 = Panel(ghpython_script_7.out)

ghpython_script_8 = GhPythonScript(conf=trajectory.configuration)  # -> out, joint_values
# ---------- ghpython_script_8: Python ----------
joint_values = list(conf.joint_values)
# ---------- end ghpython_script_8 ----------
stream_filter_2 = StreamFilter(Gate=manual_jog, Stream0=trajectory.configuration, Stream1=ghpython_script_7.a)

# ----
# Tool / Beam Visualisation
robot_artist = GhPythonScript(tool_model=trajectory.attached_toolchanger, current_frame=trajectory.robot_t0cp_frame)  # -> out, visual, tcf
# ---------- robot_artist: Python ----------
from compas_ghpython.artists import RobotModelArtist
from compas_rhino.geometry import RhinoPlane
from compas.geometry import Transformation, Frame, Scale
from Rhino.Geometry import Plane


# Create a transformation for base location
if current_frame:
    if isinstance(current_frame, Plane):
        current_frame = RhinoPlane.from_geometry(current_frame).to_compas()
        print("frame converted from RhinoPlane")
    tool_model.current_frame = current_frame


artist = RobotModelArtist(tool_model)
visual = tool_model.draw_visual(artist)
tcf = tool_model.current_tcf
# ---------- end robot_artist ----------
robot_artist_2 = GhPythonScript(tool_model=trajectory.attached_tool, current_frame=robot_artist.tcf)  # -> out, visual, tcf
# ---------- robot_artist_2: Python ----------
from compas_ghpython.artists import RobotModelArtist
from compas_rhino.geometry import RhinoPlane
from compas.geometry import Transformation, Frame, Scale
from Rhino.Geometry import Plane


# Create a transformation for base location
if current_frame:
    if isinstance(current_frame, Plane):
        current_frame = RhinoPlane.from_geometry(current_frame).to_compas()
        print("frame converted from RhinoPlane")
    tool_model.current_frame = current_frame

    artist = RobotModelArtist(tool_model)
    visual = tool_model.draw_visual(artist)
    tcf = tool_model.current_tcf
# ---------- end robot_artist_2 ----------
beam_artist = GhPythonScript(process=ghpython_script_4.process, beam=trajectory.attached_beam, current_frame=robot_artist_2.tcf)  # -> out, visual
# ---------- beam_artist: Python ----------
from compas_ghpython.artists import MeshArtist
from compas_rhino.geometry import RhinoPlane
from compas.geometry import Transformation, Frame, Scale
from Rhino.Geometry import Plane


# Create a transformation for base location



if beam:
    # Beam frame
    if current_frame:
        if isinstance(current_frame, Plane):
            current_frame = RhinoPlane.from_geometry(current_frame).to_compas()
        print("frame converted from RhinoPlane")

        # Transform Beam to frame
        beam_id = beam.name
        beam_from_gripper_tcp = Transformation.from_frame(process.assembly.get_beam_attribute(beam_id, 'gripper_tcp_in_ocf'))
        world_from_gripper_tcp = Transformation.from_frame(current_frame)
        world_from_beam_final = Transformation.from_frame(beam.frame)
        beam_final_from_beam = world_from_gripper_tcp * beam_from_gripper_tcp.inverse() * world_from_beam_final.inverse()
        mesh = beam.cached_mesh.transformed( beam_final_from_beam )
    else:
        world_from_beam_final = Transformation.from_frame(beam.frame)
        T = Transformation.from_frame(beam.current_frame)
        mesh = beam.cached_mesh.transformed( T * world_from_beam_final.inverse())

    artist = MeshArtist(mesh)
    visual = artist.draw()
# ---------- end beam_artist ----------
panel_12 = Panel("Attached")
panel_13 = Panel("Detached")
beam_artist_2 = GhPythonScript(process=ghpython_script_4.process, beam=trajectory.other_beams)  # -> out, visual
# ---------- beam_artist_2: Python ----------
from compas_ghpython.artists import MeshArtist
from compas_rhino.geometry import RhinoPlane
from compas.geometry import Transformation, Frame, Scale
from Rhino.Geometry import Plane


# Create a transformation for base location



if beam:
    # Beam frame
    if current_frame:
        if isinstance(current_frame, Plane):
            current_frame = RhinoPlane.from_geometry(current_frame).to_compas()
        print("frame converted from RhinoPlane")

        # Transform Beam to frame
        beam_id = beam.name
        beam_from_gripper_tcp = Transformation.from_frame(process.assembly.get_beam_attribute(beam_id, 'gripper_tcp_in_ocf'))
        world_from_gripper_tcp = Transformation.from_frame(current_frame)
        world_from_beam_final = Transformation.from_frame(beam.frame)
        beam_final_from_beam = world_from_gripper_tcp * beam_from_gripper_tcp.inverse() * world_from_beam_final.inverse()
        mesh = beam.cached_mesh.transformed( beam_final_from_beam )
    else:
        world_from_beam_final = Transformation.from_frame(beam.frame)
        T = Transformation.from_frame(beam.current_frame)
        mesh = beam.cached_mesh.transformed( T * world_from_beam_final.inverse())

artist = MeshArtist(mesh)
visual = artist.draw()
# ---------- end beam_artist_2 ----------
robot_artist_3 = GhPythonScript(tool_model=trajectory.other_tools)  # -> out, visual, tcf
# ---------- robot_artist_3: Python ----------
from compas_ghpython.artists import RobotModelArtist
from compas_rhino.geometry import RhinoPlane
from compas.geometry import Transformation, Frame, Scale
from Rhino.Geometry import Plane


# Create a transformation for base location
if current_frame:
    if isinstance(current_frame, Plane):
        current_frame = RhinoPlane.from_geometry(current_frame).to_compas()
        print("frame converted from RhinoPlane")
    tool_model.current_frame = current_frame

artist = RobotModelArtist(tool_model)
visual = tool_model.draw_visual(artist)
tcf = tool_model.current_tcf
# ---------- end robot_artist_3 ----------
panel_14 = Panel("Tool Changer")
panel_15 = Panel("Tool")
panel_16 = Panel("Beam")

attached_tool = CustomPreview(Geometry=[robot_artist.visual, robot_artist_2.visual], Material=ColourSwatch(SwatchColor=RGBA(168, 117, 50, 137)))
attached_beam = CustomPreview(Geometry=beam_artist.visual, Material=ColourSwatch(SwatchColor=RGBA(121, 168, 50, 137)))
other_beams = CustomPreview(Geometry=beam_artist_2.visual, Material=ColourSwatch(SwatchColor=RGBA(50, 168, 90, 137)))
other_tools = CustomPreview(Geometry=robot_artist_3.visual, Material=ColourSwatch(SwatchColor=RGBA(168, 117, 50, 137)))

# ----
# Robot Visualisation
configurations_at_pickup = Data(stream_filter_2)
show_end_effector_frame = BooleanToggle(True)
show_base_frame = BooleanToggle(False)
show_collision = BooleanToggle(True)
show_frames = BooleanToggle(False)
show_visual = BooleanToggle(True)
visualize = PythonScript(
    robot=robot,
    group=panel_4,
    configuration=configuration_change_2.configuration,
    show_visual=show_visual,
    show_collision=show_collision,
    show_frames=show_frames,
    show_base_frame=show_base_frame,
    show_end_effector_frame=show_end_effector_frame)  # -> out, visual, collision, frames, ee_frame, base_frame
# ---------- visualize: Python ----------
"""Visualizes a robot.
    Inputs:
        robot: The robot
        configuration: :class:`compas_fab.robots.Configuration`
            The robot's full configuration to display.
        show_visual: bool
           Whether or not to show the robot's visual meshes.
        show_collision: bool
           Whether or not to show the robot's collision meshes.
        show_frames: bool
           Whether or not to show the robot's joint frames.
        show_base_frame: bool
           Whether or not to show the robot's base frame.
        show_end_effector_frame: bool
            Whether or not to show the robot's end-effector frame.
    Output:
        visual: The robot's visual meshes.
        collision: The robot's collision meshes.
        frames: The robot's joint frames.
        base_frame: The robot's base frame.
        ee_frame: The robot's end-effector frame.
"""
from __future__ import print_function
from compas.geometry import Frame
print (robot.group_names)
if robot and configuration:
    group = group or robot.main_group_name
    robot.update(configuration, group, visual=show_visual, collision=show_collision)
    print(robot.get_end_effector_link_name(group))
    if show_visual:
        visual = robot.artist.draw_visual()

    if show_collision:
        collision = robot.artist.draw_collision()

    if show_frames:
        axes = robot.transformed_axes(configuration, group)
        frames = robot.transformed_frames(configuration, group)

    if show_base_frame:
        frames = robot.transformed_frames(configuration, group)
        base_frame = frames[0]

    if show_end_effector_frame:
        ee_frame = robot.forward_kinematics(configuration, group)
        ee_frame = Frame.from_data(ee_frame.data)
        
        print ("End-effector", ee_frame)
# ---------- end visualize ----------
ghpython_script_9 = GhPythonScript(frame=visualize.ee_frame)  # -> out, plane
# ---------- ghpython_script_9: Python ----------
from compas_ghpython import draw_frame
plane = draw_frame(frame)
# ---------- end ghpython_script_9 ----------
draw = GhPythonScript(frames=[visualize.frames, visualize.ee_frame, visualize.base_frame], scale=Slider(1, range=0..1))  # -> P, V, C, W, flatten(planes); inputs frames: list
# ---------- draw: Python ----------
from System.Drawing import Color
from compas_ghpython import draw_frame

red = Color.FromArgb(255, 0, 0)
green = Color.FromArgb(0, 255, 0)
blue = Color.FromArgb(0, 0, 255)

P = []
V = []
C = []
planes = []

scale = float(scale)

for frame in frames:
    if not frame:
        continue
    plane = draw_frame(frame)
    P += [plane.Origin] * 3
    V.append(plane.XAxis * scale)
    V.append(plane.YAxis * scale)
    V.append(plane.ZAxis * scale)
    C += [red, green, blue]
    planes.append(plane)

W = 3
# ---------- end draw ----------
geometry = Geometry(visualize.collision)
geometry_2 = Geometry(visualize.visual)
scale = Scale(Geometry=draw.P, Center=Point(0, 0, 0), Factor=1000)  # -> Geometry, Transform
scale_2 = Scale(Geometry=ghpython_script_9.plane, Center=Point(0, 0, 0), Factor=1000)  # -> Geometry, Transform
scale_3 = Scale(Geometry=geometry_2, Center=Point(0, 0, 0), Factor=1000)  # -> Geometry, Transform
scale_4 = Scale(Geometry=geometry, Center=Point(0, 0, 0), Factor=1000)  # -> Geometry, Transform
vector_display_ex = VectorDisplayEx(Point=scale.Geometry, Vector=draw.V, Colour=draw.C, Width=draw.W)
cull_index = CullIndex(List=scale_4.Geometry, Indices=merge, Wrap=True)
cull_index_2 = CullIndex(List=scale_3.Geometry, Indices=merge, Wrap=True)
panel_17 = Panel(scale_2.Geometry)
custom_preview = CustomPreview(Geometry=cull_index, Material=ColourSwatch(SwatchColor=RGBA(176, 99, 99, 42)))

unweld = UnweldMesh(Mesh=cull_index_2, Angle=0.3141592654)

custom_preview_2 = CustomPreview(Geometry=unweld, Material=ColourSwatch(SwatchColor=RGB(75, 92, 50)))
