# Grasshopper definition robot_trajectory_visualize_YJ.gh (Grasshopper 1.0.7)
# plug-ins: MetaHopper, Kangaroo2 Components

rhino_doc_dir = RhinoDocDir()  # -> rhino_doc_dir
# ---------- rhino_doc_dir: Python ----------
import scriptcontext as sc
from os import path

rhino_doc_dir = path.abspath(path.dirname(sc.doc.Path))
# ---------- end rhino_doc_dir ----------
python = GhPythonScript(current_path=rhino_doc_dir)  # -> out, path
# ---------- python: Python ----------
import os

path = os.path.abspath(os.path.join(current_path, '..', '..', 'external', 'itj_design_study', 
    '210128_RemodelFredPavilion'))
# ---------- end python ----------
python_2 = GhPythonScript(current_path=rhino_doc_dir)  # -> out, path
# ---------- python_2: Python ----------
import os

path = os.path.abspath(os.path.join(current_path, '..', '..', 'external',))
# ---------- end python_2 ----------
concat = Concatenate(FragmentA=python.path, FragmentB="\", FragmentC="results", FragmentA_2="\", FragmentB_2="pavilion_process.json")

txt = Text("Configuration((19.525, -4.632, -7.280, 1.076, 1.054, -2.063, 0.620, -1.506, -1.564), (2, 2, 2, 0, 0, 0, 0, 0, 0), ('bridge1_joint_EA_X', 'robot11_joint_EA_Z', 'robot11_joint_EA_Y', 'robot11_joint_6', 'robot11_joint_5', 'robot11_joint_4', 'robot11_joint_3', 'robot11_joint_2', 'robot11_joint_1'))")
panel = Panel(txt)

panel_2 = Panel(python_2.path)
panel_3 = Panel(concat)

# ----
# Development Tools
# Reload Python Modules (if Module Code is Changed)
python_module_to_reload = Panel("""compas
compas_fab
roslibpy
integral_timber_joints""")
reload = Button()
py = PythonScript(reload_module_button=reload, module_names=python_module_to_reload)  # inputs module_names: list
# ---------- py: Python ----------
import compas_ghpython
from compas_ghpython import unload_modules
if reload_module_button:
    for module in module_names:
        unload_modules(module)
# ---------- end py ----------

# ----
# Check Path and Environment
compas_version = GhPythonScript()  # -> out, compas_version, compas_fab_version, compas_path, compas_fab_path, compas_env_name, python_directory
# ---------- compas_version: Python ----------
__author__ = "leungp"
__version__ = "2020.04.20"

import rhinoscriptsyntax as rs
import compas
import compas_fab
compas_version  = compas.__version__
compas_fab_version = compas_fab.__version__
import os
compas_path = os.path.abspath(compas.__file__)
compas_fab_path = os.path.abspath(compas_fab.__file__)

import compas_bootstrapper
compas_env_name = compas_bootstrapper.ENVIRONMENT_NAME
python_directory = compas_bootstrapper.PYTHON_DIRECTORY
# ---------- end compas_version ----------
compas_environment_name = Panel(compas_version.compas_env_name)
compas_version_2 = Panel(compas_version.compas_version)
compas_fab_version = Panel(compas_version.compas_fab_version)
compas_path = Panel(compas_version.compas_path)
compas_fab_path = Panel(compas_version.compas_fab_path)
python_directory = Panel(compas_version.python_directory)

# ----
# Robot
load_robot = Button()
python_3 = PythonScript(load=load_robot, pkg_path=panel_2, pkg_name="rfl_description", urdf_file="rfl_pybullet.urdf", srdf_file="rfl.srdf")  # -> out, robot
# ---------- python_3: Python ----------
from scriptcontext import sticky as st
import os
import compas

from compas.robots import RobotModel
from compas.robots import GithubPackageMeshLoader
from compas.robots import LocalPackageMeshLoader
from compas_fab.robots import Robot
from compas_fab.robots import RobotSemantics
from compas_ghpython.artists import RobotModelArtist

# Robot meshes are usually in meters
# Set a high percision to prevent parsing errors
# and configure Rhino itself in meters
compas.PRECISION = '12f'

# Store robot in component-based key
robot_key = 'robot_{}'.format(str(ghenv.Component.InstanceGuid))

if robot_key not in st:
    st[robot_key] = None

if load:
    # Also load geometry
    loader = LocalPackageMeshLoader(os.path.join(pkg_path, 'rfl_description'), pkg_name)
    abb_loader = LocalPackageMeshLoader(os.path.join(pkg_path), "abb_irb4600_40_255")
    
    # Create robot model from URDF
    model = RobotModel.from_urdf_string(loader.load_urdf(urdf_file).read())
    model.load_geometry(loader, abb_loader)

    artist = RobotModelArtist(model)
    
    robot_semantics = None
    if srdf_file:
        robot_semantics = RobotSemantics.from_srdf_file(loader.build_path('urdf', srdf_file), model)
    
    robot = Robot(model, artist, semantics=robot_semantics)
#    robot.scale(1000)
    st[robot_key] = robot

robot = st[robot_key]

#repo    = 'ros-industrial/abb'
#package = 'abb_irb6600_support'
#branch  = 'kinetic-devel'
#
#github = GithubPackageMeshLoader(repo, package, branch)
#
#model = RobotModel.from_urdf_file(github.load_urdf('irb6640.urdf'))
#model.load_geometry(github)
#artist = RobotModelArtist(model)
#robot = Robot(model, artist)
# ---------- end python_3 ----------
robot = Data(python_3.robot)

boolean_toggle = BooleanToggle(True)

# ----
# Process
panel_4 = Panel("robot11_eaXYZ")
load_process = Button()
python_4 = PythonScript(load=load_process, process_path=panel_3, robot_group_name=panel_4)  # -> out, process
# ---------- python_4: Python ----------
from scriptcontext import sticky as st
import compas
import json
import os
from compas.utilities import DataDecoder, DataEncoder

# Robot meshes are usually in meters
# Set a high percision to prevent parsing errors
# and configure Rhino itself in meters
compas.PRECISION = '12f'

# Store robot in component-based key
process_key = 'process_{}'.format(str(ghenv.Component.InstanceGuid))

if process_key not in st:
    st[process_key] = None

if load:
    with open(process_path, 'r') as f:
        process = json.load(f, cls=DataDecoder)
    external_m = process.load_external_movements(os.path.dirname(process_path), movement_id=movement_id)
    process.robot_group_name = robot_group_name
    st[process_key] = process

process = st[process_key]
# ---------- end python_4 ----------

# ---- group: Global joint flip checks
jump_across_all_movements = GhPythonScript(process=python_4.process, threshold="0.1")  # -> out, avg_jump, max_jump, problems
# ---------- jump_across_all_movements: Python ----------
from integral_timber_joints.process import RoboticFreeMovement, RoboticLinearMovement, RoboticMovement
problems = []
diffs = [[],[],[],[],[],[],[],[],[]]
threshold
previous_point = None
for action in process.actions:
    for movement in action.movements:
        if not isinstance(movement, RoboticMovement):
            continue
        if (movement.trajectory is None):
            problems.append ("Skipping seq #%s, %s because no trajectory" % (action.seq_n, movement.movement_id))
            continue
        t = movement.trajectory
        for p in range(len(t.points)):
            
           # Compare with previous_point 
           if previous_point is not None:
                for i in range (9):
                    diff = abs(t.points[p].joint_values[i] - previous_point.joint_values[i])
                    diffs[i].append(diff)
                    if diff > threshold:
                        problems.append ("Problem at seq #%i, %s, Point %i, Joint %i: Jump = %.4g" % (action.seq_n, movement.movement_id, p, i, diff))
           # Store point for next loop
           previous_point = t.points[p]
            
avg_jump = [sum(diffs[i]) / len(diffs[i]) for i in range(9)]
max_jump = [max(diffs[i]) for i in range(9)]
# ---------- end jump_across_all_movements ----------
panel_5 = Panel(jump_across_all_movements.problems)
avg = Panel(jump_across_all_movements.avg_jump)
# Beam Pickup: 0 clamp - Movement 6
# 1 clamps - Movement 14
# 2 clamps - Movement 22
max = Panel(jump_across_all_movements.max_jump)

# ----
# Grasp Information
panel_6 = Panel("1005")
beam_pickup_info = GhPythonScript(process=python_4.process, PG1000_width=panel_6, PG500_width="505")  # -> out, beam_ids, lengths, start_lengths, end_lengths, gripper_types, clamps
# ---------- beam_pickup_info: Python ----------
beam_ids = list(process.assembly.sequence)
lengths = [process.assembly.beam(beam_id).length for beam_id in process.assembly.sequence]
gripper_types = [process.assembly.get_beam_attribute(beam_id, 'gripper_type') for beam_id in process.assembly.sequence]
clamps = []
start_lengths = []
end_lengths = []

for beam_id in process.assembly.sequence:
    dist_from_start = process.assembly.get_beam_attribute(beam_id, 'gripper_grasp_dist_from_start')
    length = process.assembly.beam(beam_id).length
    gripper_type = process.assembly.get_beam_attribute(beam_id, 'gripper_type')
    if gripper_type == "PG1000":
        gripper_width = PG1000_width
    elif gripper_type == "PG500":
        gripper_width = PG500_width
    else:
        raise ValueError()
    start_lengths.append(dist_from_start - gripper_width / 2)
    end_lengths.append(length - dist_from_start - gripper_width / 2)
    
    if len(process.assembly.get_joint_ids_of_beam_clamps(beam_id)) > 0:
        actions = process.get_action_by_beam_id(beam_id)
        for action in actions:
            if action.__class__.__name__ == "BeamPlacementWithClampsAction":
                clamps.append(' ,'.join(sorted(action.clamp_ids)))
                break
    else:
        clamps.append(" ")
# ---------- end beam_pickup_info ----------
panel_7 = Panel(beam_pickup_info.clamps)

panel_8 = Panel(python_4.out)
panel_9 = Panel(python_3.out)

series = Series(Start=Slider(52, range=0..100), Step=1, Count=Slider(30, range=0..30))
merge = Merge(
    Data1=Slider(0, range=0..100),
    Data2=Slider(1, range=0..100),
    Data3=series,
    Data4=Slider(82, range=0..100),
    Data5=Slider(83, range=0..100))  # -> flatten(Result)

# ----
# Main Control
movement_number_not_meaningful_if_sorted = Slider(1, range=0..11)
filter = ValueList({"All": None, "RoboticFreeMovement", "RoboticLinearMovement"}, selected="RoboticFreeMovement")
next_movement_hold_1_sec = Button()
seq_n = Slider(28, range=0..40)
trajectorypoint = Slider(0, range=0..228)

movements = GhPythonScript(process=python_4.process, filter_seq_n=seq_n, filter_only_with_traj=Toggle(True), filter_by_movement_type=filter)  # -> out, movements, movement_descriptions, movement_ids, beam_ids, trajectory, trajectory_points; inputs filter_seq_n: Int32, filter_only_with_traj: Boolean
# ---------- movements: Python ----------
from integral_timber_joints.process import RoboticFreeMovement, RoboticLinearMovement, RoboticMovement

movement_descriptions = []
movement_ids = []
trajectory = []
trajectory_points = []
beam_ids = process.assembly.sequence

for action in process.actions:
    
    if (filter_seq_n is not None) and filter_seq_n != action.seq_n:
        continue
    for movement in action.movements:
        #print(movement.__class__.__name__)
        if filter_only_with_traj and not isinstance(movement, RoboticMovement):
            continue
        if filter_only_with_traj and (movement.trajectory is None):
            continue
        if filter_by_movement_type is not None and (movement.__class__.__name__ != filter_by_movement_type):
            continue

        speed_type = (" ; " + movement.speed_type) if hasattr(movement, 'speed_type') else ""
        movement_descriptions.append(movement.movement_id + ": " + movement.tag + speed_type)
        movement_ids.append(movement.movement_id)
        if isinstance(movement, RoboticMovement):
            trajectory.append(movement.trajectory)
            if movement.trajectory is not None:
                trajectory_points.append(len(movement.trajectory.points))
            else:
                trajectory_points.append(0)
        else:
            trajectory.append(None)
            trajectory_points.append(0)
# ---------- end movements ----------
panel_10 = Panel(movements.movement_descriptions)

# ----
# Smoothing Experiment
number_slider = Slider(10, range=0..10)  # disabled
number_slider_2 = Slider(1, range=0..1)  # disabled
item = ListItem(List=movements.trajectory, Index=movement_number_not_meaningful_if_sorted, Wrap=True)  # disabled
python_5 = GhPythonScript(trajectory=item, iteration=number_slider, amount=number_slider_2)  # -> out, trajectory_out; inputs iteration: Int32; disabled
# ---------- python_5: Python ----------
from copy import deepcopy

trajectory = deepcopy(trajectory)

print (trajectory.points[10].values)

def smooth(trajectory, percentage):
    for i in range (1, len(trajectory.points)- 1):
        for j in range(9):
            value = trajectory.points[i].values[j]
            average = ( trajectory.points[i - 1].values[j] + trajectory.points[i + 1].values[j] ) / 2
            trajectory.points[i].values[j] = value * (1-percentage) + average * percentage
    return trajectory

for i in range(iteration):
    trajectory = smooth(trajectory, amount)
    print (trajectory.points[10].values)

trajectory_out = trajectory
# ---------- end python_5 ----------

item_2 = ListItem(List=movements.movement_ids, Index=movement_number_not_meaningful_if_sorted, Wrap=True)
addition = Addition(A=movement_number_not_meaningful_if_sorted, B=1)
movement_id = Text(item_2)
panel_11 = Panel(movement_id)
filter_2 = StreamFilter(Gate=next_movement_hold_1_sec, Stream0=movement_number_not_meaningful_if_sorted, Stream1=addition)

item_3 = ListItem(List=movements.trajectory_points, Index=movement_number_not_meaningful_if_sorted, Wrap=True)
lng = ListLength(List=movements.movement_ids)
number_of_points = Panel(item_3)
subtraction = Subtraction(A=lng, B=1)
dam = DataDam(DataA=filter_2, BufferDelay=20000000, BufferMode=2)
selobj = GetSelectedObjects(AllObjects_Object=movement_number_not_meaningful_if_sorted)  # -> ComponentObjects, ParamObjects, OtherObjects
subtraction_2 = Subtraction(A=number_of_points, B=1)
dom = ConstructDomain(DomainStart=0, DomainEnd=subtraction)
set_slider = SetSliderProperties(Slider=selobj.ParamObjects, Value=dam, Range=dom)

item_4 = ListItem(List=movements.movement_descriptions, Index=movement_number_not_meaningful_if_sorted, Wrap=True)

selobj_2 = GetSelectedObjects(AllObjects_Object=trajectorypoint)  # -> ComponentObjects, ParamObjects, OtherObjects
dom_2 = ConstructDomain(DomainStart=0, DomainEnd=subtraction_2)
set_slider_2 = SetSliderProperties(Slider=selobj_2.ParamObjects, Value=Slider(0, range=0..100), Range=dom_2)

trajectory = GhPythonScript(robot=robot, process=python_4.process, movement_id=movement_id, trajectory=python_5.trajectory_out)  # -> out, start_t0cp_frame, attached_toolchanger_mesh_at_start, attached_tool_mesh_at_start, attached_beam_mesh_at_start, graft(robot_t0cp_frames); disabled
# ---------- trajectory: Python ----------
from integral_timber_joints.process import RoboticFreeMovement, RoboticLinearMovement, RoboticMovement
from compas.geometry import Frame
from compas.geometry import Transformation, Frame, Scale
from compas_ghpython import draw_frame
from copy import deepcopy
from compas_ghpython.artists import RobotModelArtist
from compas_ghpython.artists import MeshArtist

movement = process.get_movement_by_movement_id(movement_id)
start_state = process.get_movement_start_state(movement)

robot_11_joints= ['bridge1_joint_EA_X', 'robot11_joint_EA_Y', 'robot11_joint_EA_Z', 'robot11_joint_1', 'robot11_joint_2', 'robot11_joint_3', 'robot11_joint_4', 'robot11_joint_5', 'robot11_joint_6']

full_config = deepcopy(process.robot_initial_config)

robot_t0cp_frames = []

if hasattr(movement,'trajectory'):
    if trajectory is None:
        trajectory = movement.trajectory
    else:
        print ("Using external trajectory")
    
    # Get robotic configutation at traj point
    for i, point in enumerate(trajectory.points):
        point.joint_names = trajectory.joint_names
        full_config.merge(point)

        #robot_t0cp_frame = movement.path_from_link['robot11_tool0'][i]
        robot_t0cp_frame = robot.forward_kinematics(full_config, process.robot_group_name)
        T = Scale.from_factors([1000] * 3)
        robot_t0cp_frame = robot_t0cp_frame.transformed(T)
        robot_t0cp_frames.append(draw_frame(robot_t0cp_frame))
        if i == 0 :
            start_t0cp_frame = draw_frame(robot_t0cp_frame)
    
    # Get tool changer
    toolchanger = process.robot_toolchanger
    toolchanger.set_state(start_state['tool_changer'])
    artist = RobotModelArtist(toolchanger)
    attached_toolchanger_mesh_at_start = toolchanger.draw_visual(artist)


# Get attached tool
for id, state in start_state.items():
    if id in process.tool_ids:
        if state.attached_to_robot:
            attached_tool = process.tool(id)
            attached_tool.set_state(state)
            artist = RobotModelArtist(attached_tool)
            attached_tool_mesh_at_start = attached_tool.draw_visual(artist)
            break
            
# Get attached beam
for id, state in start_state.items():
    if id in process.assembly.beam_ids():
        if state.attached_to_robot:
            beam = process.assembly.beam(id)
            beam.set_state(state)
            T = Transformation.from_frame_to_frame(beam.frame, beam.current_frame)
            mesh = beam.cached_mesh.transformed(T)
            artist = MeshArtist(mesh)
            attached_beam_mesh_at_start = artist.draw()
            break
# ---------- end trajectory ----------
demesh = DeconstructMesh(Mesh=trajectory.attached_toolchanger_mesh_at_start)  # -> flatten(Vertices), Faces, Colours, Normals
demesh_2 = DeconstructMesh(Mesh=trajectory.attached_tool_mesh_at_start)  # -> flatten(Vertices), Faces, Colours, Normals
demesh_3 = DeconstructMesh(Mesh=trajectory.attached_beam_mesh_at_start)  # -> flatten(Vertices), Faces, Colours, Normals
duppt = RemoveDuplicatePts(Points=demesh.Vertices, Tolerance=0.01)
duppt_2 = RemoveDuplicatePts(Points=demesh_2.Vertices, Tolerance=0.01)
duppt_3 = RemoveDuplicatePts(Points=demesh_3.Vertices, Tolerance=0.01)
orient = Orient(Geometry=graft(duppt), Source=trajectory.start_t0cp_frame, Target=flatten(trajectory.robot_t0cp_frames))  # -> Geometry, Transform
orient_2 = Orient(Geometry=graft(duppt_3), Source=trajectory.start_t0cp_frame, Target=flatten(trajectory.robot_t0cp_frames))  # -> Geometry, Transform
orient_3 = Orient(Geometry=graft(duppt_2), Source=trajectory.start_t0cp_frame, Target=flatten(trajectory.robot_t0cp_frames))  # -> Geometry, Transform
pline = PolyLine(Vertices=orient.Geometry, Closed=False)
pline_2 = PolyLine(Vertices=orient_3.Geometry, Closed=False)
pline_3 = PolyLine(Vertices=orient_2.Geometry, Closed=False)

trajectory_2 = GhPythonScript(robot=robot, process=python_4.process, movement_id=movement_id, trajectory_point_n=trajectorypoint)  # -> out, trajectory, start_state, robot_t0cp_frame, attached_toolchanger, attached_tool, other_tools, attached_beam, other_beams, configuration; inputs trajectory_point_n: Int32
# ---------- trajectory_2: Python ----------
from integral_timber_joints.process import RoboticFreeMovement, RoboticLinearMovement, RoboticMovement
from compas.geometry import Frame
from compas.geometry import Transformation, Frame, Scale
from copy import deepcopy

movement = process.get_movement_by_movement_id(movement_id)
start_state = process.get_movement_start_state(movement)

robot_11_joints= ['bridge1_joint_EA_X', 'robot11_joint_EA_Y', 'robot11_joint_EA_Z', 'robot11_joint_1', 'robot11_joint_2', 'robot11_joint_3', 'robot11_joint_4', 'robot11_joint_5', 'robot11_joint_6']
#full_config = deepcopy(full_config)
full_config = deepcopy(process.robot_initial_config)
if isinstance(movement, RoboticMovement):
    # Get robotic configutation at traj point
    point = movement.trajectory.points[trajectory_point_n]
    point.joint_names = movement.trajectory.joint_names
    full_config.merge(point)
    
    # Robot FK
    robot_t0cp_frame = robot.forward_kinematics(full_config, process.robot_group_name)
    robot_t0cp_frame = Frame.from_data(robot_t0cp_frame.data)
    T = Scale.from_factors([1000] * 3)
    robot_t0cp_frame.transform(T)
else:
    # bug here hot fix
    start_state['robot'].kinematic_config.joint_names = robot_11_joints
    full_config.merge(start_state['robot'].kinematic_config)
    
    # Robot at TargetFrame
    robot_t0cp_frame = start_state['robot'].current_frame



# Get tool changer
attached_toolchanger = process.robot_toolchanger
other_tools = []
other_beams = []
# Get attached tool
for id, state in start_state.items():
    if id in process.tool_ids:
        tool_id = id
        tool = process.tool(id)
        tool.set_state(start_state[id])
        if state.attached_to_robot:
            attached_tool = tool
        else:
            other_tools.append(tool)
    
    # Get attached beam
    if id in process.assembly.beam_ids():
        beam = process.assembly.beam(id)
        beam.current_frame = state.current_frame
        if state.attached_to_robot:
            attached_beam = beam
        else:
            other_beams.append(beam)
configuration = full_config
# ---------- end trajectory_2 ----------

# ----
# Configuration (at point)
python_6 = GhPythonScript(configuration=trajectory_2.configuration)  # -> out
# ---------- python_6: Python ----------
print (configuration)
# ---------- end python_6 ----------
panel_12 = Panel(python_6)

# ----
# Attached Toolchanger / Tool / Beam Polylines
trajectory_3 = GhPythonScript(robot=robot, process=python_4.process, movement_id=movement_id)  # -> out, start_t0cp_frame, attached_toolchanger_mesh_at_start, attached_tool_mesh_at_start, attached_beam_mesh_at_start, graft(robot_t0cp_frames)
# ---------- trajectory_3: Python ----------
from integral_timber_joints.process import RoboticFreeMovement, RoboticLinearMovement, RoboticMovement
from compas.geometry import Frame
from compas.geometry import Transformation, Frame, Scale
from compas_ghpython import draw_frame
from copy import deepcopy
from compas_ghpython.artists import RobotModelArtist
from compas_ghpython.artists import MeshArtist

movement = process.get_movement_by_movement_id(movement_id)
start_state = process.get_movement_start_state(movement)

robot_11_joints= ['bridge1_joint_EA_X', 'robot11_joint_EA_Y', 'robot11_joint_EA_Z', 'robot11_joint_1', 'robot11_joint_2', 'robot11_joint_3', 'robot11_joint_4', 'robot11_joint_5', 'robot11_joint_6']

full_config = deepcopy(process.robot_initial_config)

robot_t0cp_frames = []

if hasattr(movement,'trajectory'):
    # Get robotic configutation at traj point
    for i, point in enumerate(movement.trajectory.points):
        point.joint_names = movement.trajectory.joint_names
        full_config.merge(point)

        robot_t0cp_frame = movement.path_from_link['robot11_tool0'][i]
        T = Scale.from_factors([1000] * 3)
        robot_t0cp_frame = robot_t0cp_frame.transformed(T)
        robot_t0cp_frames.append(draw_frame(robot_t0cp_frame))
        if i == 0 :
            start_t0cp_frame = draw_frame(robot_t0cp_frame)
    
    # Get tool changer
    toolchanger = process.robot_toolchanger
    toolchanger.set_state(start_state['tool_changer'])
    artist = RobotModelArtist(toolchanger)
    attached_toolchanger_mesh_at_start = toolchanger.draw_visual(artist)


# Get attached tool
for id, state in start_state.items():
    if id in process.tool_ids:
        if state.attached_to_robot:
            attached_tool = process.tool(id)
            attached_tool.set_state(state)
            artist = RobotModelArtist(attached_tool)
            attached_tool_mesh_at_start = attached_tool.draw_visual(artist)
            break
            
# Get attached beam
for id, state in start_state.items():
    if id in process.assembly.beam_ids():
        if state.attached_to_robot:
            beam = process.assembly.beam(id)
            beam.set_state(state)
            T = Transformation.from_frame_to_frame(beam.frame, beam.current_frame)
            mesh = beam.cached_mesh.transformed(T)
            artist = MeshArtist(mesh)
            attached_beam_mesh_at_start = artist.draw()
            break
# ---------- end trajectory_3 ----------
demesh_4 = DeconstructMesh(Mesh=trajectory_3.attached_toolchanger_mesh_at_start)  # -> flatten(Vertices), Faces, Colours, Normals
demesh_5 = DeconstructMesh(Mesh=trajectory_3.attached_tool_mesh_at_start)  # -> flatten(Vertices), Faces, Colours, Normals
demesh_6 = DeconstructMesh(Mesh=trajectory_3.attached_beam_mesh_at_start)  # -> flatten(Vertices), Faces, Colours, Normals
duppt_4 = RemoveDuplicatePts(Points=demesh_4.Vertices, Tolerance=0.01)
duppt_5 = RemoveDuplicatePts(Points=demesh_5.Vertices, Tolerance=0.01)
duppt_6 = RemoveDuplicatePts(Points=demesh_6.Vertices, Tolerance=0.01)
orient_4 = Orient(Geometry=graft(duppt_4), Source=trajectory_3.start_t0cp_frame, Target=flatten(trajectory_3.robot_t0cp_frames))  # -> Geometry, Transform
orient_5 = Orient(Geometry=graft(duppt_6), Source=trajectory_3.start_t0cp_frame, Target=flatten(trajectory_3.robot_t0cp_frames))  # -> Geometry, Transform
orient_6 = Orient(Geometry=graft(duppt_5), Source=trajectory_3.start_t0cp_frame, Target=flatten(trajectory_3.robot_t0cp_frames))  # -> Geometry, Transform
pline_4 = PolyLine(Vertices=orient_4.Geometry, Closed=False)
pline_5 = PolyLine(Vertices=orient_6.Geometry, Closed=False)
pline_6 = PolyLine(Vertices=orient_5.Geometry, Closed=False)
crv = Curve(flatten([pline_4, pline_5, pline_6]))
null = NullItem(Item=crv)  # -> NullFlags, InvalidFlags, Description
cull = CullPattern(List=crv, CullPattern=invert(null.NullFlags))
crv_2 = Curve(flatten(cull))

# ----
# Tool / Beam Visualisation
robot_artist = GhPythonScript(tool_model=trajectory_2.attached_toolchanger, current_frame=trajectory_2.robot_t0cp_frame)  # -> out, visual, tcf
# ---------- robot_artist: Python ----------
from compas_ghpython.artists import RobotModelArtist
from compas_rhino.geometry import RhinoPlane
from compas.geometry import Transformation, Frame, Scale
from Rhino.Geometry import Plane


# Create a transformation for base location
if current_frame:
    if isinstance(current_frame, Plane):
        current_frame = RhinoPlane.from_geometry(current_frame).to_compas()
        print("frame converted from RhinoPlane")
    tool_model.current_frame = current_frame


artist = RobotModelArtist(tool_model)
visual = tool_model.draw_visual(artist)
tcf = tool_model.current_tcf
# ---------- end robot_artist ----------
robot_artist_2 = GhPythonScript(tool_model=trajectory_2.attached_tool, current_frame=robot_artist.tcf)  # -> out, visual, tcf
# ---------- robot_artist_2: Python ----------
from compas_ghpython.artists import RobotModelArtist
from compas_rhino.geometry import RhinoPlane
from compas.geometry import Transformation, Frame, Scale
from Rhino.Geometry import Plane


# Create a transformation for base location
if current_frame:
    if isinstance(current_frame, Plane):
        current_frame = RhinoPlane.from_geometry(current_frame).to_compas()
        print("frame converted from RhinoPlane")
    tool_model.current_frame = current_frame

    artist = RobotModelArtist(tool_model)
    visual = tool_model.draw_visual(artist)
    tcf = tool_model.current_tcf
# ---------- end robot_artist_2 ----------
beam_artist = GhPythonScript(process=python_4.process, beam=trajectory_2.attached_beam, current_frame=robot_artist_2.tcf)  # -> out, visual
# ---------- beam_artist: Python ----------
from compas_ghpython.artists import MeshArtist
from compas_rhino.geometry import RhinoPlane
from compas.geometry import Transformation, Frame, Scale
from Rhino.Geometry import Plane


# Create a transformation for base location



if beam:
    # Beam frame
    if current_frame:
        if isinstance(current_frame, Plane):
            current_frame = RhinoPlane.from_geometry(current_frame).to_compas()
        print("frame converted from RhinoPlane")

        # Transform Beam to frame
        beam_id = beam.name
        beam_from_gripper_tcp = Transformation.from_frame(process.assembly.get_beam_attribute(beam_id, 'gripper_tcp_in_ocf'))
        world_from_gripper_tcp = Transformation.from_frame(current_frame)
        world_from_beam_final = Transformation.from_frame(beam.frame)
        beam_final_from_beam = world_from_gripper_tcp * beam_from_gripper_tcp.inverse() * world_from_beam_final.inverse()
        mesh = beam.cached_mesh.transformed( beam_final_from_beam )
    else:
        world_from_beam_final = Transformation.from_frame(beam.frame)
        T = Transformation.from_frame(beam.current_frame)
        mesh = beam.cached_mesh.transformed( T * world_from_beam_final.inverse())

    artist = MeshArtist(mesh)
    visual = artist.draw()
# ---------- end beam_artist ----------
panel_13 = Panel("Attached")
panel_14 = Panel("Detached")
beam_artist_2 = GhPythonScript(process=python_4.process, beam=trajectory_2.other_beams)  # -> out, visual
# ---------- beam_artist_2: Python ----------
from compas_ghpython.artists import MeshArtist
from compas_rhino.geometry import RhinoPlane
from compas.geometry import Transformation, Frame, Scale
from Rhino.Geometry import Plane


# Create a transformation for base location



if beam:
    # Beam frame
    if current_frame:
        if isinstance(current_frame, Plane):
            current_frame = RhinoPlane.from_geometry(current_frame).to_compas()
        print("frame converted from RhinoPlane")

        # Transform Beam to frame
        beam_id = beam.name
        beam_from_gripper_tcp = Transformation.from_frame(process.assembly.get_beam_attribute(beam_id, 'gripper_tcp_in_ocf'))
        world_from_gripper_tcp = Transformation.from_frame(current_frame)
        world_from_beam_final = Transformation.from_frame(beam.frame)
        beam_final_from_beam = world_from_gripper_tcp * beam_from_gripper_tcp.inverse() * world_from_beam_final.inverse()
        mesh = beam.cached_mesh.transformed( beam_final_from_beam )
    else:
        world_from_beam_final = Transformation.from_frame(beam.frame)
        T = Transformation.from_frame(beam.current_frame)
        mesh = beam.cached_mesh.transformed( T * world_from_beam_final.inverse())

artist = MeshArtist(mesh)
visual = artist.draw()
# ---------- end beam_artist_2 ----------
robot_artist_3 = GhPythonScript(tool_model=trajectory_2.other_tools)  # -> out, visual, tcf
# ---------- robot_artist_3: Python ----------
from compas_ghpython.artists import RobotModelArtist
from compas_rhino.geometry import RhinoPlane
from compas.geometry import Transformation, Frame, Scale
from Rhino.Geometry import Plane


# Create a transformation for base location
if current_frame:
    if isinstance(current_frame, Plane):
        current_frame = RhinoPlane.from_geometry(current_frame).to_compas()
        print("frame converted from RhinoPlane")
    tool_model.current_frame = current_frame

artist = RobotModelArtist(tool_model)
visual = tool_model.draw_visual(artist)
tcf = tool_model.current_tcf
# ---------- end robot_artist_3 ----------
panel_15 = Panel("Tool Changer")
panel_16 = Panel("Tool")
panel_17 = Panel("Beam")

attached_tool = CustomPreview(Geometry=[robot_artist.visual, robot_artist_2.visual], Material=ColourSwatch(SwatchColor=RGBA(168, 117, 50, 137)))
attached_beam = CustomPreview(Geometry=beam_artist.visual, Material=ColourSwatch(SwatchColor=RGBA(121, 168, 50, 137)))
other_beams = CustomPreview(Geometry=beam_artist_2.visual, Material=ColourSwatch(SwatchColor=RGBA(50, 168, 90, 137)))
other_tools = CustomPreview(Geometry=robot_artist_3.visual, Material=ColourSwatch(SwatchColor=RGBA(168, 117, 50, 137)))

# ----
# Robot Visualisation
show_end_effector_frame = BooleanToggle(True)
show_base_frame = BooleanToggle(False)
show_collision = BooleanToggle(True)
show_frames = BooleanToggle(False)
configurations_at_pickup = Data(trajectory_2.configuration)
show_visual = BooleanToggle(True)
visualize = PythonScript(
    robot=robot,
    group=panel_4,
    configuration=configurations_at_pickup,
    show_visual=show_visual,
    show_collision=show_collision,
    show_frames=show_frames,
    show_base_frame=show_base_frame,
    show_end_effector_frame=show_end_effector_frame)  # -> out, visual, collision, frames, ee_frame, base_frame
# ---------- visualize: Python ----------
"""Visualizes a robot.
    Inputs:
        robot: The robot
        configuration: :class:`compas_fab.robots.Configuration`
            The robot's full configuration to display.
        show_visual: bool
           Whether or not to show the robot's visual meshes.
        show_collision: bool
           Whether or not to show the robot's collision meshes.
        show_frames: bool
           Whether or not to show the robot's joint frames.
        show_base_frame: bool
           Whether or not to show the robot's base frame.
        show_end_effector_frame: bool
            Whether or not to show the robot's end-effector frame.
    Output:
        visual: The robot's visual meshes.
        collision: The robot's collision meshes.
        frames: The robot's joint frames.
        base_frame: The robot's base frame.
        ee_frame: The robot's end-effector frame.
"""
from __future__ import print_function
from compas.geometry import Frame
print (robot.group_names)
if robot and configuration:
    group = group or robot.main_group_name
    robot.update(configuration, group, visual=show_visual, collision=show_collision)
    print(robot.get_end_effector_link_name(group))
    if show_visual:
        visual = robot.artist.draw_visual()

    if show_collision:
        collision = robot.artist.draw_collision()

    if show_frames:
        axes = robot.transformed_axes(configuration, group)
        frames = robot.transformed_frames(configuration, group)

    if show_base_frame:
        frames = robot.transformed_frames(configuration, group)
        base_frame = frames[0]

    if show_end_effector_frame:
        ee_frame = robot.forward_kinematics(configuration, group)
        ee_frame = Frame.from_data(ee_frame.data)
        
        print ("End-effector", ee_frame)
# ---------- end visualize ----------
python_7 = GhPythonScript(frame=visualize.ee_frame)  # -> out, plane
# ---------- python_7: Python ----------
from compas_ghpython import draw_frame
plane = draw_frame(frame)
# ---------- end python_7 ----------
draw = GhPythonScript(frames=[visualize.frames, visualize.ee_frame, visualize.base_frame], scale=Slider(1, range=0..1))  # -> P, V, C, W, flatten(planes); inputs frames: list
# ---------- draw: Python ----------
from System.Drawing import Color
from compas_ghpython import draw_frame

red = Color.FromArgb(255, 0, 0)
green = Color.FromArgb(0, 255, 0)
blue = Color.FromArgb(0, 0, 255)

P = []
V = []
C = []
planes = []

scale = float(scale)

for frame in frames:
    if not frame:
        continue
    plane = draw_frame(frame)
    P += [plane.Origin] * 3
    V.append(plane.XAxis * scale)
    V.append(plane.YAxis * scale)
    V.append(plane.ZAxis * scale)
    C += [red, green, blue]
    planes.append(plane)

W = 3
# ---------- end draw ----------
geo = Geometry(visualize.collision)
geo_2 = Geometry(visualize.visual)
scale = Scale(Geometry=draw.P, Center=Point(0, 0, 0), Factor=1000)  # -> Geometry, Transform
scale_2 = Scale(Geometry=python_7.plane, Center=Point(0, 0, 0), Factor=1000)  # -> Geometry, Transform
scale_3 = Scale(Geometry=geo_2, Center=Point(0, 0, 0), Factor=1000)  # -> Geometry, Transform
scale_4 = Scale(Geometry=geo, Center=Point(0, 0, 0), Factor=1000)  # -> Geometry, Transform
vdisex = VectorDisplayEx(Point=scale.Geometry, Vector=draw.V, Colour=draw.C, Width=draw.W)
cull_i = CullIndex(List=scale_3.Geometry, Indices=merge, Wrap=True)
cull_i_2 = CullIndex(List=scale_4.Geometry, Indices=merge, Wrap=True)
panel_18 = Panel(scale_2.Geometry)
preview = CustomPreview(Geometry=cull_i_2, Material=ColourSwatch(SwatchColor=RGBA(176, 99, 99, 42)))
preview_2 = CustomPreview(Geometry=cull_i, Material=ColourSwatch(SwatchColor=RGBA(50, 119, 168, 137)))

# ---- group: joint flip checks
# Joint flip check
meter = Slider(0.05, range=0..0.1)
degree = Slider(5.8, range=0..100)
rad = Radians(Degrees=degree)
trajectory_4 = GhPythonScript(
    robot=robot,
    process=python_4.process,
    movement_id=movement_id,
    revolute_joint_diff_tol=rad,
    prismatic_joint_diff_tol=meter)  # -> out, trajectory, start_state, num_joint_flips
# ---------- trajectory_4: Python ----------
from integral_timber_joints.process import RoboticFreeMovement, RoboticLinearMovement, RoboticMovement
from compas.geometry import Frame
from compas.geometry import Transformation, Frame, Scale
from compas.robots import Joint
from copy import deepcopy

movement = process.get_movement_by_movement_id(movement_id)
start_state = process.get_movement_start_state(movement)

robot_11_joints= ['bridge1_joint_EA_X', 'robot11_joint_EA_Y', 'robot11_joint_EA_Z', 'robot11_joint_1', 'robot11_joint_2', 'robot11_joint_3', 'robot11_joint_4', 'robot11_joint_5', 'robot11_joint_6']

num_joint_flips = 0
if isinstance(movement, RoboticMovement):
    prev_conf = start_state['robot'].kinematic_config
    prev_conf.joint_names = robot_11_joints
    for conf_id, jpt in enumerate(movement.trajectory.points):
        if not jpt.joint_names:
            jpt.joint_names = robot_11_joints
        # joint flip check
        for i, diff in enumerate(jpt.iter_differences(prev_conf)):
            # print('Joint #{} diff: {}'.format(robot_11_joints[i], diff))
            if jpt.joint_types[i] in [Joint.REVOLUTE, Joint.CONTINUOUS]:
                if abs(diff) > revolute_joint_diff_tol:
                    print('({}) Joint #{} (revolution) jump: {:.4f} | tol: {:.4f}'.format(conf_id, robot_11_joints[i],
                        abs(diff), revolute_joint_diff_tol))
                    num_joint_flips += 1
            else:
                if abs(diff) > prismatic_joint_diff_tol:
                    print('({}) Joint #{} (prismatic) jump: {:.4f} | tol: {:.4f}'.format(conf_id, robot_11_joints[i],
                        abs(diff), prismatic_joint_diff_tol))
                    num_joint_flips += 1
        prev_conf = jpt
# ---------- end trajectory_4 ----------

# ----
# Stationary Meshes for Polyline Check
trajectory_5 = GhPythonScript(robot=robot, process=python_4.process, movement_id=movement_id, trajectory_point_n=0)  # -> out, trajectory, start_state, robot_t0cp_frame, attached_toolchanger, attached_tool, other_tools, attached_beam, other_beams, configuration; inputs trajectory_point_n: Int32; same code as trajectory_2
environment_mesh = GhPythonScript(process=python_4.process)  # -> out, collision_meshes
# ---------- environment_mesh: Python ----------
from compas_ghpython.artists import MeshArtist
collision_meshes = []

for env_id in process.environment_models:
    env = process.environment_model(env_id)
    artist = MeshArtist(env)
    visual = artist.draw()
    collision_meshes.append(visual)
# ---------- end environment_mesh ----------
beam_artist_3 = GhPythonScript(process=python_4.process, beam=trajectory_5.other_beams)  # -> out, visual; same code as beam_artist_2
robot_artist_4 = GhPythonScript(tool_model=trajectory_5.other_tools)  # -> out, visual, tcf; same code as robot_artist_3
stationary_beams = Geometry(flatten(beam_artist_3.visual))
stationary_tools = Geometry(flatten(robot_artist_4.visual))

panel_19 = Panel(rad)
environment = Geometry(flatten(environment_mesh.collision_meshes))
item_5 = ListItem(List=trajectory_4.num_joint_flips, Index=0, Wrap=True)
mesh = Mesh([stationary_tools, stationary_beams, environment])

# ----
# Polyline Collision
colom = CollisionOneMany(Collider=crv_2, Obstacles=mesh)  # -> Collision, Index
cull_2 = CullPattern(List=crv_2, CullPattern=invert(colom.Collision))
cull_3 = CullPattern(List=crv_2, CullPattern=colom.Collision)
ma = MassAddition(Input=colom.Collision)  # -> Result, PartialResults
preview_3 = CustomPreview(Geometry=cull_3, Material=ColourSwatch(SwatchColor=RGB(222, 24, 24)))
preview_4 = CustomPreview(Geometry=cull_2, Material=ColourSwatch(SwatchColor=RGBA(99, 155, 176, 42)))

chosen_movement = Panel(item_4)
joint_flip_info = Panel(trajectory_4.out)
item_6 = ListItem(List=movements.beam_ids, Index=seq_n, Wrap=True)
number_of_joint_flips = Panel(item_5)
of_polyline_collisions = Panel(ma.Result)
beam_id = Panel(item_6)

mcx = MeshCurve(Mesh=mesh, Curve=cull_3)  # -> Points, Faces

# ---- group: collision points
pt = Point(mcx.Points)
