# Grasshopper definition gh_test_interlock.ghx (Grasshopper 1.0.7)

vector_xyz = VectorXYZ(XComponent=Slider(0, range=-1..1), YComponent=Slider(0.8, range=-1..1), ZComponent=Slider(1, range=-1..1))  # -> Vector, Length

vector_xyz_2 = VectorXYZ(XComponent=Slider(0, range=-1..1), YComponent=Slider(0, range=-1..1), ZComponent=Slider(-1, range=-1..1))  # -> Vector, Length

vector_xyz_3 = VectorXYZ(XComponent=Slider(0, range=-1..1), YComponent=Slider(0.5, range=-1..1), ZComponent=Slider(-1, range=-1..1))  # -> Vector, Length

vector_xyz_4 = VectorXYZ(XComponent=Slider(0.4, range=-1..1), YComponent=Slider(1, range=-1..1), ZComponent=Slider(0, range=-1..1))  # -> Vector, Length

vector_xyz_5 = VectorXYZ(XComponent=Slider(-0.9, range=-1..1), YComponent=Slider(0, range=-1..1), ZComponent=Slider(0, range=-1..1))  # -> Vector, Length

merge = Merge(Data1=vector_xyz_4.Vector, Data2=vector_xyz_5.Vector)
vector = Vector(merge)

# ----
# if you made changes on the
# cpython package, click on reconnect
# to make the change available here.
boolean_toggle = BooleanToggle(False)

cluster = Cluster(z_axis=vector, vector=vector)  # -> geometry, plane, domain
plane_surface = PlaneSurface(Plane=cluster.plane, XSize=cluster.domain, YSize=cluster.domain)
vector_display = VectorDisplay(Anchor=cluster.geometry, Vector=vector)
ghpython_script = GhPythonScript(block_dirs=vector, reconnect=boolean_toggle)  # -> out, feasible_region_rays, linear_index_set, feasible_rays_doubled; inputs block_dirs: list, reconnect: Boolean
# ---------- ghpython_script: Python ----------
import rhinoscriptsyntax as rs
from Rhino.Geometry import Vector3d

from compas.rpc import Proxy
interlock_util = Proxy('geometric_blocking')

if reconnect:
    interlock_util.stop_server()
    interlock_util.start_server()

bdir_lists = [(rv.X, rv.Y, rv.Z) for rv in block_dirs]
rays, lin_set = interlock_util.compute_feasible_region_from_block_dir(block_dirs=bdir_lists)


feasible_region_rays = [Vector3d(*ray) for ray in rays]
linear_index_set = lin_set

feasible_rays_doubled = [Vector3d(*ray) for ray in rays]
for index in lin_set:
    feasible_rays_doubled.append(Vector3d(*rays[index]) * -1)

print("block_dirs = %s" % bdir_lists)
print("rays = %s" % rays)
print("lin_set = %s" % lin_set)
# ---------- end ghpython_script ----------
cross_reference = CrossReference(ListA=ghpython_script.feasible_rays_doubled, ListB=ghpython_script.feasible_rays_doubled, CrossMode=3)  # -> ListA, ListB
addition = Addition(A=cross_reference.ListA, B=cross_reference.ListB)
amplitude = Amplitude(Vector=addition, Amplitude=2)
point = Point(flatten(ghpython_script.feasible_region_rays))
polyline = PolyLine(Vertices=point, Closed=True)
average = Average(Input=amplitude)
vector_2 = Vector(unitize(ghpython_script.feasible_rays_doubled))
number_slider = Slider(4, range=0..4)
explode = Explode(Curve=polyline, Recursive=True)  # -> Segments, Vertices
number_slider_2 = Slider(4, range=0..4)
end_points = EndPoints(Curve=explode.Segments)  # -> Start, End
multiplication = Multiplication(A=0, B=end_points.Start)
xy_plane = XYPlane(Origin=Point(0, 0, 0))
vector_display_ex = VectorDisplayEx(Point=xy_plane, Vector=average, Colour=ColourSwatch(SwatchColor=RGB(32, 45, 145)), Width=4)
merge_2 = Merge(Data1=simplify(graft(multiplication)), Data2=simplify(graft(end_points.Start)), Data3=simplify(graft(end_points.End)))
colour_rgb = ColourRGB(Alpha=Slider(121, range=0..255), Red=0, Green=Slider(255, range=0..255), Blue=0)
polyline_2 = PolyLine(Vertices=merge_2, Closed=True)
vector_display_ex_2 = VectorDisplayEx(Point=xy_plane, Vector=vector_2, Colour=ColourSwatch(SwatchColor=RGB(73, 180, 201)), Width=4)
boundary_surfaces = BoundarySurfaces(Edges=polyline_2)
custom_preview = CustomPreview(Geometry=boundary_surfaces, Material=colour_rgb)

# ==== cluster Cluster
vector = ClusterInput()
xy_plane = XYPlane(Origin=Point(0, 0, 0))
vector_2 = Vector(unitize(vector))
point = Point(xy_plane)
multiplication = Multiplication(A=vector_2, B=Slider(0.483, range=0..10))
number_slider = Slider(0.632, range=0..1)
move = Move(Geometry=point, Motion=multiplication)  # -> Geometry, Transform
negative = Negative(Value=number_slider)
z_axis = ClusterInput()
geometry = ClusterOutput(move.Geometry)
plane_normal = PlaneNormal(Origin=move.Geometry, ZAxis=z_axis)
construct_domain = ConstructDomain(DomainStart=negative, DomainEnd=number_slider)
plane = ClusterOutput(plane_normal)
domain = ClusterOutput(construct_domain)
