# Grasshopper definition half_lap_joint_with_gap.gh (Grasshopper 1.0.7)

# ----
# Input
beam_a = Geometry(<brep referenced from the Rhino model>)
beam_b = Geometry(<brep referenced from the Rhino model>)
# Parameters
pick_the_continue_face = Slider(1, range=0..20)
joint_depth = Slider(40, range=10..90)
gap = Slider(4, range=0..10)

# ----
# Check the chosen normal face here
debrep = DeconstructBrep(Brep=beam_a)  # -> Faces, Edges, Vertices
item = ListItem(List=debrep.Faces, Index=pick_the_continue_face, Wrap=True)
evalsrf = EvaluateSurface(Surface=reparameterize(item), Point=Point(0.5, 0.5, 0))  # -> Point, Normal, UDirection, VDirection, Frame
vec = Vector(evalsrf.Normal)
amp = Amplitude(Vector=vec, Amplitude=joint_depth)
continuous_face_normal = Vector(amp)

# ----
# Beam A - B Intersection
sint = SolidIntersection(BrepsA=beam_a, BrepsB=beam_b)
debrep_2 = DeconstructBrep(Brep=sint)  # -> Faces, Edges, Vertices

# ----
# Beam B Longest Edge analysis
intersection_edges = Curve(debrep_2.Edges)
beam_b_2 = Geometry(beam_b)
end = EndPoints(Curve=intersection_edges)  # -> Start, End
vec2pt = Vector2Pt(PointA=end.Start, PointB=end.End, Unitize=False)  # -> Vector, Length
pl = PlaneNormal(Origin=end.Start, ZAxis=vec2pt.Vector)
bbox = BoundingBox(Content=beam_b_2, Plane=pl)  # -> Box, Box_2
debox = DeconstructBox(Box=bbox.Box)  # -> Plane, X, Y, Z
dedomain = DeconstructDomain(Domain=debox.Z)  # -> Start, End
subtraction = Subtraction(A=dedomain.Start, B=dedomain.End)
abs = Absolute(Value=subtraction)
sort = SortList(Keys=flatten(abs), ValuesA=flatten(vec2pt.Vector))  # -> Keys, ValuesA
item_2 = ListItem(List=reverse(sort.ValuesA), Index=0, Wrap=True)
longest_vector = Vector(item_2)

# ----
# Beam A Longest Edge analysis
intersection_edges_2 = Curve(debrep_2.Edges)
beam_a_2 = Geometry(beam_a)
end_2 = EndPoints(Curve=intersection_edges_2)  # -> Start, End
vec2pt_2 = Vector2Pt(PointA=end_2.Start, PointB=end_2.End, Unitize=False)  # -> Vector, Length
pl_2 = PlaneNormal(Origin=end_2.Start, ZAxis=vec2pt_2.Vector)
bbox_2 = BoundingBox(Content=beam_a_2, Plane=pl_2)  # -> Box, Box_2
debox_2 = DeconstructBox(Box=bbox_2.Box)  # -> Plane, X, Y, Z
dedomain_2 = DeconstructDomain(Domain=debox_2.Z)  # -> Start, End
subtraction_2 = Subtraction(A=dedomain_2.Start, B=dedomain_2.End)
abs_2 = Absolute(Value=subtraction_2)
sort_2 = SortList(Keys=flatten(abs_2), ValuesA=flatten(vec2pt_2.Vector))  # -> Keys, ValuesA
item_3 = ListItem(List=reverse(sort_2.ValuesA), Index=0, Wrap=True)
longest_vector_2 = Vector(item_3)

# ----
# Beam A - Moved Beam B
continuous_face_normal_2 = Vector(continuous_face_normal)
beam_a_3 = Geometry(beam_a)
beam_b_3 = Geometry(beam_b)
rev = Reverse(Vector=continuous_face_normal_2)
xprod = CrossProduct(VectorA=rev, VectorB=longest_vector, Unitize=True)  # -> Vector, Length
amp_2 = Amplitude(Vector=xprod.Vector, Amplitude=expr("-x", gap))
amp_3 = Amplitude(Vector=xprod.Vector, Amplitude=gap)
addition = Addition(A=amp_3, B=rev)
addition_2 = Addition(A=amp_2, B=rev)
move = Move(Geometry=beam_b_3, Motion=rev)  # -> Geometry, Transform
move_2 = Move(Geometry=beam_b_3, Motion=addition)  # -> Geometry, Transform
move_3 = Move(Geometry=beam_b_3, Motion=addition_2)  # -> Geometry, Transform
sdiff = SolidDifference(BrepsA=beam_a_3, BrepsB=move.Geometry)
sdiff_2 = SolidDifference(BrepsA=sdiff, BrepsB=move_2.Geometry)
sdiff_3 = SolidDifference(BrepsA=sdiff_2, BrepsB=move_3.Geometry)
beam_a_output = Brep(sdiff_3)

# ----
# Beam B - ( Beam A x ( Beam B - Moved Beam B) )
continuous_face_normal_3 = Vector(continuous_face_normal)
beam_b_4 = Geometry(beam_b)
beam_a_4 = Geometry(beam_a)
rev_2 = Reverse(Vector=continuous_face_normal_3)
xprod_2 = CrossProduct(VectorA=rev_2, VectorB=longest_vector_2, Unitize=True)  # -> Vector, Length
amp_4 = Amplitude(Vector=xprod_2.Vector, Amplitude=expr("-x", gap))
amp_5 = Amplitude(Vector=xprod_2.Vector, Amplitude=gap)
move_4 = Move(Geometry=beam_b_4, Motion=rev_2)  # -> Geometry, Transform
sdiff_4 = SolidDifference(BrepsA=beam_b_4, BrepsB=move_4.Geometry)
beam_a_5 = Geometry(beam_a_4)
move_5 = Move(Geometry=beam_a_5, Motion=amp_5)  # -> Geometry, Transform
move_6 = Move(Geometry=beam_a_5, Motion=amp_4)  # -> Geometry, Transform
sint_2 = SolidIntersection(BrepsA=move_5.Geometry, BrepsB=sdiff_4)
sint_3 = SolidIntersection(BrepsA=beam_a_5, BrepsB=sdiff_4)
sint_4 = SolidIntersection(BrepsA=move_6.Geometry, BrepsB=sdiff_4)
sdiff_5 = SolidDifference(BrepsA=beam_b_4, BrepsB=sint_3)
sdiff_6 = SolidDifference(BrepsA=sdiff_5, BrepsB=sint_2)
sdiff_7 = SolidDifference(BrepsA=sdiff_6, BrepsB=sint_4)
beam_b_output = Brep(sdiff_7)

# ----
# Output
beam_a_output_2 = Brep(beam_a_output)
beam_b_output_2 = Brep(beam_b_output)

beam_a_6 = Geometry(beam_a_output_2)
beam_b_5 = Geometry(<brep referenced from the Rhino model>)
pick_the_continue_face_2 = Slider(1, range=0..20)
joint_depth_2 = Slider(40, range=10..90)
gap_2 = Slider(4, range=0..10)

debrep_3 = DeconstructBrep(Brep=beam_a_6)  # -> Faces, Edges, Vertices
item_4 = ListItem(List=debrep_3.Faces, Index=pick_the_continue_face_2, Wrap=True)
evalsrf_2 = EvaluateSurface(Surface=reparameterize(item_4), Point=Point(0.5, 0.5, 0))  # -> Point, Normal, UDirection, VDirection, Frame
vec_2 = Vector(evalsrf_2.Normal)
amp_6 = Amplitude(Vector=vec_2, Amplitude=joint_depth_2)
continuous_face_normal_4 = Vector(amp_6)

sint_5 = SolidIntersection(BrepsA=beam_a_6, BrepsB=beam_b_5)
debrep_4 = DeconstructBrep(Brep=sint_5)  # -> Faces, Edges, Vertices

intersection_edges_3 = Curve(debrep_4.Edges)
beam_b_6 = Geometry(beam_b_5)
end_3 = EndPoints(Curve=intersection_edges_3)  # -> Start, End
vec2pt_3 = Vector2Pt(PointA=end_3.Start, PointB=end_3.End, Unitize=False)  # -> Vector, Length
pl_3 = PlaneNormal(Origin=end_3.Start, ZAxis=vec2pt_3.Vector)
bbox_3 = BoundingBox(Content=beam_b_6, Plane=pl_3)  # -> Box, Box_2
debox_3 = DeconstructBox(Box=bbox_3.Box)  # -> Plane, X, Y, Z
dedomain_3 = DeconstructDomain(Domain=debox_3.Z)  # -> Start, End
subtraction_3 = Subtraction(A=dedomain_3.Start, B=dedomain_3.End)
abs_3 = Absolute(Value=subtraction_3)
sort_3 = SortList(Keys=flatten(abs_3), ValuesA=flatten(vec2pt_3.Vector))  # -> Keys, ValuesA
item_5 = ListItem(List=reverse(sort_3.ValuesA), Index=0, Wrap=True)
longest_vector_3 = Vector(item_5)

intersection_edges_4 = Curve(debrep_4.Edges)
beam_a_7 = Geometry(beam_a_6)
end_4 = EndPoints(Curve=intersection_edges_4)  # -> Start, End
vec2pt_4 = Vector2Pt(PointA=end_4.Start, PointB=end_4.End, Unitize=False)  # -> Vector, Length
pl_4 = PlaneNormal(Origin=end_4.Start, ZAxis=vec2pt_4.Vector)
bbox_4 = BoundingBox(Content=beam_a_7, Plane=pl_4)  # -> Box, Box_2
debox_4 = DeconstructBox(Box=bbox_4.Box)  # -> Plane, X, Y, Z
dedomain_4 = DeconstructDomain(Domain=debox_4.Z)  # -> Start, End
subtraction_4 = Subtraction(A=dedomain_4.Start, B=dedomain_4.End)
abs_4 = Absolute(Value=subtraction_4)
sort_4 = SortList(Keys=flatten(abs_4), ValuesA=flatten(vec2pt_4.Vector))  # -> Keys, ValuesA
item_6 = ListItem(List=reverse(sort_4.ValuesA), Index=0, Wrap=True)
longest_vector_4 = Vector(item_6)

continuous_face_normal_5 = Vector(continuous_face_normal_4)
beam_a_8 = Geometry(beam_a_6)
beam_b_7 = Geometry(beam_b_5)
rev_3 = Reverse(Vector=continuous_face_normal_5)
xprod_3 = CrossProduct(VectorA=rev_3, VectorB=longest_vector_3, Unitize=True)  # -> Vector, Length
amp_7 = Amplitude(Vector=xprod_3.Vector, Amplitude=expr("-x", gap_2))
amp_8 = Amplitude(Vector=xprod_3.Vector, Amplitude=gap_2)
addition_3 = Addition(A=amp_8, B=rev_3)
addition_4 = Addition(A=amp_7, B=rev_3)
move_7 = Move(Geometry=beam_b_7, Motion=rev_3)  # -> Geometry, Transform
move_8 = Move(Geometry=beam_b_7, Motion=addition_3)  # -> Geometry, Transform
move_9 = Move(Geometry=beam_b_7, Motion=addition_4)  # -> Geometry, Transform
sdiff_8 = SolidDifference(BrepsA=beam_a_8, BrepsB=move_7.Geometry)
sdiff_9 = SolidDifference(BrepsA=sdiff_8, BrepsB=move_8.Geometry)
sdiff_10 = SolidDifference(BrepsA=sdiff_9, BrepsB=move_9.Geometry)
beam_a_output_3 = Brep(sdiff_10)

continuous_face_normal_6 = Vector(continuous_face_normal_4)
beam_a_9 = Geometry(beam_a_6)
beam_b_8 = Geometry(beam_b_5)
rev_4 = Reverse(Vector=continuous_face_normal_6)
xprod_4 = CrossProduct(VectorA=rev_4, VectorB=longest_vector_4, Unitize=True)  # -> Vector, Length
amp_9 = Amplitude(Vector=xprod_4.Vector, Amplitude=expr("-x", gap_2))
amp_10 = Amplitude(Vector=xprod_4.Vector, Amplitude=gap_2)
move_10 = Move(Geometry=beam_b_8, Motion=rev_4)  # -> Geometry, Transform
sdiff_11 = SolidDifference(BrepsA=beam_b_8, BrepsB=move_10.Geometry)
beam_a_10 = Geometry(beam_a_9)
move_11 = Move(Geometry=beam_a_10, Motion=amp_10)  # -> Geometry, Transform
move_12 = Move(Geometry=beam_a_10, Motion=amp_9)  # -> Geometry, Transform
sint_6 = SolidIntersection(BrepsA=move_11.Geometry, BrepsB=sdiff_11)
sint_7 = SolidIntersection(BrepsA=beam_a_10, BrepsB=sdiff_11)
sint_8 = SolidIntersection(BrepsA=move_12.Geometry, BrepsB=sdiff_11)
sdiff_12 = SolidDifference(BrepsA=beam_b_8, BrepsB=sint_7)
sdiff_13 = SolidDifference(BrepsA=sdiff_12, BrepsB=sint_6)
sdiff_14 = SolidDifference(BrepsA=sdiff_13, BrepsB=sint_8)
beam_b_output_3 = Brep(sdiff_14)

beam_a_output_4 = Brep(beam_a_output_3)
beam_b_output_4 = Brep(beam_b_output_3)

beam_b_9 = Geometry(<brep referenced from the Rhino model>)
gap_3 = Slider(4, range=0..10)
beam_a_11 = Geometry(beam_a_output_4)
pick_the_continue_face_3 = Slider(1, range=0..20)
joint_depth_3 = Slider(40, range=10..90)

debrep_5 = DeconstructBrep(Brep=beam_a_11)  # -> Faces, Edges, Vertices
item_7 = ListItem(List=debrep_5.Faces, Index=pick_the_continue_face_3, Wrap=True)
evalsrf_3 = EvaluateSurface(Surface=reparameterize(item_7), Point=Point(0.5, 0.5, 0))  # -> Point, Normal, UDirection, VDirection, Frame
vec_3 = Vector(evalsrf_3.Normal)
amp_11 = Amplitude(Vector=vec_3, Amplitude=joint_depth_3)
continuous_face_normal_7 = Vector(amp_11)

sint_9 = SolidIntersection(BrepsA=beam_a_11, BrepsB=beam_b_9)
debrep_6 = DeconstructBrep(Brep=sint_9)  # -> Faces, Edges, Vertices

intersection_edges_5 = Curve(debrep_6.Edges)
beam_b_10 = Geometry(beam_b_9)
end_5 = EndPoints(Curve=intersection_edges_5)  # -> Start, End
vec2pt_5 = Vector2Pt(PointA=end_5.Start, PointB=end_5.End, Unitize=False)  # -> Vector, Length
pl_5 = PlaneNormal(Origin=end_5.Start, ZAxis=vec2pt_5.Vector)
bbox_5 = BoundingBox(Content=beam_b_10, Plane=pl_5)  # -> Box, Box_2
debox_5 = DeconstructBox(Box=bbox_5.Box)  # -> Plane, X, Y, Z
dedomain_5 = DeconstructDomain(Domain=debox_5.Z)  # -> Start, End
subtraction_5 = Subtraction(A=dedomain_5.Start, B=dedomain_5.End)
abs_5 = Absolute(Value=subtraction_5)
sort_5 = SortList(Keys=flatten(abs_5), ValuesA=flatten(vec2pt_5.Vector))  # -> Keys, ValuesA
item_8 = ListItem(List=reverse(sort_5.ValuesA), Index=0, Wrap=True)
longest_vector_5 = Vector(item_8)

intersection_edges_6 = Curve(debrep_6.Edges)
beam_a_12 = Geometry(beam_a_11)
end_6 = EndPoints(Curve=intersection_edges_6)  # -> Start, End
vec2pt_6 = Vector2Pt(PointA=end_6.Start, PointB=end_6.End, Unitize=False)  # -> Vector, Length
pl_6 = PlaneNormal(Origin=end_6.Start, ZAxis=vec2pt_6.Vector)
bbox_6 = BoundingBox(Content=beam_a_12, Plane=pl_6)  # -> Box, Box_2
debox_6 = DeconstructBox(Box=bbox_6.Box)  # -> Plane, X, Y, Z
dedomain_6 = DeconstructDomain(Domain=debox_6.Z)  # -> Start, End
subtraction_6 = Subtraction(A=dedomain_6.Start, B=dedomain_6.End)
abs_6 = Absolute(Value=subtraction_6)
sort_6 = SortList(Keys=flatten(abs_6), ValuesA=flatten(vec2pt_6.Vector))  # -> Keys, ValuesA
item_9 = ListItem(List=reverse(sort_6.ValuesA), Index=0, Wrap=True)
longest_vector_6 = Vector(item_9)

continuous_face_normal_8 = Vector(continuous_face_normal_7)
beam_a_13 = Geometry(beam_a_11)
beam_b_11 = Geometry(beam_b_9)
rev_5 = Reverse(Vector=continuous_face_normal_8)
xprod_5 = CrossProduct(VectorA=rev_5, VectorB=longest_vector_5, Unitize=True)  # -> Vector, Length
amp_12 = Amplitude(Vector=xprod_5.Vector, Amplitude=expr("-x", gap_3))
amp_13 = Amplitude(Vector=xprod_5.Vector, Amplitude=gap_3)
addition_5 = Addition(A=amp_13, B=rev_5)
addition_6 = Addition(A=amp_12, B=rev_5)
move_13 = Move(Geometry=beam_b_11, Motion=rev_5)  # -> Geometry, Transform
move_14 = Move(Geometry=beam_b_11, Motion=addition_5)  # -> Geometry, Transform
move_15 = Move(Geometry=beam_b_11, Motion=addition_6)  # -> Geometry, Transform
sdiff_15 = SolidDifference(BrepsA=beam_a_13, BrepsB=move_13.Geometry)
sdiff_16 = SolidDifference(BrepsA=sdiff_15, BrepsB=move_14.Geometry)
sdiff_17 = SolidDifference(BrepsA=sdiff_16, BrepsB=move_15.Geometry)
beam_a_output_5 = Brep(sdiff_17)

continuous_face_normal_9 = Vector(continuous_face_normal_7)
beam_b_12 = Geometry(beam_b_9)
beam_a_14 = Geometry(beam_a_11)
rev_6 = Reverse(Vector=continuous_face_normal_9)
xprod_6 = CrossProduct(VectorA=rev_6, VectorB=longest_vector_6, Unitize=True)  # -> Vector, Length
amp_14 = Amplitude(Vector=xprod_6.Vector, Amplitude=expr("-x", gap_3))
amp_15 = Amplitude(Vector=xprod_6.Vector, Amplitude=gap_3)
move_16 = Move(Geometry=beam_b_12, Motion=rev_6)  # -> Geometry, Transform
sdiff_18 = SolidDifference(BrepsA=beam_b_12, BrepsB=move_16.Geometry)
beam_a_15 = Geometry(beam_a_14)
move_17 = Move(Geometry=beam_a_15, Motion=amp_15)  # -> Geometry, Transform
move_18 = Move(Geometry=beam_a_15, Motion=amp_14)  # -> Geometry, Transform
sint_10 = SolidIntersection(BrepsA=move_17.Geometry, BrepsB=sdiff_18)
sint_11 = SolidIntersection(BrepsA=beam_a_15, BrepsB=sdiff_18)
sint_12 = SolidIntersection(BrepsA=move_18.Geometry, BrepsB=sdiff_18)
sdiff_19 = SolidDifference(BrepsA=beam_b_12, BrepsB=sint_11)
sdiff_20 = SolidDifference(BrepsA=sdiff_19, BrepsB=sint_10)
sdiff_21 = SolidDifference(BrepsA=sdiff_20, BrepsB=sint_12)
beam_b_output_5 = Brep(sdiff_21)

beam_a_output_6 = Brep(beam_a_output_5)
beam_b_output_6 = Brep(beam_b_output_5)
