# Grasshopper definition compasRRC.gh (Grasshopper 1.0.7)

reload = Button()
# START THESE ROS PROCESSES:
# 
# roslaunch rosbridge_server rosbridge_websocket.launch
# roslaunch compas_rrc_driver bringup-1_2.launch robot_ip:=192.168.0.11
ghpython_script = GhPythonScript()  # -> out
# ---------- ghpython_script: Python ----------
import compas
import compas_fab
import compas_rrc

print "compas", compas.__version__
print "compas_fab", compas_fab.__version__
# ---------- end ghpython_script ----------
panel = Panel(ghpython_script)
py = PythonScript(reload=reload)
# ---------- py: Python ----------
if reload:
    from compas_ghpython import unload_modules
    unload_modules('compas')
    unload_modules('compas_fab')
# ---------- end py ----------

# ----
# connect
inititialize_robot_instance = Button()
disconnect = Button()
connect = Button()
restart = Button()
ros = PythonScript(restart=restart, ros_IP="192.168.183.128")  # -> out, ros_client
# ---------- ros: Python ----------
import sys
import time
import logging
import scriptcontext as sc

from compas_fab.backends import RosClient

from System import TimeSpan
from System.Threading import ManualResetEventSlim

LOGGER = logging.getLogger('roslibpy')

key = 'rosclient_%s' % str(ghenv.Component.InstanceGuid)
previous_client = sc.sticky.get(key, None)
if previous_client:
    previous_client.terminate()

ros_client = RosClient(ros_IP, 9090)
sc.sticky[key] = ros_client

waitLock = ManualResetEventSlim(False)

ros_client.on_ready(lambda: waitLock.Set())

if not waitLock.Wait(TimeSpan.FromSeconds(5)):
    raise Exception('Unable to connect to ROS')

LOGGER.info('ROS connection opened')
# ---------- end ros ----------
connect_2 = PythonScript(ros_client=ros.ros_client, connect=connect, disconnect=disconnect)  # -> out, ros_client
# ---------- connect_2: Python ----------
import logging
from System import TimeSpan
from System.Threading import ManualResetEventSlim

LOGGER = logging.getLogger('roslibpy')

if connect:
    if not ros_client.is_connected:
        LOGGER.debug('Connecting...')
        waitLock = ManualResetEventSlim(False)
        ros_client.on_ready(lambda: waitLock.Set())
        ros_client.connect()

        if not waitLock.Wait(TimeSpan.FromSeconds(5)):
            raise Exception('Unable to connect to ROS')
        LOGGER.debug('Reconnected')

if disconnect:
    if ros_client.is_connected:
        ros_client.terminate()
        LOGGER.debug('Terminated')
# ---------- end connect_2 ----------
ghpython_script_2 = GhPythonScript(ros_client=connect_2.ros_client, init_robot=inititialize_robot_instance)  # -> robot_1, robot_2; inputs init_robot: Boolean
# ---------- ghpython_script_2: Python ----------
from compas_rrc import *

if ros_client:
    robot_1 = AbbClient(ros_client, "/robot_1")
    robot_2 = AbbClient(ros_client, "/robot_2")
# ---------- end ghpython_script_2 ----------

genes = GenePool(Decimals=2, Maximum=100, Minimum=-100, Value=[-6.85, -13.7, -3.1, -10.62, -5.98, -27.82])
send_command = Button()
merge = Merge(Data1=Slider(28000, range=0..100000), Data2=Slider(-2200, range=-12000..0), Data3=Slider(-4339, range=-5000..0))
ghpython_script_3 = GhPythonScript(send=send_command)  # -> out; inputs send: Boolean
# ---------- ghpython_script_3: Python ----------
import compas.geometry as cg
from compas_rrc import *


if send:
    
    
    speed = 500
    
    """
    ### SET TOOL AND WORKOBJECT
    # robot 1
    # set tool
    result = robot_1.send_and_wait(ProjectInstruction('r_A042_SetTool', ['tool0'], feedback_level=1))
    print("Set Tool:", result['instruction'])
    # set workobject
    result = robot_1.send_and_wait(ProjectInstruction('r_A042_SetWorkobject', ['wobj0'], feedback_level=1))
    print("Set Workobject:", result['instruction'])
    
    # robot 2
    # set tool
    result = robot_2.send_and_wait(ProjectInstruction('r_A042_SetTool', ['tool0'], feedback_level=1))
    print("Set Tool:", result['instruction'])
    # set workobject
    result = robot_2.send_and_wait(ProjectInstruction('r_A042_SetWorkobject', ['wobj0'], feedback_level=1))
    print("Set Workobject:", result['instruction'])
    
    
    
    
    
    ### GET CURRENT POSE
    r1 = robot_1.send_and_wait(ProjectInstruction('r_A042_GetRobT', feedback_level=1))
    print("robot 1 pose:", r1['float_values'])
    r2 = robot_2.send_and_wait(ProjectInstruction('r_A042_GetRobT', feedback_level=1))
    print("robot 2 pose:", r2['float_values'])
    
    
    
    ### GET CURRENT JOINT CONFIGURATION
    r1 = robot_1.send_and_wait(ProjectInstruction('r_A042_GetJointT', feedback_level=1))
    print("robot 1 configuration:", r1['float_values'])
    r2 = robot_2.send_and_wait(ProjectInstruction('r_A042_GetJointT', feedback_level=1))
    print("robot 2 configuration:", r2['float_values'])
    """
    
    
    ### MOVE J
    
    r1 = robot_1.send(MoveAbsJ([0, 0, 0, 0, 0, 0], [28000, -2000, -4500], speed, Zone.Z50, feedback_level=1))
    r2 = robot_2.send(MoveAbsJ([10, 0, 0, 0, 0, 0], [28000, -10000, -4500], speed, Zone.Z50, feedback_level=1))
    print("moveJ r1:", r1)
    print("moveJ r2:", r2)
    
    print('MoveJ send_and_wait commands sent')
    """
    
    ### STOP TASK FOR ROBOT 1
    robot_1.send(ProjectInstruction('r_A042_Stop'))
    
    
    
    r1 = robot_1.send(
    MoveAbsJ([10, 10, 10, 10, 10, 10], [18000, -2000, -4500], speed, Zone.Z50, feedback_level=1))
    r2 = robot_2.send(
    MoveAbsJ([10, 10, 10, 10, 10, 10], [18000, -10000, -4500], speed, Zone.Z50, feedback_level=1))
    print("moveJ r1:", r1)
    print("moveJ r2:", r2)
    
    print('MoveJ send commands sent')
    
    
    
    ### MOVE L
    r1_frame = cg.Frame.from_quaternion([0.933, 0.067, 0.25, 0.25], point=[20000, 2900, 3000])
    r1_ea = [18000, -2000, -4500]
    
    r1 = robot_1.send_and_wait(MoveL(r1_frame, r1_ea, speed, Zone.Z50, feedback_level=1))
    print("moveL r1:", r1)
    
    
    
    ### STOP TASK FOR ROBOT 2
    robot_2.send(ProjectInstruction('r_A038_PlaceAndHold'))
    
    
    
    r2_frame = cg.Frame([20000, 9600, 3200], [1,0,0], [0,1,0])
    r2_ea = [18000, -10000, -4500]
    
    r2 = robot_2.send_and_wait(MoveL(r2_frame, r2_ea, speed, Zone.Z50, feedback_level=1))
    print("moveL r2:", r2)
    
    
    print('MoveL send commands sent')
    """
# ---------- end ghpython_script_3 ----------
ghpython_script_4 = GhPythonScript(send=Toggle(False), robot=ghpython_script_2.robot_1, config=genes, ea=merge)  # -> out; inputs send: Boolean, config: list, ea: list
# ---------- ghpython_script_4: Python ----------
import compas.geometry as cg
from compas_rrc import *


if send:
    
    
    speed = 500
    
    ### MOVE ABS J
    
    r1 = robot.send(MoveAbsJ(config, ea, speed, Zone.Z50, feedback_level=1))
    print("moveJ r1:", r1)
# ---------- end ghpython_script_4 ----------
rec = DataRecorder(ghpython_script_4, DataLimit=-10000, RecordData=True)
panel_2 = Panel(rec)
